# Grasshopper definition Light_MasterScriptFiles_2022_eightPlusTwo_1-10B.gh (Grasshopper 1.0.7)
# plug-ins: Weaverbird, Bifocals

# ---- group: Light_MasterScriptFiles_2022_eightPlusTwo_1-10 / MasterScriptFiles_2022_eightPlusTwo_1-10 / edges-define-insets
pline = PolyLine(
    Vertices=[Point(-5, 3, 0), Point(-8, 10, 0), Point(0, 18, 0), Point(5, 12, 0), Point(2, 6, 0), Point(-5, 3, 0)],
    Closed=True)  # disabled
pline_2 = PolyLine(
    Vertices=[Point(2, 6, 0), Point(9, 2, 0), Point(8, -5, 0), Point(-5, -4, 0), Point(-5, 3, 0), Point(2, 6, 0)],
    Closed=True)  # disabled
line = Line(Line((3, -8, 2), (-5, 22, 2)))  # disabled
wbedges = WeaverBirdsMeshEdges(MeshOrPolylines=[pline_2, pline])  # disabled
curvepoint = PointOnCurve(line, parameter=0.378)  # disabled
eval = EvaluateLength(Curve=wbedges, Length=0.5, Normalized=True)  # -> Point, Tangent, Parameter; disabled
dist = Distance(PointA=eval.Point, PointB=curvepoint)  # disabled
division = Division(A=8, B=dist)  # disabled
wbframe = WeaverBirdsPictureFrame(MeshPolylines=[pline_2, pline], Distance=division, InsetType=1)  # disabled

# ---- group: Light_MasterScriptFiles_2022_eightPlusTwo_1-10 / MasterScriptFiles_2022_eightPlusTwo_1-10 / holes-topology
slider = Slider(7.4625, range=0..12)  # disabled
wbdipyramid = MeshDipyramid(Plane=PlaneXY(0, 0, 0), Width=slider, NumberOfSides=6, TopPoint=Point(0, 0, 10), BasePolygonMethod=True)  # disabled
wbreroute = RerouteFaces(Mesh=wbdipyramid, Index=[0, 2, 4, 6, 8, 10])  # -> Mesh0, Mesh1; disabled
D = Number(1.5)  # disabled
T = Integer(1)  # disabled
wbcarpet = SierpinskiCarpet(Mesh=wbreroute.Mesh0, Distance=D, OffsetType=T)  # disabled
wbwindow = MeshWindow(Mesh=wbreroute.Mesh0, Distance=D, OffsetType=T)  # disabled
wbcarpet_2 = SierpinskiCarpet(Mesh=wbreroute.Mesh1, Distance=D, OffsetType=T)  # disabled
D_2 = Number(0.4)  # disabled
T_2 = Integer(1)  # disabled
wbframe_2 = PictureFrame(Mesh=wbcarpet, Distance=D_2, OffsetType=T_2)  # disabled
wbjoin = WeaverbirdsJoinMeshesAndWeld(Mesh=[wbframe_2, wbwindow, wbcarpet_2], Weld=False)  # disabled
wbcatmullclark = CatmullClarkSubdivision(MeshCurves=wbjoin, Level=2, SmoothNakedEdges=1)  # disabled

# ---- group: Light_MasterScriptFiles_2022_eightPlusTwo_1-10 / MasterScriptFiles_2022_eightPlusTwo_1-10 / grid
mplane = MeshPlane(Boundary={Plane=PlaneXY(0, 0, 0), Size=Domain2(u=-10..10, v=-10..10)}, WidthCount=10, HeightCount=10)  # -> Mesh, Area; disabled
slider_2 = Slider(4.6296, range=0..50)  # disabled
mesh = Mesh(mplane.Mesh)  # disabled
wbchamfervertices = ChamferVertices(Mesh=mesh, Distance=slider_2, OffsetType=0, OutputGeometryAsMesh=True)  # disabled
wbchamferedges = ChamferEdges(Mesh=mesh, Distance=slider_2, OffsetType=0)  # disabled
slider_3 = Slider(0.3611, range=0..3)  # disabled
wbjoin_2 = JoinMeshesObsolete(Mesh=[wbchamferedges, wbchamfervertices])  # disabled
wbthicken = Thicken(Mesh=wbjoin_2, Distance=slider_3, OffsetType=0)  # disabled
wbjoin_3 = JoinMeshesAndWeld(Mesh=wbthicken, Weld=True)  # disabled

# ---- group: Light_MasterScriptFiles_2022_eightPlusTwo_1-10 / MasterScriptFiles_2022_eightPlusTwo_1-10 / half-smooth-edges
make_naked_smooth = BooleanToggle(False)  # disabled
wbprism = MeshPrism(
    Plane=PlaneXY(0, 0, 0),
    Width=5,
    NumberOfSides=6,
    TopPoint=Point(-0.1605111945, 0.2120170349, 6.294168827),
    BasePolygonMethod=True,
    FillStrategy=0)  # disabled
hard_passes = Slider(1, range=1..4)  # disabled
wbcatmullclark_2 = CatmullClarkSubdivision(MeshCurves=wbprism, Level=1, SmoothNakedEdges=make_naked_smooth)  # disabled
wbsplitq = ConstantQuadsSubdivision(MeshCurves=wbcatmullclark_2, Level=hard_passes, SmoothNakedEdges=0)  # disabled
wbcatmullclark_3 = CatmullClarkSubdivision(MeshCurves=wbsplitq, Level=1, SmoothNakedEdges=make_naked_smooth)  # disabled

# ---- group: Light_MasterScriptFiles_2022_eightPlusTwo_1-10 / MasterScriptFiles_2022_eightPlusTwo_1-10 / other-usages
slider_4 = Slider(3, range=3..32)  # disabled
box = MeshBox(
    Base={Plane=PlaneXY(14.64782224, -2.260581601, 0), X=Domain(0, 9), Y=Domain(0, 7), Z=Domain(0, 5)},
    XCount=1,
    YCount=1,
    ZCount=1)  # disabled
wbprism_2 = MeshPrism(
    Plane=PlaneXY(0, 0, 0),
    Width=5,
    NumberOfSides=slider_4,
    TopPoint=Point(1.726159131, 2.816093052, 7.222516475),
    BasePolygonMethod=True,
    FillStrategy=1)  # disabled
slider_5 = Slider(-12.2222, range=-50..50)  # disabled
slider_6 = Slider(-3.75, range=-50..50)  # disabled
wbcatmullclark_4 = CatmullClarkSubdivision(MeshCurves=box, Level=1, SmoothNakedEdges=1)  # disabled
panel = Panel("4")  # disabled
mult = Multiplication(FirstNumber=slider_4, SecondNumber=panel)  # disabled
wbwindow_2 = MeshWindow(Mesh=wbcatmullclark_4, Distance=slider_5, OffsetType=0)  # disabled
wbwindow_3 = MeshWindow(Mesh=wbcatmullclark_4, Distance=slider_6, OffsetType=0)  # disabled
series = Series(Start=0, Step=1, Count=mult)  # disabled
wbsplitq_2 = ConstantQuadsSubdivision(MeshCurves=wbprism_2, Level=1, SmoothNakedEdges=1)  # disabled
wbfacepolys = FacePolylines(Mesh=wbwindow_2)  # disabled
wbfacepolys_2 = FacePolylines(Mesh=wbwindow_3)  # disabled
wbextract = RerouteFaces(Mesh=wbsplitq_2, Index=series)  # -> Mesh0, Mesh1; disabled
slider_7 = Slider(0.2602, range=0..1)  # disabled
panel_2 = Panel("""0
1
2
3""")  # disabled
explode = Explode(Curve=wbfacepolys, Recursive=True)  # -> Segments, Vertices; disabled
panel_3 = Panel("""0
1
2
3""")  # disabled
explode_2 = Explode(Curve=wbfacepolys_2, Recursive=True)  # -> Segments, Vertices; disabled
wbedges_2 = MeshEdges(Mesh=[wbextract.Mesh1, wbextract.Mesh0])  # disabled
item = ListItem(List=explode_2.Vertices, Index=panel_2, Wrap=False)  # disabled
item_2 = ListItem(List=explode.Vertices, Index=panel_3, Wrap=False)  # disabled
intcrv = Interpolate(Vertices=item, Degree=3, Periodic=True)  # -> Curve, Length, Domain; disabled
intcrv_2 = Interpolate(Vertices=item_2, Degree=3, Periodic=True)  # -> Curve, Length, Domain; disabled
pipe = Pipe(Curve=wbedges_2, Radius=slider_7, Caps=0)  # disabled
loft = Loft(
    Section=[intcrv.Curve, intcrv_2.Curve],
    Options={Adjust=False, Closed=False, LoftEnds=3, LoftSimp=0, LoftType=0, Rebuild=10, Refit=0.01})  # disabled

# ---- group: Light_MasterScriptFiles_2022_eightPlusTwo_1-10 / MasterScriptFiles_2022_eightPlusTwo_1-10 / smooth-terrain-few-points
del = DelaunayMesh(
    Points=[Point(-0.3484427146, -18.7702733, 0), Point(-29.11069182, 7.046028104, 0), Point(-24.26454261, 30.19940057, 0), Point(1.604575932, 32.10257774, 0), Point(21.26819011, 8.454881683, 0), Point(21.09471659, -18.51527052, 0)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],
    Plane=PlaneXY(0, 0, 0))  # disabled
toggle = BooleanToggle(False)  # disabled
wbloop = LoopSubdivision(Mesh=del, Level=2, SmoothNakedEdges=toggle)  # disabled
wbvertices = VerticesComponent(Mesh=wbloop, Weld=False)  # disabled
pcomp = Decompose(Point=wbvertices)  # -> XComponent, YComponent, ZComponent; disabled
bnd = Bounds(Numbers=pcomp.ZComponent)  # disabled
domcomp = DomainComponents(Domain=bnd)  # -> Start, End; disabled
gradient = Gradient(
    LowerLimit=domcomp.Start,
    UpperLimit=domcomp.End,
    Parameter=pcomp.ZComponent,
    stops=[0.00648: RGB(0, 0, 192), 0.451: RGB(0, 255, 255), 0.5: RGB(221, 255, 53), 0.713: RGB(0, 98, 0), 0.93: RGB(240, 183, 82)])  # disabled
mcol = MeshColours(Mesh=wbloop, Colours=gradient)  # disabled
wbloop_2 = LoopSubdivision(Mesh=mcol, Level=3, SmoothNakedEdges=toggle)  # disabled

# ---- group: Light_MasterScriptFiles_2022_eightPlusTwo_1-10 / MasterScriptFiles_2022_eightPlusTwo_1-10 / a starting mesh
use_unit_offset_false_of_edge = BooleanToggle(False)  # disabled
offset = Slider(13.8299, range=0.01..16)  # disabled
level = Slider(1, range=0..4)  # disabled
sides = Slider(4, range=3..7)  # disabled
sides_2 = Slider(6, range=3..12)  # disabled
wbprism_3 = MeshPrism(
    Plane=PlaneXY(0, 0, 0),
    Width=sides_2,
    NumberOfSides=sides,
    TopPoint=Point(0, 0, 10),
    BasePolygonMethod=True,
    FillStrategy=1)  # disabled
wbcatmullclark_5 = CatmullClarkSubdivision(MeshCurves=wbprism_3, Level=level, SmoothNakedEdges=0)  # disabled
wbframe_3 = PictureFrame(Mesh=wbcatmullclark_5, Distance=offset, OffsetType=use_unit_offset_false_of_edge)  # disabled

# ---- group: Light_MasterScriptFiles_2022_eightPlusTwo_1-10 / MasterScriptFiles_2022_eightPlusTwo_1-10 / curves-welcome / a group of curves
hexgrid = Hexagonal(Plane=PlaneXY(-10.55213976, 5.665637213, 0), Size=2, ExtentX=9, ExtentY=16)  # -> Cells, Points; disabled
arc = CircularArc([{Angle=0, Angle=3.08734986, Plane=Plane(origin=(0, -12.87936404, 0.1365836204), x=(0.9999775253, 0, -0.006704395413), y=(0.006704395413, 0, 0.9999775253)), Radius=28.95298645}, {Angle=0, Angle=3.028209025, Plane=Plane(origin=(-0.4569871354, 16.87870354, 0), x=(0.9997330863, 0, 0.02310316181), y=(-0.02310316181, 0, 0.9997330863)), Radius=14.60370525}, {Angle=0, Angle=2.907187234, Plane=Plane(origin=(9.118104545, 29.47828606, 0), x=(0.9987275845, 0, 0.05043026813), y=(-0.05043026813, 0, 0.9987275845)), Radius=14.5212827}, {Angle=0, Angle=2.899501929, Plane=Plane(origin=(4.504817082, 62.81561779, 0), x=(0.9995247492, 0, 0.03082654193), y=(-0.03082654193, 0, 0.9995247492)), Radius=35.99093035}])  # disabled
loft_2 = Loft(Section=arc, Options={Adjust=False, Closed=False, LoftEnds=0, LoftSimp=1, LoftType=1, Rebuild=10, Refit=0.01})  # disabled
project = Project(Curve=hexgrid.Cells, Brep=loft_2, Direction=Vector(0, 0, 1))  # disabled
flatten = FlattenTree(Data=project, Path="{0}")  # disabled

# ---- group: Light_MasterScriptFiles_2022_eightPlusTwo_1-10 / MasterScriptFiles_2022_eightPlusTwo_1-10 / curves-welcome / find discontinuities
disc = Discontinuity(Curve=flatten, Level=1)  # -> Points, Parameters; disabled

# ---- group: Light_MasterScriptFiles_2022_eightPlusTwo_1-10 / MasterScriptFiles_2022_eightPlusTwo_1-10 / curves-welcome / make polylines
pline_3 = PolyLine(Vertices=disc.Points, Closed=False)  # disabled

# ---- group: Light_MasterScriptFiles_2022_eightPlusTwo_1-10 / MasterScriptFiles_2022_eightPlusTwo_1-10 / curves-welcome
# From this version of Wb, most subdivision
# components accept polylines as inputs.
# They automatically convert them into meshes.
# Here how we could smoothen an hexagonal mesh.
wbcatmullclark_6 = CatmullClarkSubdivision(MeshCurves=flatten(pline_3), Level=1, SmoothNakedEdges=1)  # disabled

# ---- group: Light_MasterScriptFiles_2022_eightPlusTwo_1-10 / MasterScriptFiles_2022_eightPlusTwo_1-10 / attractor
pt = Point(Point(0.1766759545, 8.583042562, 4.048119619))  # disabled

# ---- group: Light_MasterScriptFiles_2022_eightPlusTwo_1-10 / MasterScriptFiles_2022_eightPlusTwo_1-10
mcomp = Decompose(Mesh=wbframe_3)  # -> Vertices, Faces, Colours, Normals; disabled
attractor_force = Slider(3.4, range=0..100)  # disabled
dist_2 = Distance(PointA=mcomp.Vertices, PointB=pt)  # disabled
division_2 = Division(A=1, B=dist_2)  # disabled
final_double_smooth_pass = Slider(2, range=0..4)  # disabled
multiplication = Multiplication(A=division_2, B=attractor_force)  # disabled
wbthicken_2 = Thicken(Mesh=wbframe_3, Distance=multiplication, OffsetType=0)  # disabled
wbcatmullclark_7 = CatmullClarkSubdivision(MeshCurves=wbthicken_2, Level=final_double_smooth_pass, SmoothNakedEdges=1)  # disabled
wblaplace = LaplacianSmoothing(MeshCurves=wbcatmullclark_7, Level=final_double_smooth_pass, SmoothNakedEdges=1, Thin=1)  # disabled

# ---- group: Light_MasterScriptFiles_2022_eightPlusTwo_1-10 / MasterScriptFiles_2022_eightPlusTwo_1-10 / let's see the original
original = Move(Geometry=wbframe_3, Translation=Vector(0, 38.0199113, 0))  # disabled

# ---- group: Light_MasterScriptFiles_2022_eightPlusTwo_1-10 / MasterScriptFiles_2022_eightPlusTwo_1-10 / thickened with attractor
original_2 = Move(Geometry=wbthicken_2, Translation=Vector(0, 18.43144504, 0))  # disabled

# ---- group: Light_MasterScriptFiles_2022_eightPlusTwo_1-10 / MasterScriptFiles_2022_eightPlusTwo_1-10 / SubdivisionCurve_Completed
# Subdivision Curve (Chaikin scheme)
iterationcount = Slider(4, range=0..10)  # disabled
pt_2 = Point([Point(-4.897308965, 7.724109416, 0), Point(-0.8949092658, -0.5445844675, 0), Point(4.426962861, 7.240302859, 0), Point(10.14467672, -1.29228551, 0), Point(14.54291814, 7.636144588, 0), Point(20.17266717, -0.1047603248, 0), Point(23.91117239, 8.07596873, 0)])  # disabled
c_script = CSharpScript(controlPoints=pt_2, iterationCount=iterationcount)  # -> out, curve; inputs controlPoints: list of Point3d, iterationCount: Int32; disabled
# ---------- c_script: C# ----------
    for (int j = 0; j < iterationCount; j++)
    {
      List<Point3d> newControlPoints = new List<Point3d>();

      for (int i = 0; i < controlPoints.Count - 1; i++)
      {
        Point3d oneQuarterPoint = 0.75 * controlPoints[i] + 0.25 * controlPoints[i + 1];
        Point3d threeQuarterPoint = 0.25 * controlPoints[i] + 0.75 * controlPoints[i + 1];
        newControlPoints.Add(oneQuarterPoint);
        newControlPoints.Add(threeQuarterPoint);
      }

      controlPoints = newControlPoints;
    }

    curve = new PolylineCurve(controlPoints);
# ---------- end c_script ----------

# ---- group: Light_MasterScriptFiles_2022_eightPlusTwo_1-10 / MasterScriptFiles_2022_eightPlusTwo_1-10 / DeCasteljauAlgorithm_Completed
# Adaptively subdividing a curve
# (De Casteljau's algorithm)
number_slider = Slider(0.71, range=0.01..3)  # disabled
curve = Curve(reparameterize(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))  # disabled
c_script_2 = CSharpScript(curve=curve, tolerance=number_slider)  # -> out, outputSegments; inputs curve: Curve, tolerance: Double; disabled
# ---------- c_script_2: C# ----------
    List<LineCurve> segments = new List<LineCurve>();
    divideCurve(curve, 0.0, 1.0, tolerance, segments);
    outputSegments = segments;
# ---------- c_script_2: C# additional code ----------
  void divideCurve(Curve curve, double tStart, double tEnd, double tolerance, List<LineCurve> segments)
  {
    Point3d startPoint = curve.PointAt(tStart);
    Point3d endPoint = curve.PointAt(tEnd);
    Point3d middlePoint = 0.5 * (startPoint + endPoint);

    double t;
    curve.ClosestPoint(middlePoint, out t);

    double distance = curve.PointAt(t).DistanceTo(middlePoint);

    if (distance < tolerance)
    {
      segments.Add(new LineCurve(startPoint, endPoint));
    }
    else
    {
      double tMiddle = 0.5 * (tStart + tEnd);
      divideCurve(curve, tStart, tMiddle, tolerance, segments);
      divideCurve(curve, tMiddle, tEnd, tolerance, segments);
    }
  }
# ---------- end c_script_2 ----------
