# Grasshopper definition Light_MasterScriptFiles_2022_eightPlusTwo_21-30.gh (Grasshopper 1.0.7)
# plug-ins: KUKA|prc - parametric robot control, Bifocals, LunchBox

# ---- group: Parametric_Tower_WSII_2019
# Explode Tree
# Shift List
# Interpolate
# Boolean Toogle
number_slider = Slider(50, range=0..100)  # disabled
construct_point = ConstructPoint(XCoordinate=0, YCoordinate=0, ZCoordinate=number_slider)  # disabled
construct_point_2 = ConstructPoint(XCoordinate=0, YCoordinate=0, ZCoordinate=0)  # disabled
number_slider_2 = Slider(10, range=0..10)  # disabled
number_slider_3 = Slider(9, range=0..10)  # disabled
number_slider_4 = Slider(20, range=0..100)  # disabled
circle = Circle(Plane=[construct_point_2, construct_point], Radius=[number_slider_2, number_slider_3])  # disabled
divide_curve = DivideCurve(Curve=circle, Count=number_slider_4, Kinks=False)  # -> Points, Tangents, Parameters; disabled
number_slider_5 = Slider(6, range=0..10)  # disabled
number_slider_6 = Slider(-6, range=-6..10)  # disabled
explode_tree = ExplodeTree(Data=divide_curve.Points)  # -> Branch0, Branch1; disabled
shift_list = ShiftList(List=explode_tree.Branch1, Shift=number_slider_5, Wrap=True)  # disabled
shift_list_2 = ShiftList(List=explode_tree.Branch1, Shift=number_slider_6, Wrap=True)  # disabled
line = Line(StartPoint=explode_tree.Branch0, EndPoint=shift_list)  # disabled
line_2 = Line(StartPoint=explode_tree.Branch0, EndPoint=shift_list_2)  # disabled
divide_curve_2 = DivideCurve(Curve=line, Count=10, Kinks=False)  # -> Points, Tangents, Parameters; disabled
boolean_toggle = BooleanToggle(True)  # disabled
flip_matrix = FlipMatrix(Data=divide_curve_2.Points)  # disabled
interpolate = Interpolate(Vertices=flip_matrix, Degree=3, Periodic=boolean_toggle, KnotStyle=1)  # -> Curve, Length, Domain; disabled
number_slider_7 = Slider(0.5, range=0..1)  # disabled
pipe = Pipe(Curve=[interpolate.Curve, line_2, line], Radius=number_slider_7, Caps=0)  # disabled
boundary_surfaces = BoundarySurfaces(Edges=interpolate.Curve)  # disabled
brep_edges = BrepEdges(Brep=[boundary_surfaces, pipe])  # -> Naked, Interior, NonManifold; disabled

# ---- group: Curve_Attractor_WSII_2019
# input rhino curve!
number_slider_8 = Slider(6, range=0..10)  # disabled
number_slider_9 = Slider(25, range=0..100)  # disabled
number_slider_10 = Slider(4, range=0..10)  # disabled
series = Series(Start=0, Step=number_slider_8, Count=number_slider_9)  # disabled
polygon = Polygon(Plane=PlaneXY(0, 0, 0), Radius=3, Segments=number_slider_10, FilletRadius=0)  # -> Polygon, Length; disabled
unit_x = UnitX(Factor=series)  # disabled
unit_y = UnitY(Factor=series)  # disabled
move = Move(Geometry=polygon.Polygon, Motion=unit_x)  # -> Geometry, Transform; disabled
cross_reference = CrossReference(ListListA=move.Geometry, ListListB=unit_y, CrossMode=1)  # -> ListListA, ListListB; disabled
curve = Curve(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)  # disabled
move_2 = Move(Geometry=cross_reference.ListListA, Motion=cross_reference.ListListB)  # -> Geometry, Transform; disabled
area = Area(Geometry=move_2.Geometry)  # -> Area, Centroid; disabled
number_slider_11 = Slider(1.492, range=0..5)  # disabled
number_slider_12 = Slider(0.01, range=0.01..0.11)  # disabled
curve_closest_point = CurveClosestPoint(Point=area.Centroid, Curve=curve)  # -> Point, Parameter, Distance; disabled
bounds = Bounds(Numbers=curve_closest_point.Distance)  # disabled
construct_domain = ConstructDomain(DomainStart=number_slider_12, DomainEnd=number_slider_11)  # disabled
number_slider_13 = Slider(27, range=0..100)  # disabled
remap_numbers = RemapNumbers(Value=curve_closest_point.Distance, Source=bounds, Target=construct_domain)  # -> Mapped, Clipped; disabled
scale = Scale(Geometry=move_2.Geometry, Center=area.Centroid, Factor=remap_numbers.Clipped)  # -> Geometry, Transform; disabled
multiplication = Multiplication(A=remap_numbers.Mapped, B=number_slider_13)  # disabled
unit_z = UnitZ(Factor=multiplication)  # disabled
extrude = Extrude(Base=scale.Geometry, Direction=unit_z)  # disabled
gradient = Gradient(LowerLimit=0, UpperLimit=1, Parameter=remap_numbers.Mapped, stops=[0.15: RGB(40, 31, 160), 0.85: RGB(220, 0, 40)])  # disabled
custom_preview = CustomPreview(Geometry=extrude, Material=gradient)  # disabled

# ---- group: AttractorPoint_LunchBox_WSII_2019
# Scale NU
# TOOLBOX!
panel = Panel("180")  # disabled
number_slider_14 = Slider(22, range=0..100)  # disabled
xz_plane = XZPlane(Origin=Point(0, 0, 0))  # disabled
number_slider_15 = Slider(58, range=0..100)  # disabled
radians = Radians(Degrees=panel)  # disabled
unit_y_2 = UnitY(Factor=number_slider_15)  # disabled
arc = Arc(Plane=xz_plane, Radius=number_slider_14, Angle=radians)  # -> Arc, Length; disabled
number_slider_16 = Slider(1.7, range=1..3)  # disabled
number_slider_17 = Slider(1.4, range=1..3)  # disabled
number_slider_18 = Slider(1.8, range=1..3)  # disabled
move_3 = Move(Geometry=arc.Arc, Motion=unit_y_2)  # -> Geometry, Transform; disabled
number_slider_19 = Slider(1.7, range=1..3)  # disabled
number_slider_20 = Slider(1.6, range=1..3)  # disabled
scale_nu = ScaleNU(
    Geometry=move_3.Geometry,
    Plane=PlaneXY(0, 0, 0),
    ScaleX=number_slider_16,
    ScaleY=number_slider_17,
    ScaleZ=number_slider_18)  # -> Geometry, Transform; disabled
scale_nu_2 = ScaleNU(Geometry=arc.Arc, Plane=PlaneXY(0, 0, 0), ScaleX=number_slider_19, ScaleY=1, ScaleZ=number_slider_20)  # -> Geometry, Transform; disabled
number_slider_21 = Slider(33, range=0..100)  # disabled
number_slider_22 = Slider(33, range=0..100)  # disabled
loft = Loft(
    Curves=[scale_nu_2.Geometry, scale_nu.Geometry],
    Options={Adjust=False, Closed=False, LoftEnds=0, LoftSimp=0, LoftType=0, Rebuild=10, Refit=0.01})  # disabled
hexagon_cells = HexagonCells(Surface=loft, UDivisions=number_slider_22, VDivisions=number_slider_21, TParameter=0.25)  # -> HexagonCells, Centers; disabled
number_slider_23 = Slider(0.7, range=0..1)  # disabled
number_slider_24 = Slider(33, range=0..100)  # disabled
scale_2 = Scale(Geometry=hexagon_cells.HexagonCells, Center=hexagon_cells.Centers, Factor=number_slider_23)  # -> Geometry, Transform; disabled
merge = Merge(Data1=graft(hexagon_cells.HexagonCells), Data2=graft(scale_2.Geometry))  # disabled
number_slider_25 = Slider(5, range=0..10)  # disabled
point = Point(Point(-44.80305642, 43, 17.92241331))  # disabled
sphere = Sphere(Base=point, Radius=number_slider_25)  # disabled
colour_swatch = ColourSwatch(SwatchColor=RGB(56, 118, 255))  # disabled
distance = Distance(PointA=hexagon_cells.Centers, PointB=point)  # disabled
number_slider_26 = Slider(1.2, range=0..10)  # disabled
number_slider_27 = Slider(0.2, range=0..1)  # disabled
bounds_2 = Bounds(Numbers=distance)  # disabled
custom_preview_2 = CustomPreview(Geometry=sphere, Material=colour_swatch)  # disabled
construct_domain_2 = ConstructDomain(DomainStart=number_slider_27, DomainEnd=number_slider_26)  # disabled
remap_numbers_2 = RemapNumbers(Value=distance, Source=bounds_2, Target=construct_domain_2)  # -> Mapped, Clipped; disabled
scale_3 = Scale(Geometry=scale_2.Geometry, Center=hexagon_cells.Centers, Factor=remap_numbers_2.Mapped)  # -> Geometry, Transform; disabled
surface_closest_point = SurfaceClosestPoint(Point=hexagon_cells.Centers, Surface=loft)  # -> Point, UVPoint, Distance; disabled
number_slider_28 = Slider(10, range=0..10)  # disabled
evaluate_surface = EvaluateSurface(Surface=loft, Point=surface_closest_point.UVPoint)  # -> Point, Normal, UDirection, VDirection, Frame; disabled
negative = Negative(Value=number_slider_28)  # disabled
multiplication_2 = Multiplication(A=evaluate_surface.Normal, B=number_slider_28)  # disabled
move_4 = Move(Geometry=scale_3.Geometry, Motion=multiplication_2)  # -> Geometry, Transform; disabled
merge_2 = Merge(Data1=graft(scale_2.Geometry), Data2=graft(move_4.Geometry))  # disabled
colour_swatch_2 = ColourSwatch(SwatchColor=RGB(255, 255, 255))  # disabled
loft_2 = Loft(Curves=merge, Options={Adjust=False, Closed=False, LoftEnds=0, LoftSimp=0, LoftType=0, Rebuild=10, Refit=0.01})  # disabled
loft_3 = Loft(Curves=merge_2, Options={Adjust=False, Closed=False, LoftEnds=0, LoftSimp=0, LoftType=0, Rebuild=10, Refit=0.01})  # disabled
custom_preview_3 = CustomPreview(
    Geometry=loft_3,
    Material={diffuse=RGB(221, 160, 221), emission=RGB(66, 48, 66), shine=0.5, specular=RGB(255, 255, 255), transparency=0})  # disabled
brep_join = BrepJoin(Breps=loft_2)  # -> Breps, Closed; disabled
custom_preview_4 = CustomPreview(Geometry=loft_2, Material=colour_swatch_2)  # disabled

# ---- group: OcTree_WSII_2019
number_slider_29 = Slider(84, range=0..100)  # disabled
number_slider_30 = Slider(96.3, range=0..100)  # disabled
number_slider_31 = Slider(87.4, range=0..100)  # disabled
number_slider_32 = Slider(2338, range=0..10000)  # disabled
number_slider_33 = Slider(202, range=0..400)  # disabled
center_box = CenterBox(Base=PlaneXY(0, 0, 0), X=number_slider_29, Y=number_slider_30, Z=number_slider_31)  # disabled
number_slider_34 = Slider(0, range=0..100)  # disabled
populate_geometry = PopulateGeometry(Geometry=center_box, Count=number_slider_33, Seed=number_slider_32)  # disabled
boolean_toggle_2 = BooleanToggle(True)  # disabled
octree = OcTree(Points=populate_geometry, Square=boolean_toggle_2, Group=number_slider_34)  # -> Boxes, Points; disabled
number_slider_35 = Slider(18, range=0..100)  # disabled
box = Box(octree.Boxes)  # disabled
random_reduce = RandomReduce(List=box, Reduction=number_slider_35, Seed=1)  # disabled
custom_preview_5 = CustomPreview(
    Geometry=random_reduce,
    Material={diffuse=RGB(221, 160, 221), emission=RGB(66, 48, 66), shine=0.5, specular=RGB(255, 255, 255), transparency=0})  # disabled

# ---- group: Box_Morph_Wheel_WSII_2019
panel_2 = Panel("180")  # disabled
number_slider_36 = Slider(33, range=0..100)  # disabled
xz_plane_2 = XZPlane(Origin=Point(0, 0, 0))  # disabled
radians_2 = Radians(Degrees=panel_2)  # disabled
arc_2 = Arc(Plane=xz_plane_2, Radius=number_slider_36, Angle=radians_2)  # -> Arc, Length; disabled
number_slider_37 = Slider(8, range=0..100)  # disabled
number_slider_38 = Slider(15, range=0..100)  # disabled
end_points = EndPoints(Curve=arc_2.Arc)  # -> Start, End; disabled
ellipse = Ellipse(Plane=end_points.Start, Radius1=number_slider_37, Radius2=number_slider_38)  # -> Ellipse, Focus1, Focus2; disabled
number_slider_39 = Slider(33, range=0..100)  # disabled
number_slider_40 = Slider(33, range=0..100)  # disabled
number_slider_41 = Slider(-4, range=-6..1)  # disabled
number_slider_42 = Slider(5, range=0..10)  # disabled
sweep1 = Sweep1(Rail=arc_2.Arc, Sections=ellipse.Ellipse, Miter=1)  # disabled
divide_domain² = DivideDomain²(Domain=sweep1, UCount=number_slider_40, VCount=number_slider_39)  # disabled
construct_domain_3 = ConstructDomain(DomainStart=number_slider_41, DomainEnd=number_slider_42)  # disabled
number_slider_43 = Slider(1, range=0..10)  # disabled
list_length = ListLength(List=divide_domain²)  # disabled
random = Random(Range=construct_domain_3, Number=list_length, Seed=number_slider_43)  # disabled
center_box_2 = CenterBox(Base=PlaneXY(0, 0, 0), X=1, Y=1, Z=1)  # disabled
surface_box = SurfaceBox(Surface=sweep1, Domain=divide_domain², Height=random)  # disabled
bounding_box = BoundingBox(Content=center_box_2, Plane=PlaneXY(0, 0, 0))  # -> Box, Box_2; disabled
box_morph = BoxMorph(Geometry=center_box_2, Reference=bounding_box.Box, Target=surface_box)  # disabled

# ---- group: DC WSII 009 (expressions and Functions)
# Height of Plank
# On Off
# Width of Plank
# On Off
# Outer Hull
# Inner Hull
number_slider_44 = Slider(5, range=0..10)  # disabled
number_slider_45 = Slider(3, range=0..100)  # disabled
# Shape of Plank
# Shape of Plank
number_slider_46 = Slider(17, range=0..100)  # disabled
number_slider_47 = Slider(4, range=0..10)  # disabled
# Single Phase Sine Curve
# Width of Plank
# Length of Plank
# Shape of Plank
panel_3 = Panel("Hello")  # disabled
panel_4 = Panel("World")  # disabled
random_2 = Random(Range=Domain(0, 1), Number=number_slider_45, Seed=2)  # disabled
random_3 = Random(Range=Domain(0, 1), Number=number_slider_46, Seed=2)  # disabled
random_4 = Random(Range=Domain(0, 1), Number=number_slider_45, Seed=number_slider_44)  # disabled
expression = Expression(x=panel_3, y=panel_4, Expression="Format(\"{0}, {1}\", x, y)")  # disabled
expression_2 = Expression(x=random_2, y=random_4, Expression="x/y*x^2/y^2")  # disabled
expression_3 = Expression(x=random_3, y=number_slider_47, Expression="Round(x,y)")  # disabled
expression_4 = Expression(x=random_2, y=random_4, Expression="Max(x,y)")  # disabled
panel_5 = Panel(expression_2)  # disabled
panel_6 = Panel(random_2)  # disabled
panel_7 = Panel(random_4)  # disabled
panel_8 = Panel(expression)  # disabled

# ---- group: DC _WSII_A001_Graphmapper
# Download MeshFromPoints component!!!
number_slider_48 = Slider(22, range=0..100)  # disabled
construct_domain_4 = ConstructDomain(DomainStart=0, DomainEnd=1)  # disabled
number_slider_49 = Slider(73, range=0..100)  # disabled
range = Range(Domain=Domain(0, 1), Steps=number_slider_48)  # disabled
range_2 = Range(Domain=number_slider_49, Steps=number_slider_48)  # disabled
number_slider_50 = Slider(63, range=0..100)  # disabled
graph_mapper = GraphMapper(
    range,
    x0=0,
    x1=1,
    y0=0,
    y1=1,
    container_name="Sine Summation",
    Equation0_px=[0.2997187376, 0.3],
    Equation0_py=[0.2740840912, 0.3],
    Equation1_px=[0.6966772676, 0.9],
    Equation1_py=[0.1513220668, 0.5])  # disabled
graph_mapper_2 = GraphMapper(
    range,
    x0=0,
    x1=1,
    y0=0,
    y1=1,
    container_name="Sine Summation",
    Equation0_px=[0.2875808775, 0.01788686961],
    Equation0_py=[0.5703337193, 0.08610510826],
    Equation1_px=[0.6893692613, 0.9040234685],
    Equation1_py=[0.01108407974, 0.9522603154])  # disabled
cross_reference_2 = CrossReference(ListListA=range_2, ListListB=range_2, CrossMode=1)  # -> ListListA, ListListB; disabled
cross_reference_3 = CrossReference(ListListA=graph_mapper, ListListB=graph_mapper_2, CrossMode=1)  # -> ListListA, ListListB; disabled
expression_5 = Expression(u=number_slider_48, Expression="u+1")  # disabled
multiplication_3 = Multiplication(A=cross_reference_3.ListListA, B=cross_reference_3.ListListB)  # disabled
multiplication_4 = Multiplication(A=number_slider_50, B=multiplication_3)  # disabled
construct_point_3 = ConstructPoint(XCoordinate=cross_reference_2.ListListA, YCoordinate=cross_reference_2.ListListB, ZCoordinate=multiplication_4)  # disabled
surface_from_points = SurfaceFromPoints(Points=flatten(construct_point_3), UCount=expression_5, Interpolate=False)  # disabled
number_slider_51 = Slider(10, range=0..100)  # disabled
number_slider_52 = Slider(0.17, range=0..1)  # disabled
number_slider_53 = Slider(0.207, range=0..1)  # disabled
divide_domain²_2 = DivideDomain²(Domain=surface_from_points, UCount=number_slider_51, VCount=number_slider_51)  # disabled
expression_6 = Expression(x=number_slider_52, Expression="1-x")  # disabled
expression_7 = Expression(x=number_slider_53, Expression="1-x")  # disabled
isotrim = Isotrim(Surface=surface_from_points, Domain=divide_domain²_2)  # disabled
construct_domain² = ConstructDomain²(UMin=number_slider_52, UMax=expression_6, VMin=number_slider_52, VMax=expression_6)  # disabled
isotrim_2 = Isotrim(Surface=reparameterize(isotrim), Domain=construct_domain²)  # -> graft(Surface); disabled
project = Project(Geometry=isotrim_2, Plane=PlaneXY(0, 0, 0))  # -> Geometry, Transform; disabled
loft_4 = Loft(
    Curves=[isotrim_2, project.Geometry],
    Options={Adjust=False, Closed=False, LoftEnds=0, LoftSimp=0, LoftType=0, Rebuild=10, Refit=0.01})  # disabled
brep_join_2 = BrepJoin(Breps=[project.Geometry, loft_4, isotrim_2])  # -> Breps, Closed; disabled

# ---- group: Sine Functions
# Single Phase Sine Curve
number_slider_54 = Slider(4, range=0..100)  # disabled
number_slider_55 = Slider(128, range=0..128)  # disabled
pi = Pi(Factor=number_slider_54)  # disabled
number_slider_56 = Slider(0, range=0..4)  # disabled
dom = ConstructDomain(DomainStart=0, DomainEnd=pi)  # disabled
number_slider_57 = Slider(5, range=0..10)  # disabled
number_slider_58 = Slider(1, range=0..2)  # disabled
pi_2 = Pi(Factor=number_slider_56)  # disabled
range_3 = Range(Domain=dom, Steps=number_slider_55)  # disabled
number_slider_59 = Slider(6, range=0..10)  # disabled
expression_8 = Expression(A=number_slider_57, t=range_3, x=pi_2, w=number_slider_58, Expression="A*sin(w*t+x)")  # disabled
pt = ConstructPoint(XCoordinate=range_3, YCoordinate=number_slider_59, ZCoordinate=expression_8)  # disabled
intcrv = Interpolate(Vertices=pt, Degree=3, Periodic=False, KnotStyle=1)  # -> Curve, Length, Domain; disabled

# ---- group: PRC_SimplePath
number_slider_60 = Slider(31, range=0..100)  # disabled
crv = Curve(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)  # disabled
pt_2 = Point(Point(-366.8347172, 249.8187953, 0))  # disabled
number_slider_61 = Slider(1, range=0..1)  # disabled
kr_6_10_r900 = KUKAAgilusKR6KR10R900(infiniterot=False)  # disabled

# ----
mesh_box = MeshBox(Base={Plane=PlaneXY(0, 0, 0), X=Domain(-10, 10), Y=Domain(-10, 10), Z=Domain(-10, 10)}, XCount=10, YCount=10, ZCount=10)  # disabled

# ---- group: PRC_PickandPlace / Block
mesh = Mesh(mesh_box)  # disabled

# ---- group: PRC_PickandPlace / Pick Up Point
pt_3 = Point(Point(114, 837, 0))  # disabled

# ---- group: PRC_SimplePath / Divide into Points
divide = DivideCurve(Curve=crv, Count=number_slider_60, Kinks=False)  # -> Points, Tangents, Parameters; disabled

# ---- group: PRC_SimplePath / Points
pt_4 = Point(divide.Points)  # disabled

# ---- group: PRC_SimplePath / One plane at each point
xy = XYPlane(Origin=pt_4)  # disabled

# ---- group: PRC_SimplePath / Orient so that they are aligned to the robot
orient_pln = KUKAPrcOrientPlane(Plane=xy, OrientPoint=pt_2)  # disabled

# ---- group: PRC_SimplePath / Turn into LINear movement
lin_move = KUKAPrcLINearMovement(TargetAsPlane=orient_pln, extaxenabled=False, interpolation="C_DIS")  # disabled

# ---- group: PRC_SimplePath / Simplest possible toolpath > lacking control over approach etc.
divide_2 = DivideCurve(Curve=crv, Count=10, Kinks=False)  # -> Points, Tangents, Parameters; disabled
xy_2 = XYPlane(Origin=divide_2.Points)  # disabled
lin_move_2 = KUKAPrcLINearMovement(TargetAsPlane=xy_2, extaxenabled=False, interpolation="C_DIS")  # disabled

# ---- group: PRC_SimplePath / Add 20mm safety distance at start and end
panel_9 = Panel("20")  # disabled
tool_axis_offset = KUKAPrcToolAxisOffset(KUKAPrcCommand=lin_move, OffsetAlongToolaxis=panel_9, OffsetStart=True, OffsetEnd=True)  # disabled

# ---- group: PRC_SimplePath / Set same Tool-ID as calibrated at the robot!
kress_spindle = Kress1050Spindle(ToolLength=35, ToolDiameter=6, ToolNumber=6)  # disabled

# ---- group: PRC_SimplePath / Set same base number in Settings, as calibrated at the robot
kuka_prc = KUKAPrcCORE(
    SimulationSlider=number_slider_61,
    KUKAPrcCommands=tool_axis_offset,
    KUKAPrcTool=kress_spindle,
    KUKAPrcRobot=kr_6_10_r900,
    PRC_BaseExpose=False,
    PRC_SaveNameExpose=False,
    PRCsettings="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")  # -> RobotGeometry, AnalysisOutput; disabled

# ----
mesh_sphere = MeshSphere(Base=PlaneXY(0, 0, 0), Radius=10, UCount=10, VCount=20)  # disabled

# ---- group: PRC_PickandPlace
# Sequence:
# 
# Go above pick up
# Go to pick up
# Start vacuum
# Go above pick up
# Go above target
# Go down to target
# Stop vacuum
# Go above target
crv_2 = Curve(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)  # disabled
divide_3 = DivideCurve(Curve=crv_2, Count=4, Kinks=False)  # -> Points, Tangents, Parameters; disabled
xy_3 = XYPlane(Origin=divide_3.Points)  # disabled
xy_4 = XYPlane(Origin=pt_3)  # disabled
align = AlignPlane(Plane=xy_3, Direction=divide_3.Tangents)  # -> Plane, Angle; disabled
orient = Orient(Geometry=mesh, Source=xy_4, Target=align.Plane)  # -> Geometry, Transform; disabled
Z = UnitZ(Factor=100)  # disabled
move_5 = Move(Geometry=xy_4, Motion=Z)  # -> Geometry, Transform; disabled
Z_2 = UnitZ(Factor=100)  # disabled
move_6 = Move(Geometry=align.Plane, Motion=Z_2)  # -> Geometry, Transform; disabled
lng = ListLength(List=move_6.Geometry)  # disabled
mesh_2 = Mesh(mesh_sphere)  # disabled
number_slider_62 = Slider(1, range=0..1)  # disabled
custom_tool = CustomToolForKUKAPrc(
    CustomToolGeometry=mesh_2,
    toolid=6,
    toolvala=0,
    toolvalb=-90,
    toolvalc=0,
    toolvalx=0,
    toolvaly=0,
    toolvalz=185,
    valuesset=True)  # disabled
kuka_kr5_2 = KR52ArcHW(infiniterot=False)  # disabled

# ---- group: PRC_PickandPlace / Start Vacuum
toggle = BooleanToggle(True)  # disabled
set_digital = KUKAPrcSetDigitalOut(
    DigitalOut1=False,
    DigitalOut2=toggle,
    DigitalOut3=False,
    DigitalOut4=False,
    DigitalOut5=False,
    DigitalOut6=False,
    DigitalOut7=False,
    DigitalOut8=False,
    ContinuousMovement=False)  # disabled
dup = DuplicateData(Data=set_digital, Number=lng, Order=True)  # disabled

# ---- group: PRC_PickandPlace / Stop Vacuum
toggle_2 = BooleanToggle(False)  # disabled
set_digital_2 = KUKAPrcSetDigitalOut(
    DigitalOut1=False,
    DigitalOut2=toggle_2,
    DigitalOut3=False,
    DigitalOut4=False,
    DigitalOut5=False,
    DigitalOut6=False,
    DigitalOut7=False,
    DigitalOut8=False,
    ContinuousMovement=False)  # disabled
dup_2 = DuplicateData(Data=set_digital_2, Number=lng, Order=True)  # disabled

# ---- group: PRC_PickandPlace / Safety Distance above Targetblock
ptp_move = KUKAPrcPTPMovement(TargetAsPlane=move_6.Geometry, extaxenabled=False, interpolation="C_PTP")  # disabled

# ---- group: PRC_PickandPlace / At Targetblock
lin_move_3 = KUKAPrcLINearMovement(TargetAsPlane=align.Plane, extaxenabled=False, interpolation="C_DIS")  # disabled

# ---- group: PRC_PickandPlace / Safety Distance over Pick Up Point
ptp_move_2 = KUKAPrcPTPMovement(TargetAsPlane=move_5.Geometry, extaxenabled=False, interpolation="C_PTP")  # disabled
dup_3 = DuplicateData(Data=ptp_move_2, Number=lng, Order=True)  # disabled

# ---- group: PRC_PickandPlace / Point for Pick Up
lin_move_4 = KUKAPrcLINearMovement(TargetAsPlane=xy_4, extaxenabled=False, interpolation="C_DIS")  # disabled
dup_4 = DuplicateData(Data=lin_move_4, Number=lng, Order=True)  # disabled

# ---- group: PRC_PickandPlace (continued)
cmd_weave = CommandWeaver(
    Command1=dup_3,
    Command2=dup_4,
    Command3=dup,
    Command4=dup_3,
    Command5=ptp_move,
    Command6=lin_move_3,
    Command7=dup_2,
    Command8=ptp_move,
    enabletree=False)  # disabled
kuka_prc_2 = KUKAPrcCORE(
    SimulationSlider=number_slider_62,
    KUKAPrcCommands=cmd_weave,
    KUKAPrcTool=custom_tool,
    KUKAPrcRobot=kuka_kr5_2,
    PRC_BaseExpose=False,
    PRC_SaveNameExpose=False,
    PRCsettings="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")  # -> RobotGeometry, AnalysisOutput; disabled
