# Grasshopper definition Light_MasterScriptFiles_2022_sevenPlusThree11-20.gh (Grasshopper 1.0.7)
# plug-ins: Weaverbird

# ---- group: MasterScriptFiles_2022_sevenPlusThree11-20 / smoothing-groups
wbantiprism = MeshAntiPrism(Plane=PlaneXY(0, 0, 0), Width=5, NumberOfSides=6, TopPoint=Point(0, 0, 10), BasePolygonMethod=True, FillStrategy=1)  # disabled
panel = Panel("""12
13
14
15""")  # disabled
wbreroute = RerouteFaces(Mesh=wbantiprism, Index=panel)  # -> Mesh0, Mesh1; disabled
panel_2 = Panel("""darkblue
cyan""")  # disabled
panel_3 = Panel("""forestgreen
yellow
orange""")  # disabled
slider = Slider(2, range=0..4)  # disabled
mcol = MeshColours(Mesh=wbreroute.Mesh1, Colours=panel_2)  # disabled
mcol_2 = MeshColours(Mesh=wbreroute.Mesh0, Colours=panel_3)  # disabled
toggle = BooleanToggle(False)  # disabled
wbcatmullclark = CatmullClarkSubdivision(Mesh=[mcol, mcol_2], Level=slider, SmoothNakedEdges=1)  # disabled
wbjoin = WeaverbirdsJoinMeshesAndWeld(Mesh=flatten(wbcatmullclark), Weld=toggle)  # disabled

# ---- group: MasterScriptFiles_2022_sevenPlusThree11-20 / strange-tilings
mplane = MeshPlane(Boundary={Plane=PlaneXY(0, 0, 0), Size=Domain2(u=-10..10, v=-10..10)}, WidthCount=1, HeightCount=1)  # -> Mesh, Area; disabled
msphere = MeshSphere(Base=PlaneXY(0, 0, 0), Radius=10, UCount=5, VCount=5)  # disabled
wbloop = LoopSubdivision(MeshCurves=mplane.Mesh, Level=3, SmoothNakedEdges=0)  # disabled
slider_2 = Slider(3.682, range=0..33)  # disabled
wbinnerpolygons = InnerPolygonsSubdivision(MeshCurves=wbloop, Level=1)  # disabled
wbsierpinski = SierpinskiTrianglesSubdivision(MeshCurves=wbinnerpolygons, Level=3)  # disabled
wbchamfervertices = ChamferVertices(Mesh=wbloop, Distance=slider_2, OffsetType=0, OutputGeometryAsMesh=True)  # disabled
wbjoin_2 = JoinMeshesAndWeld(Mesh=[wbchamfervertices, wbsierpinski], Weld=False)  # disabled

# ---- group: MasterScriptFiles_2022_sevenPlusThree11-20 / Exercise006
numturns = Slider(3, range=1..4)  # disabled
numpoints = Slider(146, range=10..200)  # disabled
zrotation = Slider(41.5, range=0..80)  # disabled
pi = Pi(Factor=numturns)  # disabled
rad = Radians(Degrees=zrotation)  # disabled
range = Range(Domain=pi, Steps=numpoints)  # disabled
phi = GoldenRatio(Factor=range)  # disabled
panel_4 = Panel(range)  # disabled
pt = PointPolar(BasePlane=PlaneXY(0, 0, 0), XYAngle=range, ZAngle=0, Offset=phi)  # disabled
pt_2 = PointPolar(BasePlane=PlaneXY(0, 0, 0), XYAngle=range, ZAngle=rad, Offset=phi)  # disabled
ln = Line(StartPoint=pt, EndPoint=pt_2)  # disabled
loft = Loft(Curves=ln, Options={Adjust=False, Closed=False, LoftEnds=0, LoftSimp=0, LoftType=0, Rebuild=10, Refit=0.01})  # disabled

# ---- group: MasterScriptFiles_2022_sevenPlusThree11-20 / Parametric Wheel WSII 001
# Parametric Wheel (cylinder)
# Hybrid Wheel (Cyl/Cone)
# Parametric Wheel (cones)
width_of_wheel = Slider(11, range=1..20)  # disabled
width_of_wheel_2 = Slider(9, range=1..20)  # disabled
rholes = Slider(7, range=0..10)  # disabled
number_slider = Slider(4, range=2..10)  # disabled
number_slider_2 = Slider(27, range=23..40)  # disabled
number_slider_3 = Slider(38, range=27..60)  # disabled
circle = Circle({Plane=Plane(origin=(0, 0, 0), x=(0.1788854382, 0.9838699101, 0), y=(-0.9838699101, 0.1788854382, 0)), Radius=22.36067977})  # disabled
cyl = Cylinder(Base=PlaneXY(0, 0, 0), Radius=rholes, Length=width_of_wheel_2)  # disabled
cone = Cone(Base=PlaneXY(0, 0, 0), Radius=rholes, Length=width_of_wheel)  # -> Cone, Tip; disabled
cyl_2 = Cylinder(Base=PlaneXY(0, 0, 0), Radius=number_slider_3, Length=width_of_wheel_2)  # disabled
cone_2 = Cone(Base=PlaneXY(0, 0, 0), Radius=number_slider_3, Length=width_of_wheel)  # -> Cone, Tip; disabled
X = UnitX(Factor=number_slider_2)  # disabled
X_2 = UnitX(Factor=number_slider_2)  # disabled
cap = CapHoles(Brep=cyl)  # disabled
cap_2 = CapHoles(Brep=cone.Cone)  # disabled
cap_3 = CapHoles(Brep=cyl_2)  # disabled
cap_4 = CapHoles(Brep=cone_2.Cone)  # disabled
move = Move(Geometry=cap, Motion=X)  # -> Geometry, Transform; disabled
move_2 = Move(Geometry=cap_2, Motion=X_2)  # -> Geometry, Transform; disabled
arrcurve = CurveArray(Geometry=move.Geometry, Curve=circle, Count=number_slider)  # -> Geometry, Transform; disabled
arrcurve_2 = CurveArray(Geometry=move_2.Geometry, Curve=cone_2.Cone, Count=number_slider)  # -> Geometry, Transform; disabled
sdiff = SolidDifference(BrepsA=cap_4, BrepsB=arrcurve_2.Geometry)  # disabled
sdiff_2 = SolidDifference(BrepsA=cap_3, BrepsB=arrcurve.Geometry)  # disabled
sdiff_3 = SolidDifference(BrepsA=sdiff_2, BrepsB=sdiff)  # disabled

# ---- group: MasterScriptFiles_2022_sevenPlusThree11-20 / 4 Wheeled Cupola Cart WSII 001
# Single Well for Cupola Wagon
# Tap and Well Holes
number_slider_4 = Slider(3, range=2..8)  # disabled
height = Slider(10, range=5..10)  # disabled
number_slider_5 = Slider(8, range=6..8)  # disabled
tap_hole = Slider(7, range=6..7)  # disabled
number_slider_6 = Slider(16, range=1..16)  # disabled
tap_hole_2 = Slider(2, range=1..2)  # disabled
number_slider_7 = Slider(16, range=1..16)  # disabled
int = Integer(90)  # disabled
xz = XZPlane(Origin=Point(0, 0, 0))  # disabled
rad_2 = Radians(Degrees=int)  # disabled
xy = XYPlane(Origin=Point(0, 0, 0))  # disabled
Z = UnitZ(Factor=number_slider_4)  # disabled
cyl_3 = Cylinder(Base=PlaneXY(0, 0, 0), Radius=tap_hole, Length=number_slider_6)  # disabled
cyl_4 = Cylinder(Base=PlaneXY(0, 0, 0), Radius=tap_hole_2, Length=number_slider_7)  # disabled
cyl_5 = Cylinder(Base=PlaneXY(0, 0, 0), Radius=number_slider_5, Length=height)  # disabled
cap_5 = CapHoles(Brep=cyl_3)  # disabled
cap_6 = CapHoles(Brep=cyl_5)  # disabled
cap_7 = CapHoles(Brep=cyl_4)  # disabled
rot3d = Rotate3D(Geometry=cap_7, Angle=rad_2, Center=Point(0, 0, 0), Axis=xz)  # -> Geometry, Transform; disabled
rot3d_2 = Rotate3D(Geometry=rot3d.Geometry, Angle=rad_2, Center=Point(0, 0, 0), Axis=xy)  # -> Geometry, Transform; disabled
move_3 = Move(Geometry=rot3d_2.Geometry, Motion=Z)  # -> Geometry, Transform; disabled
sdiff_4 = SolidDifference(BrepsA=cap_6, BrepsB=cap_5)  # disabled

number_slider_8 = Slider(10, range=0..10)  # disabled
number_slider_9 = Slider(2, range=1..2)  # disabled
number_slider_10 = Slider(8, range=0..10)  # disabled
number_slider_11 = Slider(6, range=4..7)  # disabled
number_slider_12 = Slider(2, range=0..10)  # disabled
number_slider_13 = Slider(7, range=2..10)  # disabled
X_3 = UnitX(Factor=number_slider_11)  # disabled
cyl_6 = Cylinder(Base=PlaneXY(0, 0, 0), Radius=number_slider_8, Length=number_slider_12)  # disabled
cyl_7 = Cylinder(Base=PlaneXY(0, 0, 0), Radius=number_slider_9, Length=number_slider_12)  # disabled
cap_8 = CapHoles(Brep=cyl_6)  # disabled
cap_9 = CapHoles(Brep=cyl_7)  # disabled
move_4 = Move(Geometry=cap_9, Motion=X_3)  # -> Geometry, Transform; disabled
arrpolar = PolarArray(Geometry=move_4.Geometry, Plane=PlaneXY(0, 0, 0), Count=number_slider_13, Angle=6.283185307)  # -> Geometry, Transform; disabled
sdiff_5 = SolidDifference(BrepsA=cap_8, BrepsB=arrpolar.Geometry)  # disabled

# ---- group: MasterScriptFiles_2022_sevenPlusThree11-20 / Parametric Wheel with Sine Function WSII 003 / Thickness of Wheel
# Parametric Wheel (cylinder)
width_of_wheel_3 = Slider(18, range=1..40)  # disabled
rholes_2 = Slider(7, range=0..10)  # disabled
number_slider_14 = Slider(6, range=2..10)  # disabled
number_slider_15 = Slider(27, range=23..40)  # disabled
number_slider_16 = Slider(38, range=27..60)  # disabled
circle_2 = Circle({Plane=Plane(origin=(0, 0, 0), x=(0.1788854382, 0.9838699101, 0), y=(-0.9838699101, 0.1788854382, 0)), Radius=22.36067977})  # disabled
cyl_8 = Cylinder(Base=PlaneXY(0, 0, 0), Radius=rholes_2, Length=width_of_wheel_3)  # disabled
cyl_9 = Cylinder(Base=PlaneXY(0, 0, 0), Radius=number_slider_16, Length=width_of_wheel_3)  # disabled
X_4 = UnitX(Factor=number_slider_15)  # disabled
cap_10 = CapHoles(Brep=cyl_8)  # disabled
move_5 = Move(Geometry=cap_10, Motion=X_4)  # -> Geometry, Transform; disabled
cap_11 = CapHoles(Brep=cyl_9)  # disabled
arrcurve_3 = CurveArray(Geometry=move_5.Geometry, Curve=circle_2, Count=number_slider_14)  # -> Geometry, Transform; disabled

# ---- group: MasterScriptFiles_2022_sevenPlusThree11-20 / Parametric Wheel with Sine Function WSII 003
# Double Phase Sine Curve
number_slider_17 = Slider(24, range=0..100)  # disabled
wobble = Slider(16, range=0..128)  # disabled
number_slider_18 = Slider(2.304, range=0..4)  # disabled
pi_2 = Pi(Factor=number_slider_17)  # disabled
dom = ConstructDomain(DomainStart=0, DomainEnd=pi_2)  # disabled
number_slider_19 = Slider(7, range=0..10)  # disabled
number_slider_20 = Slider(1, range=0..2)  # disabled
pi_3 = Pi(Factor=number_slider_18)  # disabled
range_2 = Range(Domain=dom, Steps=wobble)  # disabled
number_slider_21 = Slider(5, range=0..10)  # disabled
number_slider_22 = Slider(85, range=0..200)  # disabled
expression = Expression(A=number_slider_19, t=range_2, x=pi_3, w=number_slider_20, Expression="A*sin(w*t+x)")  # disabled
pt_3 = ConstructPoint(XCoordinate=range_2, YCoordinate=number_slider_21, ZCoordinate=expression)  # disabled
intcrv = Interpolate(Vertices=pt_3, Degree=3, Periodic=False, KnotStyle=1)  # -> Curve, Length, Domain; disabled
Y = UnitY(Factor=number_slider_22)  # disabled
move_6 = Move(Geometry=intcrv.Curve, Motion=Y)  # -> Geometry, Transform; disabled

# Single Phase Sine Curve
number_slider_23 = Slider(25, range=0..100)  # disabled
wobble_2 = Slider(27, range=0..128)  # disabled
number_slider_24 = Slider(1.28, range=0..4)  # disabled
pi_4 = Pi(Factor=number_slider_23)  # disabled
dom_2 = ConstructDomain(DomainStart=0, DomainEnd=pi_4)  # disabled
number_slider_25 = Slider(4, range=0..10)  # disabled
number_slider_26 = Slider(1, range=0..2)  # disabled
pi_5 = Pi(Factor=number_slider_24)  # disabled
range_3 = Range(Domain=dom_2, Steps=wobble_2)  # disabled
number_slider_27 = Slider(6, range=0..10)  # disabled
expression_2 = Expression(A=number_slider_25, t=range_3, x=pi_5, w=number_slider_26, Expression="A*sin(w*t+x)")  # disabled
pt_4 = ConstructPoint(XCoordinate=range_3, YCoordinate=number_slider_27, ZCoordinate=expression_2)  # disabled
intcrv_2 = Interpolate(Vertices=pt_4, Degree=3, Periodic=False, KnotStyle=1)  # -> Curve, Length, Domain; disabled

# ---- group: MasterScriptFiles_2022_sevenPlusThree11-20 / 4 Wheeled Cupola Cart WSII 001
number_slider_28 = Slider(1.779, range=1.5..2)  # disabled
number_slider_29 = Slider(8, range=2..10)  # disabled
Y_2 = UnitY(Factor=1)  # disabled
Y_3 = UnitY(Factor=1)  # disabled
neg = Negative(Value=Y_2)  # disabled
rot3d_3 = Rotate3D(Geometry=sdiff_5, Angle=number_slider_28, Center=Point(0, 0, 0), Axis=Y_3)  # -> Geometry, Transform; disabled
rot3d_4 = Rotate3D(Geometry=sdiff_5, Angle=number_slider_28, Center=Point(0, 0, 0), Axis=neg)  # -> Geometry, Transform; disabled
X_5 = UnitX(Factor=number_slider_29)  # disabled
X_6 = UnitX(Factor=number_slider_29)  # disabled
neg_2 = Negative(Value=X_5)  # disabled
move_7 = Move(Geometry=rot3d_3.Geometry, Motion=X_6)  # -> Geometry, Transform; disabled
move_8 = Move(Geometry=rot3d_4.Geometry, Motion=neg_2)  # -> Geometry, Transform; disabled

# ---- group: MasterScriptFiles_2022_sevenPlusThree11-20 / 4 Wheeled Cupola Cart WSII 001 / Cupola Well
sdiff_6 = SolidDifference(BrepsA=sdiff_4, BrepsB=move_3.Geometry)  # disabled

# ---- group: MasterScriptFiles_2022_sevenPlusThree11-20 / Exercise008 / gate tools, several of them to view
or = GateOr()  # disabled

# ---- group: MasterScriptFiles_2022_sevenPlusThree11-20 / 4 Wheeled Cupola Cart WSII 001
gmerge = MergeGroup(GroupA=move_7.Geometry, GroupB=move_8.Geometry)  # disabled

# ---- group: MasterScriptFiles_2022_sevenPlusThree11-20 / 4 Wheeled Cupola Cart WSII 001 / the Wheels
gmerge_2 = MergeGroup(GroupA=move_7.Geometry, GroupB=move_8.Geometry)  # disabled

# ---- group: MasterScriptFiles_2022_sevenPlusThree11-20 / 4 Wheeled Cupola Cart WSII 001
# Wheels
# Two Wheels
# Angle of Wheels
# Spacing of Wheels
# Holes
# Four Wheels
# Hole Distance from Center of Wheel
# # of Holes
number_slider_30 = Slider(24, range=24..48)  # disabled
Y_4 = UnitY(Factor=number_slider_30)  # disabled
merge = Merge(Data1=gmerge_2, Data2=gmerge)  # disabled
move_9 = Move(Geometry=merge, Motion=Y_4)  # -> Geometry, Transform; disabled

# ---- group: MasterScriptFiles_2022_sevenPlusThree11-20 / CurveSubdivsionAndGrowth_00
panel_5 = Panel("50")  # disabled
crv = Curve(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)  # disabled
divide = DivideCurve(Curve=crv, Count=panel_5, Kinks=False)  # -> Points, Tangents, Parameters; disabled
button = Button()  # disabled
timer = Timer(Interval=50, TimerInterval=50, Target=c_script)  # disabled
panel_6 = Panel("1500")  # disabled
c_script = CSharpScript(iReset=button, iStartingPositions=divide.Points, iMaxCenterCount=panel_6)  # -> out, oCenters; inputs iReset: Boolean, iStartingPositions: list of Point3d, iMaxCenterCount: Int32; disabled
# ---------- c_script: C# ----------
    if (iReset || centers == null)
      centers = new List<Point3d>(iStartingPositions);

    List<Vector3d> totalMoves = new List<Vector3d>();
    List<double> collisionCounts = new List<double>();

    for (int i = 0; i < centers.Count; i++)
    {
      totalMoves.Add(new Vector3d(0.0, 0.0, 0.0));
      collisionCounts.Add(0.0);
    }

    double collisionDistance = 2.0;

    for (int i = 0; i < centers.Count; i++)
      for (int j = i + 1; j < centers.Count; j++)
      {
        double d = centers[i].DistanceTo(centers[j]);
        if (d > collisionDistance) continue;
        Vector3d move = centers[i] - centers[j];
        if (move.Length < 0.001) continue;
        move.Unitize();
        move *= 0.5 * (collisionDistance - d);
        totalMoves[i] += move;
        totalMoves[j] -= move;
        collisionCounts[i] += 1.0;
        collisionCounts[j] += 1.0;
      }

    for (int i = 0; i < centers.Count; i++)
      if (collisionCounts[i] != 0.0)
        centers[i] += totalMoves[i] / collisionCounts[i];

    oCenters = centers;
# ---------- c_script: C# additional code ----------
  List<Point3d> centers;
# ---------- end c_script ----------
pline = PolyLine(Vertices=c_script.oCenters, Closed=False)  # disabled
panel_7 = Panel("1")  # disabled
cir = Circle(Plane=c_script.oCenters, Radius=panel_7)  # disabled

# ---- group: MasterScriptFiles_2022_sevenPlusThree11-20 / CircleRelaxation_Completed
panel_8 = Panel("100")  # disabled
c_script_2 = CSharpScript(iCount=panel_8)  # -> out, oPoints; inputs iCount: Int32; disabled
# ---------- c_script_2: C# ----------
    Random myRandomGenerator = new Random();

    List<Point3d> points = new List<Point3d>();

    for (int i = 0; i < iCount; i++)
    {
      double x = myRandomGenerator.NextDouble() * 6.0 - 3.0;
      double y = myRandomGenerator.NextDouble() * 6.0 - 3.0;
      double z = 0.0;
      Point3d myRandomPoint = new Point3d(x, y, z);
      points.Add(myRandomPoint);
    }

    oPoints = points;
# ---------- end c_script_2 ----------
button_2 = Button()  # disabled
timer_2 = Timer(Interval=1, TimerInterval=5, Target=c_script_3)  # disabled
c_script_3 = CSharpScript(iReset=button_2, iStartingPositions=c_script_2.oPoints)  # -> out, oCenters; inputs iReset: Boolean, iStartingPositions: list of Point3d; disabled
# ---------- c_script_3: C# ----------
    if (iReset || centers == null)
      centers = new List<Point3d>(iStartingPositions);

    List<Vector3d> totalMoves = new List<Vector3d>();
    List<double> collisionCounts = new List<double>();

    for (int i = 0; i < centers.Count; i++)
    {
      totalMoves.Add(new Vector3d(0.0, 0.0, 0.0));
      collisionCounts.Add(0.0);
    }

    double collisionDistance = 2.0;

    for (int i = 0; i < centers.Count; i++)
      for (int j = i + 1; j < centers.Count; j++)
      {
        double d = centers[i].DistanceTo(centers[j]);
        if (d > collisionDistance) continue;
        Vector3d move = centers[i] - centers[j];
        move.Unitize();
        move *= 0.5 * (collisionDistance - d);
        totalMoves[i] += move;
        totalMoves[j] -= move;
        collisionCounts[i] += 1.0;
        collisionCounts[j] += 1.0;
      }

    for (int i = 0; i < centers.Count; i++)
      if (collisionCounts[i] != 0.0)
        centers[i] += totalMoves[i] / collisionCounts[i];;

    oCenters = centers;
# ---------- c_script_3: C# additional code ----------
  List<Point3d> centers;
# ---------- end c_script_3 ----------
panel_9 = Panel("1")  # disabled
cir_2 = Circle(Plane=c_script_3.oCenters, Radius=panel_9)  # disabled

# ---- group: MasterScriptFiles_2022_sevenPlusThree11-20 / CircleRelaxation_01
panel_10 = Panel("100")  # disabled
number_slider_31 = Slider(0, range=0..300)  # disabled
c_script_4 = CSharpScript(iCount=panel_10)  # -> out, oPoints; inputs iCount: Int32; disabled; same code as c_script_2
c_script_5 = CSharpScript(iStartingPositions=c_script_4.oPoints, iIterationCount=number_slider_31)  # -> out, oCenters; inputs iStartingPositions: list of Point3d, iIterationCount: Int32; disabled
# ---------- c_script_5: C# ----------
    List<Point3d> centers = new List<Point3d>(iStartingPositions);

    for (int iteration = 0; iteration < iIterationCount; iteration++)
    {
      List < Vector3d > totalMoves = new List<Vector3d>();
      List<double> collisionCounts = new List<double>();

      for (int i = 0; i < centers.Count; i++)
      {
        totalMoves.Add(new Vector3d(0.0, 0.0, 0.0));
        collisionCounts.Add(0.0);
      }

      double collisionDistance = 2.0;

      for (int i = 0; i < centers.Count; i++)
        for (int j = i + 1; j < centers.Count; j++)
        {
          double d = centers[i].DistanceTo(centers[j]);
          if (d > collisionDistance) continue;
          Vector3d move = centers[i] - centers[j];
          move.Unitize();
          move *= 0.5 * (collisionDistance - d);
          totalMoves[i] += move;
          totalMoves[j] -= move;
          collisionCounts[i] += 1.0;
          collisionCounts[j] += 1.0;
        }

      for (int i = 0; i < centers.Count; i++)
        if (collisionCounts[i] != 0.0)
          centers[i] += totalMoves[i] / collisionCounts[i];
    }

    oCenters = centers;
# ---------- end c_script_5 ----------
panel_11 = Panel("1")  # disabled
cir_3 = Circle(Plane=c_script_5.oCenters, Radius=panel_11)  # disabled

# ---- group: MasterScriptFiles_2022_sevenPlusThree11-20 / Parametric Wheel with Sine Function WSII 003 / Rectangle Circle Wheel
number_slider_32 = Slider(41, range=0..100)  # disabled
number_slider_33 = Slider(59, range=0..100)  # disabled
Z_2 = UnitZ(Factor=number_slider_33)  # disabled
rectangle = Rectangle(Plane=PlaneXY(0, 0, 0), XSize=number_slider_32, YSize=number_slider_32, Radius=number_slider_32)  # -> Rectangle, Length; disabled
extr = Extrude(Base=rectangle.Rectangle, Direction=Z_2)  # disabled
cap_12 = CapHoles(Brep=extr)  # disabled

# ---- group: MasterScriptFiles_2022_sevenPlusThree11-20 / 4 Wheeled Cupola Cart WSII 001 / 4 Wheels
merge_2 = Merge(Data1=merge, Data2=move_9.Geometry)  # disabled

# ---- group: MasterScriptFiles_2022_sevenPlusThree11-20 / Exercise008
numpts = Slider(158, range=1..200)  # disabled
panel_12 = Panel("""true
true
false
false""")  # disabled
panel_13 = Panel("true")  # disabled
panel_14 = Panel("""true
true
true
false
false
true
false""")  # disabled
number_slider_34 = Slider(40, range=0..40)  # disabled
weave = Weave(Pattern=[0, 1], NullGaps=False)  # disabled
dispatch = Dispatch(DispatchPattern=[True, False])  # -> ListA, ListB; disabled

# ---- group: MasterScriptFiles_2022_sevenPlusThree11-20 / Exercise008 / t
series = Series(Start=0, Step=1, Count=numpts)  # disabled

# ---- group: MasterScriptFiles_2022_sevenPlusThree11-20 / Exercise008 (continued)
expression_3 = Expression(t=series, Expression="cos(t)*t")  # disabled
expression_4 = Expression(t=series, Expression="sin(t)*t")  # disabled
pt_5 = ConstructPoint(XCoordinate=expression_3, YCoordinate=expression_4, ZCoordinate=0)  # disabled
points = PointList(Points=pt_5)  # disabled

# ---- group: MasterScriptFiles_2022_sevenPlusThree11-20 / Exercise008 / Culled List of Points
cull = CullPattern(List=pt_5, CullPattern=panel_12)  # disabled

# ---- group: MasterScriptFiles_2022_sevenPlusThree11-20 / Exercise008 (continued)
voronoi = Voronoi(Points=cull, Radius=number_slider_34, BruteForceOverride=False)  # disabled

# ---- group: MasterScriptFiles_2022_sevenPlusThree11-20 / Parametric Wheel with Sine Function WSII 003
# Hybrid Wheel (Cyl/Cone)
loft_2 = Loft(
    Curves=[move_6.Geometry, intcrv_2.Curve],
    Options={Adjust=False, Closed=False, LoftEnds=0, LoftSimp=0, LoftType=0, Rebuild=10, Refit=0.01})  # disabled
sdiff_7 = SolidDifference(BrepsA=cap_11, BrepsB=arrcurve_3.Geometry)  # disabled

# ---- group: MasterScriptFiles_2022_sevenPlusThree11-20 / Parametric Wheel with Sine Function WSII 003 / Sine Solid
number_slider_35 = Slider(49, range=0..100)  # disabled
Z_3 = UnitZ(Factor=width_of_wheel_3)  # disabled
neg_3 = Negative(Value=number_slider_35)  # disabled
number_slider_36 = Slider(38, range=0..100)  # disabled
extr_2 = Extrude(Base=loft_2, Direction=Z_3)  # disabled
Y_5 = UnitY(Factor=neg_3)  # disabled
cap_13 = CapHoles(Brep=extr_2)  # disabled
neg_4 = Negative(Value=number_slider_36)  # disabled
move_10 = Move(Geometry=cap_13, Motion=Y_5)  # -> Geometry, Transform; disabled
X_7 = UnitX(Factor=neg_4)  # disabled
move_11 = Move(Geometry=move_10.Geometry, Motion=Vector(0, 0, 10))  # -> Geometry, Transform; disabled
move_12 = Move(Geometry=move_10.Geometry, Motion=X_7)  # -> Geometry, Transform; disabled

# ---- group: MasterScriptFiles_2022_sevenPlusThree11-20 / Parametric Wheel with Sine Function WSII 003 (continued)
sint = SolidIntersection(BrepsA=sdiff_7, BrepsB=move_12.Geometry)  # disabled
