# Grasshopper definition Light_MasterScriptFiles_2022_ten_31-40.gh (Grasshopper 1.0.7)
# plug-ins: Bifocals

# ---- group: MasterScriptFiles_2022_ten_31-40 / January9th_WSII_2019
separate_wheels = Slider(150, range=40..200)  # disabled
wheelface_scale = Slider(1.131, range=0..2)  # disabled
# Wheels
diameter = Slider(142, range=0..200)  # disabled
hole_radii = Slider(21, range=0..100)  # disabled
thickness = Slider(50, range=0..100)  # disabled
hole_slider = Slider(89, range=0..100)  # disabled
angle_wheels = Slider(0.48, range=0.4..0.6)  # disabled
of_holes = Slider(9, range=0..10)  # disabled
circle = Circle(Plane=PlaneXY(0, 0, 0), Radius=hole_radii)  # disabled
unit_x = UnitX(Factor=hole_slider)  # disabled
move = Move(Geometry=circle, Motion=unit_x)  # -> Geometry, Transform; disabled
unit_z = UnitZ(Factor=thickness)  # disabled
polar_array = PolarArray(Geometry=move.Geometry, Plane=PlaneXY(0, 0, 0), Count=of_holes, Angle=6.283185307)  # -> Geometry, Transform; disabled
move_2 = Move(Geometry=polar_array.Geometry, Motion=unit_z)  # -> Geometry, Transform; disabled
area = Area(Geometry=move_2.Geometry)  # -> Area, Centroid; disabled
scale = Scale(Geometry=move_2.Geometry, Center=area.Centroid, Factor=wheelface_scale)  # -> Geometry, Transform; disabled
circle_2 = Circle(Plane=PlaneXY(0, 0, 0), Radius=diameter)  # disabled
move_3 = Move(Geometry=circle_2, Motion=unit_z)  # -> Geometry, Transform; disabled
area_2 = Area(Geometry=move_3.Geometry)  # -> Area, Centroid; disabled
scale_2 = Scale(Geometry=move_3.Geometry, Center=area_2.Centroid, Factor=wheelface_scale)  # -> Geometry, Transform; disabled
flip_matrix = FlipMatrix(Data=scale.Geometry)  # disabled
flip_matrix_2 = FlipMatrix(Data=polar_array.Geometry)  # disabled
boundary_surfaces = BoundarySurfaces(Edges=polar_array.Geometry)  # disabled
boundary_surfaces_2 = BoundarySurfaces(Edges=circle_2)  # disabled
boundary_surfaces_3 = BoundarySurfaces(Edges=scale_2.Geometry)  # disabled
boundary_surfaces_4 = BoundarySurfaces(Edges=scale.Geometry)  # disabled
loft = Loft(
    Curves=[circle_2, scale_2.Geometry],
    Options={Adjust=False, Closed=False, LoftEnds=0, LoftSimp=0, LoftType=0, Rebuild=10, Refit=0.01})  # disabled
loft_2 = Loft(
    Curves=[flip_matrix_2, flip_matrix],
    Options={Adjust=False, Closed=False, LoftEnds=0, LoftSimp=0, LoftType=0, Rebuild=10, Refit=0.01})  # disabled
solid_difference = SolidDifference(BrepsA=boundary_surfaces_3, BrepsB=boundary_surfaces_4)  # disabled
solid_difference_2 = SolidDifference(BrepsA=boundary_surfaces_2, BrepsB=boundary_surfaces)  # disabled
pi = Pi(Factor=angle_wheels)  # disabled
brep_join = BrepJoin(Breps=[solid_difference, loft, solid_difference_2, loft_2])  # -> Breps, Closed; disabled
xz_plane = XZPlane(Origin=Point(0, 0, 0))  # disabled
rotate_3d = Rotate3D(Geometry=brep_join.Breps, Angle=pi, Center=Point(0, 0, 0), Axis=xz_plane)  # -> Geometry, Transform; disabled
unit_x_2 = UnitX(Factor=separate_wheels)  # disabled
move_4 = Move(Geometry=rotate_3d.Geometry, Motion=unit_x_2)  # -> Geometry, Transform; disabled
mirror = Mirror(Geometry=move_4.Geometry, Plane=PlaneYZ(0, 0, 0))  # -> Geometry, Transform; disabled
brep_join_2 = BrepJoin(Breps=[move_4.Geometry, mirror.Geometry])  # -> Breps, Closed; disabled

# ---- group: MasterScriptFiles_2022_ten_31-40 / ImageSampler_WSII_2019
number_slider = Slider(0.04078, range=0..1)  # disabled
number_slider_2 = Slider(741, range=0..1000)  # disabled
number_slider_3 = Slider(805, range=0..1000)  # disabled
number_slider_4 = Slider(29.294, range=0..100)  # disabled
rectangular = Rectangular(Plane=PlaneXY(0, 0, 0), SizeX=number_slider, SizeY=number_slider, ExtentX=number_slider_2, ExtentY=number_slider_3)  # -> Cells, Points; disabled
image_sampler = ImageSampler(rectangular.Points, Filter="Saturation", Interpolate=True, Umax=40, Umin=0, Vmax=40, Vmin=0, Wrap=0)  # disabled
division = Division(A=image_sampler, B=number_slider_4)  # disabled
circle_cnr = CircleCNR(Center=rectangular.Points, Normal=Vector(0, 0, 1), Radius=division)  # disabled

# ---- group: MasterScriptFiles_2022_ten_31-40 / GomezBasicshapes_WSII_2019
# Great Intro
number_slider_5 = Slider(9, range=0..10)  # disabled
number_slider_6 = Slider(5, range=0..10)  # disabled
number_slider_7 = Slider(6, range=0..10)  # disabled
number_slider_8 = Slider(13, range=0..100)  # disabled
construct_point = ConstructPoint(XCoordinate=0, YCoordinate=0, ZCoordinate=0)  # disabled
multiplication = Multiplication(A=number_slider_8, B=number_slider_5)  # disabled
polygon = Polygon(Plane=construct_point, Radius=multiplication, Segments=number_slider_6, FilletRadius=number_slider_7)  # -> Polygon, Length; disabled
circle_3 = Circle(Plane=construct_point, Radius=number_slider_8)  # disabled
number_slider_9 = Slider(10, range=0..10)  # disabled
golden_ratio = GoldenRatio(Factor=number_slider_8)  # disabled
explode = Explode(Curve=polygon.Polygon, Recursive=True)  # -> Segments, Vertices; disabled
unit_z_2 = UnitZ(Factor=number_slider_9)  # disabled
multiplication_2 = Multiplication(A=circle_3, B=golden_ratio)  # disabled
circle_4 = Circle(Plane=explode.Vertices, Radius=multiplication_2)  # disabled
amplitude = Amplitude(Vector=unit_z_2, Amplitude=unit_z_2)  # disabled
extrude = Extrude(Base=polygon.Polygon, Direction=amplitude)  # disabled
extrude_2 = Extrude(Base=circle_3, Direction=amplitude)  # disabled
extrude_3 = Extrude(Base=circle_4, Direction=amplitude)  # disabled
cap_holes = CapHoles(Brep=extrude_2)  # disabled
cap_holes_2 = CapHoles(Brep=extrude_3)  # disabled
cap_holes_3 = CapHoles(Brep=extrude)  # disabled
solid_difference_3 = SolidDifference(BrepsA=cap_holes_3, BrepsB=cap_holes)  # disabled
solid_difference_4 = SolidDifference(BrepsA=solid_difference_3, BrepsB=cap_holes_2)  # disabled

# ---- group: MasterScriptFiles_2022_ten_31-40 / February10thAnimation
number_slider_10 = Slider(12, range=0..100)  # disabled
number_slider_11 = Slider(34, range=0..100)  # disabled
geometry = Geometry(solid_difference_4)  # disabled
populate_geometry = PopulateGeometry(Geometry=geometry, Count=number_slider_11, Seed=number_slider_10)  # disabled
voronoi_3d = Voronoi3D(Points=populate_geometry, Box=geometry)  # -> graft(Cells), Boundary; disabled
number_slider_12 = Slider(10, range=0..100)  # disabled
solid_intersection = SolidIntersection(BrepsA=geometry, BrepsB=voronoi_3d.Cells)  # -> flatten(Result); disabled
deconstruct_brep = DeconstructBrep(Brep=solid_intersection)  # -> Faces, Edges, Vertices; disabled
md_slider = MDSlider(SliderMode=0, slider_value=Point(0.5, 0.5, 0.5), x_domain=Domain(0, 1), y_domain=Domain(0, 1), z_domain=Domain(0, 1))  # disabled
number_slider_13 = Slider(1, range=0..1)  # disabled
number_slider_14 = Slider(4, range=0..10)  # disabled
number_slider_15 = Slider(8, range=0..10)  # disabled
number_slider_16 = Slider(6, range=0..10)  # disabled
number_slider_17 = Slider(2, range=0..10)  # disabled
number_slider_18 = Slider(3, range=0..10)  # disabled
number_slider_19 = Slider(5, range=0..10)  # disabled
number_slider_20 = Slider(9, range=0..10)  # disabled
number_slider_21 = Slider(10, range=0..10)  # disabled
number_slider_22 = Slider(7, range=0..10)  # disabled
list_item = ListItem(List=deconstruct_brep.Faces, Index=0, Wrap=True)  # disabled
evaluate_surface = EvaluateSurface(Surface=list_item, Point=md_slider)  # -> Point, Normal, Frame; disabled
list_item_2 = ListItem(List=deconstruct_brep.Faces, Index=number_slider_14, Wrap=True)  # disabled
list_item_3 = ListItem(List=deconstruct_brep.Faces, Index=number_slider_16, Wrap=True)  # disabled
list_item_4 = ListItem(List=deconstruct_brep.Faces, Index=number_slider_18, Wrap=True)  # disabled
list_item_5 = ListItem(List=deconstruct_brep.Faces, Index=number_slider_19, Wrap=True)  # disabled
list_item_6 = ListItem(List=deconstruct_brep.Faces, Index=number_slider_17, Wrap=True)  # disabled
list_item_7 = ListItem(List=deconstruct_brep.Faces, Index=number_slider_13, Wrap=True)  # disabled
list_item_8 = ListItem(List=deconstruct_brep.Faces, Index=number_slider_22, Wrap=True)  # disabled
list_item_9 = ListItem(List=deconstruct_brep.Faces, Index=number_slider_15, Wrap=True)  # disabled
list_item_10 = ListItem(List=deconstruct_brep.Faces, Index=number_slider_20, Wrap=True)  # disabled
list_item_11 = ListItem(List=deconstruct_brep.Faces, Index=number_slider_21, Wrap=True)  # disabled
multiplication_3 = Multiplication(A=evaluate_surface.Normal, B=number_slider_12)  # disabled

# ---- group: MasterScriptFiles_2022_ten_31-40 / Voronoi3D_WSII_2019
number_slider_23 = Slider(7, range=0..100)  # disabled
number_slider_24 = Slider(6, range=0..100)  # disabled
number_slider_25 = Slider(45, range=0..100)  # disabled
box = Box({Plane=PlaneXY(-36, -19, 0), X=Domain(0, 30), Y=Domain(0, 55), Z=Domain(0, 17)})  # disabled
point = Point([Point(-4, 1, 6.795309711), Point(4, 4, 3.733067716), Point(8, 0, 5.049135463), Point(4, -3, 3.51239839), Point(-9, -8, 0), Point(-21, -3, 2.849601055), Point(-13, 9, 0), Point(3, 8, 4.44186231), Point(8, 5, 3.354730064)])  # disabled
box_2 = Box({Plane=PlaneXY(-36, -19, 0), X=Domain(0, 30), Y=Domain(0, 55), Z=Domain(0, 17)})  # disabled
point_2 = Point([Point(-36, -19, 0), Point(-36, 36, 0), Point(-6, 24.45958227, 16.60397489), Point(-1.813228311, -5.401570817, -0.2540552989)])  # disabled
populate_geometry_2 = PopulateGeometry(Geometry=box, Count=number_slider_25, Seed=number_slider_25)  # disabled
sphere = Sphere(Base=point_2, Radius=number_slider_23)  # disabled
sphere_2 = Sphere(Base=point, Radius=number_slider_24)  # disabled
number_slider_26 = Slider(1.261, range=0..2)  # disabled
number_slider_27 = Slider(19, range=0..100)  # disabled
number_slider_28 = Slider(278, range=0..1000)  # disabled
solid_difference_5 = SolidDifference(BrepsA=box_2, BrepsB=sphere)  # disabled
voronoi_3d_2 = Voronoi3D(Points=populate_geometry_2)  # -> Cells, Boundary; disabled
area_3 = Area(Geometry=box_2)  # -> Area, Centroid; disabled
random_reduce = RandomReduce(List=voronoi_3d_2.Cells, Reduction=number_slider_27, Seed=number_slider_27)  # disabled
populate_geometry_3 = PopulateGeometry(Geometry=solid_difference_5, Count=number_slider_28, Seed=1)  # disabled
scale_3 = Scale(Geometry=solid_difference_5, Center=area_3.Centroid, Factor=number_slider_26)  # -> Geometry, Transform; disabled
solid_union = SolidUnion(Breps=random_reduce)  # disabled
box_3 = Box(scale_3.Geometry)  # disabled
voronoi_3d_3 = Voronoi3D(Points=populate_geometry_3, Box=box_3)  # -> Cells, Boundary; disabled
solid_intersection_2 = SolidIntersection(BrepsA=voronoi_3d_3.Cells, BrepsB=solid_difference_5)  # -> graft(Result); disabled
brep_brep = BrepBrep(BrepA=voronoi_3d_3.Cells, BrepB=solid_difference_5)  # -> Curves, Points; disabled
solid_union_2 = SolidUnion(Breps=solid_intersection_2)  # disabled
deconstruct_brep_2 = DeconstructBrep(Brep=solid_union_2)  # -> flatten(Faces), Edges, Vertices; disabled
number_slider_29 = Slider(0.82, range=0..1)  # disabled
surface = Surface(deconstruct_brep_2.Faces)  # disabled
area_4 = Area(Geometry=surface)  # -> Area, Centroid; disabled
curve = Curve(surface)  # disabled
scale_4 = Scale(Geometry=curve, Center=area_4.Centroid, Factor=number_slider_29)  # -> Geometry, Transform; disabled
curve_2 = Curve(graft(curve))  # disabled
curve_3 = Curve(graft(scale_4.Geometry))  # disabled
scale_5 = Scale(Geometry=surface, Center=area_4.Centroid, Factor=number_slider_29)  # -> Geometry, Transform; disabled
loft_3 = Loft(
    Curves=[curve_3, curve_2],
    Options={Adjust=False, Closed=False, LoftEnds=0, LoftSimp=0, LoftType=0, Rebuild=10, Refit=0.01})  # disabled

# ---- group: MasterScriptFiles_2022_ten_31-40 / HippocratesQuadLune
number_slider_30 = Slider(0.39, range=0..1)  # disabled
number_slider_31 = Slider(0.73, range=0..1)  # disabled
number_slider_32 = Slider(0.81, range=0..1)  # disabled
number_slider_33 = Slider(1.69, range=0..2)  # disabled
number_slider_34 = Slider(0.76, range=0..6)  # disabled
number_slider_35 = Slider(3.57, range=0..5)  # disabled
arc = Arc(Plane=PlaneXY(0, 0, 0), Radius=number_slider_35, Angle=Domain(0, 3.141592654))  # -> Arc, Length; disabled
evaluate_curve = EvaluateCurve(Curve=reparameterize(arc.Arc), Parameter=number_slider_32)  # -> Point, Tangent, Angle; disabled
evaluate_curve_2 = EvaluateCurve(Curve=reparameterize(arc.Arc), Parameter=number_slider_30)  # -> Point, Tangent, Angle; disabled
evaluate_curve_3 = EvaluateCurve(Curve=reparameterize(arc.Arc), Parameter=number_slider_31)  # -> Point, Tangent, Angle; disabled
pi_2 = Pi(Factor=number_slider_33)  # disabled
line_sdl = LineSDL(Start=evaluate_curve_3.Point, Direction=evaluate_curve_3.Tangent, Length=1)  # disabled
rotate_3d_2 = Rotate3D(Geometry=line_sdl, Angle=pi_2, Center=evaluate_curve_3.Point, Axis=Vector(0, 0, 1))  # -> Geometry, Transform; disabled
point_on_curve = PointOnCurve(rotate_3d_2.Geometry, parameter=0.619)  # disabled
arc_3pt = Arc3Pt(PointA=evaluate_curve.Point, PointB=evaluate_curve_3.Point, PointC=evaluate_curve_2.Point)  # -> Arc, Plane, Radius; disabled
arc_3pt_2 = Arc3Pt(PointA=evaluate_curve.Point, PointB=point_on_curve, PointC=evaluate_curve_2.Point)  # -> Arc, Plane, Radius; disabled
loft_4 = Loft(
    Curves=[arc_3pt.Arc, arc_3pt_2.Arc],
    Options={Adjust=False, Closed=False, LoftEnds=0, LoftSimp=0, LoftType=0, Rebuild=10, Refit=0.01})  # disabled
unit_z_3 = UnitZ(Factor=number_slider_34)  # disabled
extrude_4 = Extrude(Base=loft_4, Direction=unit_z_3)  # disabled

# ---- group: MasterScriptFiles_2022_ten_31-40 / shortestUsefulScriptEver
button = Button()  # disabled
c_script = CSharpScript(TestMyDefinition=button)  # -> out, Result; disabled
# ---------- c_script: C# ----------
    int count = GrasshopperDocument.ObjectCount;
    string result = "Wow, a negative amount of components.You must be Chuck Norris!";
    if (count >= 0) result = "Dummy, you need at least 2 additional components to compete here!";
    if (count > 3) result = "Only the Dark Lord (Peter F.) should have such a short definition, thats why he wears a mask and a voice scrambler";
    if (count > 10) result = "Your definition length is below average. You are a loft failure!";
    if (count > 100) result = "Your definition length is average, next time try to create more components not control points";
    if (count > 500) result = "Your definition length is above average, Seems like you know whats 'Copy and Paste' is all about!";
    if (count > 1000) result = "Great! Your definition is big. You have a 50 % chance of being part of the top 1% or you just doing jewellery design?";
    if (count > 2000) result = "Awesome, your definition is large. Now you are ready to build extremly useful definitions!";
    if (count > 3000) result = "Legendary! You must building kiteboards and kites,competing against $10000-per-seat software?";
    if (count > 23000) result = "NBBJ, my friend! Only the longest definition-writer get a payed internship as architect";
    Result = result;
# ---------- end c_script ----------
panel = Panel(c_script.Result)  # disabled

# ---- group: MasterScriptFiles_2022_ten_31-40 / February10thBells
circle_cnr_2 = CircleCNR(Center=Point(0, 0, 0), Normal=Vector(0, 0, 1), Radius=Slider(27, range=0..100))
construct_domain = ConstructDomain(DomainStart=0, DomainEnd=Slider(42, range=0..100))
curve_4 = Curve(reparameterize(circle_cnr_2))
range = Range(Domain=construct_domain, Steps=10)
unit_z_4 = UnitZ(Factor=range)
move_5 = Move(Geometry=curve_4, Motion=unit_z_4)  # -> Geometry, Transform
list_length = ListLength(List=move_5.Geometry)
split_list = SplitList(List=move_5.Geometry, Index=expr("x/2", list_length))  # -> ListA, ListB
area_5 = Area(Geometry=split_list.ListA)  # -> Area, Centroid
area_6 = Area(Geometry=split_list.ListB)  # -> Area, Centroid
curve_closest_point = CurveClosestPoint(Point=area_6.Centroid, Curve=curve_4)  # -> Point, Parameter, Distance
curve_closest_point_2 = CurveClosestPoint(Point=area_5.Centroid, Curve=curve_4)  # -> Point, Parameter, Distance
distance = Distance(PointA=area_5.Centroid, PointB=curve_closest_point_2.Point)
distance_2 = Distance(PointA=area_6.Centroid, PointB=curve_closest_point.Point)
bounds = Bounds(Numbers=distance_2)
bounds_2 = Bounds(Numbers=distance)
construct_domain_2 = ConstructDomain(DomainStart=Slider(0.91, range=0..1), DomainEnd=Slider(0.17, range=-1..1))
graph_mapper = GraphMapper(
    construct_domain_2,
    x0=0,
    x1=1,
    y0=0,
    y1=1,
    Ox=0.4133858383,
    Oy=0,
    Px=0.807086587,
    Py=0.1841155291,
    container_name="Parabola")
construct_domain_3 = ConstructDomain(DomainStart=Slider(0.91, range=0..1), DomainEnd=Slider(0.17, range=-1..1))
graph_mapper_2 = GraphMapper(
    construct_domain_3,
    x0=0,
    x1=1,
    y0=0,
    y1=1,
    container_name="Sine",
    Equation_px=[0.08474576473, 0.2338983119],
    Equation_py=[0.003174602985, 0.6285713911])
remap_numbers = RemapNumbers(Value=distance_2, Source=bounds, Target=graph_mapper)  # -> Mapped, Clipped
remap_numbers_2 = RemapNumbers(Value=distance, Source=bounds_2, Target=graph_mapper_2)  # -> Mapped, Clipped
scale_6 = Scale(Geometry=split_list.ListA, Center=area_5.Centroid, Factor=remap_numbers_2.Mapped)  # -> Geometry, Transform
scale_7 = Scale(Geometry=split_list.ListB, Center=area_5.Centroid, Factor=remap_numbers.Mapped)  # -> Geometry, Transform
unit_z_5 = UnitZ(Factor=Slider(14, range=0..100))
move_6 = Move(Geometry=scale_7.Geometry, Motion=unit_z_5)  # -> Geometry, Transform
loft_5 = Loft(
    Curves=[scale_6.Geometry, move_6.Geometry],
    Options={Adjust=False, Closed=False, LoftEnds=0, LoftSimp=0, LoftType=0, Rebuild=10, Refit=0.01})
reverse_list = ReverseList(List=move_6.Geometry)
surface_2 = Surface(loft_5)
offset = Offset(Surface=surface_2, Distance=expr("-x", Slider(1, range=0..1)), Retrim=True)
list_item_12 = ListItem(List=reverse_list, Index=Slider(0, range=0..100), Wrap=True)
brep = Brep(loft_5)
brep_2 = Brep(offset)
deconstruct_brep_3 = DeconstructBrep(Brep=brep_2)  # -> Faces, Edges, Vertices
deconstruct_brep_4 = DeconstructBrep(Brep=brep)  # -> Faces, Edges, Vertices
number_slider_36 = Slider(2, range=0..10)
number_slider_37 = Slider(1, range=0..10)
list_item_13 = ListItem(List=deconstruct_brep_4.Edges, Index=number_slider_36, Wrap=True)
list_item_14 = ListItem(List=deconstruct_brep_4.Edges, Index=number_slider_37, Wrap=True)
list_item_15 = ListItem(List=deconstruct_brep_3.Edges, Index=number_slider_36, Wrap=True)
list_item_16 = ListItem(List=deconstruct_brep_3.Edges, Index=number_slider_37, Wrap=True)

# ---- group: MasterScriptFiles_2022_ten_31-40 / CupolaCart_intermediate_WSII_2019
# Well #2
pattern = Slider(9.205, range=0..12)  # disabled
height = Slider(128, range=0..300)  # disabled
craziness = Slider(12, range=0..30)  # disabled
diameter_2 = Slider(73, range=0..200)  # disabled
outside_angle = Slider(-12, range=-12..12)  # disabled
range_2 = Range(Domain=height, Steps=pattern)  # disabled
sine = Sine(Value=range_2)  # disabled
multiplication_4 = Multiplication(A=sine, B=craziness)  # disabled
number_slider_38 = Slider(0.5, range=0..2)  # disabled
construct_point_2 = ConstructPoint(XCoordinate=range_2, YCoordinate=0, ZCoordinate=multiplication_4)  # disabled
interpolate = Interpolate(Vertices=construct_point_2, Degree=3, Periodic=False, KnotStyle=1)  # -> Curve, Length, Domain; disabled
xz_plane_2 = XZPlane(Origin=Point(0, 0, 0))  # disabled
pi_3 = Pi(Factor=number_slider_38)  # disabled
rotate_3d_3 = Rotate3D(Geometry=interpolate.Curve, Angle=pi_3, Center=Point(0, 0, 0), Axis=xz_plane_2)  # -> Geometry, Transform; disabled
unit_x_3 = UnitX(Factor=diameter_2)  # disabled
number_slider_39 = Slider(1, range=0..1)  # disabled
move_7 = Move(Geometry=rotate_3d_3.Geometry, Motion=unit_x_3)  # -> Geometry, Transform; disabled
divide_curve = DivideCurve(Curve=move_7.Geometry, Count=number_slider_39, Kinks=False)  # -> Points, Tangents, Parameters; disabled
number_slider_40 = Slider(0, range=0..100)  # disabled
number_slider_41 = Slider(100, range=0..100)  # disabled
radians = Radians(Degrees=outside_angle)  # disabled
xz_plane_3 = XZPlane(Origin=Point(0, 0, 0))  # disabled
list_item_17 = ListItem(List=divide_curve.Points, Index=0, Wrap=True)  # disabled
construct_point_3 = ConstructPoint(XCoordinate=0, YCoordinate=0, ZCoordinate=0)  # disabled
construct_point_4 = ConstructPoint(XCoordinate=number_slider_40, YCoordinate=number_slider_40, ZCoordinate=number_slider_41)  # disabled
rotate_3d_4 = Rotate3D(Geometry=move_7.Geometry, Angle=radians, Center=list_item_17, Axis=xz_plane_3)  # -> Geometry, Transform; disabled
line = Line(StartPoint=construct_point_3, EndPoint=construct_point_4)  # disabled
revolution = Revolution(Curve=rotate_3d_4.Geometry, Axis=line, Domain=Domain(0, 6.283185307))  # disabled

# Wheels
wheelface_scale_2 = Slider(1.085, range=0..2)  # disabled
separate_wheels_2 = Slider(109, range=40..200)  # disabled
hole_slider_2 = Slider(85, range=0..100)  # disabled
diameter_3 = Slider(105, range=0..200)  # disabled
hole_radii_2 = Slider(14, range=0..100)  # disabled
thickness_2 = Slider(33, range=0..100)  # disabled
of_holes_2 = Slider(5, range=0..10)  # disabled
angle_wheels_2 = Slider(0.46, range=0.4..0.6)  # disabled
circle_5 = Circle(Plane=PlaneXY(0, 0, 0), Radius=hole_radii_2)  # disabled
unit_x_4 = UnitX(Factor=hole_slider_2)  # disabled
move_8 = Move(Geometry=circle_5, Motion=unit_x_4)  # -> Geometry, Transform; disabled
unit_z_6 = UnitZ(Factor=thickness_2)  # disabled
polar_array_2 = PolarArray(Geometry=move_8.Geometry, Plane=PlaneXY(0, 0, 0), Count=of_holes_2, Angle=6.283185307)  # -> Geometry, Transform; disabled
move_9 = Move(Geometry=polar_array_2.Geometry, Motion=unit_z_6)  # -> Geometry, Transform; disabled
area_7 = Area(Geometry=move_9.Geometry)  # -> Area, Centroid; disabled
scale_8 = Scale(Geometry=move_9.Geometry, Center=area_7.Centroid, Factor=wheelface_scale_2)  # -> Geometry, Transform; disabled
circle_6 = Circle(Plane=PlaneXY(0, 0, 0), Radius=diameter_3)  # disabled
move_10 = Move(Geometry=circle_6, Motion=unit_z_6)  # -> Geometry, Transform; disabled
area_8 = Area(Geometry=move_10.Geometry)  # -> Area, Centroid; disabled
scale_9 = Scale(Geometry=move_10.Geometry, Center=area_8.Centroid, Factor=wheelface_scale_2)  # -> Geometry, Transform; disabled
flip_matrix_3 = FlipMatrix(Data=scale_8.Geometry)  # disabled
flip_matrix_4 = FlipMatrix(Data=polar_array_2.Geometry)  # disabled
boundary_surfaces_5 = BoundarySurfaces(Edges=polar_array_2.Geometry)  # disabled
boundary_surfaces_6 = BoundarySurfaces(Edges=circle_6)  # disabled
boundary_surfaces_7 = BoundarySurfaces(Edges=scale_9.Geometry)  # disabled
boundary_surfaces_8 = BoundarySurfaces(Edges=scale_8.Geometry)  # disabled
loft_6 = Loft(
    Curves=[flip_matrix_4, flip_matrix_3],
    Options={Adjust=False, Closed=False, LoftEnds=0, LoftSimp=0, LoftType=0, Rebuild=10, Refit=0.01})  # disabled
loft_7 = Loft(
    Curves=[circle_6, scale_9.Geometry],
    Options={Adjust=False, Closed=False, LoftEnds=0, LoftSimp=0, LoftType=0, Rebuild=10, Refit=0.01})  # disabled
solid_difference_6 = SolidDifference(BrepsA=boundary_surfaces_7, BrepsB=boundary_surfaces_8)  # disabled
solid_difference_7 = SolidDifference(BrepsA=boundary_surfaces_6, BrepsB=boundary_surfaces_5)  # disabled
pi_4 = Pi(Factor=angle_wheels_2)  # disabled
brep_join_3 = BrepJoin(Breps=[solid_difference_6, loft_7, solid_difference_7, loft_6])  # -> Breps, Closed; disabled
xz_plane_4 = XZPlane(Origin=Point(0, 0, 0))  # disabled
rotate_3d_5 = Rotate3D(Geometry=brep_join_3.Breps, Angle=pi_4, Center=Point(0, 0, 0), Axis=xz_plane_4)  # -> Geometry, Transform; disabled
unit_x_5 = UnitX(Factor=separate_wheels_2)  # disabled
move_11 = Move(Geometry=rotate_3d_5.Geometry, Motion=unit_x_5)  # -> Geometry, Transform; disabled
mirror_2 = Mirror(Geometry=move_11.Geometry, Plane=PlaneYZ(0, 0, 0))  # -> Geometry, Transform; disabled

number_slider_42 = Slider(1, range=1..2.77)  # disabled
number_slider_43 = Slider(93, range=0..300)  # disabled
number_slider_44 = Slider(100, range=0..100)  # disabled
circle_cnr_3 = CircleCNR(Center=area_8.Centroid, Normal=Vector(0, 0, 1), Radius=number_slider_43)  # disabled
unit_z_7 = UnitZ(Factor=number_slider_44)  # disabled
move_12 = Move(Geometry=circle_cnr_3, Motion=unit_z_7)  # -> Geometry, Transform; disabled
area_9 = Area(Geometry=move_12.Geometry)  # -> Area, Centroid; disabled
scale_10 = Scale(Geometry=move_12.Geometry, Center=area_9.Centroid, Factor=number_slider_42)  # -> Geometry, Transform; disabled
loft_8 = Loft(
    Curves=[circle_cnr_3, scale_10.Geometry],
    Options={Adjust=False, Closed=False, LoftEnds=0, LoftSimp=0, LoftType=0, Rebuild=10, Refit=0.01})  # disabled
cap_holes_4 = CapHoles(Brep=loft_8)  # disabled

# ---- group: MasterScriptFiles_2022_ten_31-40 / February10thBREAKTHROUGH2.0
# Create a cool closed curve in Rhino for Wheel rail
geometry_2 = Geometry(<curve referenced from the Rhino model>)  # disabled

# ---- group: MasterScriptFiles_2022_ten_31-40 / February10thAnimation
move_13 = Move(Geometry=list_item, Motion=multiplication_3)  # -> Geometry, Transform; disabled
move_14 = Move(Geometry=list_item_7, Motion=multiplication_3)  # -> Geometry, Transform; disabled
move_15 = Move(Geometry=list_item_6, Motion=multiplication_3)  # -> Geometry, Transform; disabled
move_16 = Move(Geometry=list_item_4, Motion=multiplication_3)  # -> Geometry, Transform; disabled
move_17 = Move(Geometry=list_item_2, Motion=multiplication_3)  # -> Geometry, Transform; disabled
move_18 = Move(Geometry=list_item_5, Motion=multiplication_3)  # -> Geometry, Transform; disabled
move_19 = Move(Geometry=list_item_3, Motion=multiplication_3)  # -> Geometry, Transform; disabled
move_20 = Move(Geometry=list_item_8, Motion=multiplication_3)  # -> Geometry, Transform; disabled
move_21 = Move(Geometry=list_item_9, Motion=multiplication_3)  # -> Geometry, Transform; disabled
move_22 = Move(Geometry=list_item_10, Motion=multiplication_3)  # -> Geometry, Transform; disabled
move_23 = Move(Geometry=list_item_11, Motion=multiplication_3)  # -> Geometry, Transform; disabled

# ---- group: MasterScriptFiles_2022_ten_31-40 / CupolaCart_intermediate_WSII_2019
# Well
cap_holes_5 = CapHoles(Brep=revolution)  # disabled
brep_join_4 = BrepJoin(Breps=[move_11.Geometry, mirror_2.Geometry])  # -> Breps, Closed; disabled

# ---- group: MasterScriptFiles_2022_ten_31-40 / February10thBells
boundary_surfaces_9 = BoundarySurfaces(Edges=list_item_12)
loft_9 = Loft(
    Curves=[list_item_15, list_item_13],
    Options={Adjust=False, Closed=False, LoftEnds=0, LoftSimp=0, LoftType=0, Rebuild=10, Refit=0.01})
loft_10 = Loft(
    Curves=[list_item_16, list_item_14],
    Options={Adjust=False, Closed=False, LoftEnds=0, LoftSimp=0, LoftType=0, Rebuild=10, Refit=0.01})
brep_3 = Brep(brep)
brep_4 = Brep(brep_2)

# ---- group: MasterScriptFiles_2022_ten_31-40 / Random_WSII_2019
number_slider_45 = Slider(2.5, range=0..10)  # disabled
number_slider_46 = Slider(13.8, range=0..100)  # disabled
number_slider_47 = Slider(174, range=0..1000)  # disabled
number_slider_48 = Slider(1.67, range=0..2)  # disabled
number_slider_49 = Slider(1, range=0..100)  # disabled
construct_domain_4 = ConstructDomain(DomainStart=number_slider_45, DomainEnd=number_slider_46)  # disabled
number_slider_50 = Slider(24.2, range=0..100)  # disabled
number_slider_51 = Slider(6, range=0..100)  # disabled
random = Random(Range=construct_domain_4, Number=number_slider_49, Seed=number_slider_47)  # disabled
pi_5 = Pi(Factor=number_slider_48)  # disabled
number_slider_52 = Slider(12, range=0..100)  # disabled
unit_z_8 = UnitZ(Factor=number_slider_51)  # disabled
arc_2 = Arc(Plane=PlaneXY(0, 0, 0), Radius=random, Angle=pi_5)  # -> Arc, Length; disabled
extrude_5 = Extrude(Base=arc_2.Arc, Direction=unit_z_8)  # disabled
md_slider_2 = MDSlider(
    SliderMode=0,
    slider_value=Point(0.4095533417, 0.3394611638, 0.5),
    x_domain=Domain(0, 1),
    y_domain=Domain(0, 1),
    z_domain=Domain(0, 1))  # disabled
divide_domain² = DivideDomain²(Domain=extrude_5, UCount=number_slider_52, VCount=number_slider_52)  # disabled
isotrim = Isotrim(Surface=extrude_5, Domain=divide_domain²)  # disabled
list_length_2 = ListLength(List=isotrim)  # disabled
evaluate_surface_2 = EvaluateSurface(Surface=reparameterize(isotrim), Point=md_slider_2)  # -> Point, Normal, UDirection, VDirection, Frame; disabled
vector = Vector(evaluate_surface_2.Normal)  # disabled
colour_swatch = ColourSwatch(SwatchColor=RGB(59, 44, 65))  # disabled
colour_swatch_2 = ColourSwatch(SwatchColor=RGB(225, 204, 65))  # disabled

number_slider_53 = Slider(0, range=0..10)  # disabled
number_slider_54 = Slider(2, range=0..2)  # disabled
number_slider_55 = Slider(531, range=0..1000)  # disabled
construct_domain_5 = ConstructDomain(DomainStart=number_slider_53, DomainEnd=number_slider_54)  # disabled
number_slider_56 = Slider(14, range=0..100)  # disabled
random_2 = Random(Range=construct_domain_5, Number=list_length_2, Seed=number_slider_55)  # disabled

multiplication_5 = Multiplication(A=random_2, B=vector)  # disabled
extrude_6 = Extrude(Base=isotrim, Direction=expr("-x", multiplication_5))  # disabled
brep_edges = BrepEdges(Brep=extrude_6)  # -> Naked, Interior, NonManifold; disabled
custom_preview = CustomPreview(Geometry=extrude_6, Material=colour_swatch)  # disabled
custom_preview_2 = CustomPreview(Geometry=brep_edges.Interior, Material=colour_swatch_2)  # disabled

# ---- group: MasterScriptFiles_2022_ten_31-40 / February10thBREAKTHROUGH2.0
md_slider_3 = MDSlider(SliderMode=0, slider_value=Point(1, 0.5, 0.5), x_domain=Domain(0, 1), y_domain=Domain(0, 1), z_domain=Domain(0, 1))  # disabled
md_slider_4 = MDSlider(
    SliderMode=0,
    slider_value=Point(0, 0.4756097561, 0.5),
    x_domain=Domain(0, 1),
    y_domain=Domain(0, 1),
    z_domain=Domain(0, 1))  # disabled
number_slider_57 = Slider(82, range=0..100)  # disabled
number_slider_58 = Slider(0.51, range=0.1..2)  # disabled
number_slider_59 = Slider(4, range=0..10)  # disabled
number_slider_60 = Slider(8, range=0..100)  # disabled
number_slider_61 = Slider(6, range=0..100)  # disabled
number_slider_62 = Slider(0.36, range=0..2)  # disabled
number_slider_63 = Slider(57, range=0..100)  # disabled
number_slider_64 = Slider(5, range=0..10)  # disabled
number_slider_65 = Slider(9, range=0..100)  # disabled
number_slider_66 = Slider(1.64, range=0..2)  # disabled
construct_point_5 = ConstructPoint(XCoordinate=0, YCoordinate=0, ZCoordinate=number_slider_59)  # disabled
number_slider_67 = Slider(10, range=0..100)  # disabled
number_slider_68 = Slider(20, range=0..30)  # disabled
number_slider_69 = Slider(10, range=0..10)  # disabled
number_slider_70 = Slider(4.05, range=0..5)  # disabled
number_slider_71 = Slider(10, range=0..10)  # disabled
unit_z_9 = UnitZ(Factor=number_slider_60)  # disabled
plane_normal = PlaneNormal(Origin=construct_point_5, ZAxis=Vector(0, 0, 1))  # disabled
rectangle = Rectangle(Plane=plane_normal, XSize=number_slider_65, YSize=number_slider_61, Radius=0)  # -> Rectangle, Length; disabled
negative = Negative(Value=unit_z_9)  # disabled
area_10 = Area(Geometry=rectangle.Rectangle)  # -> Area, Centroid; disabled
number_slider_72 = Slider(1, range=0..1)  # disabled
explode_2 = Explode(Curve=rectangle.Rectangle, Recursive=True)  # -> Segments, Vertices; disabled
point_on_curve_2 = PointOnCurve(explode_2.Segments, parameter=1)  # disabled
explode_3 = Explode(Curve=rectangle.Rectangle, Recursive=True)  # -> Segments, Vertices; disabled
unit_z_10 = UnitZ(Factor=number_slider_57)  # disabled
move_24 = Move(Geometry=explode_3.Vertices, Motion=negative)  # -> Geometry, Transform; disabled
pi_6 = Pi(Factor=number_slider_66)  # disabled
perp_frames = PerpFrames(Curve=explode_2.Segments, Count=number_slider_72, Align=True)  # -> Frames, Parameters; disabled
move_25 = Move(Geometry=point_on_curve_2, Motion=unit_z_10)  # -> Geometry, Transform; disabled
rotate_plane = RotatePlane(Plane=perp_frames.Frames, Angle=pi_6)  # disabled
deconstruct_plane = DeconstructPlane(Plane=rotate_plane)  # -> Origin, XAxis, YAxis, ZAxis; disabled
polyline = PolyLine(Vertices=move_25.Geometry, Closed=True)  # disabled
polyline_2 = PolyLine(Vertices=move_24.Geometry, Closed=False)  # disabled
line_sdl_2 = LineSDL(Start=deconstruct_plane.Origin, Direction=deconstruct_plane.XAxis, Length=number_slider_63)  # disabled
line_2 = Line(StartPoint=deconstruct_plane.Origin, EndPoint=move_25.Geometry)  # disabled
explode_4 = Explode(Curve=polyline_2, Recursive=True)  # -> Segments, Vertices; disabled
end_points = EndPoints(Curve=line_sdl_2)  # -> Start, End; disabled
line_3 = Line(StartPoint=end_points.End, EndPoint=move_25.Geometry)  # disabled
unit_z_11 = UnitZ(Factor=number_slider_67)  # disabled
scale_11 = Scale(Geometry=explode_4.Vertices, Center=area_10.Centroid, Factor=number_slider_64)  # -> Geometry, Transform; disabled
unit_z_12 = UnitZ(Factor=1)  # disabled
line_4 = Line(StartPoint=explode_3.Vertices, EndPoint=scale_11.Geometry)  # disabled
negative_2 = Negative(Value=unit_z_11)  # disabled
polyline_3 = PolyLine(Vertices=scale_11.Geometry, Closed=False)  # disabled
patch = Patch(Curves=polyline_3, Spans=20, Flexibility=1, Trim=True)  # disabled
patch_2 = Patch(Curves=explode_3.Segments, Spans=20, Flexibility=1, Trim=True)  # disabled
number_slider_73 = Slider(2, range=0..6)  # disabled
unit_x_6 = UnitX(Factor=1)  # disabled
unit_y = UnitY(Factor=1)  # disabled
pi_7 = Pi(Factor=number_slider_70)  # disabled
number_slider_74 = Slider(1, range=0..1)  # disabled
unit_z_13 = UnitZ(Factor=1)  # disabled
extrude_7 = Extrude(Base=geometry_2, Direction=unit_z_13)  # disabled
cap_holes_6 = CapHoles(Brep=extrude_7)  # disabled
deconstruct_brep_5 = DeconstructBrep(Brep=cap_holes_6)  # -> Faces, Edges, Vertices; disabled
list_item_18 = ListItem(List=deconstruct_brep_5.Faces, Index=0, Wrap=True)  # disabled
list_item_19 = ListItem(List=deconstruct_brep_5.Faces, Index=number_slider_74, Wrap=True)  # disabled
area_11 = Area(Geometry=list_item_18)  # -> Area, Centroid; disabled
area_12 = Area(Geometry=list_item_19)  # -> Area, Centroid; disabled
line_5 = Line(StartPoint=area_11.Centroid, EndPoint=area_12.Centroid)  # disabled

extrude_8 = Extrude(Base=patch, Direction=negative_2)  # disabled
extrude_9 = Extrude(Base=patch_2, Direction=unit_z_12)  # disabled

deconstruct_brep_6 = DeconstructBrep(Brep=extrude_8)  # -> Faces, Edges, Vertices; disabled
list_item_20 = ListItem(List=deconstruct_brep_6.Faces, Index=number_slider_73, Wrap=True)  # disabled
evaluate_surface_3 = EvaluateSurface(Surface=list_item_20, Point=[md_slider_3, md_slider_4])  # -> Point, Normal, Frame; disabled
circle_cnr_4 = CircleCNR(Center=evaluate_surface_3.Point, Normal=unit_x_6, Radius=number_slider_68)  # disabled
rotate_3d_6 = Rotate3D(Geometry=circle_cnr_4, Angle=expr("-x", pi_7), Center=evaluate_surface_3.Point, Axis=unit_y)  # -> Geometry, Transform; disabled
rotate_3d_7 = Rotate3D(Geometry=circle_cnr_4, Angle=pi_7, Center=evaluate_surface_3.Point, Axis=unit_y)  # -> Geometry, Transform; disabled
dispatch = Dispatch(List=rotate_3d_7.Geometry, DispatchPattern=[True, False])  # -> ListA, ListB; disabled
dispatch_2 = Dispatch(List=rotate_3d_6.Geometry, DispatchPattern=[True, False])  # -> ListA, ListB; disabled
area_13 = Area(Geometry=dispatch_2.ListB)  # -> Area, Centroid; disabled
area_14 = Area(Geometry=dispatch.ListA)  # -> Area, Centroid; disabled
geometry_3 = Geometry(dispatch_2.ListA)  # disabled
geometry_4 = Geometry(dispatch.ListB)  # disabled
line_6 = Line(StartPoint=area_14.Centroid, EndPoint=area_13.Centroid)  # disabled
divide_curve_2 = DivideCurve(Curve=geometry_4, Count=number_slider_69, Kinks=False)  # -> Points, Tangents, Parameters; disabled
divide_curve_3 = DivideCurve(Curve=geometry_3, Count=number_slider_69, Kinks=False)  # -> Points, Tangents, Parameters; disabled
line_7 = Line(StartPoint=divide_curve_2.Points, EndPoint=area_13.Centroid)  # disabled
line_8 = Line(StartPoint=divide_curve_3.Points, EndPoint=area_14.Centroid)  # disabled

flow = Flow(Geometry=cap_holes_6, Base=line_5, Target=geometry_4, ReverseBase=False, ReverseTarget=False, Stretch=True, Rigid=False)  # disabled
flow_2 = Flow(Geometry=cap_holes_6, Base=line_5, Target=geometry_3, ReverseBase=False, ReverseTarget=False, Stretch=True, Rigid=False)  # disabled

pipe = Pipe(Curve=line_4, Radius=expr("2*x", number_slider_58), Caps=0)  # disabled
pipe_2 = Pipe(Curve=[line_8, line_7], Radius=number_slider_58, Caps=0)  # disabled
pipe_3 = Pipe(Curve=line_3, Radius=number_slider_58, Caps=0)  # disabled
pipe_4 = Pipe(Curve=line_2, Radius=number_slider_58, Caps=0)  # disabled
pipe_5 = Pipe(Curve=line_6, Radius=number_slider_71, Caps=0)  # disabled
