# Grasshopper definition Light_MasterScriptFiles_2022_ten_41-50.gh (Grasshopper 1.0.7)
# plug-ins: Bifocals, Pufferfish

# ---- group: Vegetationline / ADJUST ME
line_density_ofpoints = Slider(463, range=0..1000)  # disabled
crv_width_amplitude_max = Slider(0.33, range=0..3)  # disabled
crv_width_amplitude_min = Slider(0.219, range=0..3)  # disabled
rng_seed = Slider(123, range=0..300)  # disabled
minmax_rotation_angle = Slider(19, range=0..60)  # disabled

# ---- group: HornsWSII001
number_slider = Slider(24, range=0..100)  # disabled
number_slider_2 = Slider(23, range=0..100)  # disabled
number_slider_3 = Slider(0, range=0..2)  # disabled
number_slider_4 = Slider(1.94, range=0.1..2)  # disabled
number_slider_5 = Slider(1.53, range=0.1..2)  # disabled
number_slider_6 = Slider(0.55, range=0.1..1)  # disabled
number_slider_7 = Slider(4, range=0..100)  # disabled
pl = ConstructPlane(Origin=Point(0, 0, 0), XAxis=Vector(-0.6663495754, 0, 2.521591296), YAxis=Vector(3.98524537, 2.82605431, 0))  # disabled
range = Range(Domain=number_slider, Steps=number_slider_2)  # disabled
cos = Cosine(Value=range)  # disabled
sin = Sine(Value=range)  # disabled
pt = ConstructPoint(XCoordinate=range, YCoordinate=sin, ZCoordinate=cos)  # disabled
pi = Pi(Factor=expr("-x", number_slider_3))  # disabled
intcrv = Interpolate(Vertices=pt, Degree=3, Periodic=False, KnotStyle=1)  # -> Curve, Length, Domain; disabled
pi_2 = Pi(Factor=number_slider_6)  # disabled
ellipse = Ellipse(Plane=PlaneXY(0, 0, 0), Radius1=number_slider_4, Radius2=number_slider_5)  # -> Ellipse, Focus1, Focus2; disabled
yz = YZPlane(Origin=Point(0, 0, 0))  # disabled
rotate = Rotate(Geometry=intcrv.Curve, Angle=pi, Plane=pl)  # -> Geometry, Transform; disabled
rotate_2 = Rotate(Geometry=ellipse.Ellipse, Angle=pi_2, Plane=yz)  # -> Geometry, Transform; disabled
swp1 = Sweep1(Rail=rotate.Geometry, Sections=rotate_2.Geometry, Miter=1)  # disabled
cap = CapHoles(Brep=swp1)  # disabled
xz = XZPlane(Origin=Point(0, 0, 0))  # disabled
mirror = Mirror(Geometry=cap, Plane=PlaneYZ(0, 0, 0))  # -> Geometry, Transform; disabled
Y = UnitY(Factor=number_slider_7)  # disabled
join = BrepJoin(Breps=[cap, mirror.Geometry])  # -> Breps, Closed; disabled
move = Move(Geometry=join.Breps, Motion=expr("-x", Y))  # -> Geometry, Transform; disabled
mirror_2 = Mirror(Geometry=move.Geometry, Plane=xz)  # -> Geometry, Transform; disabled
join_2 = BrepJoin(Breps=[mirror_2.Geometry, move.Geometry])  # -> Breps, Closed; disabled

# ---- group: TimberLogSim
jitter = Slider(658, range=0..1000)  # disabled
timber_length = Slider(10, range=0..100)  # disabled
timber_length2 = Slider(29, range=0..100)  # disabled
shape = Slider(63, range=0..100)  # disabled
timber_dia = Slider(8, range=0..8)  # disabled
number_slider_8 = Slider(7.321, range=0.2..10)  # disabled
number_slider_9 = Slider(6.995, range=0.2..10)  # disabled

# ---- group: February24th003
md_slider = MDSlider(
    SliderMode=0,
    slider_value=Point(0.452940592, 0.2833352438, 0.5),
    x_domain=Domain(0, 1),
    y_domain=Domain(0, 1),
    z_domain=Domain(0, 1))  # disabled
number_slider_10 = Slider(42, range=0..100)  # disabled
number_slider_11 = Slider(9, range=0..10)  # disabled
number_slider_12 = Slider(26, range=0..100)  # disabled
md_slider_2 = MDSlider(SliderMode=0, slider_value=Point(0, 0, 0.5), x_domain=Domain(0, 1), y_domain=Domain(0, 1), z_domain=Domain(0, 1))  # disabled
unit_z = UnitZ(Factor=1)  # disabled
line_sdl = LineSDL(Start=Point(0, 0, 0), Direction=unit_z, Length=number_slider_10)  # disabled
sequence = Sequence(Notation="[N-1] + [N-2]", Length=expr("x+1", number_slider_11), Initial=[1, 1])  # disabled
md_slider_3 = MDSlider(SliderMode=0, slider_value=Point(0, 1, 0.5), x_domain=Domain(0, 1), y_domain=Domain(0, 1), z_domain=Domain(0, 1))  # disabled
md_slider_4 = MDSlider(SliderMode=0, slider_value=Point(1, 1, 0.5), x_domain=Domain(0, 1), y_domain=Domain(0, 1), z_domain=Domain(0, 1))  # disabled
divide_curve = DivideCurve(Curve=line_sdl, Count=number_slider_11, Kinks=False)  # -> Points, Tangents, Parameters; disabled
number_slider_13 = Slider(1, range=0..1)  # disabled
unit_x = UnitX(Factor=sequence)  # disabled
move_2 = Move(Geometry=divide_curve.Points, Motion=expr("-x", unit_x))  # -> Geometry, Transform; disabled
move_3 = Move(Geometry=divide_curve.Points, Motion=unit_x)  # -> Geometry, Transform; disabled
perp_frame = PerpFrame(Curve=line_sdl, Parameter=number_slider_13)  # disabled
interpolate = Interpolate(Vertices=move_3.Geometry, Degree=3, Periodic=False, KnotStyle=1)  # -> Curve, Length, Domain; disabled
interpolate_2 = Interpolate(Vertices=move_2.Geometry, Degree=3, Periodic=False, KnotStyle=1)  # -> Curve, Length, Domain; disabled
loft = Loft(
    Curves=[interpolate.Curve, interpolate_2.Curve],
    Options={Adjust=False, Closed=False, LoftEnds=0, LoftSimp=0, LoftType=0, Rebuild=10, Refit=0.01})  # disabled
mirror_3 = Mirror(Geometry=loft, Plane=perp_frame)  # -> Geometry, Transform; disabled
evaluate_surface = EvaluateSurface(Surface=reparameterize(mirror_3.Geometry), Point=md_slider_2)  # -> Point, Normal, UDirection, VDirection, Frame; disabled
evaluate_surface_2 = EvaluateSurface(Surface=reparameterize(mirror_3.Geometry), Point=md_slider)  # -> Point, Normal, UDirection, VDirection, Frame; disabled
surface = Surface([loft, mirror_3.Geometry])  # disabled
unit_y = UnitY(Factor=number_slider_12)  # disabled
move_4 = Move(Geometry=evaluate_surface_2.Point, Motion=unit_y)  # -> Geometry, Transform; disabled
arc_3pt = Arc3Pt(PointA=Point(0, 0, 0), PointB=move_4.Geometry, PointC=evaluate_surface.Point)  # -> Arc, Plane, Radius; disabled
bend_deform = BendDeform(Geometry=surface, BendingArc=arc_3pt.Arc)  # disabled
evaluate_surface_3 = EvaluateSurface(Surface=reparameterize(bend_deform), Point=md_slider_3)  # -> Point, Normal, UDirection, VDirection, Frame; disabled
evaluate_surface_4 = EvaluateSurface(Surface=reparameterize(surface), Point=md_slider_4)  # -> Point, Normal, UDirection, VDirection, Frame; disabled
evaluate_surface_5 = EvaluateSurface(Surface=reparameterize(bend_deform), Point=md_slider_4)  # -> Point, Normal, UDirection, VDirection, Frame; disabled
evaluate_surface_6 = EvaluateSurface(Surface=reparameterize(surface), Point=md_slider_3)  # -> Point, Normal, UDirection, VDirection, Frame; disabled
number_slider_14 = Slider(0.01, range=0.01..1)  # disabled
number_slider_15 = Slider(81, range=0..100)  # disabled
line = Line(StartPoint=evaluate_surface_4.Point, EndPoint=evaluate_surface_5.Point)  # disabled
line_2 = Line(StartPoint=evaluate_surface_6.Point, EndPoint=evaluate_surface_3.Point)  # disabled
number_slider_16 = Slider(10, range=0..10)  # disabled
dispatch = Dispatch(List=line, DispatchPattern=[True, False])  # -> ListA, ListB; disabled
dispatch_2 = Dispatch(List=line_2, DispatchPattern=[True, False])  # -> ListA, ListB; disabled
construct_domain = ConstructDomain(DomainStart=number_slider_14, DomainEnd=number_slider_15)  # disabled
loft_2 = Loft(
    Curves=[dispatch_2.ListA, dispatch.ListA],
    Options={Adjust=False, Closed=False, LoftEnds=0, LoftSimp=0, LoftType=0, Rebuild=10, Refit=0.01})  # disabled
range_2 = Range(Domain=construct_domain, Steps=number_slider_16)  # disabled
offset_surface = OffsetSurface(Surface=bend_deform, Distance=expr("-x", range_2), Retrim=True)  # disabled
extrude = Extrude(Base=offset_surface, Direction=expr("x*5", evaluate_surface_3.Normal))  # disabled

# ----
point_x = Slider(38, range=0..100)  # disabled
point_y = Slider(35, range=0..100)  # disabled
point_z = Slider(68, range=0..100)  # disabled

# ----
# Play
length = Slider(0.211, range=0..1)  # disabled
length_2 = Slider(481, range=0..1000)  # disabled
amp = Slider(19, range=0..100)  # disabled
number_coils = Slider(6, range=1..6)  # disabled
pipe_radii = Slider(0.12, range=0..2)  # disabled

# ---- group: Vegetationline / ASSIGN ME / Base curve from Vectorworks
crv = Curve(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)  # disabled

# ---- group: February10thBells2
number_slider_17 = Slider(21, range=0..100)  # disabled
number_slider_18 = Slider(38, range=0..100)  # disabled
circle_cnr = CircleCNR(Center=Point(0, 0, 0), Normal=Vector(0, 0, 1), Radius=number_slider_17)  # disabled
construct_domain_2 = ConstructDomain(DomainStart=0, DomainEnd=number_slider_18)  # disabled
curve = Curve(reparameterize(circle_cnr))  # disabled
range_3 = Range(Domain=construct_domain_2, Steps=10)  # disabled
unit_z_2 = UnitZ(Factor=range_3)  # disabled
move_5 = Move(Geometry=curve, Motion=unit_z_2)  # -> Geometry, Transform; disabled
list_length = ListLength(List=move_5.Geometry)  # disabled
split_list = SplitList(List=move_5.Geometry, Index=expr("x/2", list_length))  # -> ListA, ListB; disabled
area = Area(Geometry=split_list.ListA)  # -> Area, Centroid; disabled
area_2 = Area(Geometry=split_list.ListB)  # -> Area, Centroid; disabled
curve_closest_point = CurveClosestPoint(Point=area_2.Centroid, Curve=curve)  # -> Point, Parameter, Distance; disabled
curve_closest_point_2 = CurveClosestPoint(Point=area.Centroid, Curve=curve)  # -> Point, Parameter, Distance; disabled
distance = Distance(PointA=area.Centroid, PointB=curve_closest_point_2.Point)  # disabled
distance_2 = Distance(PointA=area_2.Centroid, PointB=curve_closest_point.Point)  # disabled
number_slider_19 = Slider(0.91, range=0..1)  # disabled
number_slider_20 = Slider(0.91, range=0..1)  # disabled
number_slider_21 = Slider(0.17, range=-1..1)  # disabled
number_slider_22 = Slider(0.17, range=-1..1)  # disabled
bounds = Bounds(Numbers=distance_2)  # disabled
bounds_2 = Bounds(Numbers=distance)  # disabled
construct_domain_3 = ConstructDomain(DomainStart=number_slider_19, DomainEnd=number_slider_21)  # disabled
graph_mapper = GraphMapper(construct_domain_3, x0=0, x1=1, y0=0, y1=1, Cx=0.1889763772, Cy=0.6642599106, container_name="Conic")  # disabled
construct_domain_4 = ConstructDomain(DomainStart=number_slider_20, DomainEnd=number_slider_22)  # disabled
graph_mapper_2 = GraphMapper(
    construct_domain_4,
    x0=0,
    x1=1,
    y0=0,
    y1=1,
    Ox=0.505084753,
    Oy=0.1301587224,
    Px=0.6474575996,
    Py=0.3206349015,
    container_name="Parabola")  # disabled
number_slider_23 = Slider(14, range=0..100)  # disabled
remap_numbers = RemapNumbers(Value=distance_2, Source=bounds, Target=graph_mapper)  # -> Mapped, Clipped; disabled
remap_numbers_2 = RemapNumbers(Value=distance, Source=bounds_2, Target=graph_mapper_2)  # -> Mapped, Clipped; disabled
scale = Scale(Geometry=split_list.ListA, Center=area.Centroid, Factor=remap_numbers_2.Mapped)  # -> Geometry, Transform; disabled
scale_2 = Scale(Geometry=split_list.ListB, Center=area.Centroid, Factor=remap_numbers.Mapped)  # -> Geometry, Transform; disabled
unit_z_3 = UnitZ(Factor=number_slider_23)  # disabled
move_6 = Move(Geometry=scale_2.Geometry, Motion=unit_z_3)  # -> Geometry, Transform; disabled
loft_3 = Loft(
    Curves=[scale.Geometry, move_6.Geometry],
    Options={Adjust=False, Closed=False, LoftEnds=0, LoftSimp=0, LoftType=0, Rebuild=10, Refit=0.01})  # disabled
number_slider_24 = Slider(0, range=0..100)  # disabled
number_slider_25 = Slider(1, range=0..1)  # disabled
reverse_list = ReverseList(List=move_6.Geometry)  # disabled
surface_2 = Surface(loft_3)  # disabled
offset = Offset(Surface=surface_2, Distance=expr("-x", number_slider_25), Retrim=True)  # disabled
list_item = ListItem(List=reverse_list, Index=number_slider_24, Wrap=True)  # disabled
brep = Brep(loft_3)  # disabled
brep_2 = Brep(offset)  # disabled
deconstruct_brep = DeconstructBrep(Brep=brep_2)  # -> Faces, Edges, Vertices; disabled
deconstruct_brep_2 = DeconstructBrep(Brep=brep)  # -> Faces, Edges, Vertices; disabled
number_slider_26 = Slider(2, range=0..10)  # disabled
number_slider_27 = Slider(1, range=0..10)  # disabled
list_item_2 = ListItem(List=deconstruct_brep_2.Edges, Index=number_slider_26, Wrap=True)  # disabled
list_item_3 = ListItem(List=deconstruct_brep_2.Edges, Index=number_slider_27, Wrap=True)  # disabled
list_item_4 = ListItem(List=deconstruct_brep.Edges, Index=number_slider_26, Wrap=True)  # disabled
list_item_5 = ListItem(List=deconstruct_brep.Edges, Index=number_slider_27, Wrap=True)  # disabled

# ---- group: February 9th
rotprepframes2 = Slider(0.75, range=0..2)  # disabled
rotprepframes3 = Slider(0.78, range=0..2)  # disabled
lentoptierlines = Slider(46, range=0..100)  # disabled
heightcentroide = Slider(54, range=0..100)  # disabled
radiusbasecir = Slider(13, range=0..100)  # disabled
dividecrv = Slider(10, range=0..10)  # disabled
lenmidlines = Slider(30, range=0..100)  # disabled
radtoptiercir = Slider(14, range=0..100)  # disabled
lenbaselines = Slider(11, range=0..100)  # disabled
lentoplines = Slider(78, range=0..100)  # disabled
rotbasecir = Slider(0.36, range=0..1)  # disabled
rotperpframes = Slider(0.68, range=0..2)  # disabled

# ----
construct_point = ConstructPoint(XCoordinate=point_x, YCoordinate=point_y, ZCoordinate=point_z)  # disabled
unit_x_2 = UnitX(Factor=1)  # disabled
start = Start(Point(0, 0, 0))  # disabled
arc_sed = ArcSED(Start=start, End=construct_point, Direction=unit_x_2)  # -> Arc, Plane, Radius; disabled

series = Series(Start=0, Step=length, Count=length_2)  # disabled
sine = Sine(Value=series)  # disabled
cosine = Cosine(Value=series)  # disabled
multiplication = Multiplication(A=sine, B=amp)  # disabled
multiplication_2 = Multiplication(A=cosine, B=amp)  # disabled
construct_point_2 = ConstructPoint(XCoordinate=series, YCoordinate=multiplication, ZCoordinate=multiplication_2)  # disabled
yz_plane = YZPlane(Origin=Point(0, 0, 0))  # disabled
interpolate_3 = Interpolate(Vertices=construct_point_2, Degree=3, Periodic=False, KnotStyle=1)  # -> Curve, Length, Domain; disabled
polar_array = PolarArray(Geometry=interpolate_3.Curve, Plane=yz_plane, Count=number_coils, Angle=6.283185307)  # -> Geometry, Transform; disabled

# ---- group: Vegetationline
negative = Negative(Value=crv_width_amplitude_max)  # disabled

# ---- group: February10thBREAKTHROUGH
# Create a cool closed curve in Rhino for Wheel rail
geometry = Geometry(<curve referenced from the Rhino model>)  # disabled

number_slider_28 = Slider(9, range=0..10)  # disabled
number_slider_29 = Slider(16, range=0..100)  # disabled
number_slider_30 = Slider(29, range=0..100)  # disabled
number_slider_31 = Slider(0.24, range=0.1..2)  # disabled
number_slider_32 = Slider(15, range=0..100)  # disabled
number_slider_33 = Slider(1, range=0..1)  # disabled
number_slider_34 = Slider(0.02, range=0..2)  # disabled
number_slider_35 = Slider(57, range=0..100)  # disabled
md_slider_5 = MDSlider(SliderMode=0, slider_value=Point(0, 0, 0.5), x_domain=Domain(0, 1), y_domain=Domain(0, 1), z_domain=Domain(0, 1))  # disabled
number_slider_36 = Slider(1, range=0..10)  # disabled
md_slider_6 = MDSlider(SliderMode=0, slider_value=Point(1, 1, 0.5), x_domain=Domain(0, 1), y_domain=Domain(0, 1), z_domain=Domain(0, 1))  # disabled
number_slider_37 = Slider(8, range=0..100)  # disabled
number_slider_38 = Slider(2, range=0..6)  # disabled
construct_point_3 = ConstructPoint(XCoordinate=0, YCoordinate=0, ZCoordinate=number_slider_28)  # disabled
unit_z_4 = UnitZ(Factor=number_slider_32)  # disabled
plane_normal = PlaneNormal(Origin=construct_point_3, ZAxis=Vector(0, 0, 1))  # disabled
number_slider_39 = Slider(19, range=0..30)  # disabled
number_slider_40 = Slider(1, range=0..1)  # disabled
number_slider_41 = Slider(2.05, range=0..5)  # disabled
rectangle = Rectangle(Plane=plane_normal, XSize=number_slider_29, YSize=number_slider_29, Radius=0)  # -> Rectangle, Length; disabled
negative_2 = Negative(Value=unit_z_4)  # disabled
area_3 = Area(Geometry=rectangle.Rectangle)  # -> Area, Centroid; disabled
number_slider_42 = Slider(15, range=0..100)  # disabled
explode = Explode(Curve=rectangle.Rectangle, Recursive=True)  # -> Segments, Vertices; disabled
point_on_curve = PointOnCurve(explode.Segments, parameter=1)  # disabled
explode_2 = Explode(Curve=rectangle.Rectangle, Recursive=True)  # -> Segments, Vertices; disabled
number_slider_43 = Slider(6, range=0..10)  # disabled
number_slider_44 = Slider(6, range=0..10)  # disabled
unit_z_5 = UnitZ(Factor=number_slider_30)  # disabled
move_7 = Move(Geometry=explode_2.Vertices, Motion=negative_2)  # -> Geometry, Transform; disabled
pi_3 = Pi(Factor=number_slider_34)  # disabled
perp_frames = PerpFrames(Curve=explode.Segments, Count=number_slider_33, Align=True)  # -> Frames, Parameters; disabled
negative_3 = Negative(Value=number_slider_42)  # disabled
move_8 = Move(Geometry=point_on_curve, Motion=unit_z_5)  # -> Geometry, Transform; disabled
rotate_plane = RotatePlane(Plane=perp_frames.Frames, Angle=pi_3)  # disabled
deconstruct_plane = DeconstructPlane(Plane=rotate_plane)  # -> Origin, XAxis, YAxis, ZAxis; disabled
polyline = PolyLine(Vertices=move_8.Geometry, Closed=True)  # disabled
polyline_2 = PolyLine(Vertices=move_7.Geometry, Closed=False)  # disabled
line_sdl_2 = LineSDL(Start=deconstruct_plane.Origin, Direction=deconstruct_plane.XAxis, Length=number_slider_35)  # disabled
line_3 = Line(StartPoint=deconstruct_plane.Origin, EndPoint=move_8.Geometry)  # disabled
explode_3 = Explode(Curve=polyline_2, Recursive=True)  # -> Segments, Vertices; disabled
end_points = EndPoints(Curve=line_sdl_2)  # -> Start, End; disabled
line_4 = Line(StartPoint=end_points.End, EndPoint=move_8.Geometry)  # disabled
scale_3 = Scale(Geometry=explode_3.Vertices, Center=area_3.Centroid, Factor=number_slider_36)  # -> Geometry, Transform; disabled
unit_z_6 = UnitZ(Factor=number_slider_37)  # disabled
unit_z_7 = UnitZ(Factor=1)  # disabled
line_5 = Line(StartPoint=explode_2.Vertices, EndPoint=scale_3.Geometry)  # disabled
negative_4 = Negative(Value=unit_z_6)  # disabled
polyline_3 = PolyLine(Vertices=scale_3.Geometry, Closed=False)  # disabled
pipe = Pipe(Curve=line_5, Radius=expr("2*x", number_slider_31), Caps=0)  # disabled
pipe_2 = Pipe(Curve=line_4, Radius=number_slider_31, Caps=0)  # disabled
pipe_3 = Pipe(Curve=line_3, Radius=number_slider_31, Caps=0)  # disabled
patch = Patch(Curves=polyline_3, Spans=20, Flexibility=1, Trim=True)  # disabled
patch_2 = Patch(Curves=explode_2.Segments, Spans=20, Flexibility=1, Trim=True)  # disabled
extrude_2 = Extrude(Base=patch_2, Direction=unit_z_7)  # disabled
extrude_3 = Extrude(Base=patch, Direction=negative_4)  # disabled
deconstruct_brep_3 = DeconstructBrep(Brep=extrude_3)  # -> Faces, Edges, Vertices; disabled
list_item_6 = ListItem(List=deconstruct_brep_3.Faces, Index=number_slider_38, Wrap=True)  # disabled
evaluate_surface_7 = EvaluateSurface(Surface=list_item_6, Point=[md_slider_5, md_slider_6])  # -> Point, Normal, Frame; disabled
unit_x_3 = UnitX(Factor=1)  # disabled
unit_y_2 = UnitY(Factor=1)  # disabled
circle_cnr_2 = CircleCNR(Center=evaluate_surface_7.Point, Normal=unit_x_3, Radius=number_slider_39)  # disabled
pi_4 = Pi(Factor=number_slider_41)  # disabled
rotate_3d = Rotate3D(Geometry=circle_cnr_2, Angle=expr("-x", pi_4), Center=evaluate_surface_7.Point, Axis=unit_y_2)  # -> Geometry, Transform; disabled
rotate_3d_2 = Rotate3D(Geometry=circle_cnr_2, Angle=pi_4, Center=evaluate_surface_7.Point, Axis=unit_y_2)  # -> Geometry, Transform; disabled
unit_z_8 = UnitZ(Factor=1)  # disabled
dispatch_3 = Dispatch(List=rotate_3d_2.Geometry, DispatchPattern=[True, False])  # -> ListA, ListB; disabled
dispatch_4 = Dispatch(List=rotate_3d.Geometry, DispatchPattern=[True, False])  # -> ListA, ListB; disabled
extrude_4 = Extrude(Base=geometry, Direction=unit_z_8)  # disabled
area_4 = Area(Geometry=dispatch_4.ListB)  # -> Area, Centroid; disabled
area_5 = Area(Geometry=dispatch_3.ListA)  # -> Area, Centroid; disabled
geometry_2 = Geometry(dispatch_4.ListA)  # disabled
geometry_3 = Geometry(dispatch_3.ListB)  # disabled
cap_holes = CapHoles(Brep=extrude_4)  # disabled
deconstruct_brep_4 = DeconstructBrep(Brep=cap_holes)  # -> Faces, Edges, Vertices; disabled
list_item_7 = ListItem(List=deconstruct_brep_4.Faces, Index=0, Wrap=True)  # disabled
list_item_8 = ListItem(List=deconstruct_brep_4.Faces, Index=number_slider_40, Wrap=True)  # disabled
line_6 = Line(StartPoint=area_5.Centroid, EndPoint=area_4.Centroid)  # disabled
area_6 = Area(Geometry=list_item_7)  # -> Area, Centroid; disabled
area_7 = Area(Geometry=list_item_8)  # -> Area, Centroid; disabled
line_7 = Line(StartPoint=area_6.Centroid, EndPoint=area_7.Centroid)  # disabled
flow = Flow(Geometry=cap_holes, Base=line_7, Target=geometry_3, ReverseBase=False, ReverseTarget=False, Stretch=True, Rigid=False)  # disabled
flow_2 = Flow(Geometry=cap_holes, Base=line_7, Target=geometry_2, ReverseBase=False, ReverseTarget=False, Stretch=True, Rigid=False)  # disabled
pipe_4 = Pipe(Curve=line_6, Radius=number_slider_44, Caps=0)  # disabled
divide_curve_2 = DivideCurve(Curve=geometry_3, Count=number_slider_43, Kinks=False)  # -> Points, Tangents, Parameters; disabled
divide_curve_3 = DivideCurve(Curve=geometry_2, Count=number_slider_43, Kinks=False)  # -> Points, Tangents, Parameters; disabled
line_8 = Line(StartPoint=divide_curve_2.Points, EndPoint=area_4.Centroid)  # disabled
line_9 = Line(StartPoint=divide_curve_3.Points, EndPoint=area_5.Centroid)  # disabled
pipe_5 = Pipe(Curve=[line_9, line_8], Radius=number_slider_31, Caps=0)  # disabled

# ---- group: Vegetationline / DONT TOUCH / DENSITY
popgeo = PopulateGeometry(Geometry=crv, Count=line_density_ofpoints, Seed=rng_seed)  # disabled
crv_cp = CurveClosestPoint(Point=popgeo, Curve=crv)  # -> Point, Parameter, Distance; disabled
hframe = HorizontalFrame(Curve=crv, Parameter=crv_cp.Parameter)  # disabled

# ---- group: Vegetationline / DONT TOUCH / CURVE WIDTH
panel = Panel("1000")  # disabled
random = Random(Range=panel, Number=line_density_ofpoints, Seed=rng_seed)  # disabled
dom = ConstructDomain(DomainStart=negative, DomainEnd=crv_width_amplitude_min)  # disabled
panel_2 = Panel("2")  # disabled
random_2 = Random(Range=dom, Number=panel_2, Seed=random)  # disabled
item = ListItem(List=random_2, Index=0, Wrap=True)  # -> Item, Item1; disabled
pt_2 = PointOriented(BasePlane=graft(hframe), UComponent=item.Item, VComponent=item.Item1, WComponent=0)  # -> flatten(Point); disabled

# ---- group: Vegetationline / DONT TOUCH / ROTATION
negative_5 = Negative(Value=minmax_rotation_angle)  # disabled
construct_domain_5 = ConstructDomain(DomainStart=negative_5, DomainEnd=minmax_rotation_angle)  # disabled
random_3 = Random(Range=construct_domain_5, Number=line_density_ofpoints, Seed=rng_seed)  # disabled
line_sdl_3 = LineSDL(Start=crv_cp.Point, Direction=Vector(0, 0, 1), Length=1)  # disabled
rotate_axis = RotateAxis(Geometry=pt_2, Angle=degrees(random_3), Axis=line_sdl_3)  # -> Geometry, Transform; disabled

# ----
# Disconnect and Play
bend_deform_2 = BendDeform(Geometry=polar_array.Geometry, BendingArc=arc_sed.Arc)  # disabled

# ---- group: Vegetationline / DONT TOUCH
sort_along_curve = SortAlongCurve(Points=rotate_axis.Geometry, Curve=crv)  # -> Points, Indices; disabled

# ----
# Pipe and Bake
pipe_6 = Pipe(Curve=bend_deform_2, Radius=pipe_radii, Caps=0)  # disabled

# ---- group: Vegetationline / ADJUST ME
closecrv = BooleanToggle(False)  # disabled
crvdegree_curve_smoothing = Slider(3, range=0..10)  # disabled

# ---- group: Vegetationline / BAKE ME
interpolate_4 = Interpolate(Vertices=sort_along_curve.Points, Degree=crvdegree_curve_smoothing, Periodic=closecrv, KnotStyle=1)  # -> Curve, Length, Domain; disabled

# ---- group: February10thBells2
boundary_surfaces = BoundarySurfaces(Edges=list_item)  # disabled
loft_4 = Loft(
    Curves=[list_item_4, list_item_2],
    Options={Adjust=False, Closed=False, LoftEnds=0, LoftSimp=0, LoftType=0, Rebuild=10, Refit=0.01})  # disabled
loft_5 = Loft(
    Curves=[list_item_5, list_item_3],
    Options={Adjust=False, Closed=False, LoftEnds=0, LoftSimp=0, LoftType=0, Rebuild=10, Refit=0.01})  # disabled
brep_3 = Brep(brep)  # disabled
brep_4 = Brep(brep_2)  # disabled

# ---- group: March1stKlokken
number_slider_45 = Slider(100, range=0..100)  # disabled
number_slider_46 = Slider(6.65, range=0..10)  # disabled
number_slider_47 = Slider(3, range=0..10)  # disabled
number_slider_48 = Slider(38, range=0..100)  # disabled
number_slider_49 = Slider(0.541, range=0..1)  # disabled
number_slider_50 = Slider(68, range=0..100)  # disabled
number_slider_51 = Slider(0.107, range=-0.001..0.2)  # disabled
number_slider_52 = Slider(10, range=0..10)  # disabled
number_slider_53 = Slider(6.14, range=0..10)  # disabled
number_slider_54 = Slider(7.6, range=0..10)  # disabled
number_slider_55 = Slider(22, range=0..100)  # disabled
number_slider_56 = Slider(22, range=0..100)  # disabled
number_slider_57 = Slider(7, range=0..10)  # disabled
number_slider_58 = Slider(1, range=0..1)  # disabled
number_slider_59 = Slider(1.22, range=0..2)  # disabled
number_slider_60 = Slider(5.7, range=0..10)  # disabled
number_slider_61 = Slider(0.66, range=0..1)  # disabled
number_slider_62 = Slider(8, range=0..10)  # disabled
number_slider_63 = Slider(18, range=0..100)  # disabled
number_slider_64 = Slider(19, range=0..100)  # disabled
number_slider_65 = Slider(5, range=0..10)  # disabled
number_slider_66 = Slider(11, range=0..100)  # disabled
number_slider_67 = Slider(13, range=0..100)  # disabled
number_slider_68 = Slider(1, range=0..2)  # disabled
number_slider_69 = Slider(35, range=0..100)  # disabled
number_slider_70 = Slider(54, range=0..100)  # disabled
number_slider_71 = Slider(-5, range=-7..0)  # disabled
number_slider_72 = Slider(1.24, range=0..2)  # disabled
number_slider_73 = Slider(72, range=0..100)  # disabled
integer = Integer(4)  # disabled
integer_2 = Integer(1)  # disabled
number_slider_74 = Slider(0, range=0..100)  # disabled
number_slider_75 = Slider(2, range=0..10)  # disabled
polygon = Polygon(Plane=PlaneXY(0, 0, 0), Radius=number_slider_53, Segments=integer, FilletRadius=0)  # -> Polygon, Length; disabled
unit_x_4 = UnitX(Factor=number_slider_50)  # disabled
number_slider_76 = Slider(1, range=0..10)  # disabled
construct_point_4 = ConstructPoint(XCoordinate=0, YCoordinate=integer_2, ZCoordinate=0)  # disabled
construct_point_5 = ConstructPoint(XCoordinate=0, YCoordinate=0, ZCoordinate=0)  # disabled
number_slider_77 = Slider(1, range=0..10)  # disabled
number_slider_78 = Slider(4, range=0..10)  # disabled
unit_x_5 = UnitX(Factor=number_slider_63)  # disabled
unit_x_6 = UnitX(Factor=number_slider_57)  # disabled
move_9 = Move(Geometry=polygon.Polygon, Motion=unit_x_4)  # -> Geometry, Transform; disabled
unit_z_9 = UnitZ(Factor=number_slider_56)  # disabled
area_8 = Area(Geometry=move_9.Geometry)  # -> Area, Centroid; disabled
line_10 = Line(StartPoint=construct_point_5, EndPoint=construct_point_4)  # disabled
integer_3 = Integer(expr("1", 1))  # disabled
pi_5 = Pi(Factor=number_slider_51)  # disabled
construct_point_6 = ConstructPoint(XCoordinate=0, YCoordinate=integer_3, ZCoordinate=0)  # disabled
construct_point_7 = ConstructPoint(XCoordinate=0, YCoordinate=0, ZCoordinate=0)  # disabled
rotate_3d_3 = Rotate3D(Geometry=move_9.Geometry, Angle=expr("-x", pi_5), Center=area_8.Centroid, Axis=line_10)  # -> Geometry, Transform; disabled
line_11 = Line(StartPoint=construct_point_7, EndPoint=construct_point_6)  # disabled
md_slider_7 = MDSlider(SliderMode=0, slider_value=Point(0.5, 0.5, 0.5), x_domain=Domain(0, 1), y_domain=Domain(0, 1), z_domain=Domain(0, 1))  # disabled
pi_6 = Pi(Factor=number_slider_49)  # disabled
number_slider_79 = Slider(2, range=0..2)  # disabled
boundary_surfaces_2 = BoundarySurfaces(Edges=rotate_3d_3.Geometry)  # disabled
pi_7 = Pi(Factor=number_slider_59)  # disabled
unit_z_10 = UnitZ(Factor=number_slider_55)  # disabled
evaluate_surface_8 = EvaluateSurface(Surface=boundary_surfaces_2, Point=md_slider_7)  # -> Point, Normal, UDirection, VDirection, Frame; disabled
construct_domain_6 = ConstructDomain(DomainStart=0, DomainEnd=number_slider_79)  # disabled
unit_z_11 = UnitZ(Factor=number_slider_45)  # disabled
multiplication_3 = Multiplication(A=evaluate_surface_8.Normal, B=number_slider_45)  # disabled
range_4 = Range(Domain=construct_domain_6, Steps=number_slider_62)  # disabled
extrude_5 = Extrude(Base=rotate_3d_3.Geometry, Direction=multiplication_3)  # disabled
construct_domain_7 = ConstructDomain(DomainStart=number_slider_74, DomainEnd=number_slider_75)  # disabled
pi_8 = Pi(Factor=range_4)  # disabled
cap_holes_2 = CapHoles(Brep=extrude_5)  # disabled
range_5 = Range(Domain=construct_domain_7, Steps=integer)  # disabled
pi_9 = Pi(Factor=range_5)  # disabled
rotate_3d_4 = Rotate3D(Geometry=cap_holes_2, Angle=pi_9, Center=Point(0, 0, 0), Axis=Vector(0, 0, 1))  # -> Geometry, Transform; disabled
rotate_3d_5 = Rotate3D(Geometry=cap_holes_2, Angle=pi_9, Center=Point(0, 0, 0), Axis=Vector(0, 0, 1))  # -> Geometry, Transform; disabled
construct_domain_8 = ConstructDomain(DomainStart=0, DomainEnd=expr("x-1", integer))  # disabled
construct_point_8 = ConstructPoint(XCoordinate=0, YCoordinate=0, ZCoordinate=expr("-x", number_slider_66))  # disabled
construct_point_9 = ConstructPoint(XCoordinate=number_slider_67, YCoordinate=0, ZCoordinate=0)  # disabled
construct_point_10 = ConstructPoint(XCoordinate=0, YCoordinate=number_slider_64, ZCoordinate=expr("-x", number_slider_64))  # disabled
arc_3pt_2 = Arc3Pt(PointA=construct_point_9, PointB=construct_point_8, PointC=construct_point_10)  # -> Arc, Plane, Radius; disabled

# ---- group: January21
length_3 = Slider(41, range=0..100)
arc_height = Slider(25.526, range=0..30)
arc_height2 = Slider(30, range=0..30)
arc_rot3 = Slider(1.383, range=0..2)  # disabled
start_2 = Start(Point(0, 0, 0))
arc_height3 = Slider(30, range=0..30)
integer_4 = Integer(1)
integer_5 = Integer(1)
count_array = Slider(3, range=0..10)  # disabled
negative_6 = Negative(Value=arc_rot3)  # disabled
vector_xyz = VectorXYZ(XComponent=0, YComponent=integer_4, ZComponent=0)  # -> Vector, Length
vector_xyz_2 = VectorXYZ(XComponent=integer_4, YComponent=0, ZComponent=0)  # -> Vector, Length
vector_xyz_3 = VectorXYZ(XComponent=0, YComponent=0, ZComponent=integer_4)  # -> Vector, Length
vector_xyz_4 = VectorXYZ(XComponent=integer_5, YComponent=integer_5, ZComponent=0)  # -> Vector, Length
pi_10 = Pi(Factor=arc_rot3)  # disabled
pi_11 = Pi(Factor=Slider(0.5, range=0..0.5))
pi_12 = Pi(Factor=Slider(0.325, range=0..0.5))
xy_plane = XYPlane(Origin=Point(0, 0, 0))  # disabled
yz_plane_2 = YZPlane(Origin=Point(0, 0, 0))
xz_plane = XZPlane(Origin=Point(0, 0, 0))  # disabled
pi_13 = Pi(Factor=negative_6)  # disabled
xy_plane_2 = XYPlane(Origin=Point(0, 0, 0))  # disabled
line_sdl_4 = LineSDL(Start=start_2, Direction=vector_xyz_2.Vector, Length=length_3)
line_sdl_5 = LineSDL(Start=start_2, Direction=vector_xyz.Vector, Length=length_3)
line_sdl_6 = LineSDL(Start=start_2, Direction=vector_xyz_3.Vector, Length=length_3)
point_on_curve_2 = PointOnCurve(line_sdl_4, parameter=0)
point_on_curve_3 = PointOnCurve(line_sdl_4, parameter=0.5)
point_on_curve_4 = PointOnCurve(line_sdl_4, parameter=1)
point_on_curve_5 = PointOnCurve(line_sdl_5, parameter=0)
point_on_curve_6 = PointOnCurve(line_sdl_5, parameter=0.5)
point_on_curve_7 = PointOnCurve(line_sdl_5, parameter=1)
point_on_curve_8 = PointOnCurve(line_sdl_6, parameter=0)
point_on_curve_9 = PointOnCurve(line_sdl_6, parameter=0.5)
point_on_curve_10 = PointOnCurve(line_sdl_6, parameter=1)
number_slider_80 = Slider(7, range=0..10)  # disabled
negative_7 = Negative(Value=vector_xyz.Vector)
negative_8 = Negative(Value=vector_xyz_2.Vector)
negative_9 = Negative(Value=arc_height3)
multiplication_4 = Multiplication(A=negative_7, B=arc_height)
multiplication_5 = Multiplication(A=negative_8, B=arc_height2)
multiplication_6 = Multiplication(A=negative_9, B=vector_xyz_4.Vector)
move_10 = Move(Geometry=point_on_curve_3, Motion=multiplication_4)  # -> Geometry, Transform
move_11 = Move(Geometry=point_on_curve_6, Motion=multiplication_5)  # -> Geometry, Transform
move_12 = Move(Geometry=point_on_curve_9, Motion=multiplication_6)  # -> Geometry, Transform
arc_3pt_3 = Arc3Pt(PointA=point_on_curve_2, PointB=move_10.Geometry, PointC=point_on_curve_4)  # -> Arc, Plane, Radius
join_curves = JoinCurves(Curves=arc_3pt_3.Arc, Preserve=False)
rotate_3d_6 = Rotate3D(Geometry=join_curves, Angle=pi_11, Center=move_10.Geometry, Axis=yz_plane_2)  # -> Geometry, Transform
point_on_curve_11 = PointOnCurve(rotate_3d_6.Geometry, parameter=0)
point_on_curve_12 = PointOnCurve(rotate_3d_6.Geometry, parameter=1)
line_12 = Line(StartPoint=point_on_curve_12, EndPoint=point_on_curve_4)  # -> flatten(Line)
line_13 = Line(StartPoint=point_on_curve_11, EndPoint=point_on_curve_2)  # disabled
arc_3pt_4 = Arc3Pt(PointA=point_on_curve_5, PointB=move_11.Geometry, PointC=point_on_curve_7)  # -> Arc, Plane, Radius
join_curves_2 = JoinCurves(Curves=arc_3pt_4.Arc, Preserve=False)
rotate_3d_7 = Rotate3D(Geometry=join_curves_2, Angle=pi_12, Center=move_11.Geometry, Axis=xz_plane)  # -> Geometry, Transform
point_on_curve_13 = PointOnCurve(rotate_3d_7.Geometry, parameter=0)
point_on_curve_14 = PointOnCurve(rotate_3d_7.Geometry, parameter=1)
line_14 = Line(StartPoint=point_on_curve_14, EndPoint=point_on_curve_7)  # -> flatten(Line)
line_15 = Line(StartPoint=point_on_curve_13, EndPoint=point_on_curve_5)
arc_3pt_5 = Arc3Pt(PointA=point_on_curve_8, PointB=move_12.Geometry, PointC=point_on_curve_10)  # -> Arc, Plane, Radius
join_curves_3 = JoinCurves(Curves=arc_3pt_5.Arc, Preserve=False)  # disabled
join_curves_4 = JoinCurves(Curves=arc_3pt_5.Arc, Preserve=False)  # disabled
rotate_3d_8 = Rotate3D(Geometry=arc_3pt_5.Arc, Angle=pi_10, Center=move_12.Geometry, Axis=xy_plane)  # -> Geometry, Transform; disabled
rotate_3d_9 = Rotate3D(Geometry=arc_3pt_5.Arc, Angle=pi_13, Center=move_12.Geometry, Axis=xy_plane_2)  # -> Geometry, Transform; disabled
point_on_curve_15 = PointOnCurve(rotate_3d_8.Geometry, parameter=0)  # disabled
point_on_curve_16 = PointOnCurve(rotate_3d_8.Geometry, parameter=1)  # disabled
point_on_curve_17 = PointOnCurve(rotate_3d_9.Geometry, parameter=0)  # disabled
point_on_curve_18 = PointOnCurve(rotate_3d_9.Geometry, parameter=1)  # disabled
line_16 = Line(StartPoint=point_on_curve_17, EndPoint=point_on_curve_8)  # disabled
line_17 = Line(StartPoint=point_on_curve_18, EndPoint=point_on_curve_10)  # disabled
line_18 = Line(StartPoint=point_on_curve_15, EndPoint=point_on_curve_8)  # disabled
line_19 = Line(StartPoint=point_on_curve_16, EndPoint=point_on_curve_10)  # disabled

sweep1 = Sweep1(Rail=rotate_3d_7.Geometry, Sections=[line_14, line_15], Miter=1)  # -> flatten(Brep); disabled
sweep1_2 = Sweep1(Rail=rotate_3d_6.Geometry, Sections=[line_12, line_13], Miter=1)  # -> flatten(Brep); disabled
sweep1_3 = Sweep1(Rail=rotate_3d_8.Geometry, Sections=line_18, Miter=1)  # -> flatten(Brep); disabled
sweep1_4 = Sweep1(Rail=rotate_3d_9.Geometry, Sections=line_16, Miter=1)  # -> flatten(Brep); disabled

# ---- group: TimberLogSim
# Timber Log Simulation
# Bake Me!
series_2 = Series(Start=0, Step=timber_length, Count=timber_length2)  # disabled
construct_domain_9 = ConstructDomain(DomainStart=timber_dia, DomainEnd=expr("x+2", timber_dia))  # disabled
construct_point_11 = ConstructPoint(XCoordinate=series_2, YCoordinate=0, ZCoordinate=0)  # disabled
negative_10 = Negative(Value=number_slider_9)  # disabled
polyline_4 = PolyLine(Vertices=construct_point_11, Closed=False)  # disabled
range_6 = Range(Domain=construct_domain_9, Steps=shape)  # disabled
negative_11 = Negative(Value=number_slider_8)  # disabled
construct_domain_10 = ConstructDomain(DomainStart=negative_10, DomainEnd=number_slider_9)  # disabled
construct_domain_11 = ConstructDomain(DomainStart=negative_11, DomainEnd=number_slider_8)  # disabled
perp_frames_2 = PerpFrames(Curve=polyline_4, Count=shape, Align=True)  # -> Frames, Parameters; disabled
jitter_2 = Jitter(List=range_6, Jitter=1, Seed=jitter)  # -> Values, Indices; disabled
deconstruct_plane_2 = DeconstructPlane(Plane=perp_frames_2.Frames)  # -> Origin, XAxis, YAxis, ZAxis; disabled
circle_cnr_3 = CircleCNR(Center=perp_frames_2.Frames, Normal=deconstruct_plane_2.ZAxis, Radius=jitter_2.Values)  # disabled
area_9 = Area(Geometry=circle_cnr_3)  # -> Area, Centroid; disabled
polyline_5 = PolyLine(Vertices=area_9.Centroid, Closed=False)  # disabled
perp_frames_3 = PerpFrames(Curve=polyline_5, Count=shape, Align=True)  # -> Frames, Parameters; disabled
rectangle_2 = Rectangle(Plane=perp_frames_3.Frames, XSize=construct_domain_11, YSize=construct_domain_10, Radius=0)  # -> Rectangle, Length; disabled
loft_6 = Loft(
    Curves=rectangle_2.Rectangle,
    Options={Adjust=False, Closed=False, LoftEnds=0, LoftSimp=0, LoftType=0, Rebuild=10, Refit=0.01})  # disabled
loft_7 = Loft(Curves=circle_cnr_3, Options={Adjust=False, Closed=False, LoftEnds=0, LoftSimp=0, LoftType=0, Rebuild=10, Refit=0.01})  # disabled

cap_holes_3 = CapHoles(Brep=loft_7)  # disabled
cap_holes_4 = CapHoles(Brep=loft_6)  # disabled

solid_intersection = SolidIntersection(BrepsA=cap_holes_3, BrepsB=cap_holes_4)  # disabled

# ---- group: February 9th
# Bake This!
# PLAY
circle = Circle(Plane=PlaneXY(0, 0, 0), Radius=radiusbasecir)  # disabled
divide_curve_4 = DivideCurve(Curve=circle, Count=dividecrv, Kinks=False)  # -> Points, Tangents, Parameters; disabled
perp_frames_4 = PerpFrames(Curve=circle, Count=10, Align=True)  # -> Frames, Parameters; disabled
pi_14 = Pi(Factor=rotperpframes)  # disabled
rotate_plane_2 = RotatePlane(Plane=perp_frames_4.Frames, Angle=pi_14)  # disabled
deconstruct_plane_3 = DeconstructPlane(Plane=rotate_plane_2)  # -> Origin, XAxis, YAxis, ZAxis; disabled
line_sdl_7 = LineSDL(Start=deconstruct_plane_3.Origin, Direction=deconstruct_plane_3.XAxis, Length=lenbaselines)  # disabled
area_10 = Area(Geometry=circle)  # -> Area, Centroid; disabled
area_11 = Area(Geometry=circle)  # -> Area, Centroid; disabled
unit_z_12 = UnitZ(Factor=heightcentroide)  # disabled
end_points_2 = EndPoints(Curve=line_sdl_7)  # -> Start, End; disabled
interpolate_5 = Interpolate(Vertices=end_points_2.End, Degree=3, Periodic=False, KnotStyle=1)  # -> Curve, Length, Domain; disabled
line_20 = Line(StartPoint=end_points_2.End, EndPoint=area_10.Centroid)  # disabled
move_13 = Move(Geometry=area_11.Centroid, Motion=unit_z_12)  # -> Geometry, Transform; disabled
perp_frames_5 = PerpFrames(Curve=interpolate_5.Curve, Count=10, Align=True)  # -> Frames, Parameters; disabled
pi_15 = Pi(Factor=rotprepframes2)  # disabled
line_21 = Line(StartPoint=end_points_2.End, EndPoint=move_13.Geometry)  # disabled
rotate_plane_3 = RotatePlane(Plane=perp_frames_5.Frames, Angle=pi_15)  # disabled
deconstruct_plane_4 = DeconstructPlane(Plane=rotate_plane_3)  # -> Origin, XAxis, YAxis, ZAxis; disabled
line_sdl_8 = LineSDL(Start=deconstruct_plane_4.Origin, Direction=deconstruct_plane_4.XAxis, Length=lenmidlines)  # disabled
end_points_3 = EndPoints(Curve=line_sdl_8)  # -> Start, End; disabled
interpolate_6 = Interpolate(Vertices=end_points_3.End, Degree=3, Periodic=False, KnotStyle=1)  # -> Curve, Length, Domain; disabled
perp_frames_6 = PerpFrames(Curve=interpolate_6.Curve, Count=10, Align=True)  # -> Frames, Parameters; disabled
pi_16 = Pi(Factor=rotprepframes3)  # disabled
rotate_plane_4 = RotatePlane(Plane=perp_frames_6.Frames, Angle=pi_16)  # disabled
deconstruct_plane_5 = DeconstructPlane(Plane=rotate_plane_4)  # -> Origin, XAxis, YAxis, ZAxis; disabled
line_sdl_9 = LineSDL(Start=deconstruct_plane_5.Origin, Direction=deconstruct_plane_5.XAxis, Length=lentoplines)  # disabled
end_points_4 = EndPoints(Curve=line_sdl_9)  # -> Start, End; disabled
polyline_6 = PolyLine(Vertices=end_points_4.End, Closed=True)  # disabled
explode_4 = Explode(Curve=polyline_6, Recursive=True)  # -> Segments, Vertices; disabled
dispatch_5 = Dispatch(List=explode_4.Segments, DispatchPattern=[True, False])  # -> ListA, ListB; disabled
unit_z_13 = UnitZ(Factor=lentoptierlines)  # disabled
curve_2 = Curve(dispatch_5.ListA)  # disabled
curve_3 = Curve(dispatch_5.ListB)  # disabled
unit_z_14 = UnitZ(Factor=1)  # disabled
pi_17 = Pi(Factor=rotbasecir)  # disabled
end_points_5 = EndPoints(Curve=curve_2)  # -> Start, End; disabled
end_points_6 = EndPoints(Curve=curve_3)  # -> Start, End; disabled

# ---- group: January21 (continued)
brep_join = BrepJoin(Breps=[sweep1, sweep1_2, sweep1_3, sweep1_4])  # -> Breps, Closed; disabled
deconstruct_brep_5 = DeconstructBrep(Brep=brep_join.Breps)  # -> Faces, Edges, flatten(Vertices); disabled
list_item_9 = ListItem(List=deconstruct_brep_5.Vertices, Index=0, Wrap=True)  # disabled

polar_array_2 = PolarArray(Geometry=brep_join.Breps, Plane=list_item_9, Count=count_array, Angle=6.283185307)  # -> flatten(Geometry), Transform; disabled

deconstruct_brep_6 = DeconstructBrep(Brep=polar_array_2.Geometry)  # -> Faces, Edges, flatten(Vertices); disabled
list_item_10 = ListItem(List=deconstruct_brep_6.Vertices, Index=number_slider_80, Wrap=True)  # disabled
polar_array_3 = PolarArray(Geometry=brep_join.Breps, Plane=list_item_10, Count=count_array, Angle=6.283185307)  # -> flatten(Geometry), Transform; disabled

brep_join_2 = BrepJoin(Breps=polar_array_3.Geometry)  # -> Breps, Closed; disabled

# ---- group: February 9th
pipe_7 = Pipe(Curve=line_20, Radius=1, Caps=0)  # disabled
pipe_8 = Pipe(Curve=line_21, Radius=1, Caps=0)  # disabled
loft_8 = Loft(Curves=line_sdl_8, Options={Adjust=False, Closed=True, LoftEnds=0, LoftSimp=0, LoftType=0, Rebuild=10, Refit=0.01})  # disabled
pipe_9 = Pipe(Curve=line_sdl_9, Radius=1, Caps=0)  # disabled
boundary_surfaces_3 = BoundarySurfaces(Edges=polyline_6)  # disabled

area_12 = Area(Geometry=boundary_surfaces_3)  # -> Area, Centroid; disabled
line_22 = Line(StartPoint=area_12.Centroid, EndPoint=move_13.Geometry)  # disabled
move_14 = Move(Geometry=area_12.Centroid, Motion=unit_z_13)  # -> Geometry, Transform; disabled
circle_cnr_4 = CircleCNR(Center=move_14.Geometry, Normal=Vector(0, 0, 1), Radius=radtoptiercir)  # disabled
rotate_3d_10 = Rotate3D(Geometry=circle_cnr_4, Angle=pi_17, Center=area_12.Centroid, Axis=unit_z_14)  # -> Geometry, Transform; disabled
divide_curve_5 = DivideCurve(Curve=rotate_3d_10.Geometry, Count=dividecrv, Kinks=False)  # -> Points, Tangents, Parameters; disabled

pipe_10 = Pipe(Curve=line_22, Radius=line_22, Caps=2)  # disabled
boundary_surfaces_4 = BoundarySurfaces(Edges=circle_cnr_4)  # disabled
_4point_surface = _4PointSurface(CornerA=divide_curve_5.Points, CornerB=end_points_5.Start, CornerC=end_points_6.Start)  # disabled

# ---- group: March1stKlokken
rotate_3d_11 = Rotate3D(Geometry=cap_holes_2, Angle=pi_9, Center=Point(0, 0, 0), Axis=Vector(0, 0, 1))  # -> Geometry, Transform; disabled
rotate_3d_12 = Rotate3D(Geometry=cap_holes_2, Angle=pi_9, Center=Point(0, 0, 0), Axis=Vector(0, 0, 1))  # -> Geometry, Transform; disabled

sub_list = SubList(List=rotate_3d_12.Geometry, Domain=construct_domain_8, Wrap=True)  # -> List, Index; disabled
brep_5 = Brep(sub_list.List)  # disabled
deconstruct_brep_7 = DeconstructBrep(Brep=brep_5)  # -> Faces, Edges, Vertices; disabled
list_item_11 = ListItem(List=deconstruct_brep_7.Vertices, Index=number_slider_76, Wrap=True)  # -> flatten(Item); disabled
list_item_12 = ListItem(List=deconstruct_brep_7.Vertices, Index=number_slider_77, Wrap=True)  # -> flatten(Item); disabled
list_item_13 = ListItem(List=deconstruct_brep_7.Vertices, Index=number_slider_78, Wrap=True)  # -> flatten(Item); disabled
dispatch_6 = Dispatch(List=list_item_12, DispatchPattern=[True, False])  # -> ListA, ListB; disabled
dispatch_7 = Dispatch(List=list_item_11, DispatchPattern=[True, False])  # -> ListA, ListB; disabled
dispatch_8 = Dispatch(List=list_item_13, DispatchPattern=[True, False])  # -> ListA, ListB; disabled
dispatch_9 = Dispatch(List=dispatch_7.ListB, DispatchPattern=[True, False])  # -> ListA, ListB; disabled
dispatch_10 = Dispatch(List=dispatch_7.ListA, DispatchPattern=[True, False])  # -> ListA, ListB; disabled
dispatch_11 = Dispatch(List=dispatch_7.ListB, DispatchPattern=[True, False])  # -> ListA, ListB; disabled
dispatch_12 = Dispatch(List=dispatch_7.ListA, DispatchPattern=[True, False])  # -> ListA, ListB; disabled
circle_cnr_5 = CircleCNR(Center=dispatch_8.ListA, Normal=Vector(0, 0, 1), Radius=number_slider_48)  # disabled
line_23 = Line(StartPoint=dispatch_6.ListA, EndPoint=dispatch_6.ListB)  # disabled
line_24 = Line(StartPoint=dispatch_10.ListB, EndPoint=dispatch_9.ListA)  # disabled
line_25 = Line(StartPoint=dispatch_12.ListA, EndPoint=dispatch_11.ListB)  # disabled
dispatch_13 = Dispatch(List=circle_cnr_5, DispatchPattern=[True, False])  # -> ListA, ListB; disabled
dispatch_14 = Dispatch(List=dispatch_8.ListA, DispatchPattern=[True, False])  # -> ListA, ListB; disabled
boundary_surfaces_5 = BoundarySurfaces(Edges=[line_23, line_25, line_24])  # disabled
area_13 = Area(Geometry=boundary_surfaces_5)  # -> Area, Centroid; disabled
point = Point(area_13.Centroid)  # disabled
construct_domain_12 = ConstructDomain(DomainStart=point, DomainEnd=number_slider_71)  # disabled
move_15 = Move(Geometry=area_13.Centroid, Motion=expr("-x", unit_z_9))  # -> Geometry, Transform; disabled
move_16 = Move(Geometry=move_15.Geometry, Motion=unit_x_5)  # -> Geometry, Transform; disabled
range_7 = Range(Domain=construct_domain_12, Steps=number_slider_73)  # disabled
cosine_2 = Cosine(Value=range_7)  # disabled
sine_2 = Sine(Value=range_7)  # disabled
extrude_6 = Extrude(Base=boundary_surfaces_5, Direction=unit_z_10)  # disabled
extrude_7 = Extrude(Base=boundary_surfaces_5, Direction=unit_z_10)  # disabled
multiplication_7 = Multiplication(A=sine_2, B=number_slider_68)  # disabled
multiplication_8 = Multiplication(A=cosine_2, B=number_slider_68)  # disabled
line_26 = Line(StartPoint=area_13.Centroid, EndPoint=move_16.Geometry)  # disabled
point_on_curve_19 = PointOnCurve(line_26, parameter=0.702)  # disabled
move_17 = Move(Geometry=point_on_curve_19, Motion=unit_x_6)  # -> Geometry, Transform; disabled
construct_point_12 = ConstructPoint(XCoordinate=multiplication_7, YCoordinate=multiplication_8, ZCoordinate=range_7)  # disabled
list_item_14 = ListItem(List=construct_point_12, Index=number_slider_70, Wrap=True)  # disabled
arc_3pt_6 = Arc3Pt(PointA=area_13.Centroid, PointB=move_17.Geometry, PointC=move_16.Geometry)  # -> Arc, Plane, Radius; disabled
interpolate_7 = Interpolate(Vertices=construct_point_12, Degree=3, Periodic=False, KnotStyle=1)  # -> Curve, Length, Domain; disabled
cone = Cone(Base=list_item_14, Radius=number_slider_65, Length=number_slider_69)  # -> Cone, Tip; disabled
offset_surface_2 = OffsetSurface(Surface=cone.Cone, Distance=1, BothSides=False, CreateSolid=True)  # disabled
offset_surface_3 = OffsetSurface(Surface=cone.Cone, Distance=1, BothSides=False, CreateSolid=True)  # disabled
rotate_3d_13 = Rotate3D(Geometry=dispatch_13.ListA, Angle=pi_6, Center=dispatch_14.ListA, Axis=line_11)  # -> Geometry, Transform; disabled
perp_frames_7 = PerpFrames(Curve=rotate_3d_13.Geometry, Count=number_slider_47, Align=True)  # -> Frames, Parameters; disabled
pipe_11 = Pipe(Curve=interpolate_7.Curve, Radius=number_slider_72, Caps=0)  # disabled
rotate_3d_14 = Rotate3D(Geometry=pipe_11, Angle=pi_8, Center=Point(0, 0, 0), Axis=Vector(0, 0, 1))  # -> Geometry, Transform; disabled
rotate_3d_15 = Rotate3D(Geometry=pipe_11, Angle=pi_8, Center=Point(0, 0, 0), Axis=Vector(0, 0, 1))  # -> Geometry, Transform; disabled
rotate_3d_16 = Rotate3D(Geometry=arc_3pt_6.Arc, Angle=pi_7, Center=move_16.Geometry, Axis=Vector(0, 20.00224754, 0))  # -> Geometry, Transform; disabled
area_14 = Area(Geometry=rotate_3d_13.Geometry)  # -> Area, Centroid; disabled
ellipse_2 = Ellipse(Plane=perp_frames_7.Frames, Radius1=number_slider_52, Radius2=number_slider_54)  # -> Ellipse, Focus1, Focus2; disabled
divide_curve_6 = DivideCurve(Curve=rotate_3d_13.Geometry, Count=number_slider_47, Kinks=False)  # -> Points, Tangents, Parameters; disabled
scale_4 = Scale(Geometry=rotate_3d_16.Geometry, Center=move_16.Geometry, Factor=number_slider_58)  # -> Geometry, Transform; disabled
line_27 = Line(StartPoint=area_14.Centroid, EndPoint=divide_curve_6.Points)  # disabled
merge = Merge(Data1=scale_4.Geometry, Data2=arc_3pt_6.Arc)  # disabled
revolution = Revolution(Curve=merge, Axis=Line((0, 0, 0), (0, 0, 44.11065724)), Domain=Domain(0, 6.283185307))  # disabled
offset_surface_4 = OffsetSurface(Surface=revolution, Distance=number_slider_60, BothSides=False, CreateSolid=True)  # disabled
offset_surface_5 = OffsetSurface(Surface=revolution, Distance=number_slider_60, BothSides=False, CreateSolid=True)  # disabled
merge_2 = Merge(Data1=rotate_3d_5.Geometry, Data2=extrude_7, Data3=offset_surface_5, Data4=rotate_3d_15.Geometry, Data5=offset_surface_3)  # disabled
scale_5 = Scale(Geometry=merge_2, Center=Point(0, 0, 0), Factor=number_slider_61)  # -> Geometry, Transform; disabled
dispatch_15 = Dispatch(List=revolution, DispatchPattern=[True, False])  # -> ListA, ListB; disabled
rotate_3d_17 = Rotate3D(Geometry=pipe_11, Angle=pi_8, Center=Point(0, 0, 0), Axis=Vector(0, 0, 1))  # -> Geometry, Transform; disabled

bend_deform_3 = BendDeform(Geometry=rotate_3d_17.Geometry, BendingArc=arc_3pt_2.Arc)  # disabled
move_18 = Move(Geometry=scale_5.Geometry, Motion=unit_z_11)  # -> Geometry, Transform; disabled
extrude_8 = Extrude(Base=boundary_surfaces_5, Direction=unit_z_10)  # disabled
extrude_9 = Extrude(Base=boundary_surfaces_5, Direction=unit_z_10)  # disabled
offset_surface_6 = OffsetSurface(Surface=revolution, Distance=number_slider_60, BothSides=False, CreateSolid=True)  # disabled
offset_surface_7 = OffsetSurface(Surface=revolution, Distance=number_slider_60, BothSides=False, CreateSolid=True)  # disabled
offset_surface_8 = OffsetSurface(Surface=cone.Cone, Distance=1, BothSides=False, CreateSolid=True)  # disabled
offset_surface_9 = OffsetSurface(Surface=cone.Cone, Distance=1, BothSides=False, CreateSolid=True)  # disabled
pipe_12 = Pipe(Curve=line_27, Radius=expr("x/2", number_slider_46), Caps=0)  # disabled
sphere = Sphere(Base=area_14.Centroid, Radius=number_slider_46)  # disabled
mirror_4 = Mirror(Geometry=[sphere, pipe_12], Plane=PlaneYZ(0, 0, 0))  # -> Geometry, Transform; disabled
loft_9 = Loft(
    Curves=ellipse_2.Ellipse,
    Options={Adjust=False, Closed=True, LoftEnds=0, LoftSimp=0, LoftType=0, Rebuild=10, Refit=0.01})  # disabled
mirror_5 = Mirror(Geometry=loft_9, Plane=PlaneYZ(0, 0, 0))  # -> Geometry, Transform; disabled
