# Grasshopper definition MasterScriptFiles_2022_fivePlusFour_71-80.gh (Grasshopper 1.0.7)
# plug-ins: Bifocals, Weaverbird, HoopSnake, MeshEdit Components, LunchBox

# ---- group: January6th2020BuchmanStripedTorus
cir = Circle(Plane=PlaneXY(0, 0, 0), Radius=1)  # disabled
pframes = PerpFrames(Curve=cir, Count=10, Align=True)  # -> Frames, Parameters; disabled
number_slider = Slider(-1, range=-1..2)  # disabled
cir_2 = Circle(Plane=pframes.Frames, Radius=1)  # disabled
divide = DivideCurve(Curve=cir_2, Count=10, Kinks=False)  # -> Points, Tangents, Parameters; disabled
series = Series(Start=0, Step=number_slider, Count=10)  # disabled
shift = ShiftList(List=divide.Points, Shift=graft(series), Wrap=True)  # disabled
loft = Loft(Curves=cir_2, Options={Adjust=False, Closed=True, LoftEnds=0, LoftSimp=0, LoftType=0, Rebuild=10, Refit=0.01})  # disabled
flip = FlipMatrix(Data=shift)  # disabled
intcrv = Interpolate(Vertices=flip, Degree=3, Periodic=True, KnotStyle=1)  # -> Curve, Length, Domain; disabled
srf_cp = SurfaceClosestPoint(Point=flip, Surface=loft)  # -> Point, UVPoint, Distance; disabled
number_slider_2 = Slider(0.166, range=0..10)  # disabled
number_slider_3 = Slider(0.075, range=0..1)  # disabled
crv_cp = CurveClosestPoint(Point=flip, Curve=intcrv.Curve)  # -> Point, Parameter, Distance; disabled
evalsrf = EvaluateSurface(Surface=loft, Point=srf_cp.UVPoint)  # -> Point, Normal, UDirection, VDirection, Frame; disabled
eval = EvaluateCurve(Curve=intcrv.Curve, Parameter=crv_cp.Parameter)  # -> Point, Tangent, Angle; disabled
multiplication = Multiplication(A=number_slider_3, B=number_slider_2)  # disabled
neg = Negative(Value=number_slider_3)  # disabled
neg_2 = Negative(Value=multiplication)  # disabled
xprod = CrossProduct(VectorA=evalsrf.Normal, VectorB=eval.Tangent, Unitize=False)  # -> Vector, Length; disabled
dom = ConstructDomain(DomainStart=number_slider_3, DomainEnd=neg)  # disabled
dom_2 = ConstructDomain(DomainStart=multiplication, DomainEnd=neg_2)  # disabled
pl = ConstructPlane(Origin=evalsrf.Point, XAxis=evalsrf.Normal, YAxis=xprod.Vector)  # disabled
rectangle = Rectangle(Plane=pl, XSize=dom, YSize=dom_2, Radius=0)  # -> Rectangle, Length; disabled
loft_2 = Loft(
    Curves=rectangle.Rectangle,
    Options={Adjust=False, Closed=True, LoftEnds=0, LoftSimp=0, LoftType=0, Rebuild=10, Refit=0.01})  # disabled

# ---- group: January10tth2020TedeschiChapter001Advanced
number_slider_4 = Slider(40, range=0..210)
srf = Surface(reparameterize(<surface referenced from the Rhino model>))
trib = TrianglePanelsB(Surface=srf, UDivisions=number_slider_4, VDivisions=number_slider_4)
area = Area(Geometry=trib)  # -> Area, Centroid
debrep = DeconstructBrep(Brep=trib)  # -> Faces, Edges, Vertices
srf_cp_2 = SurfaceClosestPoint(Point=area.Centroid, Surface=srf)  # -> Point, UVPoint, Distance
crv = Curve(debrep.Edges)
evalsrf_2 = EvaluateSurface(Surface=srf, Point=srf_cp_2.UVPoint)  # -> Point, Normal, UDirection, VDirection, Frame
curvepoint = PointOnCurve(crv, parameter=0.5)
multiplication_2 = Multiplication(A=evalsrf_2.Normal, B=Slider(2.99, range=0..40))
move = Move(Geometry=area.Centroid, Motion=multiplication_2)  # -> Geometry, Transform
image = ImageSampler(
    srf_cp_2.UVPoint,
    FilePath="C:\Users\Sculpture\Documents\2020_Grasshopper\ScreenShots2019\BlackandWhiteOscar.PNG",
    Filter="Value",
    Interpolate=False,
    Umax=1,
    Umin=0,
    Vmax=1,
    Vmin=0,
    Wrap=1)
ln = Line(StartPoint=graft(move.Geometry), EndPoint=curvepoint)
neg_3 = Negative(Value=Slider(0.92, range=0..1))
dom_3 = ConstructDomain(DomainStart=neg_3, DomainEnd=Slider(0.27, range=0..1))
bnd = Bounds(Numbers=image)
pt = Point(move.Geometry)
number_slider_5 = Slider(2, range=0..10)
remap = RemapNumbers(Value=image, Source=bnd, Target=dom_3)  # -> Mapped, Clipped
ln_2 = Line(StartPoint=graft(pt), EndPoint=debrep.Vertices)
graft = GraftTree(Tree=remap.Mapped, IncludeEmptyLists=True, IncludeNullItems=True)
eval_2 = EvaluateCurve(Curve=ln, Parameter=graft)  # -> Point, Tangent, Angle
ln_3 = Line(StartPoint=graft(pt), EndPoint=eval_2.Point)
shift_2 = ShiftList(List=ln_2, Shift=number_slider_5, Wrap=True)
shift_3 = ShiftList(List=ln_3, Shift=number_slider_5, Wrap=True)
merge = Merge(Data1=graft(shift_3), Data2=graft(shift_2))
merge_2 = Merge(Data1=graft(ln_3), Data2=graft(ln_2))
loft_3 = Loft(Curves=merge, Options={Adjust=False, Closed=False, LoftEnds=0, LoftSimp=0, LoftType=0, Rebuild=10, Refit=0.01})
loft_4 = Loft(Curves=merge_2, Options={Adjust=False, Closed=False, LoftEnds=0, LoftSimp=0, LoftType=0, Rebuild=10, Refit=0.01})

# ---- group: January6th2020BuchmanFacetedCylinder
number_slider_6 = Slider(7.7, range=0..10)
cyl = Cylinder(Base=PlaneXY(0, 0, 0), Radius=Slider(5.9, range=0..10), Length=number_slider_6)
multiplication_3 = Multiplication(A=number_slider_6, B=Slider(2, range=0..10))
pt_2 = ConstructPoint(XCoordinate=0, YCoordinate=0, ZCoordinate=multiplication_3)
popgeo = PopulateGeometry(Geometry=cyl, Count=Slider(562, range=0..1000), Seed=1)
vec2pt = Vector2Pt(PointA=popgeo, PointB=pt_2, Unitize=False)  # -> Vector, Length
project = Project(Geometry=popgeo, Plane=PlaneXY(0, 0, 0))  # -> Geometry, Transform
projecta = ProjectAlong(Geometry=popgeo, Plane=PlaneXY(0, 0, 0), Direction=vec2pt.Vector)  # -> Geometry, Transform
unit = UnitVector(Vector=project.Geometry)
lng = ListLength(List=unit)
del = DelaunayMesh(Points=projecta.Geometry, Plane=PlaneXY(0, 0, 0))
random = Random(Range=Domain(0, 1), Number=lng, Seed=2)
faceb = FaceBoundaries(Mesh=del)
multiplication_4 = Multiplication(A=random, B=unit)
demesh = DeconstructMesh(Mesh=del)  # -> Vertices, Faces, Colours, Normals
len = Length(Curve=faceb)
addition = Addition(A=multiplication_4, B=popgeo)
larger = LargerThan(FirstNumber=len, SecondNumber=Slider(5.72, range=0..10))  # -> LargerThan, OrEqualTo
dispatch = Dispatch(List=demesh.Faces, DispatchPattern=larger.LargerThan)  # -> ListA, ListB
conmesh = ConstructMesh(Vertices=addition, Faces=dispatch.ListB)

# ---- group: wb-0.9.0.1-yak-and-mac-install-def / coloring
swatch = ColourSwatch(SwatchColor=RGB(120, 120, 120))
swatch_2 = ColourSwatch(SwatchColor=RGB(255, 255, 255))
swatch_3 = ColourSwatch(SwatchColor=RGB(255, 0, 0))
swatch_4 = ColourSwatch(SwatchColor=RGB(255, 250, 163))

# ---- group: wb-0.9.0.1-yak-and-mac-install-def / a starting mesh
use_unit_offset_false_of_edge = BooleanToggle(False)
level = Slider(1, range=0..4)
offset = Slider(13.8299, range=0.01..16)
sides = Slider(4, range=3..7)
sides_2 = Slider(6, range=3..12)
wbprism = MeshPrism(
    Plane=PlaneXY(0, 0, 0),
    Width=sides_2,
    NumberOfSides=sides,
    TopPoint=Point(0, 0, 10),
    BasePolygonMethod=True,
    FillStrategy=1)
wbcatmullclark = CatmullClarkSubdivision(MeshCurves=wbprism, Level=level, SmoothNakedEdges=0)
wbframe = PictureFrame(Mesh=wbcatmullclark, Distance=offset, OffsetType=use_unit_offset_false_of_edge)

# ---- group: wb-0.9.0.1-yak-and-mac-install-def / a group of curves
hexgrid = Hexagonal(Plane=PlaneXY(-10.55213976, 5.665637213, 0), Size=2, ExtentX=9, ExtentY=16)  # -> Cells, Points
arc = CircularArc([{Angle=0, Angle=3.08734986, Plane=Plane(origin=(0, -12.87936404, 0.1365836204), x=(0.9999775253, 0, -0.006704395413), y=(0.006704395413, 0, 0.9999775253)), Radius=28.95298645}, {Angle=0, Angle=3.028209025, Plane=Plane(origin=(-0.4569871354, 16.87870354, 0), x=(0.9997330863, 0, 0.02310316181), y=(-0.02310316181, 0, 0.9997330863)), Radius=14.60370525}, {Angle=0, Angle=2.907187234, Plane=Plane(origin=(9.118104545, 29.47828606, 0), x=(0.9987275845, 0, 0.05043026813), y=(-0.05043026813, 0, 0.9987275845)), Radius=14.5212827}, {Angle=0, Angle=2.899501929, Plane=Plane(origin=(4.504817082, 62.81561779, 0), x=(0.9995247492, 0, 0.03082654193), y=(-0.03082654193, 0, 0.9995247492)), Radius=35.99093035}])
loft_5 = Loft(Section=arc, Options={Adjust=False, Closed=False, LoftEnds=0, LoftSimp=1, LoftType=1, Rebuild=10, Refit=0.01})
project_2 = Project(Curve=hexgrid.Cells, Brep=loft_5, Direction=Vector(0, 0, 1))
flatten = FlattenTree(Data=project_2, Path="{0}")

# ---- group: wb-0.9.0.1-yak-and-mac-install-def / find discontinuities
disc = Discontinuity(Curve=flatten, Level=1)  # -> Points, Parameters

# ---- group: wb-0.9.0.1-yak-and-mac-install-def / attractor
pt_3 = Point(Point(0.1766759545, -8.17539107, 4.048119619))

# ---- group: wb-0.9.0.1-yak-and-mac-install-def / let's see the original
original = Move(Geometry=wbframe, Translation=Vector(0, 38.0199113, 0))

# ---- group: wb-0.9.0.1-yak-and-mac-install-def / make polylines
pline = PolyLine(Vertices=disc.Points, Closed=False)

# ----
number_slider_7 = Slider(2, range=0..10)  # disabled
number_slider_8 = Slider(6, range=0..10)  # disabled
curve = Curve(<curve referenced from the Rhino model>)  # disabled
boolean_toggle = BooleanToggle(True)  # disabled
number_slider_9 = Slider(2, range=0..2)  # disabled
number_slider_10 = Slider(39, range=0..100)  # disabled
unit_y = UnitY(Factor=number_slider_10)  # disabled

# ---- group: January10tth2020TedeschiChapter7LoopsTridimensionalFractals
number_slider_11 = Slider(2, range=0..10)  # disabled
pt_4 = Point([<point referenced from the Rhino model> x3])  # disabled
number_slider_12 = Slider(3, range=0..10)  # disabled
del_2 = DelaunayMesh(Points=pt_4, Plane=PlaneXY(0, 0, 0))  # disabled

# ---- group: December25th2019WickersonStudios
# Loops
number_slider_13 = Slider(8, range=1..14)  # disabled
rectangle_2 = Rectangle(Plane=PlaneXY(0, 0, 0), XSize=number_slider_13, YSize=number_slider_13, Radius=0)  # -> Rectangle, Length; disabled
number_slider_14 = Slider(0.46, range=0..1)  # disabled
number_slider_15 = Slider(10, range=0..10)  # disabled
boundary_surfaces = BoundarySurfaces(Edges=rectangle_2.Rectangle)  # disabled
divide_surface = DivideSurface(Surface=boundary_surfaces, UCount=10, VCount=10)  # -> Points, Normals, Parameters; disabled
construct_domain = ConstructDomain(DomainStart=number_slider_14, DomainEnd=number_slider_15)  # disabled
list_length = ListLength(List=divide_surface.Points)  # disabled
range = Range(Domain=construct_domain, Steps=expr("x-1", list_length))  # -> flatten(Range); disabled
construct_domain_2 = ConstructDomain(DomainStart=0, DomainEnd=1)  # disabled
jitter = Jitter(List=range, Jitter=1, Seed=2)  # -> Values, Indices; disabled
unit_z = UnitZ(Factor=jitter.Values)  # disabled
range_2 = Range(Domain=construct_domain_2, Steps=10)  # disabled
move_2 = Move(Geometry=graft(divide_surface.Points), Motion=graft(unit_z))  # -> flatten(Geometry), Transform; disabled
construct_point = ConstructPoint(XCoordinate=graft(range_2), YCoordinate=range_2, ZCoordinate=0)  # disabled
surface_from_points = SurfaceFromPoints(Points=move_2.Geometry, UCount=list_length, Interpolate=False)  # -> flatten(Surface); disabled
evaluate_surface = EvaluateSurface(Surface=reparameterize(flatten(surface_from_points)), Point=flatten(construct_point))  # -> Point, Normal, Frame; disabled
deconstruct_brep = DeconstructBrep(Brep=surface_from_points)  # -> Faces, Edges, Vertices; disabled
move_3 = Move(Geometry=evaluate_surface.Point, Motion=evaluate_surface.Normal)  # -> Geometry, Transform; disabled
surface_from_points_2 = SurfaceFromPoints(Points=move_3.Geometry, UCount=list_length, Interpolate=False)  # -> flatten(Surface); disabled
deconstruct_brep_2 = DeconstructBrep(Brep=surface_from_points_2)  # -> Faces, Edges, Vertices; disabled
list_item = ListItem(List=deconstruct_brep.Edges, Index=0, Wrap=True)  # -> Item, Item1, Item2, Item3; disabled
list_item_2 = ListItem(List=deconstruct_brep_2.Edges, Index=0, Wrap=True)  # -> Item, Item1, Item2, Item3; disabled
geometry = Geometry(list_item_2.Item1)  # disabled
geometry_2 = Geometry(list_item.Item1)  # disabled
geometry_3 = Geometry(list_item_2.Item)  # disabled
geometry_4 = Geometry(list_item.Item)  # disabled
geometry_5 = Geometry(list_item_2.Item2)  # disabled
geometry_6 = Geometry(list_item.Item2)  # disabled
geometry_7 = Geometry(list_item.Item3)  # disabled
geometry_8 = Geometry(list_item_2.Item3)  # disabled
geometry_9 = Geometry(surface_from_points)  # disabled
geometry_10 = Geometry(surface_from_points_2)  # disabled
loft_6 = Loft(
    Curves=[geometry_2, geometry],
    Options={Adjust=False, Closed=False, LoftEnds=0, LoftSimp=0, LoftType=0, Rebuild=10, Refit=0.01})  # -> flatten(Loft); disabled
loft_7 = Loft(
    Curves=[geometry_6, geometry_5],
    Options={Adjust=False, Closed=False, LoftEnds=0, LoftSimp=0, LoftType=0, Rebuild=10, Refit=0.01})  # -> flatten(Loft); disabled
loft_8 = Loft(
    Curves=[geometry_7, geometry_8],
    Options={Adjust=False, Closed=False, LoftEnds=0, LoftSimp=0, LoftType=0, Rebuild=10, Refit=0.01})  # -> flatten(Loft); disabled
loft_9 = Loft(
    Curves=[geometry_4, geometry_3],
    Options={Adjust=False, Closed=False, LoftEnds=0, LoftSimp=0, LoftType=0, Rebuild=10, Refit=0.01})  # -> flatten(Loft); disabled

list_item_3 = ListItem(List=geometry_9, Index=0, Wrap=True)  # disabled
list_item_4 = ListItem(List=geometry_10, Index=0, Wrap=True)  # disabled

list_item_5 = ListItem(List=loft_9, Index=0, Wrap=True)  # disabled
list_item_6 = ListItem(List=loft_6, Index=0, Wrap=True)  # disabled
list_item_7 = ListItem(List=loft_7, Index=0, Wrap=True)  # disabled
list_item_8 = ListItem(List=loft_8, Index=0, Wrap=True)  # disabled

brep_join = BrepJoin(Breps=[list_item_3, list_item_4, list_item_5, list_item_6, list_item_7, list_item_8])  # -> Breps, Closed; disabled

# ---- group: wb-0.9.0.1-yak-and-mac-install-def
# From this version of Wb, most subdivision
# components accept polylines as inputs.
# They automatically convert them into meshes.
# Here how we could smoothen an hexagonal mesh.
# for Yak and Mac
# 
# v 0.9.0.1
# 1
# 
# A grid of hexagons is projected onto a surface and then subdivided. Wb subdivides also groups of curves.
# This release of Wb contains a few definitions (you can find more in the example folder) and can be installed via Yak. Just use Rhino 6 to be able to download it from the server. Before using it, you must accept the license agreement.
# 
# NOTE: On most machines, you will need to restart Rhino for the Yak installation of WB to take effect!
# 2
# 
# Few mesh vertices are colored, then Wb's CC subd is applied to give a smooth gradient.
# 3
# 
# A simple attractor is used to show proximity to a point.
# 4
# 
# A terrain mesh is generated from a few points and then vertex-colored
# 5
# 
# A set of extruded polyhedra..
# 
# for more, see the sample folder!
pline_2 = PolyLine(
    Vertices=[Point(12, -31, 0), Point(11, -23, 0), Point(19, -19, 0), Point(27, -22, 0), Point(27, -27, 0), Point(22, -32, 0), Point(12, -31, 0)],
    Closed=True)
image_2 = ImageSampler(Filter="Colour", Interpolate=False, Umax=1, Umin=0, Vmax=1, Vmin=0, Wrap=1)
wb = ImageSampler(Filter="Colour", Interpolate=False, Umax=1, Umin=0, Vmax=1, Vmin=0, Wrap=1)
del_3 = DelaunayMesh(
    Points=[Point(67, 12, 0), Point(57, -2, 0), Point(65, -16, 0), Point(98, -25, 0), Point(111, -4, 0), Point(123, 20, 0), Point(105, 34, 0), Point(83, 26, 0), Point(74, 4, -9), Point(86, -2, -8), Point(98, -7, -7), Point(104, -11, -5), Point(110, -12, -5), Point(102, 1, 10), Point(95, 8, 10), Point(84, 7, 12)],
    Plane=PlaneXY(0, 0, 0))
pline_3 = PolyLine(
    Vertices=[Point(3, -44, 0), Point(2, -33, 0), Point(12, -31, 0), Point(22, -32, 0), Point(21, -40, 0), Point(14, -46, 0), Point(3, -44, 0)],
    Closed=True)
toggle = BooleanToggle(False)
pline_4 = PolyLine(Vertices=[Point(12, -31, 0), Point(11, -23, 0), Point(0, -23, 0), Point(2, -33, 0), Point(12, -31, 0)], Closed=True)
crv_2 = Curve([pline_3, pline_2, pline_4])
panel = Panel("Weaverbird")
C = Colours([swatch_3, swatch_4, swatch, swatch_2])
wbloop = LoopSubdivision(Mesh=del_3, Level=2, SmoothNakedEdges=toggle)
line = Line(Line((8, -51, 3), (26, -17, 4)))
mplane = MeshPlane(Boundary={Plane=PlaneXY(-24, 4, 0), Size=Domain2(u=-7..7, v=-7..7)}, WidthCount=1, HeightCount=1)  # -> Mesh, Area
wbvertices = VerticesComponent(Mesh=wbloop, Weld=False)
wbedges = WeaverBirdsMeshEdges(MeshOrPolylines=crv_2)
eval_3 = EvaluateLength(Curve=wbedges, Length=0.5, Normalized=True)  # -> Point, Tangent, Parameter
pcomp = Decompose(Point=wbvertices)  # -> XComponent, YComponent, ZComponent
mcol = MeshColours(Mesh=mplane.Mesh, Colours=C)
bnd_2 = Bounds(Numbers=pcomp.ZComponent)
wbcatmullclark_2 = CatmullClarkSubdivision(MeshCurves=mcol, Level=3, SmoothNakedEdges=0)
domcomp = DomainComponents(Domain=bnd_2)  # -> Start, End
mcomp = Decompose(Mesh=wbframe)  # -> Vertices, Faces, Colours, Normals
attractor_force = Slider(5, range=0..100)
dist = Distance(PointA=mcomp.Vertices, PointB=pt_3)
wbcatmullclark_3 = CatmullClarkSubdivision(MeshCurves=flatten(pline), Level=1, SmoothNakedEdges=1)
division = Division(A=1, B=dist)
final_double_smooth_pass = Slider(2, range=0..4)
medges = MeshEdges(Mesh=wbcatmullclark_3)  # -> NakedEdges, InteriorEdges, NonManifoldEdges
multiplication_5 = Multiplication(A=division, B=attractor_force)
wbthicken = Thicken(Mesh=wbframe, Distance=multiplication_5, OffsetType=0)
move_4 = Move(Geometry=wbthicken, Motion=Vector(0, 20, 0))  # -> Geometry, Transform
wbcatmullclark_4 = CatmullClarkSubdivision(MeshCurves=wbthicken, Level=final_double_smooth_pass, SmoothNakedEdges=1)
wblaplace = LaplacianSmoothing(MeshCurves=wbcatmullclark_4, Level=final_double_smooth_pass, SmoothNakedEdges=1, Thin=1)

# ---- group: wb-0.9.0.1-yak-and-mac-install-def / offset
curvepoint_2 = PointOnCurve(line, parameter=0.782)

# ---- group: wb-0.9.0.1-yak-and-mac-install-def (continued)
dist_2 = Distance(PointA=eval_3.Point, PointB=curvepoint_2)
division_2 = Division(A=8, B=dist_2)
wbframe_2 = WeaverBirdsPictureFrame(MeshPolylines=crv_2, Distance=division_2, InsetType=1)

# ---- group: wb-0.9.0.1-yak-and-mac-install-def / Colored t
gradient = Gradient(
    LowerLimit=domcomp.Start,
    UpperLimit=domcomp.End,
    Parameter=pcomp.ZComponent,
    stops=[0.00648: RGB(0, 0, 192), 0.449: RGB(0, 255, 255), 0.487: RGB(221, 255, 53), 0.68: RGB(0, 98, 0), 0.893: RGB(240, 183, 82), 1: RGB(255, 255, 255)])
mcol_2 = MeshColours(Mesh=wbloop, Colours=gradient)
wbloop_2 = LoopSubdivision(Mesh=mcol_2, Level=3, SmoothNakedEdges=toggle)

# ---- group: January10tth2020TedeschiChapter7LoopsFractals
number_slider_16 = Slider(3, range=0..10)  # disabled
number_slider_17 = Slider(4, range=0..10)  # disabled
crv_3 = Curve(<curve referenced from the Rhino model>)  # disabled
number_slider_18 = Slider(1, range=0..10)  # disabled

number_slider_19 = Slider(3, range=0..10)  # disabled
crv_4 = Curve(reparameterize(<curve referenced from the Rhino model>))  # disabled
crv_5 = Curve(reparameterize(<curve referenced from the Rhino model>))  # disabled
divide_2 = DivideCurve(Curve=crv_5, Count=number_slider_19, Kinks=False)  # -> Points, Tangents, Parameters; disabled
number_slider_20 = Slider(1, range=0..10)  # disabled
shatter = Shatter(Curve=crv_5, Parameters=divide_2.Parameters)  # disabled
item = ListItem(List=shatter, Index=number_slider_20, Wrap=True)  # disabled
lng_2 = ListLength(List=item)  # disabled
number_slider_21 = Slider(1, range=0..1)  # disabled
end = EndPoints(Curve=item)  # -> Start, End; disabled
cull_i = CullIndex(List=shatter, Indices=number_slider_21, Wrap=True)  # disabled

# Check out: Toyo Ito's and Cecil Balmond's 2002 Serpentine Pavilion
number_slider_22 = Slider(6, range=0..10)  # disabled
panel_2 = Panel("(x/2)*Sqrt(3)")  # disabled

expression = Expression(x=lng_2, y=number_slider_22, Expression="y*(x/2)*Sqrt(3)")  # disabled
neg_4 = Negative(Value=expression)  # disabled
offset_2 = OffsetCurve(Curve=item, Distance=neg_4, Plane=PlaneXY(0, 0, 0), Corners=1)  # disabled
curvepoint_3 = PointOnCurve(offset_2, parameter=0.5)  # disabled
ln_4 = Line(StartPoint=end.Start, EndPoint=curvepoint_3)  # disabled
ln_5 = Line(StartPoint=curvepoint_3, EndPoint=end.End)  # disabled
merge_3 = Merge(Data1=cull_i, Data2=ln_4, Data3=ln_5)  # -> graft(Result); disabled

divide_3 = DivideCurve(Curve=hs_2.Feedback, Count=number_slider_16, Kinks=False)  # -> Points, Tangents, Parameters; disabled

# ---- group: January10tth2020TedeschiChapter7LoopsTridimensionalFractals (continued)
facen = FaceNormals(Mesh=graft(hs.Feedback))  # -> Centers, Normals; disabled
multiplication_6 = Multiplication(A=facen.Normals, B=number_slider_11)  # disabled
move_5 = Move(Geometry=facen.Centers, Motion=multiplication_6)  # -> Geometry, Transform; disabled
wbedges_2 = WeaverbirdsMeshEdges(MeshOrPolylines=graft(hs.Feedback))  # disabled
end_2 = EndPoints(Curve=wbedges_2)  # -> Start, End; disabled
crossref = CrossReference(ListA=end_2.Start, ListB=end_2.End, ListC=move_5.Geometry, CrossMode=1)  # -> ListA, ListB, ListC; disabled
merge_4 = Merge(Data1=crossref.ListA, Data2=crossref.ListB, Data3=crossref.ListC)  # disabled
cullpt = CullDuplicates(Points=merge_4, Tolerance=0.1, CullMode=3)  # -> Points, Indices, Valence; disabled
del_4 = DelaunayMesh(Points=cullpt.Points, Plane=PlaneXY(0, 0, 0))  # disabled
explode = MeshExplode(Mesh=del_4, Interpolate=False)  # -> graft(Faces); disabled
hs = HoopSnake(
    StartingData=del_2,
    Data=explode,
    TerminationCondition=number_slider_12,
    Hoopsnake_Data_autoUpdate=False,
    Hoopsnake_Data_dataLimit=2147483647,
    Hoopsnake_Data_resetCounter=True,
    Hoopsnake_Data_updateView=True)  # -> Feedback, FeedbackHistory, LoopsCounter, IterationsCounter; disabled
mesh = Mesh(hs.FeedbackHistory)  # disabled

# ---- group: January10tth2020TedeschiChapter7LoopsFractals (continued)
hs_2 = HoopSnake(
    StartingData=crv_3,
    Data=merge_5,
    TerminationCondition=number_slider_17,
    Hoopsnake_Data_autoUpdate=False,
    Hoopsnake_Data_dataLimit=2147483647,
    Hoopsnake_Data_resetCounter=True,
    Hoopsnake_Data_updateView=True)  # -> Feedback, FeedbackHistory, LoopsCounter, IterationsCounter; disabled
shatter_2 = Shatter(Curve=hs_2.Feedback, Parameters=divide_3.Parameters)  # disabled
item_2 = ListItem(List=shatter_2, Index=number_slider_18, Wrap=True)  # disabled

len_2 = Length(Curve=item_2)  # disabled
panel_3 = Panel(hs_2.IterationsCounter)  # disabled
eval_4 = Evaluate(F="Sqrt(3)*(x/2)", x=len_2)  # disabled

neg_5 = Negative(Value=eval_4)  # disabled
offset_3 = OffsetCurve(Curve=item_2, Distance=neg_5, Plane=PlaneXY(0, 0, 0), Corners=1)  # disabled

end_3 = EndPoints(Curve=item_2)  # -> Start, End; disabled
curvepoint_4 = PointOnCurve(offset_3, parameter=0.5)  # disabled
cull_i_2 = CullIndex(List=shatter_2, Indices=number_slider_18, Wrap=True)  # disabled
ln_6 = Line(StartPoint=end_3.Start, EndPoint=curvepoint_4)  # disabled
ln_7 = Line(StartPoint=curvepoint_4, EndPoint=end_3.End)  # disabled
merge_5 = Merge(Data1=cull_i_2, Data2=ln_6, Data3=ln_7)  # -> graft(Result); disabled

# ----
hoopsnake = HoopSnake(
    StartingData=curve,
    Data=move_6.Geometry,
    TerminationCondition=number_slider_8,
    Trigger=boolean_toggle,
    Hoopsnake_Data_autoUpdate=False,
    Hoopsnake_Data_dataLimit=2147483647,
    Hoopsnake_Data_resetCounter=True,
    Hoopsnake_Data_updateView=True)  # -> Feedback, FeedbackHistory, LoopsCounter, IterationsCounter; disabled
divide_curve = DivideCurve(Curve=hoopsnake.Feedback, Count=number_slider_7, Kinks=False)  # -> Points, Tangents, Parameters; disabled
shatter_3 = Shatter(Curve=hoopsnake.Feedback, Parameters=divide_curve.Parameters)  # disabled
panel_4 = Panel(hoopsnake.IterationsCounter)  # disabled
curve_2 = Curve(hoopsnake.FeedbackHistory)  # disabled
list_item_9 = ListItem(List=shatter_3, Index=number_slider_9, Wrap=True)  # disabled
move_6 = Move(Geometry=list_item_9, Motion=unit_y)  # -> Geometry, Transform; disabled
