# Grasshopper definition MasterScriptFiles_2022_fivePlusSeven_51-60.gh (Grasshopper 1.0.7)
# plug-ins: Bifocals, Pufferfish, treesloth01

# ---- group: March1stIsabella
beam_width_depth = Slider(1.68, range=0..10)  # disabled
beam_angle = Slider(38, range=0..100)  # disabled
beam_angle_2 = Slider(-0.001, range=-0.001..0.23)  # disabled
beam_height = Slider(100, range=0..100)  # disabled

wheel_rotation = Slider(0.473, range=0..1)  # disabled
elipse_dim_1 = Slider(2.93, range=0..10)  # disabled
wheel_perpf = Slider(10, range=0..10)  # disabled
spoke_radii = Slider(10, range=0..10)  # disabled
spoke_length = Slider(100, range=0..100)  # disabled
ellipse_dim_2 = Slider(10, range=0..10)  # disabled

# ---- group: March6thAniveDuchameCamp001
number_slider = Slider(300, range=0..300)  # disabled
number_slider_2 = Slider(57, range=0..100)  # disabled
number_slider_3 = Slider(266, range=0..300)  # disabled
number_slider_4 = Slider(78, range=0..100)  # disabled
number_slider_5 = Slider(12, range=0..100)  # disabled
number_slider_6 = Slider(24, range=0..100)  # disabled
number_slider_7 = Slider(23, range=0..100)  # disabled
number_slider_8 = Slider(38, range=0..100)  # disabled
number_slider_9 = Slider(0.002826, range=0..0.1)  # disabled
unit_z = UnitZ(Factor=number_slider_2)  # disabled
number_slider_10 = Slider(9, range=0..100)  # disabled
number_slider_11 = Slider(1, range=0..10)  # disabled
circle = Circle(Plane=PlaneXY(0, 0, 0), Radius=number_slider_3)  # disabled
circle_2 = Circle(Plane=PlaneXY(0, 0, 0), Radius=number_slider)  # disabled
number_slider_12 = Slider(0, range=0..1)  # disabled
rectangle = Rectangle(Plane=PlaneXY(0, 0, 0), XSize=number_slider_5, YSize=number_slider_6, Radius=0)  # -> Rectangle, Length; disabled
rectangle_2 = Rectangle(Plane=PlaneXY(0, 0, 0), XSize=number_slider_7, YSize=number_slider_8, Radius=0)  # -> Rectangle, Length; disabled
move = Move(Geometry=circle, Motion=unit_z)  # -> Geometry, Transform; disabled
number_slider_13 = Slider(30, range=0..100)  # disabled
rectangular_array = RectangularArray(Geometry=rectangle.Rectangle, Cell=rectangle_2.Rectangle, XCount=number_slider_10, YCount=number_slider_10)  # -> Geometry, Transform; disabled
md_slider = MDSlider(
    SliderMode=0,
    slider_value=Point(0.614153642, 0.7209465213, 0.5),
    x_domain=Domain(0, 1),
    y_domain=Domain(0, 1),
    z_domain=Domain(0, 1))  # disabled
area = Area(Geometry=move.Geometry)  # -> Area, Centroid; disabled
divide_curve = DivideCurve(Curve=move.Geometry, Count=number_slider_4, Kinks=False)  # -> Points, Tangents, Parameters; disabled
series = Series(Start=number_slider_12, Step=number_slider_9, Count=expr("x/2", number_slider_4))  # disabled
dispatch = Dispatch(List=divide_curve.Points, DispatchPattern=[True, False])  # -> ListA, ListB; disabled
jitter = Jitter(List=series, Jitter=1, Seed=number_slider_13)  # -> Values, Indices; disabled
number_slider_14 = Slider(15, range=0..100)  # disabled
vector_2pt = Vector2Pt(PointA=area.Centroid, PointB=dispatch.ListA, Unitize=False)  # -> Vector, Length; disabled
vector_2pt_2 = Vector2Pt(PointA=dispatch.ListB, PointB=area.Centroid, Unitize=False)  # -> Vector, Length; disabled
unit_z_2 = UnitZ(Factor=number_slider_14)  # disabled
multiplication = Multiplication(A=vector_2pt_2.Vector, B=jitter.Values)  # disabled
multiplication_2 = Multiplication(A=vector_2pt.Vector, B=jitter.Values)  # disabled
move_2 = Move(Geometry=dispatch.ListA, Motion=multiplication_2)  # -> Geometry, Transform; disabled
move_3 = Move(Geometry=dispatch.ListB, Motion=multiplication)  # -> Geometry, Transform; disabled
number_slider_15 = Slider(3, range=0..10)  # disabled
number_slider_16 = Slider(4, range=0..10)  # disabled
number_slider_17 = Slider(5, range=0..10)  # disabled
number_slider_18 = Slider(7, range=0..10)  # disabled
number_slider_19 = Slider(2, range=0..10)  # disabled
number_slider_20 = Slider(6, range=0..10)  # disabled
number_slider_21 = Slider(8, range=0..10)  # disabled
number_slider_22 = Slider(1, range=0..10)  # disabled
number_slider_23 = Slider(4.45, range=0..10)  # disabled
weave = Weave(Pattern=[0, 1], Stream0=move_2.Geometry, Stream1=move_3.Geometry, NullGaps=False)  # -> flatten(Weave); disabled
interpolate = Interpolate(Vertices=weave, Degree=3, Periodic=True, KnotStyle=1)  # -> Curve, Length, Domain; disabled
unit_y = UnitY(Factor=number_slider_23)  # disabled
unit_y_2 = UnitY(Factor=number_slider_23)  # disabled
unit_y_3 = UnitY(Factor=number_slider_23)  # disabled
unit_y_4 = UnitY(Factor=number_slider_23)  # disabled
loft = Loft(
    Curves=[interpolate.Curve, circle_2],
    Options={Adjust=False, Closed=False, LoftEnds=0, LoftSimp=0, LoftType=0, Rebuild=10, Refit=0.01})  # disabled
number_slider_24 = Slider(48, range=0..100)  # disabled
cap_holes = CapHoles(Brep=loft)  # disabled
deconstruct_brep = DeconstructBrep(Brep=cap_holes)  # -> Faces, Edges, Vertices; disabled
list_item = ListItem(List=deconstruct_brep.Faces, Index=number_slider_11, Wrap=True)  # disabled
surface = Surface(reparameterize(list_item))  # disabled
evaluate_surface = EvaluateSurface(Surface=surface, Point=md_slider)  # -> Point, Normal, UDirection, VDirection, Frame; disabled
orient = Orient(Geometry=rectangular_array.Geometry, Source=evaluate_surface.Point, Target=surface)  # -> Geometry, Transform; disabled
extrude = Extrude(Base=orient.Geometry, Direction=unit_z_2)  # disabled
deconstruct_brep_2 = DeconstructBrep(Brep=extrude)  # -> Faces, Edges, Vertices; disabled
list_item_2 = ListItem(List=deconstruct_brep_2.Vertices, Index=number_slider_19, Wrap=True)  # disabled
list_item_3 = ListItem(List=deconstruct_brep_2.Vertices, Index=number_slider_15, Wrap=True)  # disabled
list_item_4 = ListItem(List=deconstruct_brep_2.Vertices, Index=number_slider_22, Wrap=True)  # disabled
list_item_5 = ListItem(List=deconstruct_brep_2.Vertices, Index=number_slider_16, Wrap=True)  # disabled
list_item_6 = ListItem(List=deconstruct_brep_2.Vertices, Index=number_slider_17, Wrap=True)  # disabled
list_item_7 = ListItem(List=deconstruct_brep_2.Vertices, Index=number_slider_18, Wrap=True)  # disabled
list_item_8 = ListItem(List=deconstruct_brep_2.Vertices, Index=number_slider_21, Wrap=True)  # disabled
list_item_9 = ListItem(List=deconstruct_brep_2.Vertices, Index=number_slider_20, Wrap=True)  # disabled
move_4 = Move(Geometry=list_item_9, Motion=expr("-x", unit_y))  # -> Geometry, Transform; disabled
move_5 = Move(Geometry=list_item_6, Motion=expr("-x", unit_y_3))  # -> Geometry, Transform; disabled
move_6 = Move(Geometry=list_item_7, Motion=unit_y_2)  # -> Geometry, Transform; disabled
move_7 = Move(Geometry=list_item_8, Motion=unit_y_4)  # -> Geometry, Transform; disabled
vector_2pt_3 = Vector2Pt(PointA=move_5.Geometry, PointB=list_item_5, Unitize=False)  # -> Vector, Length; disabled
vector_2pt_4 = Vector2Pt(PointA=move_7.Geometry, PointB=list_item_4, Unitize=False)  # -> Vector, Length; disabled
vector_2pt_5 = Vector2Pt(PointA=move_4.Geometry, PointB=list_item_3, Unitize=False)  # -> Vector, Length; disabled
vector_2pt_6 = Vector2Pt(PointA=move_6.Geometry, PointB=list_item_2, Unitize=False)  # -> Vector, Length; disabled
line_sdl = LineSDL(Start=move_5.Geometry, Direction=vector_2pt_3.Vector, Length=number_slider_24)  # disabled
line_sdl_2 = LineSDL(Start=move_7.Geometry, Direction=vector_2pt_4.Vector, Length=number_slider_24)  # disabled
line_sdl_3 = LineSDL(Start=move_4.Geometry, Direction=vector_2pt_5.Vector, Length=number_slider_24)  # disabled
line_sdl_4 = LineSDL(Start=move_6.Geometry, Direction=vector_2pt_6.Vector, Length=number_slider_24)  # disabled

# ---- group: March9thLiftingPullingWSII001
number_slider_25 = Slider(21, range=0..100)  # disabled
number_slider_26 = Slider(12.564, range=0..100)  # disabled
number_slider_27 = Slider(0.4, range=0..10)  # disabled
construct_domain = ConstructDomain(DomainStart=0, DomainEnd=number_slider_26)  # disabled
number_slider_28 = Slider(0.5, range=0..1)  # disabled
number_slider_29 = Slider(4, range=0..10)  # disabled
range = Range(Domain=construct_domain, Steps=number_slider_25)  # disabled
cosine = Cosine(Value=range)  # disabled
sine = Sine(Value=range)  # disabled
multiplication_3 = Multiplication(A=sine, B=number_slider_27)  # disabled
multiplication_4 = Multiplication(A=cosine, B=number_slider_27)  # disabled
series_2 = Series(Start=0, Step=number_slider_28, Count=number_slider_29)  # disabled
construct_point = ConstructPoint(XCoordinate=range, YCoordinate=0, ZCoordinate=0)  # disabled
construct_point_2 = ConstructPoint(XCoordinate=range, YCoordinate=expr("-x", multiplication_3), ZCoordinate=expr("-x", multiplication_4))  # disabled
yz_plane = YZPlane(Origin=Point(0, 0, 0))  # disabled
pi = Pi(Factor=series_2)  # disabled
number_slider_30 = Slider(0.13, range=0..1)  # disabled
interpolate_2 = Interpolate(Vertices=construct_point, Degree=3, Periodic=False, KnotStyle=1)  # -> Curve, Length, Domain; disabled
interpolate_3 = Interpolate(Vertices=construct_point_2, Degree=3, Periodic=False, KnotStyle=1)  # -> Curve, Length, Domain; disabled
number_slider_31 = Slider(6, range=0..100)  # disabled
xz_plane = XZPlane(Origin=Point(0, 0, 0))  # disabled
number_slider_32 = Slider(0, range=0..1)  # disabled
number_slider_33 = Slider(1, range=0..1)  # disabled
pipe = Pipe(Curve=interpolate_3.Curve, Radius=number_slider_30, Caps=2)  # disabled
arc = Arc(Plane=xz_plane, Radius=number_slider_31, Angle=Domain(0, 3.141592654))  # -> Arc, Length; disabled
rotate_3d = Rotate3D(Geometry=pipe, Angle=pi, Center=Point(0, 0, 0), Axis=yz_plane)  # -> Geometry, Transform; disabled
evaluate_curve = EvaluateCurve(Curve=reparameterize(arc.Arc), Parameter=number_slider_32)  # -> Point, Tangent, Angle; disabled
evaluate_curve_2 = EvaluateCurve(Curve=reparameterize(arc.Arc), Parameter=number_slider_33)  # -> Point, Tangent, Angle; disabled
flow = Flow(
    Geometry=rotate_3d.Geometry,
    Base=interpolate_2.Curve,
    Target=arc.Arc,
    ReverseBase=False,
    ReverseTarget=False,
    Stretch=True,
    Rigid=False)  # disabled
xy_plane = XYPlane(Origin=evaluate_curve.Point)  # disabled
xy_plane_2 = XYPlane(Origin=evaluate_curve_2.Point)  # disabled
number_slider_34 = Slider(1, range=0..10)  # disabled
orient_2 = Orient(Geometry=[rotate_3d.Geometry, interpolate_2.Curve], Source=yz_plane, Target=xy_plane)  # -> Geometry, Transform; disabled
orient_3 = Orient(Geometry=rotate_3d.Geometry, Source=yz_plane, Target=xy_plane_2)  # -> Geometry, Transform; disabled
unit_z_3 = UnitZ(Factor=number_slider_26)  # disabled
orient_4 = Orient(Geometry=interpolate_2.Curve, Source=yz_plane, Target=xy_plane)  # -> Geometry, Transform; disabled
mirror = Mirror(Geometry=orient_4.Geometry, Plane=xy_plane)  # -> Geometry, Transform; disabled
number_slider_35 = Slider(4, range=0..10)  # disabled
move_8 = Move(Geometry=orient_2.Geometry, Motion=expr("-x", unit_z_3))  # -> Geometry, Transform; disabled
move_9 = Move(Geometry=orient_3.Geometry, Motion=expr("-x", unit_z_3))  # -> Geometry, Transform; disabled
unit_z_4 = UnitZ(Factor=number_slider_26)  # disabled
unit_z_5 = UnitZ(Factor=number_slider_26)  # disabled
linear_array = LinearArray(Geometry=mirror.Geometry, Direction=expr("-x", unit_z_5), Count=number_slider_35)  # -> Geometry, Transform; disabled
list_item_10 = ListItem(List=linear_array.Geometry, Index=number_slider_34, Wrap=True)  # disabled
point_on_curve = PointOnCurve(list_item_10, parameter=0.957)  # disabled
construct_plane = ConstructPlane(Origin=point_on_curve, XAxis=Vector(1, 0, 0), YAxis=Vector(0, 1, 0))  # disabled
mirror_2 = Mirror(Geometry=flow, Plane=construct_plane)  # -> Geometry, Transform; disabled

# ---- group: March3rdAirportDuchame004
number_slider_36 = Slider(0.64, range=0..1)  # disabled
number_slider_37 = Slider(0.339, range=0..1)  # disabled
number_slider_38 = Slider(8, range=0..100)  # disabled
number_slider_39 = Slider(7, range=0..100)  # disabled
number_slider_40 = Slider(20, range=0..100)  # disabled
number_slider_41 = Slider(9, range=0..100)  # disabled
number_slider_42 = Slider(0.593, range=0..1)  # disabled
# East west Docks
number_slider_43 = Slider(4, range=0..100)  # disabled
number_slider_44 = Slider(0.32, range=0..1)  # disabled
construct_domain_2 = ConstructDomain(DomainStart=number_slider_43, DomainEnd=number_slider_38)  # disabled
range_2 = Range(Domain=construct_domain_2, Steps=number_slider_39)  # disabled
sine_2 = Sine(Value=range_2)  # disabled
multiplication_5 = Multiplication(A=range_2, B=number_slider_40)  # disabled
multiplication_6 = Multiplication(A=sine_2, B=number_slider_41)  # disabled
construct_point_3 = ConstructPoint(XCoordinate=expr("-x", multiplication_5), YCoordinate=multiplication_6, ZCoordinate=0)  # disabled
pi_2 = Pi(Factor=number_slider_36)  # disabled
pi_3 = Pi(Factor=number_slider_44)  # disabled
construct_point_4 = ConstructPoint(XCoordinate=multiplication_5, YCoordinate=multiplication_6, ZCoordinate=0)  # disabled
pi_4 = Pi(Factor=number_slider_37)  # disabled
pi_5 = Pi(Factor=number_slider_42)  # disabled
list_item_11 = ListItem(List=construct_point_4, Index=0, Wrap=True)  # disabled
list_item_12 = ListItem(List=construct_point_3, Index=0, Wrap=True)  # disabled
construct_plane_2 = ConstructPlane(Origin=list_item_12, XAxis=Vector(1, 0, 0), YAxis=Vector(0, 1, 0))  # disabled
construct_plane_3 = ConstructPlane(Origin=list_item_11, XAxis=Vector(1, 0, 0), YAxis=Vector(0, 1, 0))  # disabled
rotate = Rotate(Geometry=construct_point_4, Angle=expr("-x", pi_3), Plane=construct_plane_3)  # -> Geometry, Transform; disabled
rotate_2 = Rotate(Geometry=construct_point_3, Angle=expr("-x", pi_5), Plane=construct_plane_2)  # -> Geometry, Transform; disabled
rotate_3 = Rotate(Geometry=construct_point_4, Angle=pi_2, Plane=construct_plane_3)  # -> Geometry, Transform; disabled
rotate_4 = Rotate(Geometry=construct_point_3, Angle=pi_4, Plane=construct_plane_2)  # -> Geometry, Transform; disabled

# The World of Duchame
# 
# Airport
number_slider_45 = Slider(3, range=0..100)  # disabled
number_slider_46 = Slider(12, range=0..100)  # disabled
number_slider_47 = Slider(2, range=0..10)  # disabled
construct_point_5 = ConstructPoint(XCoordinate=expr("-x", number_slider_46), YCoordinate=expr("-x", number_slider_45), ZCoordinate=number_slider_47)  # disabled
construct_point_6 = ConstructPoint(XCoordinate=number_slider_46, YCoordinate=number_slider_45, ZCoordinate=number_slider_47)  # disabled
line = Line(StartPoint=construct_point_6, EndPoint=construct_point_5)  # disabled
unit_z_6 = UnitZ(Factor=number_slider_47)  # disabled
point_on_curve_2 = PointOnCurve(line, parameter=0.5)  # disabled
number_slider_48 = Slider(0.1, range=0..0.1)  # disabled
number_slider_49 = Slider(1, range=0..1)  # disabled
move_10 = Move(Geometry=point_on_curve_2, Motion=expr("-x", unit_z_6))  # -> Geometry, Transform; disabled
construct_domain_3 = ConstructDomain(DomainStart=number_slider_48, DomainEnd=number_slider_49)  # disabled
number_slider_50 = Slider(1.96, range=0..10)  # disabled
arc_3pt = Arc3Pt(PointA=construct_point_6, PointB=move_10.Geometry, PointC=construct_point_5)  # -> Arc, Plane, Radius; disabled
number_slider_51 = Slider(1, range=0..1)  # disabled
range_3 = Range(Domain=construct_domain_3, Steps=10)  # disabled
number_slider_52 = Slider(1, range=0..1)  # disabled
construct_domain_4 = ConstructDomain(DomainStart=number_slider_50, DomainEnd=number_slider_48)  # disabled
scale = Scale(Geometry=arc_3pt.Arc, Center=point_on_curve_2, Factor=range_3)  # -> flatten(Geometry), Transform; disabled
construct_point_7 = ConstructPoint(XCoordinate=number_slider_52, YCoordinate=0, ZCoordinate=0)  # disabled
range_4 = Range(Domain=construct_domain_4, Steps=10)  # disabled
number_slider_53 = Slider(0, range=0..10)  # disabled
rotate_3d_2 = Rotate3D(Geometry=scale.Geometry, Angle=range_4, Center=point_on_curve_2, Axis=construct_point_7)  # -> Geometry, Transform; disabled
unit_y_5 = UnitY(Factor=1)  # disabled
move_11 = Move(Geometry=rotate_3d_2.Geometry, Motion=unit_y_5)  # -> Geometry, Transform; disabled
list_item_13 = ListItem(List=move_11.Geometry, Index=expr("x-1", number_slider_53), Wrap=True)  # disabled
xz_plane_2 = XZPlane(Origin=Point(0, 0, 0))  # disabled
mirror_3 = Mirror(Geometry=move_11.Geometry, Plane=xz_plane_2)  # -> Geometry, Transform; disabled
list_item_14 = ListItem(List=mirror_3.Geometry, Index=expr("x-1", number_slider_53), Wrap=True)  # disabled
loft_2 = Loft(
    Curves=move_11.Geometry,
    Options={Adjust=False, Closed=False, LoftEnds=0, LoftSimp=0, LoftType=0, Rebuild=10, Refit=0.01})  # disabled
loft_3 = Loft(
    Curves=[list_item_13, list_item_14],
    Options={Adjust=False, Closed=False, LoftEnds=0, LoftSimp=0, LoftType=0, Rebuild=10, Refit=0.01})  # disabled
loft_4 = Loft(
    Curves=mirror_3.Geometry,
    Options={Adjust=False, Closed=False, LoftEnds=0, LoftSimp=0, LoftType=0, Rebuild=10, Refit=0.01})  # disabled
unit_z_7 = UnitZ(Factor=1)  # disabled
extrude_2 = Extrude(Base=[loft_2, loft_4, loft_3], Direction=unit_z_7)  # disabled
number_slider_54 = Slider(1.53, range=0..10)  # disabled
number_slider_55 = Slider(3, range=0..100)  # disabled
panel = Panel(".1")  # disabled
number_slider_56 = Slider(0.23, range=0..1)  # disabled
number_slider_57 = Slider(0.56, range=0..1)  # disabled
construct_domain_5 = ConstructDomain(DomainStart=panel, DomainEnd=number_slider_54)  # disabled
number_slider_58 = Slider(1.9, range=0..10)  # disabled
range_5 = Range(Domain=construct_domain_5, Steps=number_slider_55)  # disabled
pi_6 = Pi(Factor=number_slider_58)  # disabled
polar_array = PolarArray(Geometry=extrude_2, Plane=construct_plane_2, Count=10, Angle=pi_6)  # -> Geometry, Transform; disabled
number_slider_59 = Slider(1, range=0..10)  # disabled
construct_domain_6 = ConstructDomain(DomainStart=number_slider_56, DomainEnd=number_slider_57)  # disabled
flip_matrix = FlipMatrix(Data=polar_array.Geometry)  # disabled
range_6 = Range(Domain=construct_domain_6, Steps=number_slider_59)  # disabled
scale_2 = Scale(Geometry=flip_matrix, Center=Point(0, 0, 0), Factor=range_5)  # -> graft(Geometry), Transform; disabled
pi_7 = Pi(Factor=range_6)  # disabled
number_slider_60 = Slider(5, range=0..5)  # disabled
param_viewer = ParamViewer(flip_matrix)  # disabled
rotate_3d_3 = Rotate3D(Geometry=scale_2.Geometry, Angle=pi_7, Center=Point(0, 0, 0), Axis=Vector(0, 0, 1))  # -> Geometry, Transform; disabled
unit_z_8 = UnitZ(Factor=number_slider_60)  # disabled
move_12 = Move(Geometry=rotate_3d_3.Geometry, Motion=unit_z_8)  # -> Geometry, Transform; disabled

# ---- group: March1stIsabella
number_slider_61 = Slider(35, range=0..100)  # disabled
number_slider_62 = Slider(49, range=0..100)  # disabled
number_slider_63 = Slider(89, range=0..100)  # disabled

number_slider_64 = Slider(7, range=0..10)  # disabled
number_slider_65 = Slider(86, range=0..100)  # disabled
number_slider_66 = Slider(46, range=0..100)  # disabled
number_slider_67 = Slider(5, range=0..10)  # disabled

number_slider_68 = Slider(33, range=0..100)  # disabled
number_slider_69 = Slider(1.2, range=0..2)  # disabled
number_slider_70 = Slider(0.64, range=0..2)  # disabled
number_slider_71 = Slider(-7, range=-7..0)  # disabled

# ---- group: March3rdAirportDuchame004
number_slider_72 = Slider(17, range=0..100)  # disabled
number_slider_73 = Slider(12, range=0..100)  # disabled
number_slider_74 = Slider(17, range=0..100)  # disabled
number_slider_75 = Slider(17, range=0..100)  # disabled
vector_xyz = VectorXYZ(XComponent=number_slider_72, YComponent=number_slider_72, ZComponent=0)  # -> Vector, Length; disabled
vector_xyz_2 = VectorXYZ(XComponent=expr("-x", number_slider_72), YComponent=number_slider_72, ZComponent=0)  # -> Vector, Length; disabled
vector_xyz_3 = VectorXYZ(XComponent=expr("-x", number_slider_75), YComponent=number_slider_75, ZComponent=0)  # -> Vector, Length; disabled
vector_xyz_4 = VectorXYZ(XComponent=number_slider_75, YComponent=number_slider_75, ZComponent=0)  # -> Vector, Length; disabled
unit_z_9 = UnitZ(Factor=number_slider_73)  # disabled
unit_z_10 = UnitZ(Factor=number_slider_74)  # disabled
move_13 = Move(Geometry=[rotate_3.Geometry, rotate.Geometry], Motion=vector_xyz.Vector)  # -> Geometry, Transform; disabled
move_14 = Move(Geometry=[rotate_3.Geometry, rotate.Geometry], Motion=vector_xyz_2.Vector)  # -> Geometry, Transform; disabled
move_15 = Move(Geometry=[rotate_2.Geometry, rotate_4.Geometry], Motion=vector_xyz_3.Vector)  # -> Geometry, Transform; disabled
move_16 = Move(Geometry=[rotate_2.Geometry, rotate_4.Geometry], Motion=vector_xyz_4.Vector)  # -> Geometry, Transform; disabled
move_17 = Move(Geometry=reverse([rotate_2.Geometry, rotate_4.Geometry]), Motion=unit_z_10)  # -> Geometry, Transform; disabled
move_18 = Move(Geometry=[rotate_3.Geometry, rotate.Geometry], Motion=unit_z_9)  # -> Geometry, Transform; disabled
move_19 = Move(Geometry=move_13.Geometry, Motion=unit_z_9)  # -> Geometry, Transform; disabled
move_20 = Move(Geometry=move_15.Geometry, Motion=unit_z_10)  # -> Geometry, Transform; disabled
reverse_list = ReverseList(List=move_17.Geometry)  # disabled
reverse_list_2 = ReverseList(List=move_17.Geometry)  # disabled
line_2 = Line(StartPoint=move_19.Geometry, EndPoint=move_18.Geometry)  # disabled
line_3 = Line(StartPoint=move_19.Geometry, EndPoint=move_13.Geometry)  # disabled
line_4 = Line(StartPoint=[rotate_3.Geometry, rotate.Geometry], EndPoint=move_18.Geometry)  # disabled
line_5 = Line(StartPoint=reverse_list_2, EndPoint=move_20.Geometry)  # disabled
line_6 = Line(StartPoint=[rotate_2.Geometry, rotate_4.Geometry], EndPoint=reverse_list)  # disabled
line_7 = Line(StartPoint=move_20.Geometry, EndPoint=move_15.Geometry)  # disabled
number_slider_76 = Slider(2, range=0..10)  # disabled
merge = Merge(Data1=line_2, Data2=line_5)  # disabled
merge_2 = Merge(Data1=line_3, Data2=line_4, Data3=line_7, Data4=line_6)  # disabled
perp_frames = PerpFrames(Curve=merge, Count=number_slider_76, Align=True)  # -> Frames, Parameters; disabled
number_slider_77 = Slider(9, range=0..10)  # disabled
number_slider_78 = Slider(2, range=0..10)  # disabled
rectangle_3 = Rectangle(Plane=perp_frames.Frames, XSize=number_slider_78, YSize=number_slider_77, Radius=0)  # -> Rectangle, Length; disabled

# ---- group: March6thAniveDuchameCamp001
loft_5 = Loft(
    Curves=[line_sdl_2, line_sdl_4],
    Options={Adjust=False, Closed=False, LoftEnds=0, LoftSimp=0, LoftType=0, Rebuild=10, Refit=0.01})  # disabled
loft_6 = Loft(
    Curves=[line_sdl, line_sdl_3],
    Options={Adjust=False, Closed=False, LoftEnds=0, LoftSimp=0, LoftType=0, Rebuild=10, Refit=0.01})  # disabled

# ---- group: March9thLiftingPullingWSII001
linear_array_2 = LinearArray(Geometry=move_9.Geometry, Direction=expr("-x", unit_z_4), Count=number_slider_35)  # -> Geometry, Transform; disabled
linear_array_3 = LinearArray(Geometry=move_8.Geometry, Direction=expr("-x", unit_z_5), Count=number_slider_35)  # -> Geometry, Transform; disabled

# ---- group: March3rdAirportDuchame004
pipe_2 = Pipe(Curve=merge_2, Radius=1, Caps=0)  # disabled
loft_7 = Loft(
    Curves=rectangle_3.Rectangle,
    Options={Adjust=False, Closed=False, LoftEnds=0, LoftSimp=0, LoftType=0, Rebuild=10, Refit=0.01})  # disabled

# ----
first_last = FirstLast(List=reverse(<missing>))  # -> FirstValue, LastValue

# ---- group: GUIDHepertWalker002WheelBarrow
number_slider_79 = Slider(44, range=0..100)  # disabled
number_slider_80 = Slider(793, range=-1..1000)  # disabled
number_slider_81 = Slider(3, range=0..10)  # disabled
ghpython_script = GhPythonScript(seed=number_slider_79, time=number_slider_80)  # -> out, a; inputs time: Int32; disabled
# ---------- ghpython_script: Python ----------
__author__ = "Sculpture"
__version__ = "2019.10.18"

import rhinoscriptsyntax as rs
#randomness
import random as r
r.seed(seed) #functionname and function variable



#class
class Walker:
    
    def __init__(self):
        self.x = 0 #initialize it
        self.y = 0
        self.z = 0
        
    def point(self):
        shape = rs.AddPoint(self.x, self.y, self.z)
        return shape
    
    def step(self):
        stepX = r.uniform(-1,1.11)
        stepY = r.uniform(-1,1)
        stepZ = r.uniform(-1,1)
        
        self.x += stepX
        self.y += stepY
        self.z += stepZ
        



#time
w = Walker()


pList = []
for t in range(time):
    w.step()
    pList.append(w.point())

a = pList
print pList
# ---------- end ghpython_script ----------
point = Point(ghpython_script.a)  # disabled
rectangle_4 = Rectangle(Plane=point, XSize=Domain(-1, 1), YSize=Domain(-2, 2), Radius=0)  # -> Rectangle, Length; disabled
box_rectangle = BoxRectangle(Rectangle=rectangle_4.Rectangle, Height=number_slider_81)  # disabled
panel_2 = Panel(ghpython_script.a)  # disabled

# ---- group: HepertGauss003
number_slider_82 = Slider(3, range=0..10)  # disabled
number_slider_83 = Slider(120, range=0..1000)  # disabled
number_slider_84 = Slider(0, range=0..100)  # disabled
number_slider_85 = Slider(53, range=0..100)  # disabled
number_slider_86 = Slider(8, range=0..10)  # disabled
number_slider_87 = Slider(120, range=0..1000)  # disabled
number_slider_88 = Slider(12, range=0..100)  # disabled
number_slider_89 = Slider(10, range=0..100)  # disabled
number_slider_90 = Slider(6, range=0..10)  # disabled
number_slider_91 = Slider(120, range=0..1000)  # disabled
number_slider_92 = Slider(12, range=0..100)  # disabled
number_slider_93 = Slider(29, range=0..100)  # disabled
gauss = GhPythonScript(seed=number_slider_82, count=number_slider_83, mean=number_slider_84, sd=number_slider_85)  # -> out, a; inputs count: Int32; disabled
# ---------- gauss: Python ----------
__author__ = "Sculpture"
__version__ = "2019.10.19"

import rhinoscriptsyntax as rs
import random as r
r.seed(seed)

list = []
for c in range(count):
    rand = r.gauss(mean, sd)
    list.append(rand)
    
a = list
# ---------- end gauss ----------
gauss_2 = GhPythonScript(seed=number_slider_86, count=number_slider_87, mean=number_slider_88, sd=number_slider_89)  # -> out, a; inputs count: Int32; disabled; same code as gauss
gauss_3 = GhPythonScript(seed=number_slider_90, count=number_slider_91, mean=number_slider_92, sd=number_slider_93)  # -> out, a; inputs count: Int32; disabled; same code as gauss
pt = ConstructPoint(XCoordinate=gauss.a, YCoordinate=gauss_2.a, ZCoordinate=gauss_3.a)  # disabled
voronoi³ = Voronoi3D(Points=pt)  # -> Cells, Boundary; disabled

# ---- group: GUIDHepertWalker
number_slider_94 = Slider(23, range=0..100)  # disabled
number_slider_95 = Slider(1935, range=0..10000)  # disabled
number_slider_96 = Slider(0.4, range=0..1)  # disabled
ghpython_script_2 = GhPythonScript(seed=number_slider_94, time=number_slider_95)  # -> out, a; inputs time: Int32; disabled
# ---------- ghpython_script_2: Python ----------
__author__ = "Sculpture"
__version__ = "2019.10.18"

import rhinoscriptsyntax as rs
#randomness
import random as r
r.seed(seed) #functionname and function variable



#class
class Walker:
    
    def __init__(self):
        self.x = 0 #initialize it
        self.y = 0
        
        
    def point(self):
        shape = rs.AddPoint(self.x, self.y, 0)
        return shape
    
    def step(self):
        choice = r.randint(0,3) #returns 0, 1, 2, or 3
        if(choice == 0):
            self.x = self.x + 1
        elif(choice == 1):
            self.x = self.x - 1
        elif(choice == 2):
            self.y = self.y + 1
        else:
            self.y = self.y - 1



#time
w = Walker()


pList = []
for t in range(time):
    w.step()
    pList.append(w.point())

a = pList
print pList
# ---------- end ghpython_script_2 ----------
point_2 = Point(ghpython_script_2.a)  # disabled
mesh_sphere = MeshSphere(Base=point_2, Radius=number_slider_96, UCount=10, VCount=20)  # disabled
panel_3 = Panel(ghpython_script_2.a)  # disabled

# ---- group: MyFirstPyNode
panel_4 = Panel("433143d0-bd45-427b-bc00-0f08915fece9")  # disabled
number_slider_97 = Slider(5, range=0..10)  # disabled
unit_x = UnitX(Factor=1)  # disabled
ghpython_script_3 = GhPythonScript(x=unit_x)  # -> out, a; disabled
# ---------- ghpython_script_3: Python ----------
__author__ = "mwickerson"
__version__ = "2019.10.15"

import rhinoscriptsyntax as rs
for input in ghenv.Component.Params.Input:
    for source in input.Sources:
        a = str(source.InstanceGuid)
# ---------- end ghpython_script_3 ----------
panel_5 = Panel(ghpython_script_3.a)  # disabled

# ---- group: DanielNagy004Camera
number_slider_98 = Slider(6.4, range=0..10)  # disabled
number_slider_99 = Slider(1, range=0..1)  # disabled
number_slider_100 = Slider(60345, range=0..100000)  # disabled
pt_2 = ConstructPoint(XCoordinate=0, YCoordinate=0, ZCoordinate=0)  # disabled
number_slider_101 = Slider(79, range=0..100)  # disabled
number_slider_102 = Slider(69, range=0..100)  # disabled
geometry = Geometry(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)  # disabled
point_3 = Point(pt_2)  # disabled
vector_xyz_5 = VectorXYZ(XComponent=number_slider_98, YComponent=number_slider_98, ZComponent=number_slider_98)  # -> Vector, Length; disabled
ghpython_script_4 = GhPythonScript(startPoint=point_3, size=number_slider_98, movefactor=number_slider_99, randomSeed=number_slider_100)  # -> out, a; inputs randomSeed: Int32; disabled
# ---------- ghpython_script_4: Python ----------
__author__ = "Sculpture"
__version__ = "2019.10.19"

import rhinoscriptsyntax as rs
from Rhino.Geometry import Point3d
import random
random.seed(randomSeed)

def boxMaker(firstPoint, recursion):
    
    a.append(firstPoint)
    
    moveX = random.uniform(-size*movefactor,size*movefactor)
    moveY = random.uniform(-size*movefactor, size*movefactor)
    
    if recursion < 10:
        movedPoint1 = firstPoint + Point3d(moveX ,moveY,size)
        boxMaker(movedPoint1, recursion + 1)
        
        if abs(moveX) > size * .5 and abs(moveY) > size * .5:
            movedPoint2 = firstPoint + Point3d(-moveX,-moveY,size)
            boxMaker(movedPoint2, recursion + 1)




firstPoint = rs.coerce3dpoint(startPoint)

a = []

boxMaker(firstPoint, 0)
# ---------- end ghpython_script_4 ----------
divide_curve_2 = DivideCurve(Curve=geometry, Count=number_slider_101, Kinks=False)  # -> Points, Tangents, Parameters; disabled
move_21 = Move(Geometry=ghpython_script_4.a, Motion=vector_xyz_5.Vector)  # -> Geometry, Transform; disabled
list_item_15 = ListItem(List=divide_curve_2.Points, Index=number_slider_102, Wrap=True)  # disabled
box_2pt = Box2Pt(PointA=ghpython_script_4.a, PointB=move_21.Geometry, Plane=PlaneXY(0, 0, 0))  # disabled
ghpython_script_5 = GhPythonScript(location=list_item_15, target=point_3)  # -> out, a; disabled
# ---------- ghpython_script_5: Python ----------
__author__ = "Sculpture"
__version__ = "2019.10.19"

import rhinoscriptsyntax as rs
import scriptcontext as sc

sc.doc = ghdoc

loc = rs.coerce3dpoint(location)
tar = rs.coerce3dpoint(target)

vp = sc.doc.Views.ActiveView.ActiveViewport
vp.SetCameraLocation(loc, False)
vp.SetCameraDirection(tar - loc, True)
# ---------- end ghpython_script_5 ----------
panel_6 = Panel(box_2pt)  # disabled

# ---- group: Nagy003Wheel
number_slider_103 = Slider(10, range=0..10)
number_slider_104 = Slider(20, range=1..20)
number_slider_105 = Slider(100, range=0..100)
number_slider_106 = Slider(21, range=0..100)

# ----
number_slider_107 = Slider(27, range=0..100)  # disabled
number_slider_108 = Slider(88, range=0..100)  # disabled
md_slider_2 = MDSlider(
    SliderMode=0,
    slider_value=Point(0.602439043, 0.5634145969, 0.5),
    x_domain=Domain(0, 1),
    y_domain=Domain(0, 1),
    z_domain=Domain(0, 1))  # disabled
number_slider_109 = Slider(0.52, range=0..1)  # disabled
number_slider_110 = Slider(10, range=0..100)  # disabled
number_slider_111 = Slider(6.08, range=0..10)  # disabled
number_slider_112 = Slider(18, range=0..100)  # disabled
number_slider_113 = Slider(2, range=0..10)  # disabled
number_slider_114 = Slider(0.46, range=0..1)  # disabled
number_slider_115 = Slider(4, range=0..100)  # disabled
unit_z_11 = UnitZ(Factor=number_slider_108)  # disabled
plane_surface = PlaneSurface(Plane=PlaneXY(0, 0, 0), XSize=Domain(-100, 100), YSize=Domain(-100, 100))  # disabled
construct_domain_7 = ConstructDomain(DomainStart=number_slider_112, DomainEnd=number_slider_110)  # disabled
construct_point_8 = ConstructPoint(XCoordinate=number_slider_109, YCoordinate=number_slider_114, ZCoordinate=0)  # disabled
number_slider_116 = Slider(2, range=0..10)  # disabled
number_slider_117 = Slider(10, range=0..10)  # disabled
yz_plane_2 = YZPlane(Origin=Point(0, 0, 0))  # disabled
extrude_3 = Extrude(Base=plane_surface, Direction=unit_z_11)  # disabled
divide_surface = DivideSurface(Surface=plane_surface, UCount=number_slider_107, VCount=number_slider_107)  # -> flatten(Points), Normals, Parameters; disabled
evaluate_surface_2 = EvaluateSurface(Surface=reparameterize(plane_surface), Point=construct_point_8)  # -> Point, Normal, UDirection, VDirection, Frame; disabled
number_slider_118 = Slider(0.49, range=0..1)  # disabled
number_slider_119 = Slider(0.04, range=-0.01..0.1)  # disabled
number_slider_120 = Slider(12, range=0..100)  # disabled
range_7 = Range(Domain=construct_domain_7, Steps=number_slider_117)  # disabled
number_slider_121 = Slider(36, range=0..100)  # disabled
vector_xyz_6 = VectorXYZ(
    XComponent=expr("-x", number_slider_115),
    YComponent=expr("-x*2", number_slider_115),
    ZComponent=expr("2*x", number_slider_115))  # -> Vector, Length; disabled
ellipse = Ellipse(Plane=yz_plane_2, Radius1=number_slider_113, Radius2=number_slider_111)  # -> Ellipse, Focus1, Focus2; disabled
distance = Distance(PointA=divide_surface.Points, PointB=evaluate_surface_2.Point)  # disabled
number_slider_122 = Slider(5.12, range=0..10)  # disabled
number_slider_123 = Slider(0.608, range=0..1)  # disabled
series_3 = Series(Start=number_slider_118, Step=number_slider_119, Count=10)  # disabled
number_slider_124 = Slider(12, range=0..100)  # disabled
series_4 = Series(Start=number_slider_110, Step=1, Count=10)  # disabled
remap = Remap(data=distance, min=0, max=1)  # disabled
jitter_2 = Jitter(List=series_3, Jitter=1, Seed=number_slider_120)  # -> Values, Indices; disabled
jitter_3 = Jitter(List=series_3, Jitter=1, Seed=number_slider_121)  # -> Values, Indices; disabled
number_slider_125 = Slider(35, range=0..100)  # disabled
number_slider_126 = Slider(0, range=0..100)  # disabled
jitter_4 = Jitter(List=series_4, Jitter=1, Seed=2)  # -> Values, Indices; disabled
number_slider_127 = Slider(0.19, range=0..1)  # disabled
number_slider_128 = Slider(0, range=0..1)  # disabled
series_5 = Series(Start=number_slider_122, Step=number_slider_123, Count=10)  # disabled
graph_mapper = GraphMapper(
    remap,
    x0=0,
    x1=1,
    y0=0,
    y1=1,
    container_name="Bezier",
    cpx=[0, 0.3297710717, 0.03053435124, 1],
    cpy=[0.1273238659, 0.5788732171, 1, 1])  # disabled
scale_nu = ScaleNU(Geometry=ellipse.Ellipse, Plane=yz_plane_2, ScaleX=jitter_2.Values, ScaleY=jitter_3.Values, ScaleZ=1)  # -> Geometry, Transform; disabled
unit_z_12 = UnitZ(Factor=jitter_4.Values)  # disabled
number_slider_129 = Slider(0.13, range=0..1)  # disabled
number_slider_130 = Slider(0.26, range=0..1)  # disabled
number_slider_131 = Slider(0.17, range=0..1)  # disabled
number_slider_132 = Slider(0.37, range=0..1)  # disabled
jitter_5 = Jitter(List=series_5, Jitter=1, Seed=number_slider_124)  # -> Values, Indices; disabled
graph_mapper_2 = GraphMapper(
    graph_mapper,
    x0=0,
    x1=1,
    y0=0,
    y1=1,
    container_name="Sine",
    Equation_px=[0.2974683642, 1],
    Equation_py=[0.1699998975, 0.9376811385])  # disabled
series_6 = Series(Start=number_slider_128, Step=number_slider_127, Count=10)  # disabled
move_22 = Move(Geometry=scale_nu.Geometry, Motion=unit_z_12)  # -> Geometry, Transform; disabled
number_slider_133 = Slider(12, range=0..100)  # disabled
remap_2 = Remap(data=graph_mapper_2, min=number_slider_126, max=number_slider_125)  # disabled
jitter_6 = Jitter(List=series_6, Jitter=1, Seed=2)  # -> Values, Indices; disabled
number_slider_134 = Slider(0.59, range=0..1)  # disabled
series_7 = Series(Start=number_slider_130, Step=number_slider_129, Count=10)  # disabled
series_8 = Series(Start=number_slider_132, Step=number_slider_131, Count=10)  # disabled
area_2 = Area(Geometry=move_22.Geometry)  # -> Area, Centroid; disabled
unit_z_13 = UnitZ(Factor=remap_2)  # disabled
pi_8 = Pi(Factor=jitter_6.Values)  # disabled
move_23 = Move(Geometry=divide_surface.Points, Motion=unit_z_13)  # -> Geometry, Transform; disabled
jitter_7 = Jitter(List=series_7, Jitter=1, Seed=number_slider_133)  # -> Values, Indices; disabled
rotate_3d_4 = Rotate3D(Geometry=move_22.Geometry, Angle=pi_8, Center=area_2.Centroid, Axis=Vector(0, 0, 1))  # -> Geometry, Transform; disabled
number_slider_135 = Slider(67, range=0..100)  # disabled
md_slider_3 = MDSlider(SliderMode=0, slider_value=Point(0.5, 0.5, 0.5), x_domain=Domain(0, 1), y_domain=Domain(0, 1), z_domain=Domain(0, 1))  # disabled
number_slider_136 = Slider(19, range=0..100)  # disabled
number_slider_137 = Slider(2, range=0..10)  # disabled
surface_from_points = SurfaceFromPoints(Points=move_23.Geometry, UCount=expr("x+1", number_slider_107), Interpolate=False)  # disabled
boundary_surfaces = BoundarySurfaces(Edges=rotate_3d_4.Geometry)  # disabled
split_brep = SplitBrep(Brep=extrude_3, Cutter=surface_from_points)  # disabled
evaluate_surface_3 = EvaluateSurface(Surface=reparameterize(boundary_surfaces), Point=md_slider_3)  # -> Point, Normal, UDirection, VDirection, Frame; disabled
series_9 = Series(Start=number_slider_135, Step=number_slider_137, Count=10)  # disabled
dispatch_2 = Dispatch(List=split_brep, DispatchPattern=[True, False])  # -> ListA, ListB; disabled
jitter_8 = Jitter(List=series_9, Jitter=1, Seed=number_slider_136)  # -> Values, Indices; disabled
multiplication_7 = Multiplication(A=evaluate_surface_3.Normal, B=jitter_8.Values)  # disabled
brep = Brep(dispatch_2.ListA)  # disabled
extrude_4 = Extrude(Base=boundary_surfaces, Direction=multiplication_7)  # disabled
deconstruct_brep_3 = DeconstructBrep(Brep=extrude_4)  # -> Faces, Edges, Vertices; disabled
list_item_16 = ListItem(List=deconstruct_brep_3.Faces, Index=number_slider_116, Wrap=True)  # disabled
area_3 = Area(Geometry=list_item_16)  # -> Area, Centroid; disabled
construct_plane_4 = ConstructPlane(Origin=area_3.Centroid, XAxis=Vector(1, 0, 0), YAxis=Vector(0, 1, 0))  # -> flatten(Plane); disabled
sphere = Sphere(Base=construct_plane_4, Radius=jitter_5.Values)  # disabled
scale_nu_2 = ScaleNU(Geometry=sphere, Plane=construct_plane_4, ScaleX=series_8, ScaleY=jitter_7.Values, ScaleZ=number_slider_134)  # -> Geometry, Transform; disabled
brep_join = BrepJoin(Breps=[brep, surface_from_points])  # -> flatten(Breps), Closed; disabled
solid_union = SolidUnion(Breps=brep_join.Breps)  # disabled
solid_difference = SolidDifference(BrepsA=solid_union, BrepsB=extrude_4)  # disabled

brep_2 = Brep(scale_nu_2.Geometry)  # disabled
solid_difference_2 = SolidDifference(BrepsA=solid_difference, BrepsB=brep_2)  # disabled

# ---- group: March1stIsabella
# Bell Top and Bottom Shape
# Rope
# Clapper
# Rope Bend
landing_platform_height = Slider(8, range=0..100)  # disabled
scale_3 = Slider(0.62, range=0..1)  # disabled
number_slider_138 = Slider(6, range=0..10)  # disabled
number_slider_139 = Slider(159, range=0..300)  # disabled
number_slider_140 = Slider(14, range=0..100)  # disabled
number_slider_141 = Slider(0.22, range=0..1)  # disabled
number_slider_142 = Slider(244, range=0..400)  # disabled
number_slider_143 = Slider(100, range=0..200)  # disabled
integer = Integer(4)  # disabled
integer_2 = Integer(1)  # disabled
number_slider_144 = Slider(2, range=0..10)  # disabled
number_slider_145 = Slider(0, range=0..100)  # disabled
polygon = Polygon(Plane=PlaneXY(0, 0, 0), Radius=beam_width_depth, Segments=integer, FilletRadius=0)  # -> Polygon, Length; disabled
unit_x_2 = UnitX(Factor=beam_angle)  # disabled
number_slider_146 = Slider(1, range=0..10)  # disabled
construct_point_9 = ConstructPoint(XCoordinate=0, YCoordinate=integer_2, ZCoordinate=0)  # disabled
construct_point_10 = ConstructPoint(XCoordinate=0, YCoordinate=0, ZCoordinate=0)  # disabled
number_slider_147 = Slider(1, range=0..10)  # disabled
number_slider_148 = Slider(4, range=0..10)  # disabled
unit_x_3 = UnitX(Factor=number_slider_138)  # disabled
unit_y_6 = UnitY(Factor=number_slider_139)  # disabled
construct_point_11 = ConstructPoint(XCoordinate=0, YCoordinate=number_slider_142, ZCoordinate=0)  # disabled
move_24 = Move(Geometry=polygon.Polygon, Motion=unit_x_2)  # -> Geometry, Transform; disabled
unit_z_14 = UnitZ(Factor=number_slider_143)  # disabled
area_4 = Area(Geometry=move_24.Geometry)  # -> Area, Centroid; disabled
line_8 = Line(StartPoint=construct_point_10, EndPoint=construct_point_9)  # disabled
move_25 = Move(Geometry=construct_point_11, Motion=unit_z_14)  # -> Geometry, Transform; disabled
integer_3 = Integer(expr("1", 1))  # disabled
pi_9 = Pi(Factor=beam_angle_2)  # disabled
number_slider_149 = Slider(1, range=0..1)  # disabled
construct_point_12 = ConstructPoint(XCoordinate=0, YCoordinate=integer_3, ZCoordinate=0)  # disabled
construct_point_13 = ConstructPoint(XCoordinate=0, YCoordinate=0, ZCoordinate=0)  # disabled
unit_z_15 = UnitZ(Factor=number_slider_140)  # disabled
rotate_3d_5 = Rotate3D(Geometry=move_24.Geometry, Angle=expr("-x", pi_9), Center=area_4.Centroid, Axis=line_8)  # -> Geometry, Transform; disabled
pi_10 = Pi(Factor=number_slider_141)  # disabled
line_9 = Line(StartPoint=construct_point_13, EndPoint=construct_point_12)  # disabled
construct_point_14 = ConstructPoint(XCoordinate=0, YCoordinate=number_slider_149, ZCoordinate=0)  # disabled
md_slider_4 = MDSlider(SliderMode=0, slider_value=Point(0.5, 0.5, 0.5), x_domain=Domain(0, 1), y_domain=Domain(0, 1), z_domain=Domain(0, 1))  # disabled
pi_11 = Pi(Factor=wheel_rotation)  # disabled
number_slider_150 = Slider(2, range=0..2)  # disabled
boundary_surfaces_2 = BoundarySurfaces(Edges=rotate_3d_5.Geometry)  # disabled
number_slider_151 = Slider(1, range=0..1)  # disabled
number_slider_152 = Slider(100, range=0..100)  # disabled
unit_z_16 = UnitZ(Factor=landing_platform_height)  # disabled
evaluate_surface_4 = EvaluateSurface(Surface=boundary_surfaces_2, Point=md_slider_4)  # -> Point, Normal, UDirection, VDirection, Frame; disabled
point_4 = Point(evaluate_surface_4.Point)  # disabled
move_26 = Move(Geometry=point_4, Motion=unit_y_6)  # -> Geometry, Transform; disabled
line_10 = Line(StartPoint=point_4, EndPoint=move_26.Geometry)  # disabled
move_27 = Move(Geometry=line_10, Motion=unit_x_3)  # -> Geometry, Transform; disabled
arc_3pt_2 = Arc3Pt(PointA=point_4, PointB=move_26.Geometry, PointC=construct_point_11)  # -> Arc, Plane, Radius; disabled
point_on_curve_3 = PointOnCurve(arc_3pt_2.Arc, parameter=0.27)  # disabled
loft_8 = Loft(
    Curves=[line_10, move_27.Geometry],
    Options={Adjust=False, Closed=False, LoftEnds=0, LoftSimp=0, LoftType=0, Rebuild=10, Refit=0.01})  # disabled
extrude_5 = Extrude(Base=loft_8, Direction=unit_z_15)  # disabled
rotate_3d_6 = Rotate3D(Geometry=extrude_5, Angle=pi_10, Center=point_4, Axis=construct_point_14)  # -> Geometry, Transform; disabled
construct_domain_8 = ConstructDomain(DomainStart=0, DomainEnd=number_slider_150)  # disabled
unit_z_17 = UnitZ(Factor=beam_height)  # disabled
construct_domain_9 = ConstructDomain(DomainStart=number_slider_151, DomainEnd=number_slider_152)  # disabled
bend_deform = BendDeform(Geometry=rotate_3d_6.Geometry, BendingArc=arc_3pt_2.Arc)  # disabled
multiplication_8 = Multiplication(A=evaluate_surface_4.Normal, B=beam_height)  # disabled
range_8 = Range(Domain=construct_domain_8, Steps=number_slider_67)  # disabled
range_9 = Range(Domain=construct_domain_9, Steps=10)  # disabled
extrude_6 = Extrude(Base=rotate_3d_5.Geometry, Direction=multiplication_8)  # disabled
construct_domain_10 = ConstructDomain(DomainStart=number_slider_145, DomainEnd=number_slider_144)  # disabled
pi_12 = Pi(Factor=range_8)  # disabled
unit_z_18 = UnitZ(Factor=range_9)  # disabled
cap_holes_2 = CapHoles(Brep=extrude_6)  # disabled
move_28 = Move(Geometry=bend_deform, Motion=unit_z_18)  # -> Geometry, Transform; disabled
arc_3pt_3 = Arc3Pt(PointA=point_4, PointB=point_on_curve_3, PointC=move_25.Geometry)  # -> Arc, Plane, Radius; disabled
range_10 = Range(Domain=construct_domain_10, Steps=integer)  # disabled
dispatch_3 = Dispatch(List=move_28.Geometry, DispatchPattern=[True, False])  # -> ListA, ListB; disabled
pi_13 = Pi(Factor=range_10)  # disabled
rotate_3d_7 = Rotate3D(Geometry=cap_holes_2, Angle=pi_13, Center=Point(0, 0, 0), Axis=Vector(0, 0, 1))  # -> Geometry, Transform; disabled
rotate_3d_8 = Rotate3D(Geometry=cap_holes_2, Angle=pi_13, Center=Point(0, 0, 0), Axis=Vector(0, 0, 1))  # -> Geometry, Transform; disabled
xz_plane_3 = XZPlane(Origin=Point(0, 0, 0))  # disabled
bend_deform_2 = BendDeform(Geometry=dispatch_3.ListA, BendingArc=arc_3pt_3.Arc)  # disabled
construct_domain_11 = ConstructDomain(DomainStart=0, DomainEnd=expr("x-1", integer))  # disabled
mirror_4 = Mirror(Geometry=bend_deform_2, Plane=PlaneYZ(0, 0, 0))  # -> Geometry, Transform; disabled
mirror_5 = Mirror(Geometry=[bend_deform_2, mirror_4.Geometry], Plane=xz_plane_3)  # -> Geometry, Transform; disabled
solid_union_2 = SolidUnion(Breps=[bend_deform_2, mirror_4.Geometry, mirror_5.Geometry])  # disabled
number_slider_153 = Slider(1.64, range=0..10)  # disabled
number_slider_154 = Slider(0.478, range=0..2.5)  # disabled
number_slider_155 = Slider(0.762, range=0..2.5)  # disabled
number_slider_156 = Slider(0.379, range=0..2.5)  # disabled
construct_point_15 = ConstructPoint(XCoordinate=0, YCoordinate=0, ZCoordinate=expr("-x", number_slider_62))  # disabled
construct_point_16 = ConstructPoint(XCoordinate=number_slider_63, YCoordinate=0, ZCoordinate=0)  # disabled
construct_point_17 = ConstructPoint(XCoordinate=0, YCoordinate=number_slider_61, ZCoordinate=expr("-x", number_slider_61))  # disabled
scale_4 = Scale(Geometry=solid_union_2, Center=Point(0, 0, 0), Factor=number_slider_153)  # -> Geometry, Transform; disabled
arc_3pt_4 = Arc3Pt(PointA=construct_point_16, PointB=construct_point_15, PointC=construct_point_17)  # -> Arc, Plane, Radius; disabled
scale_nu_3 = ScaleNU(
    Geometry=scale_4.Geometry,
    Plane=PlaneXY(0, 0, 0),
    ScaleX=number_slider_156,
    ScaleY=number_slider_155,
    ScaleZ=number_slider_154)  # -> Geometry, Transform; disabled
unit_z_19 = UnitZ(Factor=1)  # disabled
move_29 = Move(Geometry=scale_nu_3.Geometry, Motion=unit_z_19)  # -> Geometry, Transform; disabled
curve = Curve(<curve referenced from the Rhino model>)  # disabled

number_slider_157 = Slider(5, range=0..10)  # disabled
number_slider_158 = Slider(35, range=0..100)  # disabled
number_slider_159 = Slider(26, range=0..100)  # disabled
number_slider_160 = Slider(1, range=0..1)  # disabled
number_slider_161 = Slider(0.52, range=0..2)  # disabled
number_slider_162 = Slider(10, range=0..10)  # disabled

# ----
number_slider_163 = Slider(398, range=0..1100)  # disabled
number_slider_164 = Slider(14, range=0..100)  # disabled
number_slider_165 = Slider(11, range=0..100)  # disabled
height = Slider(10, range=-1..10)  # disabled
planesrf = PlaneSurface(Plane=PlaneXY(0, 0, 0), XSize=number_slider_165, YSize=number_slider_164)  # disabled

move_30 = Move(Geometry=planesrf, Motion=vector_xyz_6.Vector)  # -> Geometry, Transform; disabled

pop2d = Populate2D(Region=move_30.Geometry, Count=number_slider_163, Seed=1)  # disabled
del = DelaunayMesh(Points=pop2d, Plane=PlaneXY(0, 0, 0))  # disabled
demesh = DeconstructMesh(Mesh=del)  # -> Vertices, Faces, Colours, Normals; disabled
lng = ListLength(List=demesh.Vertices)  # disabled
pdecon = Deconstruct(Point=demesh.Vertices)  # -> XComponent, YComponent, ZComponent; disabled
random = Random(Range=Domain(0, 1), Number=lng, Seed=2)  # disabled
multiplication_9 = Multiplication(A=random, B=height)  # disabled
pt_3 = ConstructPoint(XCoordinate=pdecon.XComponent, YCoordinate=pdecon.YComponent, ZCoordinate=multiplication_9)  # disabled
conmesh = ConstructMesh(Vertices=pt_3, Faces=demesh.Faces)  # disabled

# ---- group: March1stIsabella (continued)
unit_x_4 = UnitX(Factor=number_slider_158)  # disabled
unit_x_5 = UnitX(Factor=number_slider_157)  # disabled
unit_z_20 = UnitZ(Factor=number_slider_159)  # disabled
pi_14 = Pi(Factor=number_slider_161)  # disabled

rotate_3d_9 = Rotate3D(Geometry=cap_holes_2, Angle=pi_13, Center=Point(0, 0, 0), Axis=Vector(0, 0, 1))  # -> Geometry, Transform; disabled

sub_list = SubList(List=rotate_3d_9.Geometry, Domain=construct_domain_11, Wrap=True)  # -> List, Index; disabled
brep_3 = Brep(sub_list.List)  # disabled
deconstruct_brep_4 = DeconstructBrep(Brep=brep_3)  # -> Faces, Edges, Vertices; disabled
list_item_17 = ListItem(List=deconstruct_brep_4.Vertices, Index=number_slider_146, Wrap=True)  # -> flatten(Item); disabled
list_item_18 = ListItem(List=deconstruct_brep_4.Vertices, Index=number_slider_147, Wrap=True)  # -> flatten(Item); disabled
list_item_19 = ListItem(List=deconstruct_brep_4.Vertices, Index=number_slider_148, Wrap=True)  # -> flatten(Item); disabled
dispatch_4 = Dispatch(List=list_item_18, DispatchPattern=[True, False])  # -> ListA, ListB; disabled
dispatch_5 = Dispatch(List=list_item_17, DispatchPattern=[True, False])  # -> ListA, ListB; disabled
dispatch_6 = Dispatch(List=list_item_19, DispatchPattern=[True, False])  # -> ListA, ListB; disabled
dispatch_7 = Dispatch(List=dispatch_5.ListB, DispatchPattern=[True, False])  # -> ListA, ListB; disabled
dispatch_8 = Dispatch(List=dispatch_5.ListA, DispatchPattern=[True, False])  # -> ListA, ListB; disabled
dispatch_9 = Dispatch(List=dispatch_5.ListB, DispatchPattern=[True, False])  # -> ListA, ListB; disabled
dispatch_10 = Dispatch(List=dispatch_5.ListA, DispatchPattern=[True, False])  # -> ListA, ListB; disabled
circle_cnr = CircleCNR(Center=dispatch_6.ListA, Normal=Vector(0, 0, 1), Radius=spoke_length)  # disabled
line_11 = Line(StartPoint=dispatch_4.ListA, EndPoint=dispatch_4.ListB)  # disabled
line_12 = Line(StartPoint=dispatch_8.ListB, EndPoint=dispatch_7.ListA)  # disabled
line_13 = Line(StartPoint=dispatch_10.ListA, EndPoint=dispatch_9.ListB)  # disabled
dispatch_11 = Dispatch(List=circle_cnr, DispatchPattern=[True, False])  # -> ListA, ListB; disabled
dispatch_12 = Dispatch(List=dispatch_6.ListA, DispatchPattern=[True, False])  # -> ListA, ListB; disabled
boundary_surfaces_3 = BoundarySurfaces(Edges=[line_11, line_13, line_12])  # disabled
area_5 = Area(Geometry=boundary_surfaces_3)  # -> Area, Centroid; disabled
point_5 = Point(area_5.Centroid)  # disabled
construct_domain_12 = ConstructDomain(DomainStart=point_5, DomainEnd=number_slider_71)  # disabled
move_31 = Move(Geometry=area_5.Centroid, Motion=expr("-x", unit_z_20))  # -> Geometry, Transform; disabled
move_32 = Move(Geometry=move_31.Geometry, Motion=unit_x_4)  # -> Geometry, Transform; disabled
range_11 = Range(Domain=construct_domain_12, Steps=number_slider_68)  # disabled
cosine_2 = Cosine(Value=range_11)  # disabled
sine_3 = Sine(Value=range_11)  # disabled
extrude_7 = Extrude(Base=boundary_surfaces_3, Direction=unit_z_16)  # disabled
extrude_8 = Extrude(Base=boundary_surfaces_3, Direction=unit_z_16)  # disabled
multiplication_10 = Multiplication(A=sine_3, B=number_slider_69)  # disabled
multiplication_11 = Multiplication(A=cosine_2, B=number_slider_69)  # disabled
line_14 = Line(StartPoint=area_5.Centroid, EndPoint=move_32.Geometry)  # disabled
construct_point_18 = ConstructPoint(XCoordinate=multiplication_10, YCoordinate=multiplication_11, ZCoordinate=range_11)  # disabled
list_item_20 = ListItem(List=construct_point_18, Index=number_slider_65, Wrap=True)  # disabled
interpolate_4 = Interpolate(Vertices=construct_point_18, Degree=3, Periodic=False, KnotStyle=1)  # -> Curve, Length, Domain; disabled
cone = Cone(Base=list_item_20, Radius=number_slider_64, Length=number_slider_66)  # -> Cone, Tip; disabled
offset_surface = OffsetSurface(Surface=cone.Cone, Distance=1, BothSides=False, CreateSolid=True)  # disabled
offset_surface_2 = OffsetSurface(Surface=cone.Cone, Distance=1, BothSides=False, CreateSolid=True)  # disabled
rotate_3d_10 = Rotate3D(Geometry=dispatch_11.ListA, Angle=pi_11, Center=dispatch_12.ListA, Axis=line_9)  # -> Geometry, Transform; disabled
perp_frames_2 = PerpFrames(Curve=rotate_3d_10.Geometry, Count=wheel_perpf, Align=True)  # -> Frames, Parameters; disabled
pipe_3 = Pipe(Curve=interpolate_4.Curve, Radius=number_slider_70, Caps=0)  # disabled
rotate_3d_11 = Rotate3D(Geometry=pipe_3, Angle=pi_12, Center=Point(0, 0, 0), Axis=Vector(0, 0, 1))  # -> Geometry, Transform; disabled
rotate_3d_12 = Rotate3D(Geometry=pipe_3, Angle=pi_12, Center=Point(0, 0, 0), Axis=Vector(0, 0, 1))  # -> Geometry, Transform; disabled
ellipse_2 = Ellipse(Plane=perp_frames_2.Frames, Radius1=elipse_dim_1, Radius2=ellipse_dim_2)  # -> Ellipse, Focus1, Focus2; disabled
area_6 = Area(Geometry=rotate_3d_10.Geometry)  # -> Area, Centroid; disabled
divide_curve_3 = DivideCurve(Curve=rotate_3d_10.Geometry, Count=wheel_perpf, Kinks=False)  # -> Points, Tangents, Parameters; disabled
line_15 = Line(StartPoint=area_6.Centroid, EndPoint=divide_curve_3.Points)  # disabled
rotate_3d_13 = Rotate3D(Geometry=pipe_3, Angle=pi_12, Center=Point(0, 0, 0), Axis=Vector(0, 0, 1))  # -> Geometry, Transform; disabled

point_on_curve_4 = PointOnCurve(line_14, parameter=0)  # disabled

move_33 = Move(Geometry=point_on_curve_4, Motion=unit_x_5)  # -> Geometry, Transform; disabled
arc_3pt_5 = Arc3Pt(PointA=area_5.Centroid, PointB=move_33.Geometry, PointC=move_32.Geometry)  # -> Arc, Plane, Radius; disabled
rotate_3d_14 = Rotate3D(Geometry=arc_3pt_5.Arc, Angle=pi_14, Center=move_32.Geometry, Axis=Vector(0, 20.00224754, 0))  # -> Geometry, Transform; disabled
scale_5 = Scale(Geometry=rotate_3d_14.Geometry, Center=move_32.Geometry, Factor=number_slider_160)  # -> Geometry, Transform; disabled
merge_3 = Merge(Data1=scale_5.Geometry, Data2=arc_3pt_5.Arc)  # disabled
revolution = Revolution(Curve=merge_3, Axis=Line((0, 0, 0), (0, 0, 44.11065724)), Domain=Domain(0, 6.283185307))  # disabled
offset_surface_3 = OffsetSurface(Surface=revolution, Distance=number_slider_162, BothSides=False, CreateSolid=True)  # disabled
offset_surface_4 = OffsetSurface(Surface=revolution, Distance=number_slider_162, BothSides=False, CreateSolid=True)  # disabled
merge_4 = Merge(Data1=rotate_3d_8.Geometry, Data2=extrude_8, Data3=offset_surface_4, Data4=rotate_3d_12.Geometry, Data5=offset_surface_2)  # disabled
scale_6 = Scale(Geometry=merge_4, Center=Point(0, 0, 0), Factor=scale_3)  # -> Geometry, Transform; disabled
dispatch_13 = Dispatch(List=revolution, DispatchPattern=[True, False])  # -> ListA, ListB; disabled

bend_deform_3 = BendDeform(Geometry=rotate_3d_13.Geometry, BendingArc=arc_3pt_4.Arc)  # disabled
move_34 = Move(Geometry=scale_6.Geometry, Motion=unit_z_17)  # -> Geometry, Transform; disabled
extrude_9 = Extrude(Base=boundary_surfaces_3, Direction=unit_z_16)  # disabled
offset_surface_5 = OffsetSurface(Surface=revolution, Distance=number_slider_162, BothSides=False, CreateSolid=True)  # disabled
offset_surface_6 = OffsetSurface(Surface=cone.Cone, Distance=1, BothSides=False, CreateSolid=True)  # disabled
pipe_4 = Pipe(Curve=line_15, Radius=expr("x/2", spoke_radii), Caps=0)  # disabled
sphere_2 = Sphere(Base=area_6.Centroid, Radius=spoke_radii)  # disabled
mirror_6 = Mirror(Geometry=[sphere_2, pipe_4], Plane=PlaneYZ(0, 0, 0))  # -> Geometry, Transform; disabled
loft_9 = Loft(
    Curves=ellipse_2.Ellipse,
    Options={Adjust=False, Closed=True, LoftEnds=0, LoftSimp=0, LoftType=0, Rebuild=10, Refit=0.01})  # disabled
mirror_7 = Mirror(Geometry=loft_9, Plane=PlaneYZ(0, 0, 0))  # -> Geometry, Transform; disabled

brep_4 = Brep([mirror_6.Geometry, sphere_2, pipe_4, loft_9, mirror_7.Geometry, rotate_3d_9.Geometry, extrude_9, offset_surface_5, offset_surface_6, move_34.Geometry, bend_deform_3])  # disabled
bend_deform_4 = BendDeform(Geometry=brep_4, BendingArc=curve)  # disabled

# ---- group: Nagy001
pt_4 = ConstructPoint(XCoordinate=0, YCoordinate=0, ZCoordinate=0)
number_slider_166 = Slider(0.6, range=0..10)
pt_5 = Point(pt_4)
python = GhPythonScript(startPoint=pt_5, size=number_slider_166, moveFactor=Slider(1, range=0..1), randomSeed=Slider(70838, range=0..100000))  # -> out, a
# ---------- python: Python ----------
__author__ = "Sculpture"
__version__ = "2019.10.19"

import rhinoscriptsyntax as rs
from Rhino.Geometry import Point3d
import random
random.seed(randomSeed)

def boxMaker(firstPoint, recursion):
    a.append(firstPoint)
    
    moveX = random.uniform(-size*moveFactor, size*moveFactor)
    moveY = random.uniform(-size*moveFactor, size*moveFactor)
    
    if recursion < 10:
        movedPoint1 = firstPoint + Point3d(moveX,moveY,size)
        boxMaker(movedPoint1, recursion + 1)
        
        if abs(moveX) > size * .5 and abs(moveY) > size * .5:
            movedPoint2 = firstPoint + Point3d(-moveX,-moveY,size)
            boxMaker(movedPoint2, recursion + 1)
        


firstPoint = rs. coerce3dpoint(startPoint)

a = []

boxMaker(firstPoint, 0)
# ---------- end python ----------
vec = VectorXYZ(XComponent=number_slider_166, YComponent=number_slider_166, ZComponent=number_slider_166)  # -> Vector, Length

Z = UnitZ(Factor=Slider(5, range=0..10))
move_35 = Move(Geometry=pt_5, Motion=Z)  # -> Geometry, Transform

number_slider_167 = Slider(62, range=0..100)
crv = Curve(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)
divide = DivideCurve(Curve=crv, Count=Slider(82, range=0..100), Kinks=False)  # -> Points, Tangents, Parameters
item = ListItem(List=divide.Points, Index=number_slider_167, Wrap=True)
python_2 = GhPythonScript(location=item, target=move_35.Geometry)  # -> out, a
# ---------- python_2: Python ----------
__author__ = "Sculpture"
__version__ = "2019.10.19"

import rhinoscriptsyntax as rs
import scriptcontext as sc

sc.doc = ghdoc
loc = rs.coerce3dpoint(location)
tar = rs.coerce3dpoint(target)

vp = sc.doc.Views.ActiveView.ActiveViewport
vp.SetCameraLocation(loc, False)
vp.SetCameraDirection(tar - loc, True)
# ---------- end python_2 ----------

dom = ConstructDomain(DomainStart=0, DomainEnd=number_slider_167)
subset = SubList(List=python.a, Domain=dom, Wrap=True)  # -> List, Index
move_36 = Move(Geometry=subset.List, Motion=vec.Vector)  # -> Geometry, Transform
box = Box2Pt(PointA=subset.List, PointB=move_36.Geometry, Plane=PlaneXY(0, 0, 0))

geo = Geometry(<mesh referenced from the Rhino model>)
geo_2 = Geometry(<brep referenced from the Rhino model>)
morph = BoxMorph(Geometry=geo, Reference=geo_2, Target=box)

python_3 = GhPythonScript(active=Toggle(True), geo=morph, layer="Layer 01")  # -> out, C; inputs geo: list
# ---------- python_3: Python ----------
__author__ = "Sculpture"
__version__ = "2019.10.19"

import rhinoscriptsyntax as rs
import scriptcontext as sc
import Rhino


if active:
    
    for i in range(len(geo)):
        
        geo_id = geo[i]
        
        sc.doc = ghdoc
        
        doc_object = rs. coercerhinoobject(geo_id)
        
        print doc_object
        
        geometry = doc_object.Geometry
        attributes = doc_object.Attributes
        
        sc.doc = Rhino.RhinoDoc.ActiveDoc
        
        rhino_ref = sc.doc.Objects.Add(geometry, attributes)
        
        rs.ObjectLayer(rhino_ref, layer)
        
    C = True
else:
    C = False
# ---------- end python_3 ----------

# ---- group: Nagy003Wheel
pt_6 = Point(Point(0.8661752419, -0.6277713234, 0))
python_4 = GhPythonScript(startPoint=pt_6, size=number_slider_104, moveFactor=number_slider_103, randomSeed=Slider(59806, range=0..100000))  # -> out, a; inputs startPoint: Point3d
# ---------- python_4: Python ----------
__author__ = "Sculpture"
__version__ = "2019.10.19"

import rhinoscriptsyntax as rs
from Rhino.Geometry import Point3d
import random
random.seed(randomSeed)

def boxMaker(firstPoint, recursion):
    a.append(firstPoint)
    
    moveX = random.uniform(-size*moveFactor, size*moveFactor)
    moveY = random.uniform(-size*moveFactor, size*moveFactor)
    
    if recursion < 10:
        movedPoint1 = firstPoint + Point3d(moveX,moveY,size)
        boxMaker(movedPoint1, recursion + 1)
        
        if abs(moveX) > size * .8 and abs(moveY) > size * .8:
            movedPoint2 = firstPoint + Point3d(-moveX,-moveY,size)
            boxMaker(movedPoint2, recursion + 1)
        


firstPoint = rs. coerce3dpoint(startPoint)

a = []

boxMaker(firstPoint, 0)
# ---------- end python_4 ----------
vec_2 = VectorXYZ(XComponent=number_slider_105, YComponent=number_slider_105, ZComponent=number_slider_105)  # -> Vector, Length

Z_2 = UnitZ(Factor=number_slider_106)
move_37 = Move(Geometry=pt_6, Motion=Z_2)  # -> Geometry, Transform

number_slider_168 = Slider(100, range=0..100)
crv_2 = Curve(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)
divide_2 = DivideCurve(Curve=crv_2, Count=Slider(100, range=0..100), Kinks=False)  # -> Points, Tangents, Parameters
item_2 = ListItem(List=divide_2.Points, Index=number_slider_168, Wrap=True)
python_5 = GhPythonScript(location=item_2, target=move_37.Geometry)  # -> out, a; same code as python_2

dom_2 = ConstructDomain(DomainStart=0, DomainEnd=number_slider_168)
subset_2 = SubList(List=python_4.a, Domain=dom_2, Wrap=True)  # -> List, Index
move_38 = Move(Geometry=subset_2.List, Motion=vec_2.Vector)  # -> Geometry, Transform
box_2 = Box2Pt(PointA=subset_2.List, PointB=move_38.Geometry, Plane=PlaneXY(0, 0, 0))

volume = Volume(Geometry=box_2)  # -> Volume, Centroid
interpolate_5 = Interpolate(Vertices=volume.Centroid, Degree=3, Periodic=False, KnotStyle=1)  # -> Curve, Length, Domain
pipe_5 = Pipe(Curve=interpolate_5.Curve, Radius=Slider(0.32, range=0..1), Caps=0)

geo_3 = Geometry(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)
geo_4 = Geometry(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)
morph_2 = BoxMorph(Geometry=geo_3, Reference=geo_4, Target=box_2)

python_6 = GhPythonScript(active=Toggle(True), geo=[morph_2, pipe_5], layer="Layer 01")  # -> out, C; inputs geo: list; same code as python_3

# ==== cluster Remap: Remaps numbers
data = ClusterInput()
min = ClusterInput()
max = ClusterInput()
bnd = Bounds(Numbers=data)
dom = ConstructDomain(DomainStart=min, DomainEnd=max)
remap = RemapNumbers(Value=data, Source=bnd, Target=dom)  # -> Mapped, Clipped
R = ClusterOutput(remap.Mapped)
