# Grasshopper definition MasterScriptFiles_2022_onePlusSeven_101-110.gh (Grasshopper 1.0.7)
# plug-ins: Bifocals, Firefly.X, Fologram For Grasshopper Utilities, Human, FologramForGrasshopper

# ----
# Gene Pool
# for Dispatch Pattern
gene_pool = GenePool(
    Decimals=0,
    Maximum=1,
    Minimum=0,
    Value=[0.1016146117, 0.1933914671, 0.3456139091, 0.2262482751, 0.8090761648, 1, 1, 0.6660769669, 0, 0.7147953914])  # disabled

uv_point_count = Slider(34, range=0..100)  # disabled
width = Slider(10, range=0..10)  # disabled
rectangle = Rectangle(Plane=PlaneXY(0, 0, 0), XSize=uv_point_count, YSize=width, Radius=0)  # -> Rectangle, Length; disabled
divide_surface = DivideSurface(Surface=rectangle.Rectangle, UCount=uv_point_count, VCount=uv_point_count)  # -> flatten(Points), Normals, Parameters; disabled
height_map = Slider(2, range=0..2)  # disabled
dispatch = Dispatch(List=divide_surface.Points, DispatchPattern=gene_pool)  # -> ListA, ListB; disabled
construct_domain = ConstructDomain(DomainStart=0, DomainEnd=height_map)  # disabled
list_length = ListLength(List=dispatch.ListA)  # -> flatten(Length); disabled
range = Range(Domain=construct_domain, Steps=expr("x-1", list_length))  # disabled
optional_seed_for_jitter_node = Slider(45, range=0..100)  # disabled
unit_z = UnitZ(Factor=range)  # disabled
thickness_of_zinc = Slider(1.9, range=0..10)  # disabled
surface_from_points = SurfaceFromPoints(Points=divide_surface.Points, UCount=expr("x+1", uv_point_count), Interpolate=False)  # disabled
jitter = Jitter(List=unit_z, Jitter=1, Seed=optional_seed_for_jitter_node)  # -> Values, Indices; disabled
unit_z_2 = UnitZ(Factor=thickness_of_zinc)  # disabled
point_deform = PointDeform(Geometry=surface_from_points, Points=dispatch.ListA, Motion=jitter.Values)  # disabled

# ---- group: Extrude
# Bake this into RHINO
extrude = Extrude(Base=point_deform, Direction=unit_z_2)  # disabled

# ---- group: March5th_Sound_WickersonStudios_v004
boolean_toggle = BooleanToggle(True)  # disabled
number_slider = Slider(4, range=0..10)  # disabled
number_slider_2 = Slider(5, range=0..100)  # disabled
number_slider_3 = Slider(0.02, range=0..0.1)  # disabled
number_slider_4 = Slider(1.077, range=0.02..2)  # disabled
number_slider_5 = Slider(10, range=0..100)  # disabled
curve = Curve(<curve referenced from the Rhino model>)  # disabled
sound_capture = SoundCapture(TimePeriod=number_slider_3, StartStopSoundCapture=boolean_toggle)  # -> WavePressureSamplesFromLeftChannel, WavePressureSamplesFromRightChannel, Volume; disabled
timer = Timer(Interval=20, TimerInterval=20, Target=sound_capture)  # disabled
number_slider_6 = Slider(9, range=0..100)  # disabled
data_recorder = DataRecorder(sound_capture.Volume, DataLimit=10, RecordData=True)  # disabled
series = Series(Start=number_slider, Step=number_slider, Count=number_slider_2)  # disabled
multiplication = Multiplication(A=data_recorder, B=number_slider_4)  # disabled
mesh_sphere = MeshSphere(Base=PlaneXY(0, 0, 0), Radius=series, UCount=number_slider_6, VCount=number_slider_6)  # disabled
divide_curve = DivideCurve(Curve=curve, Count=number_slider_5, Kinks=False)  # -> Points, Tangents, Parameters; disabled
unit_z_3 = UnitZ(Factor=multiplication)  # disabled
circle = Circle(Plane=PlaneXY(0, 0, 0), Radius=series)  # disabled
number_slider_7 = Slider(6, range=0..10)  # disabled
move = Move(Geometry=divide_curve.Points, Motion=unit_z_3)  # -> Geometry, Transform; disabled
scale = Scale(Geometry=mesh_sphere, Center=Point(0, 0, 0), Factor=multiplication)  # -> Geometry, Transform; disabled
move_2 = Move(Geometry=reverse(circle), Motion=unit_z_3)  # -> Geometry, Transform; disabled
deconstruct_mesh = DeconstructMesh(Mesh=scale.Geometry)  # -> Vertices, Faces, Colours, Normals; disabled
line = Line(StartPoint=divide_curve.Points, EndPoint=move.Geometry)  # disabled
polyline = PolyLine(Vertices=move.Geometry, Closed=False)  # disabled
loft = Loft(Curves=move_2.Geometry, Options={Adjust=False, Closed=False, LoftEnds=0, LoftSimp=0, LoftType=0, Rebuild=10, Refit=0.01})  # disabled
interpolate = Interpolate(Vertices=move.Geometry, Degree=3, Periodic=False, KnotStyle=1)  # -> Curve, Length, Domain; disabled
panel = Panel(scale.Geometry)  # disabled
rotate = Rotate(Geometry=deconstruct_mesh.Vertices, Angle=data_recorder, Plane=PlaneXY(0, 0, 0))  # -> Geometry, Transform; disabled
number_slider_8 = Slider(263, range=0..290)  # disabled
param_viewer = ParamViewer(deconstruct_mesh.Vertices)  # disabled
pipe = Pipe(Curve=line, Radius=number_slider_7, Caps=0)  # disabled
circle_2 = Circle(Plane=rotate.Geometry, Radius=number_slider_8)  # disabled
panel_2 = Panel(data_recorder)  # disabled

# ---- group: 2.26_BarcelonaAnimatingWater_v002WheelBarrow
animate_texture = BooleanToggle(True)  # disabled
state_gate = StateGate(States=animate_texture)  # disabled
timer_2 = Timer(Interval=20, TimerInterval=20, Target=counter)  # disabled
animation_speed = Slider(0.796, range=0..1)  # disabled
button = Button()  # disabled
counter = Counter(Reset=button)  # disabled
multiplication_2 = Multiplication(A=counter, B=animation_speed)  # disabled
number_slider_9 = Slider(38, range=0..100)  # disabled
vector_xyz = VectorXYZ(XComponent=multiplication_2, YComponent=0, ZComponent=0)  # -> Vector, Length; disabled
water_texture_scale = Slider(100, range=0..100)  # disabled
mesh_plane = MeshPlane(
    Boundary=[{Plane=PlaneXY(-220, -99, -3.5), Size=Domain2(u=-220..220, v=-99..99)}, {Plane=PlaneXY(616, 11, -3.5), Size=Domain2(u=-44..44, v=-121..121)}],
    WidthCount=1,
    HeightCount=1)  # -> Mesh, Area; disabled
geo = Geometry(<mesh referenced from the Rhino model>)  # disabled
xy_plane = XYPlane(Origin=vector_xyz.Vector)  # disabled
msphere = MeshSphere(Base=PlaneXY(0, 0, 0), Radius=number_slider_9, UCount=10, VCount=20)  # disabled
planarmapping = PlanarMapping(Mesh=geo, Plane=xy_plane, XExtents=water_texture_scale, YExtents=water_texture_scale)  # -> MappedMesh, MappingPlane; disabled
sync_object = SyncObject(
    GM=planarmapping.MappedMesh,
    AlwaysIncludeTextureCoordinates=False,
    Clickable=False,
    DefaultCurveThicknessMillimeters=2.5,
    DefaultGlossPercent=0,
    DefaultMaterialColor=RGB(255, 255, 255),
    DefaultSpecularPercent=0,
    Grabbable=False,
    Interactive=False,
    Occlusion=False,
    Outline=False,
    TextureFileName="G:\Shared drives\Development\QA\FologramNEXT January 2020\Sean QA\Community Posts - Grasshopper\Water.jpg",
    hasSerializedData=True)  # disabled

# ---- group: 2.26_BarcelonaAnimatingWater_v002Pool
animate_texture_2 = BooleanToggle(True)  # disabled
state_gate_2 = StateGate(States=animate_texture_2)  # disabled
timer_3 = Timer(Interval=20, TimerInterval=20, Target=counter_2)  # disabled
animation_speed_2 = Slider(0.796, range=0..1)  # disabled
button_2 = Button()  # disabled
counter_2 = Counter(Reset=button_2)  # disabled
multiplication_3 = Multiplication(A=counter_2, B=animation_speed_2)  # disabled
number_slider_10 = Slider(38, range=0..100)  # disabled
vector_xyz_2 = VectorXYZ(XComponent=multiplication_3, YComponent=0, ZComponent=0)  # -> Vector, Length; disabled
water_texture_scale_2 = Slider(100, range=0..100)  # disabled
mesh_plane_2 = MeshPlane(
    Boundary=[{Plane=PlaneXY(-220, -99, -3.5), Size=Domain2(u=-220..220, v=-99..99)}, {Plane=PlaneXY(616, 11, -3.5), Size=Domain2(u=-44..44, v=-121..121)}],
    WidthCount=1,
    HeightCount=1)  # -> Mesh, Area; disabled
geo_2 = Geometry(<mesh referenced from the Rhino model>)  # disabled
xy_plane_2 = XYPlane(Origin=vector_xyz_2.Vector)  # disabled
msphere_2 = MeshSphere(Base=PlaneXY(0, 0, 0), Radius=number_slider_10, UCount=10, VCount=20)  # disabled
planarmapping_2 = PlanarMapping(Mesh=mesh_plane_2.Mesh, Plane=xy_plane_2, XExtents=water_texture_scale_2, YExtents=water_texture_scale_2)  # -> MappedMesh, MappingPlane; disabled
sync_object_2 = SyncObject(
    GM=planarmapping_2.MappedMesh,
    AlwaysIncludeTextureCoordinates=False,
    Clickable=False,
    DefaultCurveThicknessMillimeters=2.5,
    DefaultGlossPercent=0,
    DefaultMaterialColor=RGB(255, 255, 255),
    DefaultSpecularPercent=0,
    Grabbable=False,
    Interactive=False,
    Occlusion=False,
    Outline=False,
    TextureFileName="G:\Shared drives\Development\QA\FologramNEXT January 2020\Sean QA\Community Posts - Grasshopper\Water.jpg",
    hasSerializedData=True)  # disabled

# ---- group: 2.26_BarcelonaAnimatingWater
sync_parameters = SyncParameters(
    augmented_trigger_0_key=animate_texture_3,
    augmented_trigger_10_key=number_slider_15,
    augmented_trigger_11_key=number_slider_13,
    augmented_trigger_12_key=number_slider_14,
    augmented_trigger_13_key=number_slider_16,
    augmented_trigger_14_key=number_slider_17,
    augmented_trigger_15_key=boolean_toggle_2,
    augmented_trigger_16_key=number_slider_19,
    augmented_trigger_17_key=number_slider_18,
    augmented_trigger_18_key=number_slider_21,
    augmented_trigger_19_key=number_slider_20,
    augmented_trigger_1_key=button_3,
    augmented_trigger_20_key=number_slider_3,
    augmented_trigger_21_key=boolean_toggle,
    augmented_trigger_22_key=number_slider,
    augmented_trigger_23_key=number_slider_2,
    augmented_trigger_24_key=number_slider_4,
    augmented_trigger_25_key=number_slider_5,
    augmented_trigger_26_key=number_slider_7,
    augmented_trigger_27_key=number_slider_8,
    augmented_trigger_28_key=number_slider_6,
    augmented_trigger_29_key=animate_texture_4,
    augmented_trigger_2_key=animation_speed_3,
    augmented_trigger_30_key=button_4,
    augmented_trigger_31_key=animation_speed_4,
    augmented_trigger_32_key=water_texture_scale_4,
    augmented_trigger_33_key=number_slider_12,
    augmented_trigger_34_key=animate_texture_2,
    augmented_trigger_35_key=button_2,
    augmented_trigger_36_key=animation_speed_2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)  # disabled
animate_texture_3 = BooleanToggle(True)  # disabled
state_gate_3 = StateGate(States=animate_texture_3)  # disabled
timer_4 = Timer(Interval=20, TimerInterval=20, Target=counter_3)  # disabled
animation_speed_3 = Slider(0.5, range=0..1)  # disabled
button_3 = Button()  # disabled
counter_3 = Counter(Reset=button_3)  # disabled
multiplication_4 = Multiplication(A=counter_3, B=animation_speed_3)  # disabled
vector_xyz_3 = VectorXYZ(XComponent=multiplication_4, YComponent=0, ZComponent=0)  # -> Vector, Length; disabled
number_slider_11 = Slider(38, range=0..100)  # disabled
water_texture_scale_3 = Slider(69.92, range=0..100)  # disabled
mesh_plane_3 = MeshPlane(
    Boundary=[{Plane=PlaneXY(-220, -99, -3.5), Size=Domain2(u=-220..220, v=-99..99)}, {Plane=PlaneXY(616, 11, -3.5), Size=Domain2(u=-44..44, v=-121..121)}],
    WidthCount=1,
    HeightCount=1)  # -> Mesh, Area; disabled
geo_3 = Geometry(<mesh referenced from the Rhino model>)  # disabled
xy_plane_3 = XYPlane(Origin=vector_xyz_3.Vector)  # disabled
msphere_3 = MeshSphere(Base=PlaneXY(0, 0, 0), Radius=number_slider_11, UCount=10, VCount=20)  # disabled
planarmapping_3 = PlanarMapping(Mesh=geo_3, Plane=xy_plane_3, XExtents=water_texture_scale_3, YExtents=water_texture_scale_3)  # -> MappedMesh, MappingPlane; disabled
sync_object_3 = SyncObject(
    GM=planarmapping_3.MappedMesh,
    AlwaysIncludeTextureCoordinates=False,
    Clickable=False,
    DefaultCurveThicknessMillimeters=2.5,
    DefaultGlossPercent=0,
    DefaultMaterialColor=RGB(255, 255, 255),
    DefaultSpecularPercent=0,
    Grabbable=False,
    Interactive=False,
    Occlusion=False,
    Outline=False,
    TextureFileName="G:\Shared drives\Development\QA\FologramNEXT January 2020\Sean QA\Community Posts - Grasshopper\Water.jpg",
    hasSerializedData=True)  # disabled

# ---- group: 2.26_BarcelonaAnimatingWater_v002Sphere
animate_texture_4 = BooleanToggle(True)  # disabled
state_gate_4 = StateGate(States=animate_texture_4)  # disabled
timer_5 = Timer(Interval=20, TimerInterval=20, Target=counter_4)  # disabled
animation_speed_4 = Slider(0.5, range=0..1)  # disabled
button_4 = Button()  # disabled
counter_4 = Counter(Reset=button_4)  # disabled
multiplication_5 = Multiplication(A=counter_4, B=animation_speed_4)  # disabled
number_slider_12 = Slider(38, range=0..100)  # disabled
vector_xyz_4 = VectorXYZ(XComponent=multiplication_5, YComponent=0, ZComponent=0)  # -> Vector, Length; disabled
water_texture_scale_4 = Slider(69.92, range=0..100)  # disabled
mesh_plane_4 = MeshPlane(
    Boundary=[{Plane=PlaneXY(-220, -99, -3.5), Size=Domain2(u=-220..220, v=-99..99)}, {Plane=PlaneXY(616, 11, -3.5), Size=Domain2(u=-44..44, v=-121..121)}],
    WidthCount=1,
    HeightCount=1)  # -> Mesh, Area; disabled
geo_4 = Geometry(<mesh referenced from the Rhino model>)  # disabled
xy_plane_4 = XYPlane(Origin=vector_xyz_4.Vector)  # disabled
msphere_4 = MeshSphere(Base=PlaneXY(0, 0, 0), Radius=number_slider_12, UCount=10, VCount=20)  # disabled
planarmapping_4 = PlanarMapping(Mesh=msphere_4, Plane=xy_plane_4, XExtents=water_texture_scale_4, YExtents=water_texture_scale_4)  # -> MappedMesh, MappingPlane; disabled
sync_object_4 = SyncObject(
    GM=planarmapping_4.MappedMesh,
    AlwaysIncludeTextureCoordinates=False,
    Clickable=False,
    DefaultCurveThicknessMillimeters=2.5,
    DefaultGlossPercent=0,
    DefaultMaterialColor=RGB(255, 255, 255),
    DefaultSpecularPercent=0,
    Grabbable=False,
    Interactive=False,
    Occlusion=False,
    Outline=False,
    TextureFileName="G:\Shared drives\Development\QA\FologramNEXT January 2020\Sean QA\Community Posts - Grasshopper\Water.jpg",
    hasSerializedData=True)  # disabled

# ---- group: OMDec17_2016ImageSampler
number_slider_13 = Slider(253, range=0..1000)  # disabled
number_slider_14 = Slider(0.116, range=0..1)  # disabled
number_slider_15 = Slider(327, range=0..1000)  # disabled
recgrid = Rectangular(
    Plane=PlaneXY(0, 0, 0),
    SizeX=number_slider_14,
    SizeY=number_slider_14,
    ExtentX=number_slider_15,
    ExtentY=number_slider_13)  # -> Cells, Points; disabled
number_slider_16 = Slider(21.625, range=0..100)  # disabled
image = ImageSampler(
    recgrid.Points,
    FilePath="C:\Users\Sculpture\Documents\2020_Grasshopper\ScreenShots2019\BlackandWhiteMax.PNG",
    Filter="Value",
    Interpolate=True,
    Umax=40,
    Umin=0,
    Vmax=30,
    Vmin=0,
    Wrap=0)  # disabled
division = Division(A=image, B=number_slider_16)  # disabled
circle_3 = CircleCNR(Center=recgrid.Points, Normal=Vector(0, 0, 1), Radius=division)  # disabled
boundary = BoundarySurfaces(Edges=circle_3)  # disabled

# ---- group: March5th_Sound_WickersonStudios_v002
number_slider_17 = Slider(0.02, range=0..0.1)  # disabled
boolean_toggle_2 = BooleanToggle(False)  # disabled
sound_capture_2 = SoundCapture(TimePeriod=number_slider_17, StartStopSoundCapture=boolean_toggle_2)  # -> WavePressureSamplesFromLeftChannel, WavePressureSamplesFromRightChannel, Volume; disabled
timer_6 = Timer(Interval=20, TimerInterval=20, Target=sound_capture_2)  # disabled
number_slider_18 = Slider(77, range=0..100)  # disabled
number_slider_19 = Slider(2, range=0..10)  # disabled
number_slider_20 = Slider(100, range=0..100)  # disabled
data_recorder_2 = DataRecorder(sound_capture_2.Volume, DataLimit=100, RecordData=True)  # disabled
number_slider_21 = Slider(0.894, range=0.02..2)  # disabled
curve_2 = Curve(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)  # disabled
series_2 = Series(Start=number_slider_19, Step=number_slider_19, Count=number_slider_18)  # disabled
divide_curve_2 = DivideCurve(Curve=curve_2, Count=number_slider_20, Kinks=False)  # -> Points, Tangents, Parameters; disabled
circle_4 = Circle(Plane=PlaneXY(0, 0, 0), Radius=series_2)  # disabled
multiplication_6 = Multiplication(A=data_recorder_2, B=number_slider_21)  # disabled
unit_z_4 = UnitZ(Factor=multiplication_6)  # disabled
move_3 = Move(Geometry=divide_curve_2.Points, Motion=unit_z_4)  # -> Geometry, Transform; disabled
move_4 = Move(Geometry=reverse(circle_4), Motion=unit_z_4)  # -> Geometry, Transform; disabled
polyline_2 = PolyLine(Vertices=move_3.Geometry, Closed=False)  # disabled
line_2 = Line(StartPoint=divide_curve_2.Points, EndPoint=move_3.Geometry)  # disabled
loft_2 = Loft(Curves=move_4.Geometry, Options={Adjust=False, Closed=False, LoftEnds=0, LoftSimp=0, LoftType=0, Rebuild=10, Refit=0.01})  # disabled
panel_3 = Panel(data_recorder_2)  # disabled
