# Grasshopper definition MasterScriptFiles_2022_sevenPlusThree11-20.gh (Grasshopper 1.0.7)
# plug-ins: Weaverbird, Bifocals, Speckle 2

# ---- group: smoothing-groups
wbantiprism = MeshAntiPrism(Plane=PlaneXY(0, 0, 0), Width=5, NumberOfSides=6, TopPoint=Point(0, 0, 10), BasePolygonMethod=True, FillStrategy=1)
panel = Panel("""12
13
14
15""")
wbreroute = RerouteFaces(Mesh=wbantiprism, Index=panel)  # -> Mesh0, Mesh1
panel_2 = Panel("""darkblue
cyan""")
panel_3 = Panel("""forestgreen
yellow
orange""")
mcol = MeshColours(Mesh=wbreroute.Mesh1, Colours=panel_2)
mcol_2 = MeshColours(Mesh=wbreroute.Mesh0, Colours=panel_3)
wbcatmullclark = CatmullClarkSubdivision(Mesh=[mcol, mcol_2], Level=Slider(2, range=0..4), SmoothNakedEdges=1)
wbjoin = WeaverbirdsJoinMeshesAndWeld(Mesh=flatten(wbcatmullclark), Weld=Toggle(False))

# ---- group: strange-tilings
mplane = MeshPlane(Boundary={Plane=PlaneXY(0, 0, 0), Size=Domain2(u=-10..10, v=-10..10)}, WidthCount=1, HeightCount=1)  # -> Mesh, Area
msphere = MeshSphere(Base=PlaneXY(0, 0, 0), Radius=10, UCount=5, VCount=5)
wbloop = LoopSubdivision(MeshCurves=mplane.Mesh, Level=3, SmoothNakedEdges=0)
wbinnerpolygons = InnerPolygonsSubdivision(MeshCurves=wbloop, Level=1)
wbsierpinski = SierpinskiTrianglesSubdivision(MeshCurves=wbinnerpolygons, Level=3)
wbchamfervertices = ChamferVertices(Mesh=wbloop, Distance=Slider(3.682, range=0..33), OffsetType=0, OutputGeometryAsMesh=True)
wbjoin_2 = JoinMeshesAndWeld(Mesh=[wbchamfervertices, wbsierpinski], Weld=False)

# ---- group: Exercise006
numturns = Slider(3, range=1..4)
numpoints = Slider(146, range=10..200)
zrotation = Slider(41.5, range=0..80)
pi = Pi(Factor=numturns)
rad = Radians(Degrees=zrotation)
range = Range(Domain=pi, Steps=numpoints)
phi = GoldenRatio(Factor=range)
panel_4 = Panel(range)
pt = PointPolar(BasePlane=PlaneXY(0, 0, 0), XYAngle=range, ZAngle=0, Offset=phi)
pt_2 = PointPolar(BasePlane=PlaneXY(0, 0, 0), XYAngle=range, ZAngle=rad, Offset=phi)
ln = Line(StartPoint=pt, EndPoint=pt_2)
loft = Loft(Curves=ln, Options={Adjust=False, Closed=False, LoftEnds=0, LoftSimp=0, LoftType=0, Rebuild=10, Refit=0.01})

# ---- group: Parametric Wheel WSII 001
# Parametric Wheel (cylinder)
# Hybrid Wheel (Cyl/Cone)
# Parametric Wheel (cones)
width_of_wheel = Slider(11, range=1..20)
width_of_wheel_2 = Slider(9, range=1..20)
rholes = Slider(7, range=0..10)
number_slider = Slider(4, range=2..10)
number_slider_2 = Slider(27, range=23..40)
number_slider_3 = Slider(38, range=27..60)
circle = Circle({Plane=Plane(origin=(0, 0, 0), x=(0.1788854382, 0.9838699101, 0), y=(-0.9838699101, 0.1788854382, 0)), Radius=22.36067977})
cyl = Cylinder(Base=PlaneXY(0, 0, 0), Radius=rholes, Length=width_of_wheel_2)
cone = Cone(Base=PlaneXY(0, 0, 0), Radius=rholes, Length=width_of_wheel)  # -> Cone, Tip
cyl_2 = Cylinder(Base=PlaneXY(0, 0, 0), Radius=number_slider_3, Length=width_of_wheel_2)
cone_2 = Cone(Base=PlaneXY(0, 0, 0), Radius=number_slider_3, Length=width_of_wheel)  # -> Cone, Tip
X = UnitX(Factor=number_slider_2)
X_2 = UnitX(Factor=number_slider_2)
cap = CapHoles(Brep=cyl)
cap_2 = CapHoles(Brep=cone.Cone)
cap_3 = CapHoles(Brep=cyl_2)
cap_4 = CapHoles(Brep=cone_2.Cone)
move = Move(Geometry=cap, Motion=X)  # -> Geometry, Transform
move_2 = Move(Geometry=cap_2, Motion=X_2)  # -> Geometry, Transform
arrcurve = CurveArray(Geometry=move.Geometry, Curve=circle, Count=number_slider)  # -> Geometry, Transform
arrcurve_2 = CurveArray(Geometry=move_2.Geometry, Curve=cone_2.Cone, Count=number_slider)  # -> Geometry, Transform
sdiff = SolidDifference(BrepsA=cap_4, BrepsB=arrcurve_2.Geometry)
sdiff_2 = SolidDifference(BrepsA=cap_3, BrepsB=arrcurve.Geometry)
sdiff_3 = SolidDifference(BrepsA=sdiff_2, BrepsB=sdiff)

# ---- group: 4 Wheeled Cupola Cart WSII 001
# Single Well for Cupola Wagon
# Tap and Well Holes
number_slider_4 = Slider(3, range=2..8)
height = Slider(10, range=5..10)
tap_hole = Slider(7, range=6..7)
tap_hole_2 = Slider(2, range=1..2)
int = Integer(90)
xz = XZPlane(Origin=Point(0, 0, 0))
rad_2 = Radians(Degrees=int)
xy = XYPlane(Origin=Point(0, 0, 0))
Z = UnitZ(Factor=number_slider_4)
cyl_3 = Cylinder(Base=PlaneXY(0, 0, 0), Radius=tap_hole, Length=Slider(16, range=1..16))
cyl_4 = Cylinder(Base=PlaneXY(0, 0, 0), Radius=tap_hole_2, Length=Slider(16, range=1..16))
cyl_5 = Cylinder(Base=PlaneXY(0, 0, 0), Radius=Slider(8, range=6..8), Length=height)
cap_5 = CapHoles(Brep=cyl_3)
cap_6 = CapHoles(Brep=cyl_5)
cap_7 = CapHoles(Brep=cyl_4)
rot3d = Rotate3D(Geometry=cap_7, Angle=rad_2, Center=Point(0, 0, 0), Axis=xz)  # -> Geometry, Transform
rot3d_2 = Rotate3D(Geometry=rot3d.Geometry, Angle=rad_2, Center=Point(0, 0, 0), Axis=xy)  # -> Geometry, Transform
move_3 = Move(Geometry=rot3d_2.Geometry, Motion=Z)  # -> Geometry, Transform
sdiff_4 = SolidDifference(BrepsA=cap_6, BrepsB=cap_5)

number_slider_5 = Slider(8, range=0..10)
number_slider_6 = Slider(2, range=0..10)
X_3 = UnitX(Factor=Slider(6, range=4..7))
cyl_6 = Cylinder(Base=PlaneXY(0, 0, 0), Radius=Slider(10, range=0..10), Length=number_slider_6)
cyl_7 = Cylinder(Base=PlaneXY(0, 0, 0), Radius=Slider(2, range=1..2), Length=number_slider_6)
cap_8 = CapHoles(Brep=cyl_6)
cap_9 = CapHoles(Brep=cyl_7)
move_4 = Move(Geometry=cap_9, Motion=X_3)  # -> Geometry, Transform
arrpolar = PolarArray(Geometry=move_4.Geometry, Plane=PlaneXY(0, 0, 0), Count=Slider(7, range=2..10), Angle=6.283185307)  # -> Geometry, Transform
sdiff_5 = SolidDifference(BrepsA=cap_8, BrepsB=arrpolar.Geometry)

# ---- group: Parametric Wheel with Sine Function WSII 003 / Thickness of Wheel
# Parametric Wheel (cylinder)
width_of_wheel_3 = Slider(18, range=1..40)
rholes_2 = Slider(7, range=0..10)
circle_2 = Circle({Plane=Plane(origin=(0, 0, 0), x=(0.1788854382, 0.9838699101, 0), y=(-0.9838699101, 0.1788854382, 0)), Radius=22.36067977})
cyl_8 = Cylinder(Base=PlaneXY(0, 0, 0), Radius=rholes_2, Length=width_of_wheel_3)
cyl_9 = Cylinder(Base=PlaneXY(0, 0, 0), Radius=Slider(38, range=27..60), Length=width_of_wheel_3)
X_4 = UnitX(Factor=Slider(27, range=23..40))
cap_10 = CapHoles(Brep=cyl_8)
move_5 = Move(Geometry=cap_10, Motion=X_4)  # -> Geometry, Transform
cap_11 = CapHoles(Brep=cyl_9)
arrcurve_3 = CurveArray(Geometry=move_5.Geometry, Curve=circle_2, Count=Slider(6, range=2..10))  # -> Geometry, Transform

# ---- group: Parametric Wheel with Sine Function WSII 003
# Double Phase Sine Curve
number_slider_7 = Slider(24, range=0..100)
wobble = Slider(16, range=0..128)
pi_2 = Pi(Factor=number_slider_7)
dom = ConstructDomain(DomainStart=0, DomainEnd=pi_2)
pi_3 = Pi(Factor=Slider(2.304, range=0..4))
range_2 = Range(Domain=dom, Steps=wobble)
expression = Expression(A=Slider(7, range=0..10), t=range_2, x=pi_3, w=Slider(1, range=0..2), Expression="A*sin(w*t+x)")
pt_3 = ConstructPoint(XCoordinate=range_2, YCoordinate=Slider(5, range=0..10), ZCoordinate=expression)
intcrv = Interpolate(Vertices=pt_3, Degree=3, Periodic=False, KnotStyle=1)  # -> Curve, Length, Domain
Y = UnitY(Factor=Slider(85, range=0..200))
move_6 = Move(Geometry=intcrv.Curve, Motion=Y)  # -> Geometry, Transform

# Single Phase Sine Curve
number_slider_8 = Slider(25, range=0..100)
wobble_2 = Slider(27, range=0..128)
pi_4 = Pi(Factor=number_slider_8)
dom_2 = ConstructDomain(DomainStart=0, DomainEnd=pi_4)
pi_5 = Pi(Factor=Slider(1.28, range=0..4))
range_3 = Range(Domain=dom_2, Steps=wobble_2)
expression_2 = Expression(A=Slider(4, range=0..10), t=range_3, x=pi_5, w=Slider(1, range=0..2), Expression="A*sin(w*t+x)")
pt_4 = ConstructPoint(XCoordinate=range_3, YCoordinate=Slider(6, range=0..10), ZCoordinate=expression_2)
intcrv_2 = Interpolate(Vertices=pt_4, Degree=3, Periodic=False, KnotStyle=1)  # -> Curve, Length, Domain

# ---- group: 4 Wheeled Cupola Cart WSII 001
number_slider_9 = Slider(1.779, range=1.5..2)
number_slider_10 = Slider(8, range=2..10)
Y_2 = UnitY(Factor=1)
Y_3 = UnitY(Factor=1)
neg = Negative(Value=Y_2)
rot3d_3 = Rotate3D(Geometry=sdiff_5, Angle=number_slider_9, Center=Point(0, 0, 0), Axis=Y_3)  # -> Geometry, Transform
rot3d_4 = Rotate3D(Geometry=sdiff_5, Angle=number_slider_9, Center=Point(0, 0, 0), Axis=neg)  # -> Geometry, Transform
X_5 = UnitX(Factor=number_slider_10)
X_6 = UnitX(Factor=number_slider_10)
neg_2 = Negative(Value=X_5)
move_7 = Move(Geometry=rot3d_3.Geometry, Motion=X_6)  # -> Geometry, Transform
move_8 = Move(Geometry=rot3d_4.Geometry, Motion=neg_2)  # -> Geometry, Transform

# ---- group: 4 Wheeled Cupola Cart WSII 001 / Cupola Well
sdiff_6 = SolidDifference(BrepsA=sdiff_4, BrepsB=move_3.Geometry)

# ---- group: Exercise008 / gate tools, several of them to view
or = GateOr()

# ---- group: 4 Wheeled Cupola Cart WSII 001
gmerge = MergeGroup(GroupA=move_7.Geometry, GroupB=move_8.Geometry)

# ---- group: 4 Wheeled Cupola Cart WSII 001 / the Wheels
gmerge_2 = MergeGroup(GroupA=move_7.Geometry, GroupB=move_8.Geometry)

# ---- group: 4 Wheeled Cupola Cart WSII 001
# Wheels
# Two Wheels
# Angle of Wheels
# Spacing of Wheels
# Holes
# Four Wheels
# Hole Distance from Center of Wheel
# # of Holes
number_slider_11 = Slider(24, range=24..48)
Y_4 = UnitY(Factor=number_slider_11)
merge = Merge(Data1=gmerge_2, Data2=gmerge)
move_9 = Move(Geometry=merge, Motion=Y_4)  # -> Geometry, Transform

# ----
panel_5 = Panel("https://speckle.xyz/streams/12d57a96c6")

# ---- group: CurveSubdivsionAndGrowth_00
crv = Curve(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)
divide = DivideCurve(Curve=crv, Count="50", Kinks=False)  # -> Points, Tangents, Parameters
timer = Timer(Interval=50, TimerInterval=50, Target=c_script)
c_script = CSharpScript(iReset=Button(), iStartingPositions=divide.Points, iMaxCenterCount="1500")  # -> out, oCenters; inputs iReset: Boolean, iStartingPositions: list of Point3d, iMaxCenterCount: Int32
# ---------- c_script: C# ----------
    if (iReset || centers == null)
      centers = new List<Point3d>(iStartingPositions);

    List<Vector3d> totalMoves = new List<Vector3d>();
    List<double> collisionCounts = new List<double>();

    for (int i = 0; i < centers.Count; i++)
    {
      totalMoves.Add(new Vector3d(0.0, 0.0, 0.0));
      collisionCounts.Add(0.0);
    }

    double collisionDistance = 2.0;

    for (int i = 0; i < centers.Count; i++)
      for (int j = i + 1; j < centers.Count; j++)
      {
        double d = centers[i].DistanceTo(centers[j]);
        if (d > collisionDistance) continue;
        Vector3d move = centers[i] - centers[j];
        if (move.Length < 0.001) continue;
        move.Unitize();
        move *= 0.5 * (collisionDistance - d);
        totalMoves[i] += move;
        totalMoves[j] -= move;
        collisionCounts[i] += 1.0;
        collisionCounts[j] += 1.0;
      }

    for (int i = 0; i < centers.Count; i++)
      if (collisionCounts[i] != 0.0)
        centers[i] += totalMoves[i] / collisionCounts[i];

    oCenters = centers;
# ---------- c_script: C# additional code ----------
  List<Point3d> centers;
# ---------- end c_script ----------
pline = PolyLine(Vertices=c_script.oCenters, Closed=False)
cir = Circle(Plane=c_script.oCenters, Radius="1")

# ---- group: CircleRelaxation_Completed
c_script_2 = CSharpScript(iCount="100")  # -> out, oPoints; inputs iCount: Int32
# ---------- c_script_2: C# ----------
    Random myRandomGenerator = new Random();

    List<Point3d> points = new List<Point3d>();

    for (int i = 0; i < iCount; i++)
    {
      double x = myRandomGenerator.NextDouble() * 6.0 - 3.0;
      double y = myRandomGenerator.NextDouble() * 6.0 - 3.0;
      double z = 0.0;
      Point3d myRandomPoint = new Point3d(x, y, z);
      points.Add(myRandomPoint);
    }

    oPoints = points;
# ---------- end c_script_2 ----------
timer_2 = Timer(Interval=1, TimerInterval=5, Target=c_script_3)
c_script_3 = CSharpScript(iReset=Button(), iStartingPositions=c_script_2.oPoints)  # -> out, oCenters; inputs iReset: Boolean, iStartingPositions: list of Point3d
# ---------- c_script_3: C# ----------
    if (iReset || centers == null)
      centers = new List<Point3d>(iStartingPositions);

    List<Vector3d> totalMoves = new List<Vector3d>();
    List<double> collisionCounts = new List<double>();

    for (int i = 0; i < centers.Count; i++)
    {
      totalMoves.Add(new Vector3d(0.0, 0.0, 0.0));
      collisionCounts.Add(0.0);
    }

    double collisionDistance = 2.0;

    for (int i = 0; i < centers.Count; i++)
      for (int j = i + 1; j < centers.Count; j++)
      {
        double d = centers[i].DistanceTo(centers[j]);
        if (d > collisionDistance) continue;
        Vector3d move = centers[i] - centers[j];
        move.Unitize();
        move *= 0.5 * (collisionDistance - d);
        totalMoves[i] += move;
        totalMoves[j] -= move;
        collisionCounts[i] += 1.0;
        collisionCounts[j] += 1.0;
      }

    for (int i = 0; i < centers.Count; i++)
      if (collisionCounts[i] != 0.0)
        centers[i] += totalMoves[i] / collisionCounts[i];;

    oCenters = centers;
# ---------- c_script_3: C# additional code ----------
  List<Point3d> centers;
# ---------- end c_script_3 ----------
cir_2 = Circle(Plane=c_script_3.oCenters, Radius="1")

# ---- group: CircleRelaxation_01
c_script_4 = CSharpScript(iCount="100")  # -> out, oPoints; inputs iCount: Int32; same code as c_script_2
c_script_5 = CSharpScript(iStartingPositions=c_script_4.oPoints, iIterationCount=Slider(0, range=0..300))  # -> out, oCenters; inputs iStartingPositions: list of Point3d, iIterationCount: Int32
# ---------- c_script_5: C# ----------
    List<Point3d> centers = new List<Point3d>(iStartingPositions);

    for (int iteration = 0; iteration < iIterationCount; iteration++)
    {
      List < Vector3d > totalMoves = new List<Vector3d>();
      List<double> collisionCounts = new List<double>();

      for (int i = 0; i < centers.Count; i++)
      {
        totalMoves.Add(new Vector3d(0.0, 0.0, 0.0));
        collisionCounts.Add(0.0);
      }

      double collisionDistance = 2.0;

      for (int i = 0; i < centers.Count; i++)
        for (int j = i + 1; j < centers.Count; j++)
        {
          double d = centers[i].DistanceTo(centers[j]);
          if (d > collisionDistance) continue;
          Vector3d move = centers[i] - centers[j];
          move.Unitize();
          move *= 0.5 * (collisionDistance - d);
          totalMoves[i] += move;
          totalMoves[j] -= move;
          collisionCounts[i] += 1.0;
          collisionCounts[j] += 1.0;
        }

      for (int i = 0; i < centers.Count; i++)
        if (collisionCounts[i] != 0.0)
          centers[i] += totalMoves[i] / collisionCounts[i];
    }

    oCenters = centers;
# ---------- end c_script_5 ----------
cir_3 = Circle(Plane=c_script_5.oCenters, Radius="1")

# ---- group: Parametric Wheel with Sine Function WSII 003 / Rectangle Circle Wheel
number_slider_12 = Slider(41, range=0..100)
Z_2 = UnitZ(Factor=Slider(59, range=0..100))
rectangle = Rectangle(Plane=PlaneXY(0, 0, 0), XSize=number_slider_12, YSize=number_slider_12, Radius=number_slider_12)  # -> Rectangle, Length
extr = Extrude(Base=rectangle.Rectangle, Direction=Z_2)
cap_12 = CapHoles(Brep=extr)

# ---- group: 4 Wheeled Cupola Cart WSII 001 / 4 Wheels
merge_2 = Merge(Data1=merge, Data2=move_9.Geometry)

# ----
send = Send(
    Stream=panel_5,
    Data=[pt_2, pt, ln, loft],
    AutoSend=False,
    BaseId="013cccebe98f3689544cda3ba51a2554",
    CurrentComponentState="up_to_date",
    KitName="Objects",
    OutputWrappers="https://speckle.xyz\t12d57a96c6\t0552636cd6",
    UseDefaultCache=True,
    selectedKitName="Objects")
receive = Receive(
    Stream=panel_5,
    AutoReceive=False,
    CurrentComponentState="expired",
    ExpandOutput=True,
    LastInfoMessage="Michael Wickerson @ 2023-04-15T17:53:22.724Z: Pushed 445 elements from Grasshopper. (id:c6ca307f91)",
    ReceiveOnOpen=False,
    ReceivedCommitId="c6ca307f91",
    StreamWrapper="https://speckle.xyz/streams/12d57a96c6",
    selectedKitName="Objects")  # -> Info, Data
panel_6 = Panel(receive.Data)
panel_7 = Panel(send)
panel_8 = Panel(receive.Info)

# ---- group: Exercise008
numpts = Slider(158, range=1..200)
panel_9 = Panel("""true
true
false
false""")
panel_10 = Panel("true")
panel_11 = Panel("""true
true
true
false
false
true
false""")
weave = Weave(Pattern=[0, 1], NullGaps=False)
dispatch = Dispatch(DispatchPattern=[True, False])  # -> ListA, ListB

# ---- group: Exercise008 / t
series = Series(Start=0, Step=1, Count=numpts)

# ---- group: Exercise008 (continued)
expression_3 = Expression(t=series, Expression="cos(t)*t")
expression_4 = Expression(t=series, Expression="sin(t)*t")
pt_5 = ConstructPoint(XCoordinate=expression_3, YCoordinate=expression_4, ZCoordinate=0)
points = PointList(Points=pt_5)

# ---- group: Exercise008 / Culled List of Points
cull = CullPattern(List=pt_5, CullPattern=panel_9)

# ---- group: Exercise008 (continued)
voronoi = Voronoi(Points=cull, Radius=Slider(40, range=0..40), BruteForceOverride=False)

# ---- group: Parametric Wheel with Sine Function WSII 003
# Hybrid Wheel (Cyl/Cone)
loft_2 = Loft(
    Curves=[move_6.Geometry, intcrv_2.Curve],
    Options={Adjust=False, Closed=False, LoftEnds=0, LoftSimp=0, LoftType=0, Rebuild=10, Refit=0.01})
sdiff_7 = SolidDifference(BrepsA=cap_11, BrepsB=arrcurve_3.Geometry)

# ---- group: Parametric Wheel with Sine Function WSII 003 / Sine Solid
Z_3 = UnitZ(Factor=width_of_wheel_3)
neg_3 = Negative(Value=Slider(49, range=0..100))
extr_2 = Extrude(Base=loft_2, Direction=Z_3)
Y_5 = UnitY(Factor=neg_3)
cap_13 = CapHoles(Brep=extr_2)
neg_4 = Negative(Value=Slider(38, range=0..100))
move_10 = Move(Geometry=cap_13, Motion=Y_5)  # -> Geometry, Transform
X_7 = UnitX(Factor=neg_4)
move_11 = Move(Geometry=move_10.Geometry, Motion=Vector(0, 0, 10))  # -> Geometry, Transform
move_12 = Move(Geometry=move_10.Geometry, Motion=X_7)  # -> Geometry, Transform

# ---- group: Parametric Wheel with Sine Function WSII 003 (continued)
sint = SolidIntersection(BrepsA=sdiff_7, BrepsB=move_12.Geometry)
