# Grasshopper definition MasterScriptFiles_2022_sevenPlusTwo_91-100.gh (Grasshopper 1.0.7)
# plug-ins: Anemone, Bifocals, Pufferfish, Weaverbird

# ---- group: 001WickersonStudiosWavy Joint
number_slider = Slider(1, range=0..100)  # disabled
number_slider_2 = Slider(2.056, range=0..10)  # disabled
number_slider_3 = Slider(22, range=0..100)  # disabled
number_slider_4 = Slider(6, range=0..10)  # disabled
rectangular = Rectangular(Plane=PlaneXY(0, 0, 0), SizeX=number_slider_2, SizeY=number_slider_4, ExtentX=number_slider, ExtentY=number_slider_3)  # -> simplify(Cells), Points; disabled
tree_statistics = TreeStatistics(Tree=rectangular.Cells)  # -> Paths, Length, Count; disabled
list_item = ListItem(List=tree_statistics.Paths, Index=0, Wrap=True)  # disabled
tree_branch = TreeBranch(Tree=rectangular.Cells, Path=list_item, MaintainPaths=True)  # disabled
control_points = ControlPoints(Curve=tree_branch)  # -> Points, Weights, Knots; disabled
cull_index = CullIndex(List=control_points.Points, Indices=0, Wrap=True)  # disabled
dispatch = Dispatch(List=cull_index, DispatchPattern=[True, False])  # -> ListA, ListB; disabled
polyline = PolyLine(Vertices=dispatch.ListA, Closed=False)  # disabled
polyline_2 = PolyLine(Vertices=dispatch.ListB, Closed=False)  # disabled
merge = Merge(Data1=polyline, Data2=polyline_2)  # -> simplify(Result); disabled
group = Group(Objects=merge)  # -> flatten(Group); disabled
dispatch_2 = Dispatch(List=group, DispatchPattern=[True, False])  # -> ListA, ListB; disabled
ungroup = Ungroup(Group=dispatch_2.ListB)  # disabled
ungroup_2 = Ungroup(Group=dispatch_2.ListA)  # disabled
list_item_2 = ListItem(List=ungroup, Index=1, Wrap=True)  # disabled
list_item_3 = ListItem(List=ungroup_2, Index=0, Wrap=True)  # disabled
merge_2 = Merge(Data1=list_item_3, Data2=list_item_2)  # -> flatten(Result); disabled
join_curves = JoinCurves(Curves=merge_2, Preserve=False)  # disabled
control_points_2 = ControlPoints(Curve=join_curves)  # -> Points, Weights, Knots; disabled
interpolate = Interpolate(Vertices=control_points_2.Points, Degree=3, Periodic=False, KnotStyle=1)  # -> Curve, Length, Domain; disabled
number_slider_5 = Slider(50, range=0..100)  # disabled
number_slider_6 = Slider(15, range=0..100)  # disabled
mirror = Mirror(Geometry=interpolate.Curve, Plane=PlaneYZ(0, 0, 0))  # -> Geometry, Transform; disabled
merge_3 = Merge(Data1=interpolate.Curve, Data2=mirror.Geometry)  # disabled
series = Series(Start=0, Step=number_slider_6, Count=number_slider_5)  # disabled
group_2 = Group(Objects=merge_3)  # disabled
radians = Radians(Degrees=series)  # disabled
number_slider_7 = Slider(5.01, range=0..10)  # disabled
number_slider_8 = Slider(30, range=0..30)  # disabled
number_slider_9 = Slider(0.5, range=0..1)  # disabled
number_slider_10 = Slider(1.5, range=0..10)  # disabled
bounding_box = BoundingBox(Content=group_2, Plane=PlaneXY(0, 0, 0))  # -> Box, Box_2; disabled
cosine = Cosine(Value=radians)  # disabled
area = Area(Geometry=bounding_box.Box)  # -> Area, Centroid; disabled
sine = Sine(Value=radians)  # disabled
construct_domain = ConstructDomain(DomainStart=number_slider_9, DomainEnd=number_slider_10)  # disabled
bounds = Bounds(Numbers=cosine)  # disabled
construct_domain_2 = ConstructDomain(DomainStart=number_slider_7, DomainEnd=number_slider_8)  # disabled
bounds_2 = Bounds(Numbers=sine)  # disabled
remap_numbers = RemapNumbers(Value=sine, Source=bounds_2, Target=construct_domain)  # -> Mapped, Clipped; disabled
scale_nu = ScaleNU(Geometry=group_2, Plane=area.Centroid, ScaleX=remap_numbers.Mapped, ScaleY=1, ScaleZ=1)  # -> Geometry, Transform; disabled
bounding_box_2 = BoundingBox(Content=scale_nu.Geometry, Plane=PlaneXY(0, 0, 0))  # -> Box, Box_2; disabled
remap_numbers_2 = RemapNumbers(Value=cosine, Source=bounds, Target=construct_domain_2)  # -> Mapped, Clipped; disabled
deconstruct_box = DeconstructBox(Box=bounding_box_2.Box)  # -> Plane, X, Y, Z; disabled
deconstruct_domain = DeconstructDomain(Domain=deconstruct_box.X)  # -> Start, End; disabled
subtraction = Subtraction(A=deconstruct_domain.End, B=deconstruct_domain.Start)  # disabled
panel = Panel(subtraction)  # disabled
consecutive_domains = ConsecutiveDomains(Numbers=subtraction, Additive=True)  # disabled
unit_z = UnitZ(Factor=remap_numbers_2.Mapped)  # disabled
deconstruct_domain_2 = DeconstructDomain(Domain=consecutive_domains)  # -> Start, End; disabled
graft_tree = GraftTree(Tree=unit_z, IncludeEmptyLists=True, IncludeNullItems=True)  # -> simplify(Tree); disabled
merge_4 = Merge(Data1=0, Data2=flatten(deconstruct_domain_2.Start))  # disabled
unit_x = UnitX(Factor=merge_4)  # disabled
move = Move(Geometry=scale_nu.Geometry, Motion=unit_x)  # -> Geometry, Transform; disabled
ungroup_3 = Ungroup(Group=move.Geometry)  # -> simplify(Objects); disabled
panel_2 = Panel(consecutive_domains)  # disabled
extrude = Extrude(Base=ungroup_3, Direction=graft_tree)  # disabled
flatten_tree = FlattenTree(Tree=extrude, Path="{0}")  # disabled
flatten_tree_2 = FlattenTree(Tree=extrude, Path="{0}")  # disabled
list_length = ListLength(List=flatten_tree)  # -> expr("x-1", Length); disabled
range = Range(Domain=Domain(0, 1), Steps=list_length)  # disabled
colour_rgb_f = ColourRGBF(Alpha=1, Red=range, Green=0, Blue=0)  # disabled
graft_tree_2 = GraftTree(Tree=colour_rgb_f, IncludeEmptyLists=True, IncludeNullItems=True)  # -> simplify(Tree); disabled
graft_tree_3 = GraftTree(Tree=flatten_tree_2, IncludeEmptyLists=True, IncludeNullItems=True)  # disabled
custom_preview = CustomPreview(Geometry=graft_tree_3, Shader=graft_tree_2)  # disabled

# ---- group: January25th2020WickersonStudiosCupolaKlokkenstoelenAlgorithm004
number_slider_11 = Slider(0.17, range=0..1)  # disabled
number_slider_12 = Slider(18, range=0..100)  # disabled
dom = ConstructDomain(DomainStart=0, DomainEnd=1)  # disabled
dom_2 = ConstructDomain(DomainStart=0, DomainEnd=1)  # disabled
range_2 = Range(Domain=dom, Steps=number_slider_12)  # disabled
range_3 = Range(Domain=dom_2, Steps=number_slider_12)  # disabled
panel_3 = Panel("x+1")  # disabled
graph = GraphMapper(
    range_2,
    x0=0,
    x1=1,
    y0=0,
    y1=2,
    container_name="Bezier",
    cpx=[0, 1, 0.6767184138, 1],
    cpy=[1, 0.6665341854, 0.1162464619, 0])  # disabled
eval = Evaluate(F=panel_3, x=range_2)  # disabled
graph_2 = GraphMapper(
    simplify(range_3),
    x0=0,
    x1=1,
    y0=0,
    y1=1.5,
    container_name="Bezier",
    cpx=[0, 0.3867272735, 1, 1],
    cpy=[0.9931949377, 0.9677484632, 0.6914716959, 0])  # disabled
pt = ConstructPoint(XCoordinate=eval, YCoordinate=0, ZCoordinate=graph)  # disabled
panel_4 = Panel("x+1")  # disabled
eval_2 = Evaluate(F=panel_4, x=range_3)  # disabled
intcrv = Interpolate(Vertices=pt, Degree=3, Periodic=False, KnotStyle=1)  # -> Curve, Length, Domain; disabled
pt_2 = ConstructPoint(XCoordinate=eval_2, YCoordinate=0, ZCoordinate=graph_2)  # disabled
end = EndPoints(Curve=intcrv.Curve)  # -> Start, End; disabled
intcrv_2 = Interpolate(Vertices=pt_2, Degree=3, Periodic=False, KnotStyle=1)  # -> Curve, Length, Domain; disabled
pl = PlaneNormal(Origin=end.Start, ZAxis=Vector(0, 0, 1))  # disabled
orient = Orient(Geometry=intcrv_2.Curve, Source=end.End, Target=pl)  # -> Geometry, Transform; disabled
join = JoinCurves(Curves=[intcrv.Curve, orient.Geometry], Preserve=False)  # disabled
series_2 = Series(Start=0, Step=1, Count=10)  # disabled
rotate = Rotate(Geometry=join, Angle=series_2, Plane=PlaneXY(0, 0, 0))  # -> Geometry, Transform; disabled
loft = Loft(Curves=rotate.Geometry, Options={Adjust=False, Closed=False, LoftEnds=0, LoftSimp=0, LoftType=0, Rebuild=10, Refit=0.01})  # disabled
offsrf = OffsetSurface(Surface=loft, Distance=number_slider_11, BothSides=False, CreateSolid=True)  # disabled
sunion = SolidUnion(Breps=offsrf)  # disabled

# ---- group: OMSept13_2016Tower
pt_3 = ConstructPoint(XCoordinate=0, YCoordinate=0, ZCoordinate=0)
pt_4 = ConstructPoint(XCoordinate=0, YCoordinate=0, ZCoordinate=Slider(50, range=0..100))
cir = Circle(Plane=[pt_3, pt_4], Radius=[Slider(27, range=0..100), Slider(9, range=0..10)])
divide = DivideCurve(Curve=cir, Count=Slider(18, range=0..100), Kinks=False)  # -> Points, Tangents, Parameters
bang = ExplodeTree(Data=divide.Points)  # -> Branch0, Branch1
shift = ShiftList(List=bang.Branch1, Shift=Slider(5, range=-5..10), Wrap=True)
shift_2 = ShiftList(List=bang.Branch1, Shift=Slider(-5, range=-5..10), Wrap=True)
ln = Line(StartPoint=bang.Branch0, EndPoint=shift_2)
ln_2 = Line(StartPoint=bang.Branch0, EndPoint=shift)
divide_2 = DivideCurve(Curve=ln_2, Count=10, Kinks=False)  # -> Points, Tangents, Parameters
flip = FlipMatrix(Data=divide_2.Points)
intcrv_3 = Interpolate(Vertices=flip, Degree=3, Periodic=Toggle(True), KnotStyle=1)  # -> Curve, Length, Domain
boundary = BoundarySurfaces(Edges=intcrv_3.Curve)
pipe = Pipe(Curve=[intcrv_3.Curve, ln_2, ln], Radius=Slider(0.3, range=0..1), Caps=0)
join_2 = BrepJoin(Breps=[boundary, pipe])  # -> Breps, Closed

# ---- group: 002WickersonStudiosTriangle Holes
number_slider_13 = Slider(5, range=0..10)  # disabled
hexagonal = Hexagonal(Plane=PlaneXY(0, 0, 0), Size=1, ExtentX=number_slider_13, ExtentY=number_slider_13)  # -> Cells, Points; disabled
area_2 = Area(Geometry=hexagonal.Cells)  # -> Area, Centroid; disabled
extrude_point = ExtrudePoint(Base=hexagonal.Cells, Point=area_2.Centroid)  # disabled
flatten_tree_3 = FlattenTree(Tree=extrude_point, Path="{0}")  # disabled
deconstruct_brep = DeconstructBrep(Brep=flatten_tree_3)  # -> Faces, Edges, Vertices; disabled
brep_join = BrepJoin(Breps=flatten_tree_3)  # -> Breps, Closed; disabled
flatten_tree_4 = FlattenTree(Tree=deconstruct_brep.Faces, Path="{0}")  # disabled
number_slider_14 = Slider(0.17, range=0..0.5)  # disabled
curve = Curve(flatten_tree_4)  # disabled
bounding_box_3 = BoundingBox(Content=brep_join.Breps, Plane=PlaneXY(0, 0, 0))  # -> Box, Box_2; disabled
md_slider = MDSlider(
    SliderMode=0,
    slider_value=Point(0.4570729325, 0.4687805176, 0.5),
    x_domain=Domain(0, 1),
    y_domain=Domain(0, 1),
    z_domain=Domain(0, 1))  # disabled
deconstruct_brep_2 = DeconstructBrep(Brep=bounding_box_3.Box)  # -> Faces, Edges, Vertices; disabled
area_3 = Area(Geometry=curve)  # -> Area, Centroid; disabled
negative = Negative(Value=number_slider_14)  # disabled
list_item_4 = ListItem(List=deconstruct_brep_2.Faces, Index=0, Wrap=True)  # disabled
curve_2 = Curve(brep_join.Breps)  # disabled
offset_curve = Offset(Curve=curve_2, Distance=negative, Plane=PlaneXY(0, 0, 0), Corners=1)  # disabled
surface = Surface(reparameterize(list_item_4))  # disabled
evaluate_surface = EvaluateSurface(Surface=surface, Point=md_slider)  # -> Point, Normal, Frame; disabled
number_slider_15 = Slider(0.95, range=0..1)  # disabled
number_slider_16 = Slider(0.11, range=0..1)  # disabled
distance = Distance(PointA=evaluate_surface.Point, PointB=area_3.Centroid)  # disabled
construct_domain_3 = ConstructDomain(DomainStart=number_slider_16, DomainEnd=number_slider_15)  # disabled
bounds_3 = Bounds(Numbers=distance)  # disabled
number_slider_17 = Slider(0.326, range=0..1)  # disabled
number_slider_18 = Slider(0.05, range=0..0.1)  # disabled
remap_numbers_3 = RemapNumbers(Value=distance, Source=bounds_3, Target=construct_domain_3)  # -> Mapped, Clipped; disabled
graft_tree_4 = GraftTree(Tree=remap_numbers_3.Mapped, IncludeEmptyLists=True, IncludeNullItems=True)  # disabled
range_4 = Range(Domain=number_slider_17, Steps=10)  # disabled
construct_domain_4 = ConstructDomain(DomainStart=graft_tree_4, DomainEnd=number_slider_18)  # -> simplify(Domain); disabled
unit_z_2 = UnitZ(Factor=range_4)  # disabled
range_5 = Range(Domain=construct_domain_4, Steps=10)  # disabled
negative_2 = Negative(Value=unit_z_2)  # disabled
panel_5 = Panel(range_5)  # disabled
scale = Scale(Geometry=graft(curve), Center=graft(area_3.Centroid), Factor=range_5)  # -> simplify(Geometry), Transform; disabled
move_2 = Move(Geometry=scale.Geometry, Motion=negative_2)  # -> simplify(Geometry), Transform; disabled
move_3 = Move(Geometry=offset_curve, Motion=negative_2)  # -> simplify(graft(Geometry)), Transform; disabled
range_6 = Range(Domain=Domain(0, 1), Steps=10)  # disabled
flip_matrix = FlipMatrix(Data=move_2.Geometry)  # disabled
gradient = Gradient(LowerLimit=0, UpperLimit=1, Parameter=range_6, stops=[0: RGB(105, 192, 255), 0.674: RGB(43, 90, 166)])  # disabled
merge_5 = Merge(Data1=flip_matrix, Data2=move_3.Geometry)  # disabled
boundary_surfaces = BoundarySurfaces(Edges=merge_5)  # disabled
graft_tree_5 = GraftTree(Tree=gradient, IncludeEmptyLists=True, IncludeNullItems=True)  # disabled
custom_preview_2 = CustomPreview(Geometry=boundary_surfaces, Shader=graft_tree_5)  # disabled

# ---- group: OMSept13_2016
number_slider_19 = Slider(132, range=0..1000)  # disabled
panel_6 = Panel("180")  # disabled

# ---- group: January25th2020WickersonStudiosCupolaKlokkenstoelenAlgorithm004
scale_wheels = Slider(6.79, range=0..10)  # disabled
axle_arc_height = Slider(4, range=-1..4)  # disabled
number_of_spokes = Slider(6, range=2..10)  # disabled
well_thickness = Slider(3, range=0.1..3)  # disabled
wheelband_height = Slider(0.42, range=0.2..1)  # disabled
tap_hole_height = Slider(5, range=1..5)  # disabled
spoke_thickness_factor = Slider(3.196, range=1..5)  # disabled
support_thickness = Slider(0.3, range=0.05..0.3)  # disabled
scale_well_axle = Slider(4, range=3..4)  # disabled
axle_thickness = Slider(0.452, range=0..0.7)  # disabled
support_count = Slider(4, range=0..10)  # disabled
rotate_wheels = Slider(0.05, range=-0.1..1.11)  # disabled
wheelband_width = Slider(0.93, range=0..3)  # disabled

smokestack_height = Slider(5, range=1..11)  # disabled
number_slider_20 = Slider(-3, range=-3..3.001)  # disabled
smokestackshape = Slider(3, range=0..10)  # disabled
C = Slider(-3, range=-3..3.001)  # disabled

# ---- group: OMSept13_2016
number_slider_21 = Slider(35, range=0..100)  # disabled
xz_plane = XZPlane(Origin=Point(0, 0, 0))  # disabled
radians_2 = Radians(Degrees=panel_6)  # disabled
arc = Arc(Plane=xz_plane, Radius=number_slider_21, Angle=radians_2)  # -> Arc, Length; disabled
number_slider_22 = Slider(24, range=0..100)  # disabled
number_slider_23 = Slider(7, range=0..100)  # disabled
end_points = EndPoints(Curve=arc.Arc)  # -> Start, End; disabled
number_slider_24 = Slider(0, range=0..10)  # disabled
ellipse = Ellipse(Plane=end_points.Start, Radius1=number_slider_23, Radius2=number_slider_22)  # -> Ellipse, Focus1, Focus2; disabled
number_slider_25 = Slider(33, range=0..100)  # disabled
number_slider_26 = Slider(-6, range=-6..7)  # disabled
number_slider_27 = Slider(33, range=0..100)  # disabled
sweep1 = Sweep1(Rail=arc.Arc, Sections=ellipse.Ellipse, Miter=1)  # disabled
divide_domain² = DivideDomain²(Domain=sweep1, UCount=number_slider_25, VCount=number_slider_27)  # disabled
construct_domain_5 = ConstructDomain(DomainStart=number_slider_26, DomainEnd=number_slider_24)  # disabled
number_slider_28 = Slider(20, range=0..100)  # disabled
list_length_2 = ListLength(List=divide_domain²)  # disabled
random = Random(Range=construct_domain_5, Number=list_length_2, Seed=number_slider_28)  # disabled
center_box = CenterBox(Base=PlaneXY(0, 0, 0), X=1, Y=1, Z=1)  # disabled
surface_box = SurfaceBox(Surface=sweep1, Domain=divide_domain², Height=random)  # disabled
bounding_box_4 = BoundingBox(Content=center_box, Plane=PlaneXY(0, 0, 0))  # -> Box, Box_2; disabled
box_morph = BoxMorph(Geometry=center_box, Reference=bounding_box_4.Box, Target=surface_box)  # disabled
colour_swatch = ColourSwatch(SwatchColor=RGB(97, 178, 255))  # disabled
custom_preview_3 = CustomPreview(Geometry=box_morph, Material=colour_swatch)  # disabled

# ---- group: January25th2020WickersonStudiosCupolaKlokkenstoelenAlgorithm004
# Cupola Cart, Algorithm 001, Wickerson Studios, 2020
panel_7 = Panel("1")  # disabled
Z = UnitZ(Factor=axle_arc_height)  # disabled
pt_5 = ConstructPoint(XCoordinate=0, YCoordinate=0, ZCoordinate=0)  # disabled
pt_6 = Point(pt_5)  # disabled
move_4 = Move(Geometry=pt_6, Motion=Z)  # -> Geometry, Transform; disabled
panel_8 = Panel("5")  # disabled
X = UnitX(Factor=scale_well_axle)  # disabled
addition = Addition(A=scale_well_axle, B=panel_8)  # disabled
neg = Negative(Value=X)  # disabled
Y = UnitY(Factor=addition)  # disabled
merge_6 = Merge(Data1=X, Data2=neg)  # disabled
neg_2 = Negative(Value=Y)  # disabled
move_5 = Move(Geometry=pt_5, Motion=merge_6)  # -> Geometry, Transform; disabled
Z_2 = UnitZ(Factor=scale_well_axle)  # disabled
panel_9 = Panel("1.5")  # disabled
line = LineSDL(Start=pt_6, Direction=neg_2, Length=addition)  # disabled
multiplication = Multiplication(A=axle_thickness, B=panel_9)  # disabled
pl_2 = PlaneNormal(Origin=move_5.Geometry, ZAxis=X)  # disabled
circle = CircleCNR(Center=move_5.Geometry, Normal=pl_2, Radius=scale_wheels)  # -> flatten(Circle); disabled
pipe_2 = Pipe(Curve=line, Radius=multiplication, Caps=0)  # disabled
Y_2 = UnitY(Factor=1)  # disabled
panel_10 = Panel("1")  # disabled
panel_11 = Panel("0")  # disabled
neg_3 = Negative(Value=well_thickness)  # disabled
ellipse_2 = Ellipse(Plane=PlaneXY(0, 0, 0), Radius1=wheelband_height, Radius2=wheelband_width)  # -> Ellipse, Focus1, Focus2; disabled
pi = Pi(Factor=rotate_wheels)  # disabled
item = ListItem(List=circle, Index=panel_10, Wrap=True)  # disabled
item_2 = ListItem(List=circle, Index=panel_11, Wrap=True)  # disabled
division = Division(A=wheelband_width, B=spoke_thickness_factor)  # disabled
line_2 = LineSDL(Start=item, Direction=Y_2, Length=1)  # disabled
line_3 = LineSDL(Start=item_2, Direction=Y_2, Length=1)  # disabled
neg_4 = Negative(Value=pi)  # disabled
Z_3 = UnitZ(Factor=tap_hole_height)  # disabled
rotax = RotateAxis(Geometry=item_2, Angle=pi, Axis=line_3)  # -> Geometry, Transform; disabled
rotax_2 = RotateAxis(Geometry=item, Angle=neg_4, Axis=line_2)  # -> Geometry, Transform; disabled
move_6 = Move(Geometry=pipe_2, Motion=Z_3)  # -> Geometry, Transform; disabled
cap = CapHoles(Brep=move_6.Geometry)  # disabled
merge_7 = Merge(Data1=rotax.Geometry, Data2=rotax_2.Geometry)  # disabled
pt_7 = Point(graft(move_5.Geometry))  # disabled
pt_8 = Point(pt_7)  # disabled
split = SplitList(List=flatten(pt_8), Index=panel_7)  # -> ListA, ListB; disabled
arc_2 = Arc3Pt(PointA=split.ListA, PointB=move_4.Geometry, PointC=split.ListB)  # -> Arc, Plane, Radius; disabled
curvepoint = PointOnCurve(arc_2.Arc, parameter=0.5)  # disabled
crv = Curve(reparameterize(arc_2.Arc))  # disabled
curvepoint_2 = PointOnCurve(crv, parameter=0.75)  # disabled
curvepoint_3 = PointOnCurve(crv, parameter=0.25)  # disabled
cir_2 = Circle(Plane=curvepoint, Radius=scale_well_axle)  # disabled
pipe_3 = Pipe(Curve=arc_2.Arc, Radius=axle_thickness, Caps=0)  # disabled
move_7 = Move(Geometry=cir_2, Motion=Z_2)  # -> Geometry, Transform; disabled
cap_2 = CapHoles(Brep=pipe_3)  # disabled
merge_8 = Merge(Data1=curvepoint_3, Data2=curvepoint_2)  # -> graft(Result); disabled
divide_3 = DivideCurve(Curve=cir_2, Count=support_count, Kinks=False)  # -> Points, Tangents, Parameters; disabled
merge_9 = Merge(Data1=cir_2, Data2=move_7.Geometry)  # -> flatten(Result); disabled
geo = Geometry(cap_2)  # disabled
loft_2 = Loft(
    Curves=[cir_2, merge_9],
    Options={Adjust=False, Closed=False, LoftEnds=0, LoftSimp=0, LoftType=0, Rebuild=10, Refit=0.01})  # disabled
ln_3 = Line(StartPoint=divide_3.Points, EndPoint=merge_8)  # disabled
offset = OffsetSurface(Surface=loft_2, Distance=neg_3, Retrim=True)  # disabled
cap_3 = CapHoles(Brep=loft_2)  # -> flatten(Brep); disabled
pipe_4 = Pipe(Curve=ln_3, Radius=support_thickness, Caps=2)  # disabled
cap_4 = CapHoles(Brep=offset)  # -> flatten(Brep); disabled
sdiff = SolidDifference(BrepsA=cap_3, BrepsB=cap_4)  # disabled
cap_5 = CapHoles(Brep=pipe_4)  # disabled
sdiff_2 = SolidDifference(BrepsA=sdiff, BrepsB=cap)  # disabled
divide_4 = DivideCurve(Curve=merge_7, Count=number_of_spokes, Kinks=False)  # -> Points, Tangents, Parameters; disabled
sunion_2 = SolidUnion(Breps=[sdiff_2, cap_5])  # -> graft(Result); disabled
pframes = PerpFrames(Curve=[rotax_2.Geometry, rotax.Geometry], Count=10, Align=True)  # -> Frames, Parameters; disabled
ln_4 = Line(StartPoint=pt_7, EndPoint=divide_4.Points)  # disabled
orient_2 = Orient(Geometry=ellipse_2.Ellipse, Source=PlaneXY(0, 0, 0), Target=pframes.Frames)  # -> Geometry, Transform; disabled
crv_2 = Curve(merge_7)  # disabled
panel_12 = Panel("1")  # disabled
pipe_5 = Pipe(Curve=ln_4, Radius=division, Caps=panel_12)  # -> flatten(Pipe); disabled
loft_3 = Loft(
    Curves=orient_2.Geometry,
    Options={Adjust=False, Closed=True, LoftEnds=0, LoftSimp=0, LoftType=0, Rebuild=10, Refit=0.01})  # -> flatten(Loft); disabled
sunion_3 = SolidUnion(Breps=[pipe_5, loft_3])  # disabled
geo_2 = Geometry(sdiff_2)  # disabled
geo_3 = Geometry(geo)  # disabled
geo_4 = Geometry()  # disabled
geo_5 = Geometry(cap_5)  # disabled

# ---- group: SurfaceEditWickersonStudios2020
# Gene Pool
# for Dispatch Pattern
gene_pool = GenePool(
    Decimals=0,
    Maximum=1,
    Minimum=0,
    Value=[0.1016146117, 0.1933914671, 0.3456139091, 0.2262482751, 0.8090761648, 1, 1, 0.6660769669, 0, 0.7147953914])  # disabled

uv_point_count = Slider(34, range=0..100)  # disabled
width = Slider(10, range=0..10)  # disabled
rectangle = Rectangle(Plane=PlaneXY(0, 0, 0), XSize=uv_point_count, YSize=width, Radius=0)  # -> Rectangle, Length; disabled
divide_surface = DivideSurface(Surface=rectangle.Rectangle, UCount=uv_point_count, VCount=uv_point_count)  # -> flatten(Points), Normals, Parameters; disabled
height_map = Slider(2, range=0..2)  # disabled
dispatch_3 = Dispatch(List=divide_surface.Points, DispatchPattern=gene_pool)  # -> ListA, ListB; disabled
construct_domain_6 = ConstructDomain(DomainStart=0, DomainEnd=height_map)  # disabled
list_length_3 = ListLength(List=dispatch_3.ListA)  # -> flatten(Length); disabled
range_7 = Range(Domain=construct_domain_6, Steps=expr("x-1", list_length_3))  # disabled
optional_seed_for_jitter_node = Slider(45, range=0..100)  # disabled
unit_z_3 = UnitZ(Factor=range_7)  # disabled
thickness_of_zinc = Slider(1.9, range=0..10)  # disabled
surface_from_points = SurfaceFromPoints(Points=divide_surface.Points, UCount=expr("x+1", uv_point_count), Interpolate=False)  # disabled
jitter = Jitter(List=unit_z_3, Jitter=1, Seed=optional_seed_for_jitter_node)  # -> Values, Indices; disabled
unit_z_4 = UnitZ(Factor=thickness_of_zinc)  # disabled
point_deform = PointDeform(Geometry=surface_from_points, Points=dispatch_3.ListA, Motion=jitter.Values)  # disabled

# ---- group: January25th2020WickersonStudiosCupolaKlokkenstoelenAlgorithm004
number_slider_29 = Slider(2, range=0..100)  # disabled
cir_3 = Circle(Plane=PlaneXY(0, 0, 0), Radius=number_slider_29)  # disabled
crv_3 = Curve(ellipse_2.Ellipse)  # disabled
flow = Flow(Geometry=crv_2, Base=cir_3, Target=crv_3, ReverseBase=False, ReverseTarget=False, Stretch=True, Rigid=False)  # disabled
pipe_6 = Pipe(Curve=flow, Radius=1, Caps=0)  # disabled

# ---- group: SurfaceEditWickersonStudios2020 / Extrude
# Bake this into RHINO
extrude_2 = Extrude(Base=point_deform, Direction=unit_z_4)  # disabled

# ---- group: January25th2020WickersonStudiosCupolaKlokkenstoelenAlgorithm004
# Bake Me!
merge_10 = Merge(Data2=sunion_3, Data3=geo, Data5=sunion_2)  # disabled

merge_11 = Merge(Data1=geo_4, Data2=geo_2)  # disabled
geo_6 = Geometry(loft_3)  # disabled
merge_12 = Merge(Data1=geo_5, Data2=geo_3)  # disabled
geo_7 = Geometry(pipe_5)  # disabled

# ---- group: January30th2020WickersonStudiosCupolaKlokkenstoelenAlgorithm004Pulication
axle_arc_height_2 = Slider(2.57, range=-3..6)  # disabled
number_of_spokes_2 = Slider(7, range=2..20)  # disabled
well_thickness_2 = Slider(2.31, range=0.1..3)  # disabled
wheelband_height_2 = Slider(1.06, range=0.2..2)  # disabled
tap_hole_height_2 = Slider(4.91, range=1..5)  # disabled
scale_well_axle_2 = Slider(7, range=3..7)  # disabled
scale_wheels_2 = Slider(7.59, range=0..10)  # disabled
spoke_thickness_factor_2 = Slider(2.733, range=1..5)  # disabled
support_thickness_2 = Slider(0.5, range=0.05..0.5)  # disabled
axle_thickness_2 = Slider(0.546, range=0..0.7)  # disabled
support_count_2 = Slider(4, range=0..10)  # disabled
rotate_wheels_2 = Slider(0.08, range=-0.1..0.51)  # disabled
wheelband_width_2 = Slider(8, range=3..8)  # disabled

# Cupola Cart, Algorithm 001, Wickerson Studios, 2020
fillet_radius = Slider(0.035, range=0..0.1)  # disabled
panel_13 = Panel("1")  # disabled
Z_4 = UnitZ(Factor=axle_arc_height_2)  # disabled
pt_9 = ConstructPoint(XCoordinate=0, YCoordinate=0, ZCoordinate=0)  # disabled
pt_10 = Point(pt_9)  # disabled
move_8 = Move(Geometry=pt_10, Motion=Z_4)  # -> Geometry, Transform; disabled
panel_14 = Panel("5")  # disabled
X_2 = UnitX(Factor=scale_well_axle_2)  # disabled
addition_2 = Addition(A=scale_well_axle_2, B=panel_14)  # disabled
neg_5 = Negative(Value=X_2)  # disabled
Y_3 = UnitY(Factor=addition_2)  # disabled
merge_13 = Merge(Data1=X_2, Data2=neg_5)  # disabled
neg_6 = Negative(Value=Y_3)  # disabled
move_9 = Move(Geometry=pt_9, Motion=merge_13)  # -> Geometry, Transform; disabled
Z_5 = UnitZ(Factor=scale_well_axle_2)  # disabled
panel_15 = Panel("1.5")  # disabled
line_4 = LineSDL(Start=pt_10, Direction=neg_6, Length=addition_2)  # disabled
multiplication_2 = Multiplication(A=axle_thickness_2, B=panel_15)  # disabled
pl_3 = PlaneNormal(Origin=move_9.Geometry, ZAxis=X_2)  # disabled
circle_2 = CircleCNR(Center=move_9.Geometry, Normal=pl_3, Radius=scale_wheels_2)  # -> flatten(Circle); disabled
pipe_7 = Pipe(Curve=line_4, Radius=multiplication_2, Caps=0)  # disabled
Y_4 = UnitY(Factor=1)  # disabled
panel_16 = Panel("1")  # disabled
polygon = Polygon(Plane=PlaneXY(0, 0, 0), Radius=wheelband_height_2, Segments=wheelband_width_2, FilletRadius=fillet_radius)  # -> Polygon, Length; disabled
panel_17 = Panel("0")  # disabled
neg_7 = Negative(Value=well_thickness_2)  # disabled
pi_2 = Pi(Factor=rotate_wheels_2)  # disabled
ellipse_3 = Ellipse(Plane=PlaneXY(0, 0, 0), Radius1=wheelband_height_2, Radius2=wheelband_width_2)  # -> Ellipse, Focus1, Focus2; disabled
item_3 = ListItem(List=circle_2, Index=panel_16, Wrap=True)  # disabled
item_4 = ListItem(List=circle_2, Index=panel_17, Wrap=True)  # disabled
division_2 = Division(A=wheelband_height_2, B=spoke_thickness_factor_2)  # disabled
line_5 = LineSDL(Start=item_3, Direction=Y_4, Length=1)  # disabled
neg_8 = Negative(Value=pi_2)  # disabled
line_6 = LineSDL(Start=item_4, Direction=Y_4, Length=1)  # disabled
Z_6 = UnitZ(Factor=tap_hole_height_2)  # disabled
rotax_3 = RotateAxis(Geometry=item_4, Angle=pi_2, Axis=line_6)  # -> Geometry, Transform; disabled
rotax_4 = RotateAxis(Geometry=item_3, Angle=neg_8, Axis=line_5)  # -> Geometry, Transform; disabled
move_10 = Move(Geometry=pipe_7, Motion=Z_6)  # -> Geometry, Transform; disabled
cap_6 = CapHoles(Brep=move_10.Geometry)  # disabled
merge_14 = Merge(Data1=rotax_3.Geometry, Data2=rotax_4.Geometry)  # disabled
pt_11 = Point(graft(move_9.Geometry))  # disabled
pt_12 = Point(pt_11)  # disabled
split_2 = SplitList(List=flatten(pt_12), Index=panel_13)  # -> ListA, ListB; disabled
arc_3 = Arc3Pt(PointA=split_2.ListA, PointB=move_8.Geometry, PointC=split_2.ListB)  # -> Arc, Plane, Radius; disabled
curvepoint_4 = PointOnCurve(arc_3.Arc, parameter=0.5)  # disabled
crv_4 = Curve(reparameterize(arc_3.Arc))  # disabled
curvepoint_5 = PointOnCurve(crv_4, parameter=1)  # disabled
curvepoint_6 = PointOnCurve(crv_4, parameter=0)  # disabled
cir_4 = Circle(Plane=curvepoint_4, Radius=scale_well_axle_2)  # disabled
pipe_8 = Pipe(Curve=arc_3.Arc, Radius=axle_thickness_2, Caps=0)  # disabled
move_11 = Move(Geometry=cir_4, Motion=Z_5)  # -> Geometry, Transform; disabled
cap_7 = CapHoles(Brep=pipe_8)  # disabled
merge_15 = Merge(Data1=curvepoint_6, Data2=curvepoint_5)  # -> graft(Result); disabled
divide_5 = DivideCurve(Curve=cir_4, Count=support_count_2, Kinks=False)  # -> Points, Tangents, Parameters; disabled
merge_16 = Merge(Data1=cir_4, Data2=move_11.Geometry)  # -> flatten(Result); disabled
geo_8 = Geometry(cap_7)  # disabled
loft_4 = Loft(
    Curves=[cir_4, merge_16],
    Options={Adjust=False, Closed=False, LoftEnds=0, LoftSimp=0, LoftType=0, Rebuild=10, Refit=0.01})  # disabled
ln_5 = Line(StartPoint=divide_5.Points, EndPoint=merge_15)  # disabled
offset_2 = OffsetSurface(Surface=loft_4, Distance=neg_7, Retrim=True)  # disabled
cap_8 = CapHoles(Brep=loft_4)  # -> flatten(Brep); disabled
pipe_9 = Pipe(Curve=ln_5, Radius=support_thickness_2, Caps=2)  # disabled
cap_9 = CapHoles(Brep=offset_2)  # -> flatten(Brep); disabled
sdiff_3 = SolidDifference(BrepsA=cap_8, BrepsB=cap_9)  # disabled
cap_10 = CapHoles(Brep=pipe_9)  # disabled
sdiff_4 = SolidDifference(BrepsA=sdiff_3, BrepsB=cap_6)  # disabled
divide_6 = DivideCurve(Curve=merge_14, Count=number_of_spokes_2, Kinks=False)  # -> Points, Tangents, Parameters; disabled
sunion_4 = SolidUnion(Breps=[sdiff_4, cap_10])  # -> graft(Result); disabled
pframes_2 = PerpFrames(Curve=[rotax_4.Geometry, rotax_3.Geometry], Count=10, Align=True)  # -> Frames, Parameters; disabled
ln_6 = Line(StartPoint=pt_11, EndPoint=divide_6.Points)  # disabled
orient_3 = Orient(Geometry=polygon.Polygon, Source=PlaneXY(0, 0, 0), Target=pframes_2.Frames)  # -> Geometry, Transform; disabled
crv_5 = Curve(merge_14)  # disabled
panel_18 = Panel("1")  # disabled
pipe_10 = Pipe(Curve=ln_6, Radius=division_2, Caps=panel_18)  # -> flatten(Pipe); disabled
loft_5 = Loft(
    Curves=orient_3.Geometry,
    Options={Adjust=False, Closed=True, LoftEnds=0, LoftSimp=0, LoftType=0, Rebuild=10, Refit=0.01})  # -> flatten(Loft); disabled
sunion_5 = SolidUnion(Breps=[pipe_10, loft_5])  # disabled
geo_9 = Geometry(sdiff_4)  # disabled
geo_10 = Geometry(geo_8)  # disabled
geo_11 = Geometry()  # disabled
geo_12 = Geometry(cap_10)  # disabled

# Klokkenstoel Tower, algorithm 004, Wickerson Studios, 2020
main_mesh_height = Slider(29, range=0..100)  # disabled
main_mesh = Slider(4, range=0..10)  # disabled
main_mesh_rotation = Slider(0.47, range=0..0.51)  # disabled
main_mesh_top_diameter = Slider(1.2, range=0..3)  # disabled
main_mesh_thickness = Slider(1, range=0..1)  # disabled
billows = Slider(2.16, range=-3..10)  # disabled
curve_3 = Curve(move_11.Geometry)  # disabled
billows_geometry = Slider(1, range=0..3)  # disabled
main_mesh_division = Slider(3, range=0..3)  # disabled
divide_curve = DivideCurve(Curve=curve_3, Count=main_mesh, Kinks=False)  # -> Points, Tangents, Parameters; disabled
unit_z_5 = UnitZ(Factor=main_mesh_height)  # disabled
move_12 = Move(Geometry=divide_curve.Points, Motion=unit_z_5)  # -> Geometry, Transform; disabled
pi_3 = Pi(Factor=main_mesh_rotation)  # disabled
internal_billows = Slider(10, range=0..10)  # disabled
rotate_2 = Rotate(Geometry=move_12.Geometry, Angle=pi_3, Plane=PlaneXY(0, 0, 0))  # -> Geometry, Transform; disabled
polyline_3 = PolyLine(Vertices=rotate_2.Geometry, Closed=True)  # disabled
boundary_surfaces_2 = BoundarySurfaces(Edges=polyline_3)  # disabled
area_4 = Area(Geometry=boundary_surfaces_2)  # -> Area, Centroid; disabled
scale_2 = Scale(Geometry=rotate_2.Geometry, Center=area_4.Centroid, Factor=main_mesh_top_diameter)  # -> Geometry, Transform; disabled
point = Point(divide_curve.Points)  # disabled
number_slider_30 = Slider(3, range=1..3)  # disabled
merge_17 = Merge(Data1=point, Data2=scale_2.Geometry)  # -> flatten(Result); disabled
sort_points = SortPoints(Points=merge_17)  # -> Points, Indices; disabled
number_slider_31 = Slider(1, range=1..3)  # disabled
delaunay_mesh = DelaunayMesh(Points=sort_points.Points, Plane=PlaneXY(0, 0, 0))  # disabled
mesh = Mesh(delaunay_mesh)  # disabled
point_list = PointList(Points=sort_points.Points)  # disabled
weaverbird_s_midedge_subdivision = WeaverbirdsMidedgeSubdivision(MeshCurves=mesh, Level=number_slider_30, SmoothNakedEdges=1)  # disabled
weaverbird_s_split_polygons_subdivision = WeaverbirdsSplitPolygonsSubdivision(MeshCurves=mesh, Level=number_slider_31, SmoothNakedEdges=1)  # disabled
weaverbird_s_loop_subdivision = WeaverbirdsLoopSubdivision(MeshCurves=mesh, Level=1, SmoothNakedEdges=1)  # disabled
weaverbird_s_constant_quads_split_subdiv = WeaverbirdsConstantQuadsSplitSubdivision(MeshCurves=mesh, Level=number_slider_30, SmoothNakedEdges=1)  # disabled
weaverbird_s_sierpinski_triangles_subdiv = WeaverbirdsSierpinskiTrianglesSubdivision(MeshCurves=mesh, Level=number_slider_30)  # disabled
weaverbird_s_split_triangles_subdivision = WeaverbirdsSplitTrianglesSubdivision(MeshCurves=mesh, Level=number_slider_31)  # disabled
weaverbird_s_inner_polygons_subdivision = WeaverbirdsInnerPolygonsSubdivision(MeshCurves=mesh, Level=number_slider_30)  # disabled
weaverbird_s_picture_frame = WeaverbirdsPictureFrame(MeshPolylines=delaunay_mesh, Distance=5, InsetType=0)  # disabled
weaverbird_s_mesh_window = WeaverbirdsMeshWindow(MeshPolylines=delaunay_mesh, Distance=internal_billows, InsetType=0)  # disabled
negative_3 = Negative(Value=main_mesh_thickness)  # disabled
negative_4 = Negative(Value=main_mesh_thickness)  # disabled
negative_5 = Negative(Value=billows)  # disabled
weaverbird_s_mesh_thicken = WeaverbirdsMeshThicken(MeshCurves=weaverbird_s_mesh_window, Distance=negative_3, OffsetType=0)  # disabled
weaverbird_s_mesh_thicken_2 = WeaverbirdsMeshThicken(MeshCurves=weaverbird_s_picture_frame, Distance=negative_4, OffsetType=0)  # disabled
weaverbird_s_stellate_cumulation = WeaverbirdsStellateCumulation(MeshPolylines=delaunay_mesh, Distance=negative_5)  # disabled
weaverbird_s_catmull_clark_subdivision = WeaverbirdsCatmullClarkSubdivision(MeshCurves=weaverbird_s_mesh_thicken, Level=main_mesh_division, SmoothNakedEdges=1)  # disabled
weaverbird_s_catmull_clark_subdivision_2 = WeaverbirdsCatmullClarkSubdivision(MeshCurves=weaverbird_s_mesh_thicken_2, Level=main_mesh_division, SmoothNakedEdges=1)  # disabled

# Bell Tower, Algorithm 004, Wickerson Studios, 2020
number_slider_32 = Slider(0.13, range=0..1)  # disabled
number_slider_33 = Slider(2, range=0..2)  # disabled
number_slider_34 = Slider(15, range=0..100)  # disabled
dom_3 = ConstructDomain(DomainStart=0, DomainEnd=1)  # disabled
dom_4 = ConstructDomain(DomainStart=0, DomainEnd=1)  # disabled
range_8 = Range(Domain=dom_3, Steps=number_slider_34)  # disabled
range_9 = Range(Domain=dom_4, Steps=number_slider_34)  # disabled
panel_19 = Panel("x+1")  # disabled
graph_3 = GraphMapper(
    range_8,
    x0=0,
    x1=1,
    y0=0,
    y1=2,
    container_name="Bezier",
    cpx=[0, 0.1291844696, 0.3071455061, 1],
    cpy=[1, 0.4545068741, 0, 0])  # disabled
eval_3 = Evaluate(F=panel_19, x=range_8)  # disabled
graph_4 = GraphMapper(
    simplify(range_9),
    x0=0,
    x1=1,
    y0=0,
    y1=1.5,
    container_name="Bezier",
    cpx=[0, 0.1753288209, 1, 1],
    cpy=[0.9931949377, 1, 0.6188043356, 0])  # disabled
pt_13 = ConstructPoint(XCoordinate=eval_3, YCoordinate=0, ZCoordinate=graph_3)  # disabled
panel_20 = Panel("x+1")  # disabled
eval_4 = Evaluate(F=panel_20, x=range_9)  # disabled
intcrv_4 = Interpolate(Vertices=pt_13, Degree=3, Periodic=False, KnotStyle=1)  # -> Curve, Length, Domain; disabled
pt_14 = ConstructPoint(XCoordinate=eval_4, YCoordinate=0, ZCoordinate=graph_4)  # disabled
end_2 = EndPoints(Curve=intcrv_4.Curve)  # -> Start, End; disabled
intcrv_5 = Interpolate(Vertices=pt_14, Degree=3, Periodic=False, KnotStyle=1)  # -> Curve, Length, Domain; disabled
pl_4 = PlaneNormal(Origin=end_2.Start, ZAxis=Vector(0, 0, 1))  # disabled
orient_4 = Orient(Geometry=intcrv_5.Curve, Source=end_2.End, Target=pl_4)  # -> Geometry, Transform; disabled
join_3 = JoinCurves(Curves=[intcrv_4.Curve, orient_4.Geometry], Preserve=False)  # disabled
series_3 = Series(Start=0, Step=1, Count=10)  # disabled
rotate_3 = Rotate(Geometry=join_3, Angle=series_3, Plane=PlaneXY(0, 0, 0))  # -> Geometry, Transform; disabled
loft_6 = Loft(
    Curves=rotate_3.Geometry,
    Options={Adjust=False, Closed=False, LoftEnds=0, LoftSimp=0, LoftType=0, Rebuild=10, Refit=0.01})  # disabled
offsrf_2 = OffsetSurface(Surface=loft_6, Distance=number_slider_32, BothSides=False, CreateSolid=True)  # disabled
sunion_6 = SolidUnion(Breps=offsrf_2)  # disabled
area_5 = Area(Geometry=loft_6)  # -> Area, Centroid; disabled
scale_3 = Scale(Geometry=sunion_6, Center=area_5.Centroid, Factor=number_slider_33)  # -> Geometry, Transform; disabled

# Orient Bell in Tower
canopy_count = Slider(4, range=0..10)  # disabled
brep = Brep(scale_3.Geometry)  # disabled
point_2 = Point(area_4.Centroid)  # disabled
bell_heigth = Slider(1.276, range=0..5)  # disabled
rope_diameter = Slider(0.18, range=-0.01..0.5)  # disabled
canopy_diameter = Slider(8, range=0..10)  # disabled
canopy_shape = Slider(2.38, range=0..10)  # disabled
canopy_movement_z = Slider(-0.28, range=-10..10.01)  # disabled
canopy_mesh = Slider(3, range=1..3)  # disabled
bell_step = Slider(5, range=1..5)  # disabled
bells = Slider(4, range=1..6)  # disabled
deconstruct_brep_3 = DeconstructBrep(Brep=brep)  # -> Faces, Edges, Vertices; disabled
series_4 = Series(Start=bell_heigth, Step=bell_step, Count=bells)  # disabled
panel_21 = Panel("4")  # disabled
list_item_5 = ListItem(List=deconstruct_brep_3.Vertices, Index=panel_21, Wrap=True)  # disabled
orient_5 = Orient(Geometry=brep, Source=list_item_5, Target=point_2)  # -> Geometry, Transform; disabled
negative_6 = Negative(Value=series_4)  # disabled
unit_z_6 = UnitZ(Factor=negative_6)  # disabled
boolean_toggle = BooleanToggle(True)  # disabled
line_7 = Line(StartPoint=point_2, EndPoint=list_item_5)  # disabled
end_points_2 = EndPoints(Curve=line_7)  # -> Start, End; disabled
circle_3 = Circle(Plane=end_points_2.Start, Radius=canopy_diameter)  # disabled
divide_curve_2 = DivideCurve(Curve=circle_3, Count=canopy_count, Kinks=False)  # -> Points, Tangents, Parameters; disabled
line_8 = Line(StartPoint=divide_curve_2.Points, EndPoint=point_2)  # disabled
pipe_11 = Pipe(Curve=line_8, Radius=rope_diameter, Caps=boolean_toggle)  # disabled
move_13 = Move(Geometry=orient_5.Geometry, Motion=unit_z_6)  # -> graft(Geometry), Transform; disabled
pipe_12 = Pipe(Curve=line_7, Radius=rope_diameter, Caps=boolean_toggle)  # disabled
delaunay_mesh_2 = DelaunayMesh(Points=divide_curve_2.Points, Plane=PlaneXY(0, 0, 0))  # disabled
weaverbird_s_stellate_cumulation_2 = WeaverbirdsStellateCumulation(MeshPolylines=delaunay_mesh_2, Distance=canopy_shape)  # disabled
merge_18 = Merge(Data2=pipe_12, Data3=pipe_11)  # -> graft(Result); disabled
weaverbird_s_picture_frame_2 = WeaverbirdsPictureFrame(MeshPolylines=weaverbird_s_stellate_cumulation_2, Distance=5, InsetType=0)  # disabled
negative_7 = Negative(Value=canopy_movement_z)  # disabled
weaverbird_s_mesh_thicken_3 = WeaverbirdsMeshThicken(MeshCurves=weaverbird_s_picture_frame_2, Distance=negative_7, OffsetType=0)  # disabled
geometry = Geometry(move_13.Geometry)  # disabled
solid_union = SolidUnion(Breps=merge_18)  # disabled
weaverbird_s_catmull_clark_subdivision_3 = WeaverbirdsCatmullClarkSubdivision(MeshCurves=weaverbird_s_mesh_thicken_3, Level=canopy_mesh, SmoothNakedEdges=1)  # disabled

number_slider_35 = Slider(29, range=0..100)  # disabled
cir_5 = Circle(Plane=PlaneXY(0, 0, 0), Radius=number_slider_35)  # disabled
crv_6 = Curve(ellipse_3.Ellipse)  # disabled
flow_2 = Flow(Geometry=crv_5, Base=cir_5, Target=crv_6, ReverseBase=False, ReverseTarget=False, Stretch=True, Rigid=False)  # disabled
pipe_13 = Pipe(Curve=flow_2, Radius=1, Caps=0)  # disabled

# Bake Me!
merge_19 = Merge(Data2=sunion_5, Data3=geo_8, Data5=sunion_4)  # disabled

merge_20 = Merge(Data1=geo_11, Data2=geo_9)  # disabled
geo_13 = Geometry(loft_5)  # disabled
merge_21 = Merge(Data1=geo_12, Data2=geo_10)  # disabled
geo_14 = Geometry(pipe_10)  # disabled

# ----
number_slider_36 = Slider(12, range=0..100)  # disabled
number_slider_37 = Slider(5, range=0..10)  # disabled
curve_4 = Curve(<curve referenced from the Rhino model>)  # disabled
fast_loop_start = FastLoopStart(Iterations=number_slider_36, Curve=curve_4)  # -> port, Counter, Curve; disabled
curve_5 = Curve(fast_loop_start.Curve)  # disabled
explode = Explode(Curve=curve_5, Recursive=True)  # -> Segments, Vertices; disabled
boolean_toggle_2 = BooleanToggle(True)  # disabled
point_on_curve = PointOnCurve(explode.Segments, parameter=0.225)  # disabled
unit_z_7 = UnitZ(Factor=number_slider_37)  # disabled
polyline_4 = PolyLine(Vertices=point_on_curve, Closed=boolean_toggle_2)  # disabled
move_14 = Move(Geometry=polyline_4, Motion=unit_z_7)  # -> Geometry, Transform; disabled
fast_loop_end = FastLoopEnd(port=fast_loop_start.port, Exit=False, Curve=move_14.Geometry, RecordData=True, TimeOutVal=0)  # -> flatten(Data); disabled
unit_z_8 = UnitZ(Factor=1)  # disabled
curve_6 = Curve([curve_4, fast_loop_end])  # disabled
surface_2 = Surface(curve_6)  # disabled
extrude_3 = Extrude(Base=surface_2, Direction=unit_z_8)  # disabled
loft_7 = Loft(Curves=curve_6, Options={Adjust=False, Closed=False, LoftEnds=0, LoftSimp=0, LoftType=0, Rebuild=10, Refit=0.01})  # disabled

# ----
# Classic is Good for Animation
# (bonus Exit Loop script below)
number_slider_38 = Slider(89, range=0..100)  # disabled
number_slider_39 = Slider(5, range=0..10)  # disabled
boolean_toggle_3 = BooleanToggle(True)  # disabled
curve_7 = Curve(<curve referenced from the Rhino model>)  # disabled
loop_start = LoopStart(Repeat=number_slider_38, Trigger=boolean_toggle_3, Data=curve_7)  # -> port, Counter, Data; disabled
curve_8 = Curve(loop_start.Data)  # disabled
explode_2 = Explode(Curve=curve_8, Recursive=True)  # -> Segments, Vertices; disabled
panel_22 = Panel(loop_start.Counter)  # disabled
boolean_toggle_4 = BooleanToggle(True)  # disabled
point_on_curve_2 = PointOnCurve(explode_2.Segments, parameter=0.225)  # disabled
unit_z_9 = UnitZ(Factor=number_slider_39)  # disabled
polyline_5 = PolyLine(Vertices=point_on_curve_2, Closed=boolean_toggle_4)  # disabled
move_15 = Move(Geometry=polyline_5, Motion=unit_z_9)  # -> Geometry, Transform; disabled
number_slider_40 = Slider(23, range=-1..300)  # disabled
area_6 = Area(Geometry=move_15.Geometry)  # -> Area, Centroid; disabled
unit_z_10 = UnitZ(Factor=1)  # disabled
smaller_than = SmallerThan(FirstNumber=area_6.Area, SecondNumber=number_slider_40)  # -> SmallerThan, OrEqualTo; disabled
loop_end = LoopEnd(
    port=loop_start.port,
    Exit=smaller_than.SmallerThan,
    Data=move_15.Geometry,
    TimeOutVal=0,
    pausedState=False,
    state="Constant & Record")  # -> flatten(Data); disabled
curve_9 = Curve([curve_7, loop_end])  # disabled
surface_3 = Surface(curve_9)  # disabled
extrude_4 = Extrude(Base=surface_3, Direction=unit_z_10)  # disabled
loft_8 = Loft(Curves=curve_9, Options={Adjust=False, Closed=False, LoftEnds=0, LoftSimp=0, LoftType=0, Rebuild=10, Refit=0.01})  # disabled
colour_swatch_2 = ColourSwatch(SwatchColor=RGB(194, 56, 56))  # disabled
colour_swatch_3 = ColourSwatch(SwatchColor=RGB(174, 255, 255))  # disabled
custom_preview_4 = CustomPreview(Geometry=loft_8, Material=colour_swatch_2)  # disabled
custom_preview_5 = CustomPreview(Geometry=extrude_4, Material=colour_swatch_3)  # disabled

# ---- group: January25th2020WickersonStudiosCupolaKlokkenstoelenAlgorithm004
# Klokkenstoel Tower, algorithm 004, Wickerson Studios, 2020
number_slider_41 = Slider(5, range=0..10)  # disabled
number_slider_42 = Slider(0.46, range=0..1)  # disabled
number_slider_43 = Slider(17, range=0..100)  # disabled
curve_10 = Curve(move_7.Geometry)  # disabled
divide_curve_3 = DivideCurve(Curve=curve_10, Count=number_slider_41, Kinks=False)  # -> Points, Tangents, Parameters; disabled
unit_z_11 = UnitZ(Factor=number_slider_43)  # disabled
move_16 = Move(Geometry=divide_curve_3.Points, Motion=unit_z_11)  # -> Geometry, Transform; disabled
pi_4 = Pi(Factor=number_slider_42)  # disabled
rotate_4 = Rotate(Geometry=move_16.Geometry, Angle=pi_4, Plane=PlaneXY(0, 0, 0))  # -> Geometry, Transform; disabled
polyline_6 = PolyLine(Vertices=rotate_4.Geometry, Closed=True)  # disabled
boundary_surfaces_3 = BoundarySurfaces(Edges=polyline_6)  # disabled
area_7 = Area(Geometry=boundary_surfaces_3)  # -> Area, Centroid; disabled
point_3 = Point(divide_curve_3.Points)  # disabled
number_slider_44 = Slider(3, range=1..3)  # disabled
number_slider_45 = Slider(0.48, range=0..1)  # disabled
number_slider_46 = Slider(2.84, range=0..10)  # disabled
number_slider_47 = Slider(5.1, range=0..10)  # disabled
number_slider_48 = Slider(0.66, range=0..1)  # disabled
number_slider_49 = Slider(2, range=0..3)  # disabled
number_slider_50 = Slider(3, range=0..3)  # disabled

# Orient Bell in Tower
brep_2 = Brep(sunion)  # disabled
point_4 = Point(area_7.Centroid)  # disabled
number_slider_51 = Slider(0, range=0..5)  # disabled
number_slider_52 = Slider(5, range=1..5)  # disabled
number_slider_53 = Slider(4, range=1..4)  # disabled
deconstruct_brep_4 = DeconstructBrep(Brep=brep_2)  # -> Faces, Edges, Vertices; disabled
series_5 = Series(Start=number_slider_51, Step=number_slider_52, Count=number_slider_53)  # disabled
panel_23 = Panel("4")  # disabled
list_item_6 = ListItem(List=deconstruct_brep_4.Vertices, Index=panel_23, Wrap=True)  # disabled
negative_8 = Negative(Value=series_5)  # disabled
orient_6 = Orient(Geometry=brep_2, Source=list_item_6, Target=point_4)  # -> Geometry, Transform; disabled
unit_z_12 = UnitZ(Factor=negative_8)  # disabled
number_slider_54 = Slider(5.44, range=0..10)  # disabled
number_slider_55 = Slider(0.14, range=0..1)  # disabled
boolean_toggle_5 = BooleanToggle(True)  # disabled
line_9 = Line(StartPoint=point_4, EndPoint=list_item_6)  # disabled
end_points_3 = EndPoints(Curve=line_9)  # -> Start, End; disabled
circle_4 = Circle(Plane=end_points_3.Start, Radius=number_slider_54)  # disabled
move_17 = Move(Geometry=orient_6.Geometry, Motion=unit_z_12)  # -> graft(Geometry), Transform; disabled
divide_curve_4 = DivideCurve(Curve=circle_4, Count=10, Kinks=False)  # -> Points, Tangents, Parameters; disabled
line_10 = Line(StartPoint=divide_curve_4.Points, EndPoint=point_4)  # disabled
pipe_14 = Pipe(Curve=line_10, Radius=number_slider_55, Caps=boolean_toggle_5)  # disabled
pipe_15 = Pipe(Curve=line_9, Radius=number_slider_55, Caps=boolean_toggle_5)  # disabled
number_slider_56 = Slider(1.88, range=0..10)  # disabled
delaunay_mesh_3 = DelaunayMesh(Points=divide_curve_4.Points, Plane=PlaneXY(0, 0, 0))  # disabled
merge_22 = Merge(Data1=move_17.Geometry, Data2=pipe_15, Data3=pipe_14)  # -> graft(Result); disabled
weaverbird_s_stellate_cumulation_3 = WeaverbirdsStellateCumulation(MeshPolylines=delaunay_mesh_3, Distance=number_slider_56)  # disabled
number_slider_57 = Slider(2.17, range=0..10)  # disabled
number_slider_58 = Slider(1, range=1..3)  # disabled
weaverbird_s_picture_frame_3 = WeaverbirdsPictureFrame(MeshPolylines=weaverbird_s_stellate_cumulation_3, Distance=5, InsetType=0)  # disabled
negative_9 = Negative(Value=number_slider_57)  # disabled
weaverbird_s_mesh_thicken_4 = WeaverbirdsMeshThicken(MeshCurves=weaverbird_s_picture_frame_3, Distance=negative_9, OffsetType=0)  # disabled
weaverbird_s_catmull_clark_subdivision_4 = WeaverbirdsCatmullClarkSubdivision(MeshCurves=weaverbird_s_mesh_thicken_4, Level=number_slider_58, SmoothNakedEdges=1)  # disabled
solid_union_2 = SolidUnion(Breps=merge_22)  # disabled

# Bell Tower, Algorithm 004, Wickerson Studios, 2020
number_slider_59 = Slider(1.32, range=0..2)  # disabled
number_slider_60 = Slider(1, range=1..3)  # disabled
negative_10 = Negative(Value=number_slider_45)  # disabled
negative_11 = Negative(Value=number_slider_45)  # disabled
negative_12 = Negative(Value=number_slider_47)  # disabled

scale_4 = Scale(Geometry=rotate_4.Geometry, Center=area_7.Centroid, Factor=number_slider_59)  # -> Geometry, Transform; disabled
merge_23 = Merge(Data1=point_3, Data2=scale_4.Geometry)  # -> flatten(Result); disabled
sort_points_2 = SortPoints(Points=merge_23)  # -> Points, Indices; disabled
delaunay_mesh_4 = DelaunayMesh(Points=sort_points_2.Points, Plane=PlaneXY(0, 0, 0))  # disabled
mesh_2 = Mesh(delaunay_mesh_4)  # disabled
point_list_2 = PointList(Points=sort_points_2.Points)  # disabled
weaverbird_s_midedge_subdivision_2 = WeaverbirdsMidedgeSubdivision(MeshCurves=mesh_2, Level=number_slider_44, SmoothNakedEdges=1)  # disabled
weaverbird_s_split_polygons_subdivision_2 = WeaverbirdsSplitPolygonsSubdivision(MeshCurves=mesh_2, Level=number_slider_60, SmoothNakedEdges=1)  # disabled
weaverbird_s_loop_subdivision_2 = WeaverbirdsLoopSubdivision(MeshCurves=mesh_2, Level=1, SmoothNakedEdges=1)  # disabled
weaverbird_s_constant_quads_split_subdiv_2 = WeaverbirdsConstantQuadsSplitSubdivision(MeshCurves=mesh_2, Level=number_slider_44, SmoothNakedEdges=1)  # disabled
weaverbird_s_sierpinski_triangles_subdiv_2 = WeaverbirdsSierpinskiTrianglesSubdivision(MeshCurves=mesh_2, Level=number_slider_44)  # disabled
weaverbird_s_split_triangles_subdivision_2 = WeaverbirdsSplitTrianglesSubdivision(MeshCurves=mesh_2, Level=number_slider_60)  # disabled
weaverbird_s_inner_polygons_subdivision_2 = WeaverbirdsInnerPolygonsSubdivision(MeshCurves=mesh_2, Level=number_slider_44)  # disabled
weaverbird_s_picture_frame_4 = WeaverbirdsPictureFrame(MeshPolylines=delaunay_mesh_4, Distance=5, InsetType=0)  # disabled
weaverbird_s_mesh_window_2 = WeaverbirdsMeshWindow(MeshPolylines=delaunay_mesh_4, Distance=number_slider_46, InsetType=0)  # disabled
weaverbird_s_mesh_thicken_5 = WeaverbirdsMeshThicken(MeshCurves=weaverbird_s_picture_frame_4, Distance=negative_10, OffsetType=0)  # disabled
weaverbird_s_mesh_thicken_6 = WeaverbirdsMeshThicken(MeshCurves=weaverbird_s_mesh_window_2, Distance=negative_11, OffsetType=0)  # disabled
weaverbird_s_stellate_cumulation_4 = WeaverbirdsStellateCumulation(MeshPolylines=delaunay_mesh_4, Distance=negative_12)  # disabled
weaverbird_s_catmull_clark_subdivision_5 = WeaverbirdsCatmullClarkSubdivision(MeshCurves=weaverbird_s_mesh_thicken_6, Level=number_slider_50, SmoothNakedEdges=1)  # disabled
weaverbird_s_catmull_clark_subdivision_6 = WeaverbirdsCatmullClarkSubdivision(MeshCurves=weaverbird_s_stellate_cumulation_4, Level=number_slider_49, SmoothNakedEdges=1)  # disabled
weaverbird_s_catmull_clark_subdivision_7 = WeaverbirdsCatmullClarkSubdivision(MeshCurves=weaverbird_s_mesh_thicken_5, Level=number_slider_50, SmoothNakedEdges=1)  # disabled
