# Grasshopper definition MasterScriptFiles_2022_sixPlusFour_81-90.gh (Grasshopper 1.0.7)
# plug-ins: Kangaroo Components, Weaverbird, Kangaroo2 Components, MeshEdit Components, Pufferfish

# ---- group: January16tth2020WickersonStudiosCupolaCartAlgorithm001
scale_wheels = Slider(3.71, range=0..10)  # disabled
rotate_wheels = Slider(0.08, range=0..0.21)  # disabled
axle_arc_height = Slider(2, range=-1..2)  # disabled
scale_well_axle = Slider(3.364, range=3..4)  # disabled
well_thickness = Slider(1.24, range=0.1..3)  # disabled
number_of_spokes = Slider(7, range=2..10)  # disabled
wheelband_height = Slider(0.16, range=0..1)  # disabled
wheelband_width = Slider(0.92, range=0..1)  # disabled
spoke_thickness_factor = Slider(2.792, range=2..5)  # disabled
tap_hole_height = Slider(3.06, range=3..5)  # disabled
support_thickness = Slider(0.11, range=0.05..0.3)  # disabled
axle_thickness = Slider(0.162, range=0..0.5)  # disabled
support_count = Slider(6, range=0..10)  # disabled

# ---- group: January17tth2020WickersonStudiosHamletsMillAlgorithm003
# I little GEM test
number_slider = Slider(11.25, range=0..30)  # disabled
number_slider_2 = Slider(12, range=0..100)  # disabled
number_slider_3 = Slider(1, range=0..1)  # disabled
cir = Circle(Plane=PlaneXY(0, 0, 0), Radius=number_slider)  # disabled
pi = Pi(Factor=1)  # disabled
subtraction = Subtraction(A=number_slider_2, B=number_slider_3)  # disabled
division = Division(A=number_slider, B=number_slider_2)  # disabled
hframes = HorizontalFrames(Curve=cir, Count=subtraction)  # -> Frames, Parameters; disabled
multiplication = Multiplication(A=division, B=pi)  # disabled
xz = XZPlane(Origin=Point(0, 0, 0))  # disabled
sph = Sphere(Base=hframes.Frames, Radius=multiplication)  # disabled
pi_2 = Pi(Factor=division)  # disabled
panel = Panel(multiplication)  # disabled
deplane = DeconstructPlane(Plane=xz)  # -> Origin, XAxis, YAxis, ZAxis; disabled
ln = Line(StartPoint=deplane.Origin, EndPoint=deplane.YAxis)  # disabled
rotax = RotateAxis(Geometry=sph, Angle=pi_2, Axis=ln)  # -> flatten(Geometry), Transform; disabled
Z = UnitZ(Factor=multiplication)  # disabled
move = Move(Geometry=rotax.Geometry, Motion=Z)  # -> flatten(Geometry), Transform; disabled
sunion = SolidUnion(Breps=[sph, move.Geometry])  # -> flatten(Result); disabled

# Hamlet's Mill Shell
number_slider_4 = Slider(50, range=0..100)  # disabled
number_slider_5 = Slider(30, range=0..30)  # disabled
number_slider_6 = Slider(5.76, range=0..10)  # disabled
number_slider_7 = Slider(8, range=0..10)  # disabled
number_slider_8 = Slider(0, range=0..1)  # disabled
number_slider_9 = Slider(0.5, range=0..0.5)  # disabled
number_slider_10 = Slider(0, range=0..1)  # disabled
number_slider_11 = Slider(0.5, range=0..0.5)  # disabled
cir_2 = Circle(Plane=PlaneXY(0, 0, 0), Radius=number_slider_5)  # disabled
toggle = BooleanToggle(True)  # disabled
divide = DivideCurve(Curve=cir_2, Count=number_slider_4, Kinks=False)  # -> Points, Tangents, Parameters; disabled
pline = PolyLine(Vertices=divide.Points, Closed=toggle)  # disabled
md_slider = MDSlider(
    SliderMode=0,
    slider_value=Point(0.01463392304, 0.004878346513, 0.5),
    x_domain=Domain(0, 1),
    y_domain=Domain(0, 1),
    z_domain=Domain(0, 1))  # disabled
explode = Explode(Curve=pline, Recursive=True)  # -> graft(Segments), Vertices; disabled
Z_2 = UnitZ(Factor=number_slider_6)  # disabled
move_2 = Move(Geometry=explode.Segments, Motion=Z_2)  # -> Geometry, Transform; disabled
loft = Loft(
    Curves=[explode.Segments, move_2.Geometry],
    Options={Adjust=False, Closed=False, LoftEnds=0, LoftSimp=0, LoftType=0, Rebuild=10, Refit=0.01})  # disabled
debrep = DeconstructBrep(Brep=loft)  # -> Faces, Edges, Vertices; disabled
evalsrf = EvaluateSurface(Surface=reparameterize(debrep.Faces), Point=md_slider)  # -> Point, Normal, UDirection, VDirection, Frame; disabled
panel_2 = Panel("1")  # disabled
dom = ConstructDomain(DomainStart=number_slider_8, DomainEnd=number_slider_9)  # disabled
number_slider_12 = Slider(0, range=0..100)  # disabled
item = ListItem(List=debrep.Edges, Index=panel_2, Wrap=True)  # disabled
len = Length(Curve=item)  # disabled
neg = Negative(Value=evalsrf.Normal)  # disabled
multiplication_2 = Multiplication(A=neg, B=len)  # disabled
extr = Extrude(Base=evalsrf.Frame, Direction=multiplication_2)  # -> flatten(Extrusion); disabled
lng = ListLength(List=extr)  # -> flatten(Length); disabled
range = Range(Domain=dom, Steps=expr("x-1", lng))  # disabled
jitter = Jitter(List=range, Jitter=1, Seed=number_slider_12)  # -> Values, Indices; disabled
pi_3 = Pi(Factor=jitter.Values)  # disabled
lng_2 = ListLength(List=extr)  # -> flatten(Length); disabled
dom_2 = ConstructDomain(DomainStart=number_slider_10, DomainEnd=number_slider_11)  # disabled
panel_3 = Panel("2")  # disabled
range_2 = Range(Domain=dom_2, Steps=expr("x-1", lng_2))  # disabled
addition = Addition(A=number_slider_12, B=panel_3)  # disabled
pi_4 = Pi(Factor=pi_3)  # -> graft(Output); disabled
jitter_2 = Jitter(List=range_2, Jitter=1, Seed=addition)  # -> Values, Indices; disabled
rotate = Rotate(Geometry=graft(extr), Angle=pi_4, Plane=evalsrf.Point)  # -> flatten(Geometry), Transform; disabled
pi_5 = Pi(Factor=jitter_2.Values)  # disabled
panel_4 = Panel("2")  # disabled
multiplication_3 = Multiplication(A=number_slider_4, B=panel_4)  # disabled
panel_5 = Panel("360")  # disabled
sunion_2 = SolidUnion(Breps=rotate.Geometry)  # disabled
pi_6 = Pi(Factor=pi_5)  # -> graft(Output); disabled
lng_3 = ListLength(List=pi_3)  # disabled
lng_4 = ListLength(List=pi_5)  # disabled
division_2 = Division(A=panel_5, B=multiplication_3)  # disabled
panel_6 = Panel(lng_3)  # disabled
rotate_2 = Rotate(Geometry=graft(extr), Angle=pi_6, Plane=evalsrf.Point)  # -> flatten(Geometry), Transform; disabled
panel_7 = Panel(lng_4)  # disabled
rotate_3 = Rotate(Geometry=sunion_2, Angle=degrees(division_2), Plane=PlaneXY(0, 0, 0))  # -> Geometry, Transform; disabled
Z_3 = UnitZ(Factor=1)  # disabled
move_3 = Move(Geometry=rotate_3.Geometry, Motion=Z_3)  # -> Geometry, Transform; disabled
sunion_3 = SolidUnion(Breps=rotate_2.Geometry)  # disabled
panel_8 = Panel("2")  # disabled
sunion_4 = SolidUnion(Breps=[sunion_3, move_3.Geometry])  # disabled
Z_4 = UnitZ(Factor=panel_8)  # disabled
arrlinear = LinearArray(Geometry=sunion_4, Direction=Z_4, Count=number_slider_7)  # -> flatten(Geometry), Transform; disabled
sunion_5 = SolidUnion(Breps=arrlinear.Geometry)  # disabled

# ---- group: January21nd2020WickersonStudiosCupolaCartAlgorithm001
scale_wheels_2 = Slider(6.79, range=0..10)
number_of_spokes_2 = Slider(3, range=2..10)
axle_arc_height_2 = Slider(4, range=-1..4)
well_thickness_2 = Slider(3, range=0.1..3)
wheelband_height_2 = Slider(0.84, range=0.2..1)
tap_hole_height_2 = Slider(5, range=1..5)
spoke_thickness_factor_2 = Slider(1, range=1..5)
support_thickness_2 = Slider(0.3, range=0.05..0.3)
scale_well_axle_2 = Slider(4, range=3..4)
axle_thickness_2 = Slider(0.452, range=0..0.7)
support_count_2 = Slider(4, range=0..10)
rotate_wheels_2 = Slider(0.05, range=-0.1..1.11)
wheelband_width_2 = Slider(0.45, range=0..3)

smokestack_height = Slider(5, range=1..11)
smokestackshape = Slider(3, range=0..10)
number_slider_13 = Slider(-3, range=-3..3.001)
C = Slider(-3, range=-3..3.001)

# ---- group: January21nd2020WickersonStudiosCupolaKlokkenstoelenAlgorithm004
number_slider_14 = Slider(18, range=0..100)
# Bell Tower, Algorithm 004, Wickerson Studios, 2020
dom_3 = ConstructDomain(DomainStart=0, DomainEnd=1)
dom_4 = ConstructDomain(DomainStart=0, DomainEnd=1)
range_3 = Range(Domain=dom_3, Steps=number_slider_14)
range_4 = Range(Domain=dom_4, Steps=number_slider_14)
graph = GraphMapper(
    range_3,
    x0=0,
    x1=1,
    y0=0,
    y1=2,
    container_name="Bezier",
    cpx=[0, 1, 0.6767184138, 1],
    cpy=[1, 0.6665341854, 0.1162464619, 0])
eval = Evaluate(F="x+1", x=range_3)
graph_2 = GraphMapper(
    simplify(range_4),
    x0=0,
    x1=1,
    y0=0,
    y1=1.5,
    container_name="Bezier",
    cpx=[0, 0.3867272735, 1, 1],
    cpy=[0.9931949377, 0.9677484632, 0.6914716959, 0])
pt = ConstructPoint(XCoordinate=eval, YCoordinate=0, ZCoordinate=graph)
eval_2 = Evaluate(F="x+1", x=range_4)
intcrv = Interpolate(Vertices=pt, Degree=3, Periodic=False, KnotStyle=1)  # -> Curve, Length, Domain
pt_2 = ConstructPoint(XCoordinate=eval_2, YCoordinate=0, ZCoordinate=graph_2)
end = EndPoints(Curve=intcrv.Curve)  # -> Start, End
intcrv_2 = Interpolate(Vertices=pt_2, Degree=3, Periodic=False, KnotStyle=1)  # -> Curve, Length, Domain
pl = PlaneNormal(Origin=end.Start, ZAxis=Vector(0, 0, 1))
orient = Orient(Geometry=intcrv_2.Curve, Source=end.End, Target=pl)  # -> Geometry, Transform
join = JoinCurves(Curves=[intcrv.Curve, orient.Geometry], Preserve=False)
series = Series(Start=0, Step=1, Count=10)
rotate_4 = Rotate(Geometry=join, Angle=series, Plane=PlaneXY(0, 0, 0))  # -> Geometry, Transform
loft_2 = Loft(
    Curves=rotate_4.Geometry,
    Options={Adjust=False, Closed=False, LoftEnds=0, LoftSimp=0, LoftType=0, Rebuild=10, Refit=0.01})
offsrf = OffsetSurface(Surface=loft_2, Distance=Slider(0.17, range=0..1), BothSides=False, CreateSolid=True)
sunion_6 = SolidUnion(Breps=offsrf)

# ---- group: January17tth2020WickersonStudiosHamletsMillAlgorithm003
# Optional Gene Pool
# for Dispatch Pattern
genes = GenePool(Decimals=0, Maximum=1, Minimum=0, Value=[0, 1, 1, 0, 1, 0, 1, 1, 1, 1])  # disabled

# ---- group: January21nd2020WickersonStudiosCupolaCartAlgorithm001
# Cupola Cart, Algorithm 001, Wickerson Studios, 2020
panel_9 = Panel("0")
dom_5 = ConstructDomain(DomainStart=panel_9, DomainEnd=smokestack_height)
range_5 = Range(Domain=dom_5, Steps=smokestackshape)
Z_5 = UnitZ(Factor=axle_arc_height_2)
sin = Sine(Value=range_5)
cos = Cosine(Value=range_5)
multiplication_4 = Multiplication(A=sin, B=number_slider_13)
multiplication_5 = Multiplication(A=cos, B=C)
pt_3 = ConstructPoint(XCoordinate=0, YCoordinate=0, ZCoordinate=0)
pt_4 = Point(pt_3)
move_4 = Move(Geometry=pt_4, Motion=Z_5)  # -> Geometry, Transform
X = UnitX(Factor=scale_well_axle_2)
addition_2 = Addition(A=scale_well_axle_2, B="5")
pt_5 = ConstructPoint(XCoordinate=range_5, YCoordinate=multiplication_4, ZCoordinate=multiplication_5)
yz = YZPlane(Origin=Point(0, 0, 0))
neg_2 = Negative(Value=X)
toggle_2 = BooleanToggle(True)
Y = UnitY(Factor=addition_2)
md_slider_2 = MDSlider(
    SliderMode=0,
    slider_value=Point(0.510215201, 0.5143611257, 0.5),
    x_domain=Domain(0, 1),
    y_domain=Domain(0, 1),
    z_domain=Domain(0, 1))
merge = Merge(Data1=X, Data2=neg_2)
neg_3 = Negative(Value=Y)
move_5 = Move(Geometry=pt_3, Motion=merge)  # -> Geometry, Transform
loft_opt = LoftOptions(Closed=toggle_2, Adjust=False, Rebuild=0, Refit=0, Type=0)
Z_6 = UnitZ(Factor=scale_well_axle_2)
line = LineSDL(Start=pt_4, Direction=neg_3, Length=addition_2)
multiplication_6 = Multiplication(A=axle_thickness_2, B="1.5")
pl_2 = PlaneNormal(Origin=move_5.Geometry, ZAxis=X)
circle = CircleCNR(Center=move_5.Geometry, Normal=pl_2, Radius=scale_wheels_2)  # -> flatten(Circle)
pipe = Pipe(Curve=line, Radius=multiplication_6, Caps=0)
Y_2 = UnitY(Factor=1)
neg_4 = Negative(Value=well_thickness_2)
ellipse = Ellipse(Plane=PlaneXY(0, 0, 0), Radius1=wheelband_height_2, Radius2=wheelband_width_2)  # -> Ellipse, Focus1, Focus2
pi_7 = Pi(Factor=rotate_wheels_2)
item_2 = ListItem(List=circle, Index="1", Wrap=True)
item_3 = ListItem(List=circle, Index="0", Wrap=True)
division_3 = Division(A=wheelband_width_2, B=spoke_thickness_factor_2)
line_2 = LineSDL(Start=item_2, Direction=Y_2, Length=1)
line_3 = LineSDL(Start=item_3, Direction=Y_2, Length=1)
neg_5 = Negative(Value=pi_7)
Z_7 = UnitZ(Factor=tap_hole_height_2)
rotax_2 = RotateAxis(Geometry=item_3, Angle=pi_7, Axis=line_3)  # -> Geometry, Transform
rotax_3 = RotateAxis(Geometry=item_2, Angle=neg_5, Axis=line_2)  # -> Geometry, Transform
move_6 = Move(Geometry=pipe, Motion=Z_7)  # -> Geometry, Transform
cap = CapHoles(Brep=move_6.Geometry)
merge_2 = Merge(Data1=rotax_2.Geometry, Data2=rotax_3.Geometry)
pt_6 = Point(graft(move_5.Geometry))
pt_7 = Point(pt_6)
split = SplitList(List=flatten(pt_7), Index="1")  # -> ListA, ListB
arc = Arc3Pt(PointA=split.ListA, PointB=move_4.Geometry, PointC=split.ListB)  # -> Arc, Plane, Radius
curvepoint = PointOnCurve(arc.Arc, parameter=0.5)
crv = Curve(reparameterize(arc.Arc))
curvepoint_2 = PointOnCurve(crv, parameter=0.75)
curvepoint_3 = PointOnCurve(crv, parameter=0.25)
cir_3 = Circle(Plane=curvepoint, Radius=scale_well_axle_2)
pipe_2 = Pipe(Curve=arc.Arc, Radius=axle_thickness_2, Caps=0)
move_7 = Move(Geometry=cir_3, Motion=Z_6)  # -> Geometry, Transform
crv_2 = Curve(reparameterize(move_7.Geometry))
pframes = PerpFrames(Curve=crv_2, Count=10, Align=True)  # -> graft(Frames), Parameters
xy = XYPlane(Origin=pframes.Frames)
orient_2 = Orient(Geometry=pt_5, Source=yz, Target=xy)  # -> Geometry, Transform
intcrv_3 = Interpolate(Vertices=orient_2.Geometry, Degree=3, Periodic=False, KnotStyle=1)  # -> flatten(Curve), Length, Domain
loft_3 = Loft(Curves=intcrv_3.Curve, Options=loft_opt)
evalsrf_2 = EvaluateSurface(Surface=loft_3, Point=md_slider_2)  # -> Point, Normal, UDirection, VDirection, Frame
cap_2 = CapHoles(Brep=pipe_2)
merge_3 = Merge(Data1=cir_3, Data2=move_7.Geometry)  # -> flatten(Result)
merge_4 = Merge(Data1=curvepoint_3, Data2=curvepoint_2)  # -> graft(Result)
divide_2 = DivideCurve(Curve=cir_3, Count=support_count_2, Kinks=False)  # -> Points, Tangents, Parameters
rev = Reverse(Vector=evalsrf_2.Normal)
geo = Geometry(cap_2)
loft_4 = Loft(
    Curves=[cir_3, merge_3],
    Options={Adjust=False, Closed=False, LoftEnds=0, LoftSimp=0, LoftType=0, Rebuild=10, Refit=0.01})
ln_2 = Line(StartPoint=divide_2.Points, EndPoint=merge_4)
offsrf_2 = OffsetSurface(Surface=loft_3, Distance=rev, BothSides=toggle_2, CreateSolid=True)
offset = OffsetSurface(Surface=loft_4, Distance=neg_4, Retrim=True)
cap_3 = CapHoles(Brep=loft_4)  # -> flatten(Brep)
pipe_3 = Pipe(Curve=ln_2, Radius=support_thickness_2, Caps=2)
cap_4 = CapHoles(Brep=offset)  # -> flatten(Brep)
sdiff = SolidDifference(BrepsA=cap_3, BrepsB=cap_4)
cap_5 = CapHoles(Brep=pipe_3)
sdiff_2 = SolidDifference(BrepsA=sdiff, BrepsB=cap)
divide_3 = DivideCurve(Curve=merge_2, Count=number_of_spokes_2, Kinks=False)  # -> Points, Tangents, Parameters
sunion_7 = SolidUnion(Breps=[sdiff_2, cap_5])  # -> graft(Result)
pframes_2 = PerpFrames(Curve=[rotax_3.Geometry, rotax_2.Geometry], Count=10, Align=True)  # -> Frames, Parameters
ln_3 = Line(StartPoint=pt_6, EndPoint=divide_3.Points)
orient_3 = Orient(Geometry=ellipse.Ellipse, Source=PlaneXY(0, 0, 0), Target=pframes_2.Frames)  # -> Geometry, Transform
crv_3 = Curve(merge_2)
sunion_8 = SolidUnion(Breps=[sunion_7, offsrf_2])
pipe_4 = Pipe(Curve=ln_3, Radius=division_3, Caps="1")  # -> flatten(Pipe)
loft_5 = Loft(
    Curves=orient_3.Geometry,
    Options={Adjust=False, Closed=True, LoftEnds=0, LoftSimp=0, LoftType=0, Rebuild=10, Refit=0.01})  # -> flatten(Loft)
sunion_9 = SolidUnion(Breps=[pipe_4, loft_5])
geo_2 = Geometry(sdiff_2)
geo_3 = Geometry(geo)
geo_4 = Geometry(offsrf_2)
geo_5 = Geometry(cap_5)

# ---- group: January16tth2020WickersonStudiosCupolaCartAlgorithm001
# Cupola Cart, Algorithm 001, Wickerson Studios, 2020
panel_10 = Panel("1")  # disabled
Z_8 = UnitZ(Factor=axle_arc_height)  # disabled
pt_8 = ConstructPoint(XCoordinate=0, YCoordinate=0, ZCoordinate=0)  # disabled
pt_9 = Point(pt_8)  # disabled
move_8 = Move(Geometry=pt_9, Motion=Z_8)  # -> Geometry, Transform; disabled
panel_11 = Panel("5")  # disabled
X_2 = UnitX(Factor=scale_well_axle)  # disabled
addition_3 = Addition(A=scale_well_axle, B=panel_11)  # disabled
neg_6 = Negative(Value=X_2)  # disabled
Y_3 = UnitY(Factor=addition_3)  # disabled
merge_5 = Merge(Data1=X_2, Data2=neg_6)  # disabled
neg_7 = Negative(Value=Y_3)  # disabled
move_9 = Move(Geometry=pt_8, Motion=merge_5)  # -> Geometry, Transform; disabled
Z_9 = UnitZ(Factor=scale_well_axle)  # disabled
panel_12 = Panel("3")  # disabled
line_4 = LineSDL(Start=pt_9, Direction=neg_7, Length=addition_3)  # disabled
multiplication_7 = Multiplication(A=axle_thickness, B=panel_12)  # disabled
pl_3 = PlaneNormal(Origin=move_9.Geometry, ZAxis=X_2)  # disabled
circle_2 = CircleCNR(Center=move_9.Geometry, Normal=pl_3, Radius=scale_wheels)  # -> flatten(Circle); disabled
pipe_5 = Pipe(Curve=line_4, Radius=multiplication_7, Caps=0)  # disabled
Y_4 = UnitY(Factor=1)  # disabled
panel_13 = Panel("1")  # disabled
panel_14 = Panel("0")  # disabled
neg_8 = Negative(Value=well_thickness)  # disabled
pi_8 = Pi(Factor=rotate_wheels)  # disabled
item_4 = ListItem(List=circle_2, Index=panel_13, Wrap=True)  # disabled
item_5 = ListItem(List=circle_2, Index=panel_14, Wrap=True)  # disabled
ellipse_2 = Ellipse(Plane=PlaneXY(0, 0, 0), Radius1=wheelband_height, Radius2=wheelband_width)  # -> Ellipse, Focus1, Focus2; disabled
division_4 = Division(A=wheelband_width, B=spoke_thickness_factor)  # disabled
line_5 = LineSDL(Start=item_4, Direction=Y_4, Length=1)  # disabled
line_6 = LineSDL(Start=item_5, Direction=Y_4, Length=1)  # disabled
neg_9 = Negative(Value=pi_8)  # disabled
Z_10 = UnitZ(Factor=tap_hole_height)  # disabled
rotax_4 = RotateAxis(Geometry=item_5, Angle=pi_8, Axis=line_6)  # -> Geometry, Transform; disabled
rotax_5 = RotateAxis(Geometry=item_4, Angle=neg_9, Axis=line_5)  # -> Geometry, Transform; disabled
move_10 = Move(Geometry=pipe_5, Motion=Z_10)  # -> Geometry, Transform; disabled
cap_6 = CapHoles(Brep=move_10.Geometry)  # disabled
merge_6 = Merge(Data1=rotax_4.Geometry, Data2=rotax_5.Geometry)  # disabled
pt_10 = Point(graft(move_9.Geometry))  # disabled
pt_11 = Point(pt_10)  # disabled
split_2 = SplitList(List=flatten(pt_11), Index=panel_10)  # -> ListA, ListB; disabled
arc_2 = Arc3Pt(PointA=split_2.ListA, PointB=move_8.Geometry, PointC=split_2.ListB)  # -> Arc, Plane, Radius; disabled
curvepoint_4 = PointOnCurve(arc_2.Arc, parameter=0.5)  # disabled
crv_4 = Curve(reparameterize(arc_2.Arc))  # disabled
curvepoint_5 = PointOnCurve(crv_4, parameter=0.75)  # disabled
curvepoint_6 = PointOnCurve(crv_4, parameter=0.25)  # disabled
cir_4 = Circle(Plane=curvepoint_4, Radius=scale_well_axle)  # disabled
pipe_6 = Pipe(Curve=arc_2.Arc, Radius=axle_thickness, Caps=0)  # disabled
move_11 = Move(Geometry=cir_4, Motion=Z_9)  # -> Geometry, Transform; disabled
geo_6 = Geometry(pipe_6)  # disabled
merge_7 = Merge(Data1=cir_4, Data2=move_11.Geometry)  # -> flatten(Result); disabled
merge_8 = Merge(Data1=curvepoint_6, Data2=curvepoint_5)  # -> graft(Result); disabled
divide_4 = DivideCurve(Curve=cir_4, Count=support_count, Kinks=False)  # -> Points, Tangents, Parameters; disabled
loft_6 = Loft(
    Curves=[cir_4, merge_7],
    Options={Adjust=False, Closed=False, LoftEnds=0, LoftSimp=0, LoftType=0, Rebuild=10, Refit=0.01})  # disabled
ln_4 = Line(StartPoint=divide_4.Points, EndPoint=merge_8)  # disabled
offset_2 = OffsetSurface(Surface=loft_6, Distance=neg_8, Retrim=True)  # disabled
cap_7 = CapHoles(Brep=loft_6)  # -> flatten(Brep); disabled
cap_8 = CapHoles(Brep=offset_2)  # -> flatten(Brep); disabled
pipe_7 = Pipe(Curve=ln_4, Radius=support_thickness, Caps=2)  # disabled
cap_9 = CapHoles(Brep=pipe_7)  # disabled
sdiff_3 = SolidDifference(BrepsA=cap_7, BrepsB=cap_8)  # disabled
sdiff_4 = SolidDifference(BrepsA=sdiff_3, BrepsB=cap_6)  # disabled
divide_5 = DivideCurve(Curve=merge_6, Count=number_of_spokes, Kinks=False)  # -> Points, Tangents, Parameters; disabled
sunion_10 = SolidUnion(Breps=[sdiff_4, cap_9])  # disabled
pframes_3 = PerpFrames(Curve=[rotax_5.Geometry, rotax_4.Geometry], Count=10, Align=True)  # -> Frames, Parameters; disabled
ln_5 = Line(StartPoint=pt_10, EndPoint=divide_5.Points)  # disabled
orient_4 = Orient(Geometry=ellipse_2.Ellipse, Source=PlaneXY(0, 0, 0), Target=pframes_3.Frames)  # -> Geometry, Transform; disabled
crv_5 = Curve(merge_6)  # disabled
panel_15 = Panel("1")  # disabled
pipe_8 = Pipe(Curve=ln_5, Radius=division_4, Caps=panel_15)  # -> flatten(Pipe); disabled
loft_7 = Loft(
    Curves=orient_4.Geometry,
    Options={Adjust=False, Closed=True, LoftEnds=0, LoftSimp=0, LoftType=0, Rebuild=10, Refit=0.01})  # -> flatten(Loft); disabled
sunion_11 = SolidUnion(Breps=[pipe_8, loft_7])  # disabled

number_slider_15 = Slider(2, range=0..100)  # disabled
cir_5 = Circle(Plane=PlaneXY(0, 0, 0), Radius=number_slider_15)  # disabled
crv_6 = Curve(ellipse_2.Ellipse)  # disabled
flow = Flow(Geometry=crv_5, Base=cir_5, Target=crv_6, ReverseBase=False, ReverseTarget=False, Stretch=True, Rigid=False)  # disabled
pipe_9 = Pipe(Curve=flow, Radius=1, Caps=0)  # disabled

# ---- group: January21nd2020WickersonStudiosCupolaCartAlgorithm001
number_slider_16 = Slider(2, range=0..100)  # disabled
cir_6 = Circle(Plane=PlaneXY(0, 0, 0), Radius=number_slider_16)  # disabled
crv_7 = Curve(ellipse.Ellipse)  # disabled
flow_2 = Flow(Geometry=crv_3, Base=cir_6, Target=crv_7, ReverseBase=False, ReverseTarget=False, Stretch=True, Rigid=False)  # disabled
pipe_10 = Pipe(Curve=flow_2, Radius=1, Caps=0)  # disabled

# ---- group: January16tth2020WickersonStudiosCupolaCartAlgorithm001
# Bake Me!
merge_9 = Merge(Data1=sdiff_4, Data2=sunion_11, Data3=geo_6, Data4=sunion_10)  # disabled

# ---- group: January21nd2020WickersonStudiosCupolaCartAlgorithm001
# Bake Me!
merge_10 = Merge(Data2=sunion_9, Data3=geo, Data5=sunion_8)

merge_11 = Merge(Data1=geo_4, Data2=geo_2)
merge_12 = Merge(Data1=geo_5, Data2=geo_3)
geo_7 = Geometry(pipe_4)
geo_8 = Geometry(loft_5)

# ---- group: January13th2020TedeschiChapter009AdvancedParticleSprings
# Membrane Simulation
# 
# Discretization
number_slider_17 = Slider(17, range=0..100)
srf = Surface(reparameterize(<surface referenced from the Rhino model>))
mesh_uv = MeshSurface(Surface=srf, UCount=number_slider_17, VCount=number_slider_17, Overhang=True, Equalize=False)
wbedges = WeaverbirdsMeshEdges(MeshOrPolylines=mesh_uv)
wbvertices = WeaverbirdsVerticesComponent(MeshClosedPolylinesGroup=mesh_uv, Weld=True)

# Can be multi anchored as well
number_slider_18 = Slider(91, range=0..100)
item_6 = ListItem(List=wbvertices, Index=number_slider_18, Wrap=True)
item_7 = ListItem(List=wbvertices, Index=Slider(100, range=0..100), Wrap=True)
pt_12 = Point(item_6)
pt_13 = Point(item_7)

# ---- group: January13th2020TedeschiChapter009AdvancedCatenarySimulation
# A Catenary Curve
# Top Viewport
number_slider_19 = Slider(5, range=0..10)
number_slider_20 = Slider(20, range=1..20)
dom_6 = ConstructDomain(DomainStart=Slider(-5, range=-5..10), DomainEnd=number_slider_19)
range_6 = Range(Domain=dom_6, Steps=number_slider_20)
eval_3 = Evaluate(F="2*Cosh(x/2)", x=range_6)
short = ShortestList(ListA=range_6, ListB=eval_3, TrimMode=2)  # -> ListA, ListB
pt_14 = ConstructPoint(XCoordinate=short.ListA, YCoordinate=short.ListB, ZCoordinate=0)
intcrv_4 = Interpolate(Vertices=pt_14, Degree=3, Periodic=False, KnotStyle=1)  # -> Curve, Length, Domain

# ---- group: January17tth2020WickersonStudiosHamletsMillAlgorithm003
# Surface for Architecture Models
optional_seed_for_jitter_node = Slider(39, range=0..100)  # disabled
uv_point_count = Slider(19, range=0..20)  # disabled
height_map = Slider(8, range=0..8)  # disabled
number_slider_21 = Slider(100, range=0..100)  # disabled
panel_16 = Panel("4")  # disabled
polygon = Polygon(Plane=PlaneXY(0, 0, 0), Radius=number_slider_21, Segments=panel_16, FilletRadius=0)  # -> Polygon, Length; disabled
sdivide = DivideSurface(Surface=polygon.Polygon, UCount=uv_point_count, VCount=uv_point_count)  # -> flatten(Points), Normals, Parameters; disabled
dispatch = Dispatch(List=sdivide.Points, DispatchPattern=genes)  # -> ListA, ListB; disabled
lng_5 = ListLength(List=dispatch.ListA)  # -> flatten(Length); disabled
dom_7 = ConstructDomain(DomainStart=0, DomainEnd=height_map)  # disabled
range_7 = Range(Domain=dom_7, Steps=expr("x-1", lng_5))  # disabled
panel_17 = Panel("1")  # disabled
Z_11 = UnitZ(Factor=range_7)  # disabled
addition_4 = Addition(A=uv_point_count, B=panel_17)  # disabled
srfgrid = SurfaceFromPoints(Points=sdivide.Points, UCount=addition_4, Interpolate=False)  # disabled

# Optional
# Jitter
# Node
jitter_3 = Jitter(List=Z_11, Jitter=1, Seed=optional_seed_for_jitter_node)  # -> Values, Indices; disabled

pdeform = PointDeform(Geometry=srfgrid, Points=dispatch.ListA, Motion=jitter_3.Values)  # disabled

# ---- group: January13th2020TedeschiChapter009AdvancedShellSimulationBehavior
# Discretization
number_slider_22 = Slider(44, range=0..100)
mesh = Mesh(<mesh referenced from the Rhino model>)
kangaroo_settings = KangarooSettings(
    Tolerance=0.01,
    TimeStep=Slider(0.005, range=0..0.01),
    SubIterations=10,
    Floor=Toggle(True),
    Drag=1,
    Restitution=0.7,
    StaticFriction=10,
    KineticFriction=10,
    Settle=2,
    Tumble=1,
    Sound=False,
    Solver=0)
timer = Timer(Interval=5, TimerInterval=5, Target=kangaroo)  # disabled

msphere = MeshSphere(Base=PlaneXY(0, 0, 0), Radius=10, UCount=number_slider_22, VCount=number_slider_22)
explode_2 = MeshExplode(Mesh=mesh, Interpolate=False)
wbedges_2 = WeaverbirdsMeshEdges(MeshOrPolylines=mesh)
wbvertices_2 = WeaverbirdsVerticesComponent(MeshClosedPolylinesGroup=mesh, Weld=True)
demesh = DeconstructMesh(Mesh=explode_2)  # -> Vertices, Faces, Colours, Normals
item_8 = ListItem(List=demesh.Vertices, Index=Slider(0, range=0..1), Wrap=True)
item_9 = ListItem(List=demesh.Vertices, Index=Slider(1, range=0..1), Wrap=True)
item_10 = ListItem(List=demesh.Vertices, Index=Slider(2, range=0..2), Wrap=True)
item_11 = ListItem(List=demesh.Vertices, Index=Slider(3, range=0..3), Wrap=True)
ln_6 = Line(StartPoint=item_8, EndPoint=item_10)
ln_7 = Line(StartPoint=item_9, EndPoint=item_11)
merge_13 = Merge(Data1=ln_6, Data2=ln_7)

# Shell component is gone from Kangaroo 1 Utility
# 
# Hinge component is similar in icon but does not accept the Mesh, only 4 pioints.
# 
# What to do?
# 
# HINGE POINTS!!!
mesh_2 = Mesh(mesh)
number_slider_23 = Slider(1, range=0..1)
number_slider_24 = Slider(21, range=0..1000)

dupln = RemoveDuplicateLines(Lines=flatten(merge_13), Tolerance=0.01)
line_7 = Line(flatten(dupln))
Z_12 = UnitZ(Factor=Slider(-6, range=-20..100))
springs = SpringsFromLine(
    Connection=line_7,
    Stiffness=Slider(938, range=0..10000),
    Damping=10,
    RestLength=line_7,
    UpperCutoff=0,
    LowerCutoff=0,
    Plasticity=0)
uforce = UnaryForce(Point=wbvertices_2, Force=Z_12)

hingepoints = HingePoints(Mesh=mesh_2)  # -> _1, _2, _3, _4
hinge = Hinge(
    Point1=hingepoints._1,
    Point2=hingepoints._2,
    Point3=hingepoints._3,
    Point4=hingepoints._4,
    Strength=number_slider_24,
    RestAngle=number_slider_23)
kangaroo = KangarooPhysics(ForceObjects=flatten([springs, uforce, hinge]), Settings=kangaroo_settings, Geometry=mesh, SimulationReset=Toggle(True))  # -> Out, Iterations, ParticlesOut, GeometryOut, KE
mesh_3 = Mesh(kangaroo.GeometryOut)
panel_18 = Panel(mesh_3)

# ---- group: January13th2020TedeschiChapter009AdvancedCatenarySimulation
number_slider_25 = Slider(12, range=0..100)
crv_8 = Curve(reparameterize(<curve referenced from the Rhino model>))
crv_9 = Curve(reparameterize(<curve referenced from the Rhino model>))
divide_6 = DivideCurve(Curve=crv_8, Count=number_slider_25, Kinks=False)  # -> Points, Tangents, Parameters
divide_7 = DivideCurve(Curve=crv_9, Count=number_slider_25, Kinks=False)  # -> Points, Tangents, Parameters
end_2 = EndPoints(Curve=intcrv_4.Curve)  # -> Start, End
pipe_11 = Pipe(Radius=Slider(0.302, range=0..1), Caps=0)

# A Catenary Curve
# Front Viewport
number_slider_26 = Slider(45, range=0..100)
pt_15 = Point(end_2.End)
pt_16 = Point(end_2.Start)
Z_13 = UnitZ(Factor=number_slider_26)
neg_10 = Negative(Value=Z_13)
cat = Catenary(PointA=pt_16, PointB=pt_15, Length=number_slider_20, Gravity=neg_10)

# ---- group: January13th2020TedeschiChapter009AdvancedParticleSprings
# More Like a Cable Net!
# Membrane Simulation
# 
# Diagonals added to
# prevent deforming
# 
# Discretization
# Make Diagonals to stop distortion
# 
# Test with different patterns of diagonals and grids
number_slider_27 = Slider(17, range=0..100)
srf_2 = Surface(reparameterize(<surface referenced from the Rhino model>))
mesh_uv_2 = MeshSurface(Surface=srf_2, UCount=number_slider_27, VCount=number_slider_27, Overhang=True, Equalize=False)
explode_3 = MeshExplode(Mesh=mesh_uv_2, Interpolate=False)
wbedges_3 = WeaverbirdsMeshEdges(MeshOrPolylines=mesh_uv_2)
wbvertices_3 = WeaverbirdsVerticesComponent(MeshClosedPolylinesGroup=mesh_uv_2, Weld=True)
wbvertices_4 = WeaverbirdsVerticesComponent(MeshClosedPolylinesGroup=explode_3, Weld=True)
item_12 = ListItem(List=wbvertices_4, Index=Slider(0, range=0..100), Wrap=True)
item_13 = ListItem(List=wbvertices_4, Index=Slider(1, range=0..1), Wrap=True)
item_14 = ListItem(List=wbvertices_4, Index=Slider(2, range=0..10), Wrap=True)
item_15 = ListItem(List=wbvertices_4, Index=Slider(3, range=0..10), Wrap=True)
ln_8 = Line(StartPoint=item_13, EndPoint=item_15)
ln_9 = Line(StartPoint=item_12, EndPoint=item_14)
merge_14 = Merge(Data1=ln_9, Data2=ln_8)
timer_2 = Timer(Interval=1000, TimerInterval=1000, Target=kangaroo_2)

# Spring-Particle System
number_slider_28 = Slider(719, range=0..10000)
line_8 = Line(wbedges_3)
line_9 = Line(merge_14)
pt_17 = Point(wbvertices_3)
len_2 = Length(Curve=line_8)
len_3 = Length(Curve=line_9)
multiplication_8 = Multiplication(A=len_2, B=Slider(1, range=0..1))
multiplication_9 = Multiplication(A=len_3, B=Slider(1, range=0..1))
Z_14 = UnitZ(Factor=Slider(-20, range=-21..22))
springs_2 = SpringsFromLine(Connection=line_9, Stiffness=1000, Damping=10, RestLength=multiplication_9, UpperCutoff=0, LowerCutoff=0, Plasticity=0)
springs_3 = SpringsFromLine(Connection=line_8, Stiffness=1000, Damping=10, RestLength=multiplication_8, UpperCutoff=0, LowerCutoff=0, Plasticity=0)
uforce_2 = UnaryForce(Point=pt_17, Force=Z_14)
mc = MeshCorners(Mesh=mesh_uv_2, Angle=2.35619449)

kangaroo_2 = KangarooPhysics(
    ForceObjects=flatten([springs_3, uforce_2, springs_2]),
    AnchorPoints=mc,
    Settings=null,
    Geometry=mesh_uv_2,
    SimulationReset=Toggle(False))  # -> Out, Iterations, ParticlesOut, GeometryOut, KE
mesh_4 = Mesh(kangaroo_2.GeometryOut)

# ---- group: January13th2020TedeschiChapter009AdvancedCatenarySimulation
# Front Viewport
# 
# Arcs more acurately
# approximate the
# Catenary Curve
pt_18 = Point(<point referenced from the Rhino model>)
pt_19 = Point(<point referenced from the Rhino model>)
pt_20 = Point(<point referenced from the Rhino model>)
arc_3 = Arc3Pt(PointA=pt_20, PointB=pt_19, PointC=pt_18)  # -> Arc, Plane, Radius
len_4 = Length(Curve=arc_3.Arc)
panel_19 = Panel(len_4)
timer_3 = Timer(Interval=5, TimerInterval=5, Target=kangaroo_3)  # disabled

# Discretization
number_slider_29 = Slider(50, range=0..100)
divide_8 = DivideCurve(Curve=arc_3.Arc, Count=number_slider_29, Kinks=False)  # -> Points, Tangents, Parameters
pline_2 = PolyLine(Vertices=divide_8.Points, Closed=False)
explode_4 = Explode(Curve=pline_2, Recursive=True)  # -> Segments, Vertices

# Particle-Spring System
number_slider_30 = Slider(-1.034, range=-4..0)
line_10 = Line(explode_4.Segments)
pt_21 = Point(divide_8.Points)
len_5 = Length(Curve=line_10)
Z_15 = UnitZ(Factor=number_slider_30)
multiplication_10 = Multiplication(A=len_5, B=Slider(0.7, range=0..1))
springs_4 = SpringsFromLine(
    Connection=line_10,
    Stiffness=Slider(5118, range=0..10000),
    Damping=10,
    RestLength=multiplication_10,
    UpperCutoff=0,
    LowerCutoff=0,
    Plasticity=0)
uforce_3 = UnaryForce(Point=pt_21, Force=Z_15)
merge_15 = Merge(Data1=pt_20, Data2=pt_18)

kangaroo_3 = KangarooPhysics(
    ForceObjects=flatten([springs_4, uforce_3]),
    AnchorPoints=merge_15,
    Settings=null,
    Geometry=line_10,
    SimulationReset=Toggle(False))  # -> Out, Iterations, ParticlesOut, GeometryOut, KE
line_11 = Line(kangaroo_3.GeometryOut)

pipe_12 = Pipe(Curve=line_11, Radius=Slider(0.307, range=0..1), Caps=0)

# Front Viewport
# 
# Arcs more acurately
# approximate the
# Catenary Curve
pt_22 = Point(<point referenced from the Rhino model>)
arc_4 = Arc3Pt(PointA=divide_6.Points, PointB=pt_22, PointC=divide_7.Points)  # -> Arc, Plane, Radius
len_6 = Length(Curve=arc_4.Arc)
panel_20 = Panel(len_6)
timer_4 = Timer(Interval=5, TimerInterval=5, Target=kangaroo_4)  # disabled

# Discretization
number_slider_31 = Slider(50, range=0..100)
divide_9 = DivideCurve(Curve=arc_4.Arc, Count=number_slider_31, Kinks=False)  # -> Points, Tangents, Parameters
pline_3 = PolyLine(Vertices=divide_9.Points, Closed=False)
explode_5 = Explode(Curve=pline_3, Recursive=True)  # -> Segments, Vertices

# Particle-Spring System
number_slider_32 = Slider(-1.034, range=-4..0)
line_12 = Line(explode_5.Segments)
pt_23 = Point(divide_9.Points)
len_7 = Length(Curve=line_12)
Z_16 = UnitZ(Factor=number_slider_32)
multiplication_11 = Multiplication(A=len_7, B=Slider(0.7, range=0..1))
springs_5 = SpringsFromLine(
    Connection=line_12,
    Stiffness=Slider(5118, range=0..10000),
    Damping=10,
    RestLength=multiplication_11,
    UpperCutoff=0,
    LowerCutoff=0,
    Plasticity=0)
uforce_4 = UnaryForce(Point=pt_23, Force=Z_16)
merge_16 = Merge(Data1=divide_6.Points, Data2=divide_7.Points)

kangaroo_4 = KangarooPhysics(
    ForceObjects=flatten([springs_5, uforce_4]),
    AnchorPoints=merge_16,
    Settings=null,
    Geometry=line_12,
    SimulationReset=Toggle(False))  # -> Out, Iterations, ParticlesOut, GeometryOut, KE
line_13 = Line(kangaroo_4.GeometryOut)

# ---- group: January13th2020TedeschiChapter009AdvancedParticleSprings
# Spring-Particle System
number_slider_33 = Slider(1, range=0..1)
line_14 = Line(wbedges)
pt_24 = Point(wbvertices)
len_8 = Length(Curve=line_14)
multiplication_12 = Multiplication(A=len_8, B=number_slider_33)
Z_17 = UnitZ(Factor=Slider(-20, range=-21..22))
uforce_5 = UnaryForce(Point=pt_24, Force=Z_17)
mc_2 = MeshCorners(Mesh=mesh_uv, Angle=2.35619449)

number_slider_34 = Slider(50, range=0..10000)
mesh_5 = Mesh(mesh_uv)

springs_6 = SpringsFromLine(
    Connection=line_14,
    Stiffness=number_slider_34,
    Damping=10,
    RestLength=multiplication_12,
    UpperCutoff=0,
    LowerCutoff=0,
    Plasticity=0)

kangaroo_5 = KangarooPhysics(
    ForceObjects=flatten([springs_6, uforce_5]),
    AnchorPoints=[mc_2, pt_12, pt_13],
    Settings=null,
    Geometry=mesh_5,
    SimulationReset=Toggle(False))  # -> Out, Iterations, ParticlesOut, GeometryOut, KE
timer_5 = Timer(Interval=1000, TimerInterval=1000, Target=kangaroo_5)

mesh_6 = Mesh(kangaroo_5.GeometryOut)
