# Grasshopper definition MasterScriptFiles_2022_tenPlusOne_61-70.gh (Grasshopper 1.0.7)
# plug-ins: Bifocals

# ---- group: HorikawaRose002
number_slider = Slider(28, range=0..100)  # disabled
number_slider_2 = Slider(384, range=0..1000)  # disabled
pt = ConstructPoint(XCoordinate=0, YCoordinate=0, ZCoordinate=0)  # disabled
X = UnitX(Factor=1)  # disabled
line = LineSDL(Start=pt, Direction=X, Length=number_slider)  # disabled
number_slider_3 = Slider(25.1, range=0..100)  # disabled
crv = Curve(reparameterize(line))  # disabled
divide = DivideCurve(Curve=crv, Count=number_slider_2, Kinks=False)  # -> Points, Tangents, Parameters; disabled
number_slider_4 = Slider(63, range=0..100)  # disabled
lng = ListLength(List=divide.Points)  # disabled
graph = GraphMapper(
    divide.Parameters,
    x0=0,
    x1=1,
    y0=0,
    y1=1,
    container_name="Bezier",
    cpx=[0, 0.4947499931, 0.05687919632, 1],
    cpy=[1, 1, 0, 0])  # disabled
number_slider_5 = Slider(10, range=0..10)  # disabled
series = Series(Start=0, Step=number_slider_3, Count=lng)  # disabled
multiplication = Multiplication(A=graph, B=number_slider_4)  # disabled
rad = Radians(Degrees=series)  # disabled
panel = Panel("True")  # disabled
panel_2 = Panel("False")  # disabled
Z = UnitZ(Factor=multiplication)  # disabled
rotate = Rotate(Geometry=divide.Points, Angle=rad, Plane=PlaneXY(0, 0, 0))  # -> Geometry, Transform; disabled
dup = DuplicateData(Data=panel_2, Number=number_slider_5, Order=True)  # disabled
move = Move(Geometry=rotate.Geometry, Motion=Z)  # -> Geometry, Transform; disabled
merge = Merge(Data1=flatten(panel), Data2=flatten(dup))  # disabled
intcrv = Interpolate(Vertices=move.Geometry, Degree=3, Periodic=False, KnotStyle=1)  # -> reparameterize(Curve), Length, Domain; disabled
dispatch = Dispatch(List=move.Geometry, DispatchPattern=merge)  # -> ListA, ListB; disabled
pt_2 = Point(dispatch.ListA)  # disabled
crv_cp = CurveClosestPoint(Point=pt_2, Curve=intcrv.Curve)  # -> Point, Parameter, Distance; disabled
panel_3 = Panel(pt_2)  # disabled
eval = EvaluateCurve(Curve=intcrv.Curve, Parameter=crv_cp.Parameter)  # -> Point, Tangent, Angle; disabled
lng_2 = ListLength(List=eval.Point)  # -> expr("x-1", Length); disabled
range = Range(Domain=Domain(0, 1), Steps=lng_2)  # disabled
number_slider_6 = Slider(57.8, range=0..100)  # disabled
number_slider_7 = Slider(2.4, range=0..10)  # disabled
number_slider_8 = Slider(10, range=0..10)  # disabled
number_slider_9 = Slider(1, range=0..1)  # disabled
graph_2 = GraphMapper(
    range,
    x0=0,
    x1=1,
    y0=0,
    y1=1,
    container_name="Bezier",
    cpx=[0, 0.2333338708, 0.5463770032, 1],
    cpy=[0, 0.5971013904, 0.9391303658, 1])  # disabled
dom = ConstructDomain(DomainStart=number_slider_8, DomainEnd=number_slider_6)  # disabled
dom_2 = ConstructDomain(DomainStart=number_slider_9, DomainEnd=number_slider_7)  # disabled
panel_4 = Panel(graph_2)  # disabled
number_slider_10 = Slider(1, range=0..1)  # disabled
remap = RemapNumbers(Value=graph_2, Source=Domain(0, 1), Target=dom)  # -> Mapped, Clipped; disabled
remap_2 = RemapNumbers(Value=graph_2, Source=Domain(0, 1), Target=dom_2)  # -> Mapped, Clipped; disabled
multiplication_2 = Multiplication(A=remap.Mapped, B=-0.5)  # disabled
line_2 = LineSDL(Start=eval.Point, Direction=eval.Tangent, Length=remap.Mapped)  # disabled
panel_5 = Panel("-Rad(90)")  # disabled
Z_2 = UnitZ(Factor=1)  # disabled
amp = Amplitude(Vector=eval.Tangent, Amplitude=multiplication_2)  # disabled
multiplication_3 = Multiplication(A=remap.Mapped, B=number_slider_10)  # disabled
number_slider_11 = Slider(20, range=0..100)  # disabled
move_2 = Move(Geometry=line_2, Motion=amp)  # -> Geometry, Transform; disabled
vrot = Rotate(Vector=eval.Tangent, Axis=Z_2, Angle=panel_5)  # disabled
amp_2 = Amplitude(Vector=vrot, Amplitude=multiplication_3)  # disabled
neg = Negative(Value=number_slider_11)  # disabled
move_3 = Move(Geometry=eval.Tangent, Motion=amp_2)  # -> Geometry, Transform; disabled
end = EndPoints(Curve=move_2.Geometry)  # -> Start, End; disabled
pt_3 = ConstructPoint(XCoordinate=0, YCoordinate=0, ZCoordinate=neg)  # disabled
arc = Arc3Pt(PointA=end.Start, PointB=move_3.Geometry, PointC=end.End)  # -> Arc, Plane, Radius; disabled
number_slider_12 = Slider(12, range=0..100)  # disabled
scale = Scale(Geometry=arc.Arc, Center=pt_3, Factor=remap_2.Mapped)  # -> Geometry, Transform; disabled
graft = GraftTree(Tree=arc.Arc, IncludeEmptyLists=True, IncludeNullItems=True)  # -> graft(Tree); disabled
graft_2 = GraftTree(Tree=scale.Geometry, IncludeEmptyLists=True, IncludeNullItems=True)  # -> graft(Tree); disabled
number_slider_13 = Slider(16.5, range=0..100)  # disabled
merge_2 = Merge(Data1=graft, Data2=graft_2)  # disabled
divide_2 = DivideCurve(Curve=graft_2, Count=number_slider_12, Kinks=False)  # -> Points, Tangents, Parameters; disabled
loft = Loft(Curves=merge_2, Options={Adjust=False, Closed=False, LoftEnds=0, LoftSimp=0, LoftType=0, Rebuild=10, Refit=0.01})  # disabled
random = Random(Range=Domain(0, 1), Number=1, Seed=divide_2.Points)  # -> graft(Random); disabled
multiplication_4 = Multiplication(A=random, B=number_slider_13)  # disabled
preview = CustomPreview(
    Geometry=loft,
    Material={diffuse=RGB(221, 160, 221), emission=RGB(66, 48, 66), shine=0.5, specular=RGB(255, 255, 255), transparency=0})  # disabled

# ---- group: Duchame003
optional_seed_for_jitter_node = Slider(27, range=0..100)  # disabled
uv_point_count = Slider(100, range=0..100)  # disabled
height_map = Slider(2, range=0..2)  # disabled

# Optional Gene Pool
# for Dispatch Pattern
gene_pool = GenePool(
    Decimals=0,
    Maximum=1,
    Minimum=0,
    Value=[0.7781919342, 0.5005636865, 0.6644938833, 0.4016935711, 0.9494723957, 0.8208420462, 0.4284389147, 0.1336825402, 0.07872878531, 0.2197422638, 0.6104933292, 0.1224618853, 0.5840545528, 0.8308359435, 0.7583080031, 0.9942445485, 0.3297216638, 0.04509550289, 0.8307831552, 0.05786600106, 0.3521249012, 0.3204974194, 0.3824567559, 0.764870542, 0.1852175031, 0.1811330482, 0.750880869, 0.5847950674, 0.5203888554, 0.6547321261])  # disabled

# ---- group: HorikawaRose001
number_slider_14 = Slider(12, range=0..100)  # disabled
number_slider_15 = Slider(368, range=0..1000)  # disabled
pt_4 = ConstructPoint(XCoordinate=0, YCoordinate=0, ZCoordinate=0)  # disabled
X_2 = UnitX(Factor=1)  # disabled
line_3 = LineSDL(Start=pt_4, Direction=X_2, Length=number_slider_14)  # disabled
number_slider_16 = Slider(26.5, range=0..100)  # disabled
crv_2 = Curve(reparameterize(line_3))  # disabled
divide_3 = DivideCurve(Curve=crv_2, Count=number_slider_15, Kinks=False)  # -> Points, Tangents, Parameters; disabled
lng_3 = ListLength(List=divide_3.Points)  # disabled
series_2 = Series(Start=0, Step=number_slider_16, Count=lng_3)  # disabled
rad_2 = Radians(Degrees=series_2)  # disabled
rotate_2 = Rotate(Geometry=divide_3.Points, Angle=rad_2, Plane=PlaneXY(0, 0, 0))  # -> Geometry, Transform; disabled

# ---- group: 04 Polynomial Graphing with Derivatives / Polynomial factors
quadratic_factor = Slider(-0.278, range=-1..1)  # disabled
linear_factor = Slider(-0.76, range=-4..4)  # disabled
quartic_factor = Slider(0.019, range=-0.2..0.2)  # disabled
cubic_factor = Slider(0.048, range=-0.5..0.5)  # disabled

# ---- group: 02 Interpolating Values / Define interpolation samples
# If the GUMBALLS option is enabled
# in the DISPLAY menu, then selecting
# this parameter will allow you to
# manually drag the points around.
samples = Slider(100, range=10..500)  # disabled
range_2 = Range(Domain=Domain(0, 1), Steps=samples)  # disabled

# ---- group: 01 Simple Input and Maths / Various objects for manually defining numeric and textual values
B = Slider(1.25, range=0..10)
C = DigitScroller(Scroller_Digits=12, Scroller_Prefix="C", Scroller_Radix=10, Scroller_Value=1.3)
equation_format = Panel("({0} + {1}) / {2}")
A = ControlKnob(Decimals=2, Limit=True, Maximum=10, Minimum=0, Range=1, Value=0.25)

# ---- group: 06 Adaptive Pattern within Shape / Half shape
# Symmetry can be defined as
# a transformation, in which case
# it remains a 'live' part of a file.
pt_5 = Point([Point(0, 0, 0), Point(15, 0, 0), Point(20, 10, 0), Point(20, 30, 0), Point(10, 45, 0), Point(0, 45, 0)])  # disabled
nurbs = NurbsCurve(Vertices=pt_5, Degree=3, Periodic=False)  # -> Curve, Length, Domain; disabled

# ---- group: 02 Interpolating Values / Define 3 colours
A_2 = ColourSwatch(SwatchColor=RGB(201, 12, 88))  # disabled
# Click on the colour swatches
# to modify the colours.
C_2 = ColourSwatch(SwatchColor=RGB(29, 196, 185))  # disabled
B_2 = ColourSwatch(SwatchColor=RGB(255, 185, 20))  # disabled
col = Colour([A_2, B_2, C_2])  # disabled

# ---- group: Duchame006
optional_seed_for_jitter_node_2 = Slider(27, range=0..100)  # disabled
uv_point_count_2 = Slider(100, range=0..100)  # disabled
height_map_2 = Slider(2, range=0..2)  # disabled

# Optional Gene Pool
# for Dispatch Pattern
gene_pool_2 = GenePool(
    Decimals=0,
    Maximum=1,
    Minimum=0,
    Value=[0.7781919342, 0.5005636865, 0.6644938833, 0.4016935711, 0.9494723957, 0.8208420462, 0.4284389147, 0.1336825402, 0.07872878531, 0.2197422638, 0.6104933292, 0.1224618853, 0.5840545528, 0.8308359435, 0.7583080031, 0.9942445485, 0.3297216638, 0.04509550289, 0.8307831552, 0.05786600106, 0.3521249012, 0.3204974194, 0.3824567559, 0.764870542, 0.1852175031, 0.1811330482, 0.750880869, 0.5847950674, 0.5203888554, 0.6547321261])  # disabled

# Parameters to Play with!
number_slider_17 = Slider(72, range=0..1000)  # disabled
rectangle = Rectangle(Plane=PlaneXY(0, 0, 0), XSize=number_slider_17, YSize=number_slider_17, Radius=0)  # -> Rectangle, Length; disabled
divide_surface = DivideSurface(Surface=rectangle.Rectangle, UCount=number_slider_17, VCount=number_slider_17)  # -> flatten(Points), Normals, Parameters; disabled
boundary_surfaces = BoundarySurfaces(Edges=rectangle.Rectangle)  # disabled
surface_from_points = SurfaceFromPoints(Points=divide_surface.Points, UCount=expr("x+1", number_slider_17), Interpolate=False)  # disabled
dispatch_2 = Dispatch(List=divide_surface.Points, DispatchPattern=gene_pool_2)  # -> ListA, ListB; disabled
construct_domain = ConstructDomain(DomainStart=0, DomainEnd=height_map_2)  # disabled
list_length = ListLength(List=dispatch_2.ListA)  # -> flatten(Length); disabled
range_3 = Range(Domain=construct_domain, Steps=expr("x-1", list_length))  # disabled
number_slider_18 = Slider(0.14, range=0..1)  # disabled
unit_z = UnitZ(Factor=range_3)  # disabled
multiplication_5 = Multiplication(A=height_map_2, B=number_slider_18)  # disabled
unit_z_2 = UnitZ(Factor=multiplication_5)  # disabled
move_4 = Move(Geometry=boundary_surfaces, Motion=unit_z_2)  # -> Geometry, Transform; disabled
area = Area(Geometry=move_4.Geometry)  # -> Area, Centroid; disabled
number_slider_19 = Slider(5, range=0..10)  # disabled

# ---- group: 05 Measure and Display Values / Define a circle through 3 points
# You can define individual values
# or large groups of values in each
# parameter object.
pt_6 = Point(Point(0, 10, 0))  # disabled
pt_7 = Point(Point(15, 20, 0))  # disabled
pt_8 = Point(Point(15, 5, 0))  # disabled
circle = Circle3Pt(PointA=pt_6, PointB=pt_8, PointC=pt_7)  # -> Circle, Plane, Radius; disabled

# ---- group: 04 Polynomial Graphing with Derivatives / Define sampling domain
panel_6 = Panel("-5 to +5")  # disabled
# Since standard mathematical notation
# is difficult to type, instead of this:
#     f(x) = ax⁴ + bx³ + cx² + dx
# we have to use a less pretty, but
# more keyboard friendly approach.
range_4 = Range(Domain=panel_6, Steps=250)  # disabled

# ---- group: 05 Measure and Display Values / Define a cloud of points
pt_9 = Point([Point(19.83155331, 20.37749236, 0), Point(21.98991699, 20.88534263, 0), Point(22.1930571, 19.51414689, 0), Point(20.77107632, 19.46336186, 0), Point(21.73599185, 18.57462387, 0), Point(23.18336514, 20.04738968, 0)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])  # disabled

# ---- group: 06 Adaptive Pattern within Shape / Mirror and join to create full shape
mirror = Mirror(Geometry=nurbs.Curve, Plane=PlaneYZ(0, 0, 0))  # -> Geometry, Transform; disabled
join = JoinCurves(Curves=[nurbs.Curve, mirror.Geometry], Preserve=False)  # disabled

# ---- group: 02 Interpolating Values / Define 5 points
# ← This double wire indicates more
#     than one value is being transmitted.
pt_10 = Point([Point(2, -1, 0), Point(-2, 8, 0), Point(11, 10, 0), Point(10, -1, 0), Point(20, 3, 0)])  # disabled

# ---- group: 02 Interpolating Values / Interpolate points
interp = InterpolateData(Data=pt_10, Parameter=range_2, Interpolation=4)  # disabled

# ---- group: 02 Interpolating Values / Interpolate colours
# Components with black labels usually
# have additional options in their menus.
# In this case you can set the interpolation
# scheme.
interp_2 = InterpolateData(Data=col, Parameter=range_2, Interpolation=2)  # disabled

# ---- group: 06 Adaptive Pattern within Shape / Measure bounds of full shape
# Finding the horizontal and
# vertical extent of a shape can
# be done using bounding boxes.
bbox = BoundingBox(Content=join, Plane=PlaneXY(0, 0, 0))  # -> Box, Box_2; disabled
box_corners = BoxCorners(Box=bbox.Box)  # -> CornerA, CornerB, CornerC, CornerD, CornerE, CornerF, CornerG, CornerH; disabled
dist = Distance(PointA=box_corners.CornerC, PointB=box_corners.CornerD)  # disabled
dist_2 = Distance(PointA=box_corners.CornerE, PointB=box_corners.CornerG)  # disabled

# ---- group: 01 Simple Input and Maths / Combine various values according to a formatting rule
format = Format(Format=equation_format, Culture=127, Data0=A, Data1=B, Data2=C)

# ---- group: 05 Measure and Display Values / Measure deviation for each point
crv_cp_2 = CurveClosestPoint(Point=pt_9, Curve=circle.Circle)  # -> Point, Parameter, Distance; disabled

# ---- group: 04 Polynomial Graphing with Derivatives / Evaluate derivative and map onto colour gradient
# Although Grasshopper is capable of evaluating
# many equations, it lacks the mathematical
# capabilities of programs such as Maple or
# Mathematica. Prepare to dust off your
# old high school calculus books.
expression = Expression(
    x=range_4,
    a=quartic_factor,
    b=cubic_factor,
    c=quadratic_factor,
    d=linear_factor,
    Expression="4*a*x^3 + 3*b*x^2 + 2*c*x + d")  # disabled
gradient = Gradient(
    LowerLimit=-10,
    UpperLimit=10,
    Parameter=expression,
    stops=[0: RGB(234, 38, 0), 0.301: RGB(234, 126, 0), 0.5: RGB(254, 244, 84), 0.734: RGB(173, 203, 249), 1: RGB(75, 107, 169)])  # disabled

# ---- group: 04 Polynomial Graphing with Derivatives / Evaluate polynomial
expression_2 = Expression(
    x=range_4,
    a=quartic_factor,
    b=cubic_factor,
    c=quadratic_factor,
    d=linear_factor,
    Expression="a*x^4 + b*x^3 + c*x^2 + d*x")  # disabled

# ---- group: 02 Interpolating Values / Display coloured points
# This component lets you display
# geometry with custom colours.
preview_2 = CustomPreview(Geometry=interp, Material=interp_2)  # disabled

# ---- group: 01 Simple Input and Maths
# Panels are a great way to inspect your
# values, just be careful to not insert them
# into the data-flow. Panels convert all data
# to text, which may lead to loss of accuracy.
# If the provided data is of a different type
# than the required data, it will often get
# automatically converted. In this case text
# is re-interpreted as a numeric value.
# 
# Some auto-conversions are more
# sensible than others, be careful when
# making files that rely on this 'silent'
# feature.
# There are lots of special objects
# for inputting values. You will find
# most of them in the PARAMS tab,
# INPUT panel.
formatting_result = Panel(format)

# ---- group: 01 Simple Input and Maths / Resolve equation by running it through a Number parameter
num = Number(format)
equation_result = Panel(num)

# ---- group: 05 Measure and Display Values / Format and display average deviation inside the circle
panel_7 = Panel("{0:0.00} mm")  # disabled
avr = Average(Input=crv_cp_2.Distance)  # disabled
format_2 = Format(Format=panel_7, Culture=127, Data0=avr)  # disabled
pt_11 = Point(circle.Circle)  # disabled
# The DISPLAY tab contains various components
# for visualising data both in Rhino viewports and
# the Grasshopper canvas. But there are plug-ins
# available that offer more functionality. Be sure
# to check out www.food4rhino.com
# Text Tags can be used to display
# information in the Rhino viewport,
# instead of on the Grasshopper canvas.
# Sometimes you must sort, reverse,
# re-order or cull values before you can
# meaningfully display them.
# The MATHS and SETS tabs contain
# many components for statistical and
# logical operations on data.
tag = TextTag3D(Location=pt_11, Text=format_2, Size=1.5, Justification=5)  # disabled

# ---- group: 05 Measure and Display Values / Sort all distances and graph them
sort = SortList(Keys=crv_cp_2.Distance)  # -> Keys, ValuesA; disabled
graph_3 = QuickGraph(sort.Keys, SortOrder=0)  # disabled

# ---- group: 05 Measure and Display Values / Bar graph of distances
bar_graph = BarGraph(crv_cp_2.Distance, BarColor=RGB(255, 0, 90))  # disabled

# ---- group: 06 Adaptive Pattern within Shape / Make big enough grid
# RELAY objects can be used to organise
# the wiring in a file. Double click on wires
# to insert them, and double click on relays
# to remove them.
hexgrid = Hexagonal(Plane=box_corners.CornerA, Size=1.5, ExtentX=expr("x/2", dist), ExtentY=expr("x/3", dist_2))  # -> Cells, flatten(Points); disabled

# ---- group: 04 Polynomial Graphing with Derivatives / Combine X and Y coordinates
# This component is hidden (dark grey).
# You can enable/disable the preview of
# components from within their menus.
pt_12 = ConstructPoint(XCoordinate=range_4, YCoordinate=expression_2, ZCoordinate=0)  # disabled

# ---- group: 06 Adaptive Pattern within Shape / Remove exterior points
incurve = PointInCurve(Point=hexgrid.Points, Curve=join)  # -> Relationship, Point; disabled
cull = CullPattern(List=hexgrid.Points, CullPattern=incurve.Relationship)  # disabled

# ---- group: 04 Polynomial Graphing with Derivatives / Display coloured points
preview_3 = CustomPreview(Geometry=pt_12, Material=gradient)  # disabled

# ---- group: 06 Adaptive Pattern within Shape / Measure and normalise distance to boundary curve
# Since distances can be any positive
# value, sometimes it's a good idea to
# 'remap' your numbers into a fixed domain.
# This makes subsequent mathematics
# easier to write.
crv_cp_3 = CurveClosestPoint(Point=cull, Curve=join)  # -> Point, Parameter, Distance; disabled
bnd = Bounds(Numbers=crv_cp_3.Distance)  # disabled
remap_3 = RemapNumbers(Value=crv_cp_3.Distance, Source=bnd, Target=Domain(0, 1))  # -> Mapped, Clipped; disabled

# ---- group: Duchame006
# Optional Jitter
# Node for
# SEED
jitter = Jitter(List=unit_z, Jitter=1, Seed=optional_seed_for_jitter_node_2)  # -> Values, Indices; disabled

# ---- group: 06 Adaptive Pattern within Shape / Create circles based on modified, normalised distance
graph_4 = GraphMapper(
    remap_3.Mapped,
    x0=0,
    x1=1,
    y0=0.2,
    y1=1,
    container_name="Bezier",
    cpx=[0, 0.6108490825, 0.2806603909, 1],
    cpy=[0, 0, 0.6578947306, 1])  # disabled
cir = Circle(Plane=cull, Radius=graph_4)  # disabled

# ---- group: Duchame006
# Bake me in to RHINO!
scale_2 = Scale(Geometry=move_4.Geometry, Center=area.Centroid, Factor=number_slider_19)  # -> Geometry, Transform; disabled
point_deform = PointDeform(Geometry=surface_from_points, Points=dispatch_2.ListA, Motion=jitter.Values)  # disabled

number_slider_20 = Slider(36, range=0..100)  # disabled
point = Point(divide_surface.Points)  # disabled
list_length_2 = ListLength(List=number_slider_20)  # disabled
partition_list = PartitionList(List=point, Size=number_slider_20)  # disabled
list_item = ListItem(List=partition_list, Index=list_length_2, Wrap=True)  # disabled
unit_z_3 = UnitZ(Factor=1)  # disabled
gene_pool_3 = GenePool(
    Decimals=0,
    Maximum=1,
    Minimum=0,
    Value=[0.7915271233, 0.4465030641, 0.2036759027, 0.1057908512, 0.1580188338, 0.7903156915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])  # disabled
project_point = ProjectPoint(Point=list_item, Direction=unit_z_3, Geometry=point_deform)  # -> flatten(Point), Index; disabled
number_slider_21 = Slider(0.1, range=0..0.1)  # disabled
number_slider_22 = Slider(1, range=0..1)  # disabled
dispatch_3 = Dispatch(List=project_point.Point, DispatchPattern=gene_pool_3)  # -> ListA, ListB; disabled
construct_domain_2 = ConstructDomain(DomainStart=number_slider_21, DomainEnd=1)  # disabled
number_slider_23 = Slider(4, range=3..10)  # disabled
point_2 = Point(dispatch_3.ListA)  # disabled
range_5 = Range(Domain=construct_domain_2, Steps=10)  # disabled
number_slider_24 = Slider(1.45, range=0..10)  # disabled
polygon = Polygon(Plane=point_2, Radius=range_5, Segments=number_slider_23, FilletRadius=0)  # -> graft(Polygon), Length; disabled
number_slider_25 = Slider(0.454, range=0..1)  # disabled
area_2 = Area(Geometry=polygon.Polygon)  # -> Area, Centroid; disabled
scale_3 = Scale(Geometry=polygon.Polygon, Center=area_2.Centroid, Factor=number_slider_25)  # -> Geometry, Transform; disabled
unit_z_4 = UnitZ(Factor=number_slider_24)  # disabled
negative = Negative(Value=unit_z_4)  # disabled
move_5 = Move(Geometry=scale_3.Geometry, Motion=unit_z_4)  # -> graft(Geometry), Transform; disabled
move_6 = Move(Geometry=scale_3.Geometry, Motion=negative)  # -> Geometry, Transform; disabled
curve = Curve(move_5.Geometry)  # disabled
curve_2 = Curve(polygon.Polygon)  # disabled
curve_3 = Curve(move_6.Geometry)  # disabled
divide_curve = DivideCurve(Curve=curve_2, Count=10, Kinks=False)  # -> Points, Tangents, Parameters; disabled
divide_curve_2 = DivideCurve(Curve=curve, Count=10, Kinks=False)  # -> Points, Tangents, Parameters; disabled
divide_curve_3 = DivideCurve(Curve=curve_3, Count=10, Kinks=False)  # -> Points, Tangents, Parameters; disabled
line_4 = Line(StartPoint=divide_curve.Points, EndPoint=divide_curve_3.Points)  # disabled
line_5 = Line(StartPoint=divide_curve_2.Points, EndPoint=divide_curve.Points)  # disabled
loft_2 = Loft(Curves=line_4, Options={Adjust=False, Closed=True, LoftEnds=0, LoftSimp=0, LoftType=0, Rebuild=10, Refit=0.01})  # disabled
loft_3 = Loft(Curves=line_5, Options={Adjust=False, Closed=True, LoftEnds=0, LoftSimp=0, LoftType=0, Rebuild=10, Refit=0.01})  # disabled
brep = Brep(loft_3)  # disabled
brep_2 = Brep(loft_2)  # disabled
cap_holes = CapHoles(Brep=brep_2)  # disabled
cap_holes_2 = CapHoles(Brep=brep)  # disabled
unit_x = UnitX(Factor=1)  # disabled
number_slider_26 = Slider(4, range=0..10)  # disabled
solid_union = SolidUnion(Breps=[cap_holes_2, cap_holes])  # -> graft(Result); disabled
number_slider_27 = Slider(10, range=0..10)  # disabled
volume = Volume(Geometry=solid_union)  # -> Volume, Centroid; disabled
move_7 = Move(Geometry=solid_union, Motion=unit_x)  # -> Geometry, Transform; disabled
polar_array = PolarArray(Geometry=move_7.Geometry, Plane=volume.Centroid, Count=number_slider_26, Angle=number_slider_27)  # -> Geometry, Transform; disabled

point_3 = Point(flatten(area_2.Centroid))  # disabled
number_slider_28 = Slider(0.08, range=0..1)  # disabled
number_slider_29 = Slider(1000, range=0..1000)  # disabled
interpolate = Interpolate(Vertices=point_3, Degree=3, Periodic=False, KnotStyle=1)  # -> Curve, Length, Domain; disabled
number_slider_30 = Slider(3, range=1..3)  # disabled
divide_curve_4 = DivideCurve(Curve=interpolate.Curve, Count=number_slider_29, Kinks=False)  # -> Points, Tangents, Parameters; disabled
unit_z_5 = UnitZ(Factor=number_slider_30)  # disabled
negative_2 = Negative(Value=unit_z_5)  # disabled
move_8 = Move(Geometry=divide_curve_4.Points, Motion=negative_2)  # -> Geometry, Transform; disabled
line_6 = Line(StartPoint=divide_curve_4.Points, EndPoint=move_8.Geometry)  # disabled

# Bake me in to RHINO!
pipe = Pipe(Curve=[interpolate.Curve, line_6], Radius=number_slider_28, Caps=0)  # disabled

# ---- group: Sphere106
sin = Slider(0.98, range=0..1)  # disabled
number_slider_31 = Slider(2.874, range=0..10)  # disabled
tan = Slider(0.925, range=0..1)  # disabled
number_slider_32 = Slider(20, range=1..40)  # disabled
multiplication_6 = Multiplication(A=tan, B=number_slider_31)  # disabled
ghpython_script = GhPythonScript(radius=tan, spacing=multiplication_6, num=number_slider_32)  # -> out, spheres; inputs num: Int32; disabled
# ---------- ghpython_script: Python ----------
__author__ = "Sculpture"
__version__ = "2019.10.20"

import rhinoscriptsyntax as rs
import math
myAwesomeList = []


for i in range(0,num):
    for j in range(0,num):
        myPoint = (spacing * i,spacing * j,0)
        
        myRadius = math.tan(i*j)*radius
        
        mySphere = rs.AddSphere(myPoint,myRadius)
        print(myPoint)
        
        myAwesomeList.append(mySphere)

spheres = myAwesomeList
# ---------- end ghpython_script ----------
panel_8 = Panel(ghpython_script.out)  # disabled

# ---- group: Duchame006
# Bake me in to RHINO!
solid_union_2 = SolidUnion(Breps=polar_array.Geometry)  # disabled

# ---- group: Duchame003
# Bake me in to RHINO!
# Parameters to Play with!
number_slider_33 = Slider(72, range=0..1000)  # disabled
rectangle_2 = Rectangle(Plane=PlaneXY(0, 0, 0), XSize=number_slider_33, YSize=number_slider_33, Radius=0)  # -> Rectangle, Length; disabled
divide_surface_2 = DivideSurface(Surface=rectangle_2.Rectangle, UCount=number_slider_33, VCount=number_slider_33)  # -> flatten(Points), Normals, Parameters; disabled
boundary = BoundarySurfaces(Edges=rectangle_2.Rectangle)  # disabled
surface_from_points_2 = SurfaceFromPoints(Points=divide_surface_2.Points, UCount=expr("x+1", number_slider_33), Interpolate=False)  # disabled
dispatch_4 = Dispatch(List=divide_surface_2.Points, DispatchPattern=gene_pool)  # -> ListA, ListB; disabled
construct_domain_3 = ConstructDomain(DomainStart=0, DomainEnd=height_map)  # disabled
list_length_3 = ListLength(List=dispatch_4.ListA)  # -> flatten(Length); disabled
range_6 = Range(Domain=construct_domain_3, Steps=expr("x-1", list_length_3))  # disabled
number_slider_34 = Slider(0.14, range=0..1)  # disabled
unit_z_6 = UnitZ(Factor=range_6)  # disabled
multiplication_7 = Multiplication(A=height_map, B=number_slider_34)  # disabled
Z_3 = UnitZ(Factor=multiplication_7)  # disabled
number_slider_35 = Slider(2, range=0..10)  # disabled

# Optional Jitter
# Node for
# SEED
jitter_2 = Jitter(List=unit_z_6, Jitter=1, Seed=optional_seed_for_jitter_node)  # -> Values, Indices; disabled

move_9 = Move(Geometry=boundary, Motion=Z_3)  # -> Geometry, Transform; disabled
point_deform_2 = PointDeform(Geometry=surface_from_points_2, Points=dispatch_4.ListA, Motion=jitter_2.Values)  # disabled

area_3 = Area(Geometry=move_9.Geometry)  # -> Area, Centroid; disabled
scale_4 = Scale(Geometry=move_9.Geometry, Center=area_3.Centroid, Factor=number_slider_35)  # -> Geometry, Transform; disabled

# ---- group: 03 Wires and Conversions
# Always use a single source of data for values that
# are supposed to be identical. Related values should
# also ideally come from a single master value.
# Here, we always want exactly twice as many quads
# horizontally as vertically.
# You can insert 'expressions' inside →
# inputs to efficiently modify values.
# If the automatic conversion isn't to your liking,
# you can always define a custom scheme.
# Here we want to map Hue and Luminance onto
# X and Y, instead of the standard RGB → XYZ.
# ← Hold down SHIFT to connect all swatches
#    with the colour parameter. You can
#    remove existing connections by tracing
#    them whilst holding CONTROL.
swatch = ColourSwatch(SwatchColor=RGB(178, 29, 29))  # disabled
swatch_2 = ColourSwatch(SwatchColor=RGB(232, 193, 21))  # disabled
swatch_3 = ColourSwatch(SwatchColor=RGB(153, 232, 146))  # disabled
swatch_4 = ColourSwatch(SwatchColor=RGB(46, 217, 217))  # disabled
swatch_5 = ColourSwatch(SwatchColor=RGB(10, 2, 163))  # disabled
swatch_6 = ColourSwatch(SwatchColor=RGB(224, 63, 200))  # disabled
mesh_density = Slider(40, range=10..60)  # disabled
col_2 = Colour([swatch, swatch_2])  # disabled
mplane = MeshPlane(
    Boundary={Plane=PlaneXY(10, 5, 0), Size=Domain2(u=-10..10, v=-5..5)},
    WidthCount=expr("x*2", mesh_density),
    HeightCount=mesh_density)  # -> Mesh, Area; disabled

# ---- group: 03 Wires and Conversions / Colour to coordinate conversion
ahsl = SplitAHSL(Colour=col_2)  # -> Alpha, Hue, Saturation, Luminance; disabled
pt_13 = ConstructPoint(XCoordinate=expr("x*20", ahsl.Hue), YCoordinate=expr("x*10", ahsl.Luminance), ZCoordinate=0)  # disabled

# ---- group: 03 Wires and Conversions (continued)
mspray = MeshSpray(Mesh=mplane.Mesh, Points=pt_13, Colours=col_2, SprayMode=11)  # disabled
